# Grasshopper definition theatronStadia.gh (Grasshopper 1.0.7)
# plug-ins: Toro, BH.UI.Grasshopper

# ----
# Set multiple parameters
# Base section is defined in the YZ
# with 0,0,0 as the focal point
boolean_toggle = BooleanToggle(True)
superriserparameters = SuperRiserParameters(SuperRiser=boolean_toggle, SuperRiserStart=10, SuperRiserKerbWidth=0.15, Component="{ .SuperRiserParameters")
boolean_toggle_2 = BooleanToggle(True)
eyepositionparameters = EyePositionParameters(Scale=1, Component="{ .EyePositionParameters")
profileparameters = ProfileParameters(
    StartX=Slider(4.6, range=0..10),
    StartZ=Slider(3.7, range=0..10),
    RowWidth=0.8,
    TargetC=0.09,
    SeatWidth=0.4,
    NumRows=20,
    BoardHeight=1.1,
    RiserRounding=0,
    Component="{ .ProfileParameters")
profileparameters_2 = ProfileParameters(
    StartX=Slider(4.6, range=0..10),
    StartZ=1,
    RowWidth=0.8,
    TargetC=0.09,
    SeatWidth=0.4,
    NumRows=20,
    BoardHeight=1.1,
    RiserRounding=0,
    EyePositionParameters=eyepositionparameters,
    SuperRiserParameters=superriserparameters,
    Component="{ .ProfileParameters")

activityarea = ActivityArea(Width=60, Length=90, Component="{ .ActivityArea")

# ----
# Demonstrates use case where a user requires full stadium based on predefined plan formats.
number_slider = Slider(1, range=0..10)
stadiatypeenum = StadiaTypeEnum(TypeNum=number_slider, Component="{ .StadiaTypeEnum")
stadiaparameters = StadiaParameters(
    StructBayWidth=7.5,
    CornerRadius=10,
    SideBound=6.7,
    EndBound=7.8,
    SideRadius=240,
    EndRadius=200,
    TheatronRadius=100,
    NumCornerBays=7,
    TypeOfBowl=stadiatypeenum,
    CornerFraction=0.5,
    ActivityArea=activityarea,
    PitchLength=90,
    PitchWidth=45,
    Component="{ .StadiaParameters")

data = Data([profileparameters, profileparameters_2])

# ----
# Create plan and profile
theatronfullprofile = TheatronFullProfile(Parameters=data, Component="{ .TheatronFullProfile")
plangeometry = PlanGeometry(Parameters=stadiaparameters, Component="{ .PlanGeometry")

# ----
# Set the TheatronGeometry
theatrongeometry = TheatronGeometry(
    PlanFull=plangeometry,
    Profile=theatronfullprofile,
    SParams=stadiaparameters,
    PParams=data,
    Component="{ .TheatronGeometry")
explode = Explode(Object=theatrongeometry, Component="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")  # -> TotalTiers, Tiers3d, Audience, BHoM_Guid, Name, Fragments, Tags, CustomData

data_2 = Data(activityarea)
list_item = ListItem(List=explode.Audience, Index=0, Wrap=True)
explode_2 = Explode(Object=list_item, Component="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")  # -> Spectators, BHoM_Guid, Name, Fragments, Tags, CustomData

explode_3 = Explode(Object=data_2, Component="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")  # -> PlayingArea, ActivityFocalPoint, BHoM_Guid, Name, Fragments, Tags, CustomData
explode_4 = Explode(Object=explode_2.Spectators, Component="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")  # -> Head, HeadOutline, BHoM_Guid, Name, Fragments, Tags, CustomData
explode_5 = Explode(Object=explode_4.Head, Component="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")  # -> TrackingPoint, PairOfEyes
explode_6 = Explode(Object=explode_5.PairOfEyes, Component="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")  # -> TrackingPoint, LeftEye, RightEye, ReferenceLocation, ViewDirection

# ----
# Theatron analysis
number_slider_2 = Slider(1, range=0..100)
number_slider_3 = Slider(0.3, range=0..0.3)
viewconetype = ViewConeType(TypeNum=number_slider_2, Component="{ .ViewConeType")
cvaluefocalmethod = CvalueFocalMethod(TypeNum=Slider(0, range=0..100), Component="{ .CvalueFocalMethod")
evalueviewtype = EvalueViewType(TypeNum=Slider(0, range=0..100), Component="{ .EvalueViewType")
avaluesettings = AvalueSettings(Conetype=viewconetype, CalcOcclusion=Toggle(False), Component="{ .AvalueSettings")
evaluesettings = EvalueSettings(Viewtype=evalueviewtype, Component="{ .EvalueSettings")
avalueanalysis = AvalueAnalysis(Audience=list_item, Settings=avaluesettings, ActivityArea=data_2, Component="{ .AvalueAnalysis")
evalueanalysis = EvalueAnalysis(Audience=list_item, Settings=evaluesettings, ActivityArea=data_2, Component="{ .EvalueAnalysis")

cvaluesettings = CvalueSettings(Ctype=cvaluefocalmethod, DefaultC=0.09, Component="{ .CvalueSettings")
explode_7 = Explode(Object=avalueanalysis, Component="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")  # -> Occulsion, AValue, FullActivityArea, ClippedActivityArea, ViewCone, ObjectId, ResultCase, TimeStep
explode_8 = Explode(Object=evalueanalysis, Component="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")  # -> Torsion, HorizViewAng, HorizViewVectors, VertViewVectors, VertViewAng, ObjectId, ResultCase, TimeStep

cvalueanalysis = CvalueAnalysis(Audience=list_item, Settings=cvaluesettings, FocalPolyline=explode_3.PlayingArea, Component="{ .CvalueAnalysis")

explode_9 = Explode(Object=cvalueanalysis, Component="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")  # -> CValue, HorizDist, HeightAbovePitch, AbsoluteDist, Focalpoint, ObjectId, ResultCase, TimeStep

data_3 = FlattenTree(Tree=explode_8.VertViewAng, Path="{0}")
points = FlattenTree(Tree=explode_6.ReferenceLocation, Path="{0}")
bounds = Bounds(Numbers=data_3)
delaunay_mesh = DelaunayMesh(Points=points, Plane=PlaneXY(0, 0, 0))
deconstruct_domain = DeconstructDomain(Domain=bounds)  # -> Start, End
mesh_face_cull = MeshFaceCull(MeshToCull=delaunay_mesh, MaximumEdgeLength=Slider(1.8, range=0..10))
gradient = Gradient(
    LowerLimit=deconstruct_domain.Start,
    UpperLimit=deconstruct_domain.End,
    Parameter=data_3,
    stops=[0: RGB(234, 38, 0), 0.25: RGB(234, 126, 0), 0.5: RGB(254, 244, 84), 0.75: RGB(173, 203, 249), 1: RGB(75, 107, 169)])
deconstruct_mesh = DeconstructMesh(Mesh=mesh_face_cull)  # -> Vertices, Faces, Colours, Normals
construct_mesh = ConstructMesh(Vertices=deconstruct_mesh.Vertices, Faces=deconstruct_mesh.Faces, Colours=gradient)
