# Grasshopper definition theatronTheatreB.gh (Grasshopper 1.0.7)
# plug-ins: Toro, BH.UI.Grasshopper

# ----
# Set the plan geometry
number_slider = Slider(0.2, range=0..1)
pi = Pi(Factor=number_slider)
pi_2 = Pi(Factor=Slider(0.8, range=0..1))
construct_domain = ConstructDomain(DomainStart=pi, DomainEnd=pi_2)
arc = Arc(Plane=PlaneXY(0, 0, 0), Radius=Slider(45, range=0..100), Angle=construct_domain)  # -> Arc, Length
divide_curve = DivideCurve(Curve=arc.Arc, Count=10, Kinks=False)  # -> Points, Tangents, Parameters
construct_point = ConstructPoint(XCoordinate=0, YCoordinate=0, ZCoordinate=0)
vector_2pt = Vector2Pt(PointA=construct_point, PointB=divide_curve.Points, Unitize=False)  # -> Vector, Length

# ----
# Construct the stage
# Demonstrates use case where a profile is defined by plan geometry. Distance between the plan front row and the focalPolyline defiens the worst case section and this is used to define the profile.
# This also shows how the avalue and evalues can be evalauted based on a large curved cinema screen or theatre proscenium. Uses are cinemas, theatres, auditoria, part stadium geometry. Use cases are concerned with applying Cvalue method to generate profile in relation to the plan geometry
number_slider_2 = Slider(40, range=0..100)
arc_2 = Arc(Plane=PlaneXY(0, 0, 0), Radius=number_slider_2, Angle=construct_domain)  # -> Arc, Length
divide_curve_2 = DivideCurve(Curve=arc_2.Arc, Count=10, Kinks=False)  # -> Points, Tangents, Parameters
construct_point_2 = ConstructPoint(XCoordinate=0, YCoordinate=0, ZCoordinate=0)
point = Point(flatten([divide_curve_2.Points, construct_point_2]))
polyline = PolyLine(Vertices=point, Closed=Toggle(True))
area = Area(Geometry=polyline)  # -> Area, Centroid

# ----
# Set multiple parameters
# Base section is defined in the YZ
# with 0,0,0 as the focal point
number_slider_3 = Slider(3.7, range=0..10)
boolean_toggle = BooleanToggle(True)
boolean_toggle_2 = BooleanToggle(True)
profileparameters = ProfileParameters(
    StartX=Slider(0, range=0..10),
    StartZ=number_slider_3,
    RowWidth=0.8,
    TargetC=0.09,
    SeatWidth=0.4,
    NumRows=20,
    BoardHeight=1.1,
    RiserRounding=0,
    Component="{ .ProfileParameters")
profileparameters_2 = ProfileParameters(
    StartX=Slider(4.6, range=0..10),
    StartZ=1,
    RowWidth=0.8,
    TargetC=0.09,
    SeatWidth=0.4,
    NumRows=20,
    BoardHeight=1.1,
    RiserRounding=0,
    Component="{ .ProfileParameters")

data = Data([profileparameters_2, profileparameters])

# ----
# Define where the structural sections are
profileorigin = ProfileOrigin(Origin=divide_curve.Points, Direction=vector_2pt.Vector, Component="{ .ProfileOrigin")

# ----
# Define TheatronPlan
plangeometry = PlanGeometry(StructuralSections=profileorigin, FocalPolyline=polyline, Component="{ .PlanGeometry")

activityarea = ActivityArea(ActivityArea=polyline, ActivityFocalPoint=area.Centroid, Component="{ .ActivityArea")

# ----
# FullProfile based on TheatronPlan
theatronfullprofile = TheatronFullProfile(Parameters=data, PlanGeometry=plangeometry, Component="{ .TheatronFullProfile")

# ----
# Set the TheatronGeometry
theatrongeometry = TheatronGeometry(PlanPart=plangeometry, Profile=theatronfullprofile, PParams=data, Component="{ .TheatronGeometry")
explode = Explode(Object=theatrongeometry, Component="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")  # -> TotalTiers, Tiers3d, Audience, BHoM_Guid, Name, Fragments, Tags, CustomData

# ----
# A massive curved screen for avalue / evalue analysis
curve = Curve(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)
point_2 = Point(Point(0, 6.49610867, 10))
activityarea_2 = ActivityArea(ActivityArea=curve, ActivityFocalPoint=point_2, Component="{ .ActivityArea")

data_2 = Data(activityarea)
list_item = ListItem(List=explode.Audience, Index=0, Wrap=True)
explode_2 = Explode(Object=list_item, Component="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")  # -> Spectators, BHoM_Guid, Name, Fragments, Tags, CustomData

explode_3 = Explode(Object=data_2, Component="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")  # -> PlayingArea, ActivityFocalPoint, BHoM_Guid, Name, Fragments, Tags, CustomData
explode_4 = Explode(Object=explode_2.Spectators, Component="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")  # -> Head, HeadOutline, BHoM_Guid, Name, Fragments, Tags, CustomData
explode_5 = Explode(Object=explode_4.Head, Component="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")  # -> TrackingPoint, PairOfEyes
explode_6 = Explode(Object=explode_5.PairOfEyes, Component="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")  # -> TrackingPoint, LeftEye, RightEye, ReferenceLocation, ViewDirection

# ----
# Theatron analysis
number_slider_4 = Slider(1, range=0..100)
number_slider_5 = Slider(0.3, range=0..0.3)
viewconetype = ViewConeType(TypeNum=number_slider_4, Component="{ .ViewConeType")
cvaluefocalmethod = CvalueFocalMethod(TypeNum=Slider(0, range=0..100), Component="{ .CvalueFocalMethod")
evalueviewtype = EvalueViewType(TypeNum=Slider(0, range=0..100), Component="{ .EvalueViewType")
avaluesettings = AvalueSettings(Conetype=viewconetype, CalcOcclusion=Toggle(False), Component="{ .AvalueSettings")
evaluesettings = EvalueSettings(Viewtype=evalueviewtype, Component="{ .EvalueSettings")
avalueanalysis = AvalueAnalysis(Audience=list_item, Settings=avaluesettings, ActivityArea=activityarea_2, Component="{ .AvalueAnalysis")
evalueanalysis = EvalueAnalysis(Audience=list_item, Settings=evaluesettings, ActivityArea=activityarea_2, Component="{ .EvalueAnalysis")

cvaluesettings = CvalueSettings(Ctype=cvaluefocalmethod, DefaultC=0.09, Component="{ .CvalueSettings")
explode_7 = Explode(Object=avalueanalysis, Component="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")  # -> Occulsion, AValue, FullActivityArea, ClippedActivityArea, ViewCone, ObjectId, ResultCase, TimeStep
explode_8 = Explode(Object=evalueanalysis, Component="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")  # -> Torsion, HorizViewAng, HorizViewVectors, VertViewVectors, VertViewAng, ObjectId, ResultCase, TimeStep

cvalueanalysis = CvalueAnalysis(Audience=list_item, Settings=cvaluesettings, FocalPolyline=explode_3.PlayingArea, Component="{ .CvalueAnalysis")

explode_9 = Explode(Object=cvalueanalysis, Component="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")  # -> CValue, HorizDist, HeightAbovePitch, AbsoluteDist, Focalpoint, ObjectId, ResultCase, TimeStep

data_3 = FlattenTree(Tree=explode_8.VertViewAng, Path="{0}")
points = FlattenTree(Tree=explode_6.ReferenceLocation, Path="{0}")
bounds = Bounds(Numbers=data_3)
delaunay_mesh = DelaunayMesh(Points=points, Plane=PlaneXY(0, 0, 0))
deconstruct_domain = DeconstructDomain(Domain=bounds)  # -> Start, End
mesh_face_cull = MeshFaceCull(MeshToCull=delaunay_mesh, MaximumEdgeLength=Slider(1.8, range=0..10))
gradient = Gradient(
    LowerLimit=deconstruct_domain.Start,
    UpperLimit=deconstruct_domain.End,
    Parameter=data_3,
    stops=[0: RGB(234, 38, 0), 0.25: RGB(234, 126, 0), 0.5: RGB(254, 244, 84), 0.75: RGB(173, 203, 249), 1: RGB(75, 107, 169)])
deconstruct_mesh = DeconstructMesh(Mesh=mesh_face_cull)  # -> Vertices, Faces, Colours, Normals
construct_mesh = ConstructMesh(Vertices=deconstruct_mesh.Vertices, Faces=deconstruct_mesh.Faces, Colours=gradient)
