# Dynamo graph Live-NurbsSurface-exchange-from-Grasshopper-to-Rhino.dyn (Dynamo 1.3.2.2480)

# group: 1. Make sure that the port number for incoming data matches the port number in Grasshopper for the outcoming data
code_block = CodeBlock { 4141; }

socketAdapter = CreateAdapterComponent(arg1=code_block)

# group: 2. Set the boolean to true to start live streaming from Grasshopper . Start streaming FIRST from Grasshopper, and then start receiving in Dynamo. If nothing is streamed to Dynamo: 1. Set this boolean to FALSE 2. Set the Grasshopper boolean to False 3. Change port in both scripts 4. Follow the instructions in the scripts again
boolean = BoolSelector(true)

pull = PullComponent(socketAdapter, arg3=boolean)
flatten = Flatten(pull)
watch = Watch(flatten)
