# Grasshopper definition Live-NurbsSurface-exchange-from-Grasshopper-to-Rhino.gh (Grasshopper 0.9.76)
# plug-ins: BH.UI.Grasshopper

# ----
# 1. Make sure that the
# port number for incoming data
# matches the port number
# in Grasshopper for
# the outcoming data
number_slider = Slider(4141, range=0..10000)

pt = Point([Point(4.973371683, 1.107439772, 0.670522673), Point(3.492954962, 9.938639905, 0.02527292352), Point(14.67619918, 1.501338799, 1.13226089), Point(13.12880424, 9.375742073, 0.6371762776), Point(8.44692768, 6.064084892, 3.185796186), Point(18.96784603, 4.124965078, 0.04445029329)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])
sort_pt = SortPoints(Points=pt)  # -> Points, Indices
srfgrid = SurfaceFromPoints(Points=sort_pt.Points, UCount=Slider(10, range=0..100), Interpolate=False)
socketadapter = SocketAdapter(Address="127.0.0.1", Port=number_slider, LocalOnly=True, Component="{ ..ctor")
srf_1 = Surface(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)

# ----
# 2. Choose which
# surface to push
list = ValueList({"One": 0, "Two": 1}, selected="One")

filter = StreamFilter(Gate=list, Stream0=srf_1, Stream1=srfgrid)

# ----
# 3. Set the boolean to true
# to start live streaming to Dynamo.
# Start streaming FIRST from Grasshopper,
# and then start receiving
# in Dynamo.
# If nothing is streamed to Dynamo:
# 1. Set this boolean to FALSE
# 2. Set the Dynamo boolean to False
# 3. Change port in both scripts
# 4. Follow the instructions in the scripts again
toggle = BooleanToggle(False)

push = Push(Adapter=socketadapter, Objects=flatten(filter), Active=toggle, Component="{ .Push")  # -> Objects, Success
panel = Panel(push.Objects)
panel_2 = Panel(push.Success)
