# Grasshopper definition kmlTest.gh (Grasshopper 1.0.7)
# plug-ins: BH.UI.Grasshopper

altitudemode = AltitudeMode(
    {"ClampToGround": 0, "RelativeToGround": 1, "Absolute": 2}, selected="Absolute",
    Component="BH.oM.External.XML.Enums.AltitudeMode",
    Selection=2)
vec = Vector(Vector(-8.669710355, 129.076786, 0))
georeference = GeoReference(
    NorthVector=vec,
    Reference="{ \"_t\" : \"BH.oM.Geometry.Point\", \"X\" : 0.0, \"Y\" : 0.0, \"Z\" : 0.0 }",
    ReferenceLatitude="50.905827",
    ReferenceLongitude="-1.390975",
    ReferenceAltitude="3",
    AltitudeMode=altitudemode,
    Component="BH.oM.External.XML.GeoReference")
mesh = Mesh(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)
schema = Schema({"Undefined": 0, "GBXML": 1, "KML": 2}, selected="KML", Component="BH.oM.External.XML.Enums.Schema", Selection=2)
kmlgeometry = KMLGeometry(GeoReference=georeference, Geometries=mesh, Name="Bowl", Component="BH.oM.External.XML.KMLGeometry")
filesettings = FileSettings(
    FileName="testKML.xml",
    Directory="C:\Users\Admin\Documents\projects\BHoM\dev\KML\",
    Component="BH.oM.Adapter.FileSettings")
kmlsettings = KMLSettings(NewFile=True, Component="BH.oM.External.XML.Settings.KMLSettings")
xmlconfig = XMLConfig(
    Schema=schema,
    Settings=kmlsettings,
    WrapNonBHoMObjects=Toggle(True),
    AllowHashForComparing=False,
    DiffConfig="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",
    Component="BH.oM.External.XML.XMLConfig")
xmladapter = XMLAdapter(FileSettings=filesettings, Component="{ ..ctor")
kmldocumentbuilder = KMLDocumentBuilder(KMLGeometries=kmlgeometry, Name="St Mary's Stadium", Component="BH.oM.External.XML.KMLDocumentBuilder")
push = Push(
    Adapter=xmladapter,
    Objects=flatten(kmldocumentbuilder),
    PushType="{ \"_t\" : \"System.Enum\", \"TypeName\" : { \"_t\" : \"System.Type\", \"Name\" : \"BH.oM.Adapter.PushType\" }, \"Value\" : \"AdapterDefault\" }",
    ActionConfig=xmlconfig,
    Active=Toggle(True),
    Component="{ .Push")  # -> Objects, Success
