# Grasshopper definition BHoM_ExampleScript_PushExecutePull.gh (Grasshopper 1.0.7)
# plug-ins: BH.UI.Grasshopper

getinfo = GetInfo(Component="{ .GetInfo")
bhom_version_used_to_create = Panel("6.3.1.0")
bhom_version_currently_installed = Panel(getinfo)
# Example of push, execute commands and pull result
# Script description: Pushes a simple model with loads
# Shows of execute commands components
# Reads results
toggle = BooleanToggle(True)
list = ValueList({"Robot": 0, "ETABS17": 1, "ETABS2016": 2, "SAP2000": 3, "GSA": 4, "Lusas18": 5, "Lusas17": 6, "MidasCivil": 7, "RAM": 8, "RFEM": 9}, selected="ETABS17")

# ----
# Adapter
# Your file path here
path = FilePath("C:\Users\kedstroem\OneDrive - Buro Happold\Non-project\Issue Lusas #344\myLusas.mdl")
filepath = Panel(path)
# Adapter to software
lusasv200adapter = LusasV200Adapter(FilePath=filepath, Active=Toggle(False), Component="{ ..ctor")
adapter = BHoMAdapter(
    lusasv200adapter,
    ObjectType="{ \"_t\" : \"System.Type\", \"Name\" : \"System.Object, mscorlib, Version=4.0.0.0, Culture=neutral, PublicKeyToken=b77a5c561934e089\", \"_bhomVersion\" : \"6.3\" }",
    m_ForcePreview=False,
    m_MaxItemsPreview=10000)

# ----
# Push elements
toggle_2 = BooleanToggle(False)
# Push loads
toggle_3 = BooleanToggle(False)
bool = Boolean(toggle_3)

# ----
# Push simple model to analyse
# Push loads
number_slider = Slider(0, range=0..100)
number_slider_2 = Slider(0.05, range=0..0.3)
number_slider_3 = Slider(0, range=0..0.1)
concrete = Concrete(
    Name="myConcrete",
    YoungsModulus="2550",
    PoissonsRatio="0",
    ThermalExpansionCoeff="0.2",
    Density="0.00001",
    DampingRatio="3.7e+10",
    CubeStrength="5.0e+7",
    CylinderStrength="6.0e+7",
    Component="{ .Concrete")
pt = ConstructPoint(
    XCoordinate=[Slider(0, range=0..100), Slider(5, range=0..100), Slider(5, range=0..100), Slider(0, range=0..100)],
    YCoordinate=[Slider(0, range=0..100), number_slider, Slider(5, range=0..100), Slider(5, range=0..100)],
    ZCoordinate=0)
item = ListItem(List=pt, Index=0, Wrap=True)  # -> Item, Item1, Item2, Item3
steel = Steel(
    Name="mySteel",
    Density="7850",
    DampingRatio="0",
    PoissonsRatio="0.3",
    ThermalExpansionCoeff="0.000012",
    YoungsModulus="2.1e+11",
    YieldStress="3.55e+8",
    UltimateStress="4.9e+8",
    Component="BH.oM.Structure.MaterialFragments.Steel")
srf4pt = _4PointSurface(CornerA=item.Item, CornerB=item.Item1, CornerC=item.Item2, CornerD=item.Item3)
isectionprofile = ISectionProfile(
    Height=Slider(0.8, range=0..1),
    Width=Slider(0.3, range=0..0.5),
    WebThickness=number_slider_2,
    FlangeThickness=number_slider_2,
    RootRadius=number_slider_3,
    ToeRadius=number_slider_3,
    Component="{ .ISectionProfile")
fixconstraint6dof = FixConstraint6DOF(Name="Fixed", Component="{ .FixConstraint6DOF")
fullreleaseconstraint6dof = FullReleaseConstraint6DOF(Name="Free", Component="{ .FullReleaseConstraint6DOF")
sectionpropertyfromprofile = SectionPropertyFromProfile(Profile=isectionprofile, Material=steel, Name="myISteel", Component="{ .SectionPropertyFromProfile")
constantthickness = ConstantThickness(
    Name="mySlab",
    Thickness=Slider(0.25, range=0..1),
    Material=concrete,
    PanelType="{ \"_t\" : \"System.Enum\", \"TypeName\" : { \"_t\" : \"System.Type\", \"Name\" : \"BH.oM.Structure.SurfaceProperties.PanelType\", \"_bhomVersion\" : \"6.3\" }, \"Value\" : \"Slab\", \"_bhomVersion\" : \"6.3\" }",
    Component="BH.oM.Structure.SurfaceProperties.ConstantThickness")
merge = Merge(Data1=fixconstraint6dof, Data2=fixconstraint6dof, Data3=fixconstraint6dof, Data4=fullreleaseconstraint6dof)
node = Node(Coordinates=pt, Support=merge, Component="{ .Node")
number_slider_4 = Slider(4, range=0..10)
barreleasefixfix = BarReleaseFixFix(Name="FixFix", Component="{ .BarReleaseFixFix")
shift = ShiftList(List=node, Shift=1, Wrap=True)
split1d = Split1D(
    {"Divisions": 0, "Length": 1, "Automatic": 2}, selected="Divisions",
    Component="BH.oM.Adapters.Lusas.Split1D",
    Selection=0)
split1d_2 = Split1D(
    {"Divisions": 0, "Length": 1, "Automatic": 2}, selected="Divisions",
    Component="BH.oM.Adapters.Lusas.Split1D",
    Selection=0)
bar = Bar(
    StartNode=node,
    EndNode=shift,
    SectionProperty=sectionpropertyfromprofile,
    OrientationAngle=0,
    Release=barreleasefixfix,
    FEAType="{ \"_t\" : \"System.Enum\", \"TypeName\" : { \"_t\" : \"System.Type\", \"Name\" : \"BH.oM.Structure.Elements.BarFEAType\", \"_bhomVersion\" : \"6.3\" }, \"Value\" : \"Flexural\", \"_bhomVersion\" : \"6.3\" }",
    Component="BH.oM.Structure.Elements.Bar")
panel = Panel(Surface=srf4pt, Property=constantthickness, Name="mySlab1", Tolerance=1e-06, Component="{ .Panel")
meshsettings1d = MeshSettings1D(SplitMethod=split1d, SplitParameter=Slider(4, range=0..10), Name="Mesh 1D", Component="{ .MeshSettings1D")
meshsettings2d = MeshSettings2D(
    SplitMethod=split1d_2,
    XDivisions=number_slider_4,
    YDivisions=number_slider_4,
    Size=1,
    Name="Mesh 2D",
    Component="{ .MeshSettings2D")
addfragment = AddFragment(IBHoMObject=panel, Fragment=meshsettings2d, Replace=False, Component="{ .AddFragment")
addfragment_2 = AddFragment(IBHoMObject=bar, Fragment=meshsettings1d, Replace=False, Component="{ .AddFragment")
bool_2 = Boolean(toggle_2)
adapter_2 = BHoMAdapter(
    adapter,
    ObjectType="{ \"_t\" : \"System.Type\", \"Name\" : \"System.Object, mscorlib, Version=4.0.0.0, Culture=neutral, PublicKeyToken=b77a5c561934e089\", \"_bhomVersion\" : \"6.3\" }",
    m_ForcePreview=False,
    m_MaxItemsPreview=10000)
push = Push(
    Adapter=adapter_2,
    Objects=addfragment_2,
    PushType="{ \"_t\" : \"System.Enum\", \"TypeName\" : { \"_t\" : \"System.Type\", \"Name\" : \"BH.oM.Adapter.PushType\", \"_bhomVersion\" : \"6.3\" }, \"Value\" : \"AdapterDefault\", \"_bhomVersion\" : \"6.3\" }",
    Active=bool_2,
    Component="{ .Push")  # -> Objects, Success
adapter_3 = BHoMAdapter(
    adapter,
    ObjectType="{ \"_t\" : \"System.Type\", \"Name\" : \"System.Object, mscorlib, Version=4.0.0.0, Culture=neutral, PublicKeyToken=b77a5c561934e089\", \"_bhomVersion\" : \"6.3\" }",
    m_ForcePreview=False,
    m_MaxItemsPreview=10000)
push_2 = Push(
    Adapter=adapter_3,
    Objects=addfragment,
    PushType="{ \"_t\" : \"System.Enum\", \"TypeName\" : { \"_t\" : \"System.Type\", \"Name\" : \"BH.oM.Adapter.PushType\", \"_bhomVersion\" : \"6.3\" }, \"Value\" : \"AdapterDefault\", \"_bhomVersion\" : \"6.3\" }",
    Active=push.Success,
    Component="{ .Push")  # -> Objects, Success
loadcase = Loadcase(
    Name="Loadcase1",
    Nature="{ \"_t\" : \"System.Enum\", \"TypeName\" : { \"_t\" : \"System.Type\", \"Name\" : \"BH.oM.Structure.Loads.LoadNature\", \"_bhomVersion\" : \"6.3\" }, \"Value\" : \"Other\", \"_bhomVersion\" : \"6.3\" }",
    Number=Slider(1, range=0..1),
    Component="BH.oM.Structure.Loads.Loadcase")
loadcase_2 = Loadcase(
    Name="Loadcase2",
    Nature="{ \"_t\" : \"System.Enum\", \"TypeName\" : { \"_t\" : \"System.Type\", \"Name\" : \"BH.oM.Structure.Loads.LoadNature\", \"_bhomVersion\" : \"6.3\" }, \"Value\" : \"Other\", \"_bhomVersion\" : \"6.3\" }",
    Number=Slider(2, range=0..10),
    Component="BH.oM.Structure.Loads.Loadcase")
loadcase_3 = Loadcase(
    Name="Loadcase3",
    Nature="{ \"_t\" : \"System.Enum\", \"TypeName\" : { \"_t\" : \"System.Type\", \"Name\" : \"BH.oM.Structure.Loads.LoadNature\", \"_bhomVersion\" : \"6.3\" }, \"Value\" : \"Other\", \"_bhomVersion\" : \"6.3\" }",
    Number=Slider(3, range=0..10),
    Component="BH.oM.Structure.Loads.Loadcase")
vec = VectorXYZ(XComponent=0, YComponent=0, ZComponent=Slider(-5000, range=-5000..5000))  # -> Vector, Length
vec_2 = VectorXYZ(XComponent=0, YComponent=0, ZComponent=Slider(1000, range=-5000..5000))  # -> Vector, Length
vec_3 = VectorXYZ(XComponent=0, YComponent=0, ZComponent=Slider(2000, range=-5000..5000))  # -> Vector, Length
areauniformlydistributedload = AreaUniformlyDistributedLoad(
    Loadcase=loadcase_3,
    Pressure=vec_2.Vector,
    Objects=push_2.Objects,
    Axis="{ \"_t\" : \"System.Enum\", \"TypeName\" : { \"_t\" : \"System.Type\", \"Name\" : \"BH.oM.Structure.Loads.LoadAxis\", \"_bhomVersion\" : \"6.3\" }, \"Value\" : \"Global\", \"_bhomVersion\" : \"6.3\" }",
    Projected=False,
    Name="Loadcase3",
    Component="{ .AreaUniformlyDistributedLoad")
baruniformlydistributedload = BarUniformlyDistributedLoad(
    Loadcase=loadcase,
    Objects=push.Objects,
    Force=vec.Vector,
    Axis="{ \"_t\" : \"System.Enum\", \"TypeName\" : { \"_t\" : \"System.Type\", \"Name\" : \"BH.oM.Structure.Loads.LoadAxis\", \"_bhomVersion\" : \"6.3\" }, \"Value\" : \"Global\", \"_bhomVersion\" : \"6.3\" }",
    Projected=False,
    Name="Loadcase1",
    Component="{ .BarUniformlyDistributedLoad")
baruniformlydistributedload_2 = BarUniformlyDistributedLoad(
    Loadcase=loadcase_2,
    Objects=push.Objects,
    Force=vec_3.Vector,
    Axis="{ \"_t\" : \"System.Enum\", \"TypeName\" : { \"_t\" : \"System.Type\", \"Name\" : \"BH.oM.Structure.Loads.LoadAxis\", \"_bhomVersion\" : \"6.3\" }, \"Value\" : \"Global\", \"_bhomVersion\" : \"6.3\" }",
    Projected=False,
    Name="Loadcase2",
    Component="{ .BarUniformlyDistributedLoad")
adapter_4 = BHoMAdapter(
    adapter,
    ObjectType="{ \"_t\" : \"System.Type\", \"Name\" : \"System.Object, mscorlib, Version=4.0.0.0, Culture=neutral, PublicKeyToken=b77a5c561934e089\", \"_bhomVersion\" : \"6.3\" }",
    m_ForcePreview=False,
    m_MaxItemsPreview=10000)
push_3 = Push(
    Adapter=adapter_4,
    Objects=[baruniformlydistributedload, baruniformlydistributedload_2, areauniformlydistributedload],
    PushType="{ \"_t\" : \"System.Enum\", \"TypeName\" : { \"_t\" : \"System.Type\", \"Name\" : \"BH.oM.Adapter.PushType\", \"_bhomVersion\" : \"6.3\" }, \"Value\" : \"AdapterDefault\", \"_bhomVersion\" : \"6.3\" }",
    Active=bool,
    Component="{ .Push")  # -> Objects, Success

filepath_to_save_at = Panel("C:\Temp\tempSave.gwb")

# ----
# Commands
analyse = Analyse(Component="BH.oM.Adapter.Commands.Analyse")
adapter_5 = BHoMAdapter(
    adapter,
    ObjectType="{ \"_t\" : \"System.Type\", \"Name\" : \"System.Object, mscorlib, Version=4.0.0.0, Culture=neutral, PublicKeyToken=b77a5c561934e089\", \"_bhomVersion\" : \"6.3\" }",
    m_ForcePreview=False,
    m_MaxItemsPreview=10000)
execute = Execute(Adapter=adapter_5, Command=analyse, Active=Toggle(False), Component="{ .Execute")  # -> Output, Success

saveas = SaveAs(FileName=filepath_to_save_at, Component="BH.oM.Adapter.Commands.SaveAs")
adapter_6 = BHoMAdapter(
    adapter,
    ObjectType="{ \"_t\" : \"System.Type\", \"Name\" : \"System.Object, mscorlib, Version=4.0.0.0, Culture=neutral, PublicKeyToken=b77a5c561934e089\", \"_bhomVersion\" : \"6.3\" }",
    m_ForcePreview=False,
    m_MaxItemsPreview=10000)
execute_2 = Execute(Adapter=adapter_6, Command=saveas, Active=Toggle(False), Component="{ .Execute")  # -> Output, Success

save = Save(Component="BH.oM.Adapter.Commands.Save")
adapter_7 = BHoMAdapter(
    adapter,
    ObjectType="{ \"_t\" : \"System.Type\", \"Name\" : \"System.Object, mscorlib, Version=4.0.0.0, Culture=neutral, PublicKeyToken=b77a5c561934e089\", \"_bhomVersion\" : \"6.3\" }",
    m_ForcePreview=False,
    m_MaxItemsPreview=10000)
execute_3 = Execute(Adapter=adapter_7, Command=save, Active=Toggle(False), Component="{ .Execute")  # -> Output, Success

clearresults = ClearResults(Component="BH.oM.Adapter.Commands.ClearResults")
adapter_8 = BHoMAdapter(
    adapter,
    ObjectType="{ \"_t\" : \"System.Type\", \"Name\" : \"System.Object, mscorlib, Version=4.0.0.0, Culture=neutral, PublicKeyToken=b77a5c561934e089\", \"_bhomVersion\" : \"6.3\" }",
    m_ForcePreview=False,
    m_MaxItemsPreview=10000)
execute_4 = Execute(Adapter=adapter_8, Command=clearresults, Active=Toggle(False), Component="{ .Execute")  # -> Output, Success

newmodel = NewModel(Component="BH.oM.Adapter.Commands.NewModel")
adapter_9 = BHoMAdapter(
    adapter,
    ObjectType="{ \"_t\" : \"System.Type\", \"Name\" : \"System.Object, mscorlib, Version=4.0.0.0, Culture=neutral, PublicKeyToken=b77a5c561934e089\", \"_bhomVersion\" : \"6.3\" }",
    m_ForcePreview=False,
    m_MaxItemsPreview=10000)
execute_5 = Execute(Adapter=adapter_9, Command=newmodel, Active=Toggle(False), Component="{ .Execute")  # -> Output, Success

close = Close(SaveBeforeClose=False, Component="BH.oM.Adapter.Commands.Close")
adapter_10 = BHoMAdapter(
    adapter,
    ObjectType="{ \"_t\" : \"System.Type\", \"Name\" : \"System.Object, mscorlib, Version=4.0.0.0, Culture=neutral, PublicKeyToken=b77a5c561934e089\", \"_bhomVersion\" : \"6.3\" }",
    m_ForcePreview=False,
    m_MaxItemsPreview=10000)
execute_6 = Execute(Adapter=adapter_10, Command=close, Active=Toggle(False), Component="{ .Execute")  # -> Output, Success

# ----
# Pulling results
noderesulttype = NodeResultType(
    {"NodeReaction": 0, "NodeDisplacement": 1, "NodeVelocity": 2, "NodeAcceleration": 3, "NodeModalMass": 4, "NodeModeShape": 5, "NodeModalResult": 6}, selected="NodeReaction",
    Component="BH.oM.Structure.Requests.NodeResultType",
    Selection=0)
meshresulttype = MeshResultType(
    {"Forces": 0, "Stresses": 1, "Displacements": 2, "VonMises": 3, "MeshModeShape": 4}, selected="Stresses",
    Component="BH.oM.Structure.Results.MeshResultType",
    Selection=1)
barresulttype = BarResultType(
    {"BarForce": 0, "BarDeformation": 1, "BarStress": 2, "BarStrain": 3, "BarDisplacement": 4, "BarModeShape": 5}, selected="BarStress",
    Component="BH.oM.Structure.Requests.BarResultType",
    Selection=2)
divisiontype = DivisionType(
    {"EvenlyDistributed": 0, "ExtremeValues": 1}, selected="ExtremeValues",
    Component="BH.oM.Structure.Requests.DivisionType",
    Selection=1)
list_2 = ValueList({"One": 1, "Two": 2, "Three": 2² - 1}, selected="One")
list_3 = ValueList({"One": 1, "Two": 2, "Three": 2² - 1}, selected="One")
list_4 = ValueList({"One": 1, "Two": 2, "Three": 2² - 1}, selected="One")
meshresultrequest = MeshResultRequest(
    ResultType=meshresulttype,
    Smoothing="{ \"_t\" : \"System.Enum\", \"TypeName\" : { \"_t\" : \"System.Type\", \"Name\" : \"BH.oM.Structure.Results.MeshResultSmoothingType\", \"_bhomVersion\" : \"6.3\" }, \"Value\" : \"None\", \"_bhomVersion\" : \"6.3\" }",
    Layer="{ \"_t\" : \"System.Enum\", \"TypeName\" : { \"_t\" : \"System.Type\", \"Name\" : \"BH.oM.Structure.Results.MeshResultLayer\", \"_bhomVersion\" : \"6.3\" }, \"Value\" : \"AbsoluteMaximum\", \"_bhomVersion\" : \"6.3\" }",
    LayerPosition=0,
    Cases=list_2,
    Component="{ .MeshResultRequest")
noderesultrequest = NodeResultRequest(
    ResultType=noderesulttype,
    Axis="{ \"_t\" : \"System.Enum\", \"TypeName\" : { \"_t\" : \"System.Type\", \"Name\" : \"BH.oM.Structure.Loads.LoadAxis\", \"_bhomVersion\" : \"6.3\" }, \"Value\" : \"Global\", \"_bhomVersion\" : \"6.3\" }",
    Cases=list_3,
    Component="{ .NodeResultRequest")
barresultrequest = BarResultRequest(
    ResultType=barresulttype,
    DivisionType=divisiontype,
    Divisions=Slider(4, range=0..100),
    Cases=list_4,
    Component="BH.oM.Structure.Requests.BarResultRequest")
createtype = CreateType(Component="BH.oM.Structure.Elements.Panel")
createtype_2 = CreateType(Component="BH.oM.Structure.Elements.Bar")
adapter_11 = Data(adapter)
adapter_12 = Data(adapter)
adapter_13 = BHoMAdapter(
    adapter,
    ObjectType="{ \"_t\" : \"System.Type\", \"Name\" : \"System.Object, mscorlib, Version=4.0.0.0, Culture=neutral, PublicKeyToken=b77a5c561934e089\", \"_bhomVersion\" : \"6.3\" }",
    m_ForcePreview=False,
    m_MaxItemsPreview=10000)
adapter_14 = Data(adapter)
adapter_15 = BHoMAdapter(
    adapter,
    ObjectType="{ \"_t\" : \"System.Type\", \"Name\" : \"System.Object, mscorlib, Version=4.0.0.0, Culture=neutral, PublicKeyToken=b77a5c561934e089\", \"_bhomVersion\" : \"6.3\" }",
    m_ForcePreview=False,
    m_MaxItemsPreview=10000)
pull = Pull(
    Adapter=adapter_13,
    Request=createtype_2,
    PullType="{ \"_t\" : \"System.Enum\", \"TypeName\" : { \"_t\" : \"System.Type\", \"Name\" : \"BH.oM.Adapter.PullType\", \"_bhomVersion\" : \"6.3\" }, \"Value\" : \"AdapterDefault\", \"_bhomVersion\" : \"6.3\" }",
    Active=Toggle(False),
    Component="{ .Pull")
pull_2 = Pull(
    Adapter=adapter_14,
    Request=barresultrequest,
    PullType="{ \"_t\" : \"System.Enum\", \"TypeName\" : { \"_t\" : \"System.Type\", \"Name\" : \"BH.oM.Adapter.PullType\", \"_bhomVersion\" : \"6.3\" }, \"Value\" : \"AdapterDefault\", \"_bhomVersion\" : \"6.3\" }",
    Active=Toggle(False),
    Component="{ .Pull")
pull_3 = Pull(
    Adapter=adapter_15,
    Request=createtype,
    PullType="{ \"_t\" : \"System.Enum\", \"TypeName\" : { \"_t\" : \"System.Type\", \"Name\" : \"BH.oM.Adapter.PullType\", \"_bhomVersion\" : \"6.3\" }, \"Value\" : \"AdapterDefault\", \"_bhomVersion\" : \"6.3\" }",
    Active=Toggle(False),
    Component="{ .Pull")
pull_4 = Pull(
    Adapter=adapter_12,
    Request=noderesultrequest,
    PullType="{ \"_t\" : \"System.Enum\", \"TypeName\" : { \"_t\" : \"System.Type\", \"Name\" : \"BH.oM.Adapter.PullType\", \"_bhomVersion\" : \"6.3\" }, \"Value\" : \"AdapterDefault\", \"_bhomVersion\" : \"6.3\" }",
    Active=Toggle(False),
    Component="{ .Pull")
pull_5 = Pull(
    Adapter=adapter_11,
    Request=meshresultrequest,
    PullType="{ \"_t\" : \"System.Enum\", \"TypeName\" : { \"_t\" : \"System.Type\", \"Name\" : \"BH.oM.Adapter.PullType\", \"_bhomVersion\" : \"6.3\" }, \"Value\" : \"AdapterDefault\", \"_bhomVersion\" : \"6.3\" }",
    Active=Toggle(False),
    Component="{ .Pull")
result = BHIObject(
    pull_5,
    ObjectType="{ \"_t\" : \"System.Type\", \"Name\" : \"System.Object, mscorlib, Version=4.0.0.0, Culture=neutral, PublicKeyToken=b77a5c561934e089\", \"_bhomVersion\" : \"6.3\" }",
    m_ForcePreview=False,
    m_MaxItemsPreview=10000)
result_2 = BHIObject(
    pull_2,
    ObjectType="{ \"_t\" : \"System.Type\", \"Name\" : \"System.Object, mscorlib, Version=4.0.0.0, Culture=neutral, PublicKeyToken=b77a5c561934e089\", \"_bhomVersion\" : \"6.3\" }",
    m_ForcePreview=False,
    m_MaxItemsPreview=10000)
result_3 = BHIObject(
    pull_4,
    ObjectType="{ \"_t\" : \"System.Type\", \"Name\" : \"System.Object, mscorlib, Version=4.0.0.0, Culture=neutral, PublicKeyToken=b77a5c561934e089\", \"_bhomVersion\" : \"6.3\" }",
    m_ForcePreview=False,
    m_MaxItemsPreview=10000)
bhom = BHoMObject(
    pull,
    ObjectType="{ \"_t\" : \"System.Type\", \"Name\" : \"System.Object, mscorlib, Version=4.0.0.0, Culture=neutral, PublicKeyToken=b77a5c561934e089\", \"_bhomVersion\" : \"6.3\" }",
    m_ForcePreview=False,
    m_MaxItemsPreview=10000)
bhom_2 = BHoMObject(
    pull_3,
    ObjectType="{ \"_t\" : \"System.Type\", \"Name\" : \"System.Object, mscorlib, Version=4.0.0.0, Culture=neutral, PublicKeyToken=b77a5c561934e089\", \"_bhomVersion\" : \"6.3\" }",
    m_ForcePreview=False,
    m_MaxItemsPreview=10000)

panel_2 = Panel(result)
panel_3 = Panel(result_3)
panel_4 = Panel(result_2)
