# Grasshopper definition Data-mining-with-HTTPAdapter.gh (Grasshopper 0.9.76)
# plug-ins: BH.UI.Grasshopper

panel = Panel("Mac OS X on Intel x86 or x86_64\tMozilla/5.0 (Macintosh; Intel Mac OS X x.y; rv:10.0) Gecko/20100101 Firefox/10.0")
mongoadapter = MongoAdapter(
    ServerName="mongodb://localhost",
    Port=27017,
    DatabaseName="datasets",
    CollectionName="data-mining-example",
    UseHistory=False,
    Component="{ ..ctor")
createcustom = CreateCustom(Accept="application/vnd.github.v3+json", User_Agent=panel, Component="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")
httpadapter = HTTPAdapter(Component="{ \"_t\" : \"System.Reflection.MethodBase\", \"TypeName\" : \"{ \\\"_t\\\" : \\\"System.Type\\\", \\\"Name\\\" : \\\"BH.Adapter.HTTP.HTTPAdapter, HTTP_Adapter, Version=1.0.0.0, Culture=neutral, PublicKeyToken=null\\\" }\", \"MethodName\" : \".ctor\", \"Parameters\" : [] }")
getquery = GetQuery(BaseUrl="https://api.github.com/orgs/BHoM/repos", Headers=createcustom, Component="{ .GetQuery")
move = Move(Source=httpadapter, Target=mongoadapter, Query=getquery, Active=Toggle(False), Component="{ .Move")
panel_2 = Panel(move)
