# Dynamo graph PullDisciplines.dyn (Dynamo 2.0.2.6826)

# group: Revit adapter
boolean = BoolSelector(false)
revitAdapter = CreateAdapterComponent(active=boolean, SerialisedCaller="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", lacing=Shortest)

# group: Model elements of category filter;
filterModelElements = CreateObjectComponent()
code_block = CodeBlock { "Walls"; }
filterByCategory = CreateObjectComponent(CategoryName=code_block, SerialisedCaller="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", lacing=Shortest)
logicalAndRequest = CreateObjectComponent(request1=filterModelElements, request2=filterByCategory, SerialisedCaller="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")

# group: Physical discipline
discipline = CreateEnumComponent(index=4, SerialisedCaller="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", lacing=Shortest)
revitPullConfig = CreateObjectComponent(discipline=discipline, SerialisedCaller="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")

# group: Pull physical walls
boolean_2 = BoolSelector(false)
pull = PullComponent(adapter=revitAdapter, request=logicalAndRequest, actionConfig=revitPullConfig, active=boolean_2, SerialisedCaller="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", lacing=Shortest)  # unwired: pullType

# group: Model elements of category filter;
filterModelElements_2 = CreateObjectComponent()
code_block_2 = CodeBlock { "Walls"; }
filterByCategory_2 = CreateObjectComponent(CategoryName=code_block_2, SerialisedCaller="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", lacing=Shortest)
logicalAndRequest_2 = CreateObjectComponent(request1=filterModelElements_2, request2=filterByCategory_2, SerialisedCaller="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")

# group: Structural discipline
discipline_2 = CreateEnumComponent(index=4, SerialisedCaller="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", lacing=Shortest)
revitPullConfig_2 = CreateObjectComponent(discipline=discipline_2, SerialisedCaller="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")

# group: Pull structural walls
boolean_3 = BoolSelector(false)
pull_2 = PullComponent(adapter=revitAdapter, request=logicalAndRequest_2, actionConfig=revitPullConfig_2, active=boolean_3, SerialisedCaller="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", lacing=Shortest)  # unwired: pullType

# group: Model elements of category filter;
filterModelElements_3 = CreateObjectComponent()
code_block_3 = CodeBlock { "Walls"; }
filterByCategory_3 = CreateObjectComponent(CategoryName=code_block_3, SerialisedCaller="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", lacing=Shortest)
logicalAndRequest_3 = CreateObjectComponent(request1=filterModelElements_3, request2=filterByCategory_3, SerialisedCaller="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")

# group: Environmental discipline
discipline_3 = CreateEnumComponent(index=4, SerialisedCaller="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", lacing=Shortest)
revitPullConfig_3 = CreateObjectComponent(discipline=discipline_3, SerialisedCaller="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")

# group: Pull environmental walls
boolean_4 = BoolSelector(false)
pull_3 = PullComponent(adapter=revitAdapter, request=logicalAndRequest_3, actionConfig=revitPullConfig_3, active=boolean_4, SerialisedCaller="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", lacing=Shortest)  # unwired: pullType
