# Dynamo graph DetailLine.dyn (Dynamo 2.0.2.6826)

# group: Revit adapter
boolean = BoolSelector(false)
revitAdapter = CreateAdapterComponent(active=boolean, SerialisedCaller="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", lacing=Shortest)

# group: Create the drafting instance
code_block = CodeBlock { "Detail Line Red"; "Level 0 GA"; }
byCoordinates = Point.ByCoordinates()
code_block_2 = CodeBlock { 2; }
byCoordinates_2 = Point.ByCoordinates(x=code_block_2, y=code_block_2)
byStartPointEndPoint = Line.ByStartPointEndPoint(startPoint=byCoordinates, endPoint=byCoordinates_2)
draftingInstance = CreateObjectComponent(name=code_block.out0, viewName=code_block.out1, location=byStartPointEndPoint, SerialisedCaller="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", lacing=Shortest)

# group: Push detail line
pushType = CreateEnumComponent(index=1, SerialisedCaller="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", lacing=Shortest)
boolean_2 = BoolSelector(false)
push = PushComponent(adapter=revitAdapter, objects=draftingInstance, pushType=pushType, active=boolean_2, SerialisedCaller="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", lacing=Shortest)
