# Dynamo graph ModelInstance.dyn (Dynamo 2.0.2.6826)

# group: Revit adapter
boolean = BoolSelector(false)
revitAdapter = CreateAdapterComponent(active=boolean, SerialisedCaller="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", lacing=Shortest)

# group: Create model instance
code_block = CodeBlock { "Rectangular Duct"; "Default"; }
code_block_2 = CodeBlock { 10; 360*10; }
byAxis = Helix.ByAxis(pitch=code_block_2.out0, angleTurns=code_block_2.out1)
code_block_3 = CodeBlock { 100; }
pointsAtEqualChordLength = Curve.PointsAtEqualChordLength(curve=byAxis, divisions=code_block_3)
code_block_4 = CodeBlock { 1; -1; }
dropItems = List.DropItems(list=pointsAtEqualChordLength, amount=code_block_4.out0)
dropItems_2 = List.DropItems(list=pointsAtEqualChordLength, amount=code_block_4.out1)
byStartPointEndPoint = Line.ByStartPointEndPoint(startPoint=dropItems, endPoint=dropItems_2)
modelInstance = CreateObjectComponent(familyName=code_block.out0, familyTypeName=code_block.out1, location=byStartPointEndPoint, SerialisedCaller="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", lacing=Longest)

# group: Push model instance
pushType = CreateEnumComponent(index=1, SerialisedCaller="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", lacing=Shortest)
boolean_2 = BoolSelector(false)
push = PushComponent(adapter=revitAdapter, objects=modelInstance, pushType=pushType, active=boolean_2, SerialisedCaller="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", lacing=Shortest)
