# Dynamo graph PushElements.dyn (Dynamo 2.0.2.6826)

# group: Revit adapter
boolean = BoolSelector(false)
revitAdapter = CreateAdapterComponent(active=boolean, SerialisedCaller="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", lacing=Shortest)

# group: Create floor construction
code_block = CodeBlock { "300 THK RC SLAB"; }
construction = CreateObjectComponent(name=code_block, SerialisedCaller="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", lacing=Shortest)

# group: Inputs
building_edge = CodeBlock { 20; }
level_height = CodeBlock { 3.5; }
number_of_storeys = CodeBlock { 20; }
core_edge = CodeBlock { 6; }

# group: Create levels
sequence = Sequence(start=level_height, amount=number_of_storeys, step=level_height)
code_block_2 = CodeBlock { 1; }
sequence_2 = Sequence(start=code_block_2, amount=number_of_storeys, step=code_block_2)
code_block_3 = CodeBlock(x=sequence_2) { "Level " + x; }
level = CreateObjectComponent(elevation=sequence, name=code_block_3, SerialisedCaller="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", lacing=Shortest)

# group: Create floors
XY = Plane.XY()
byWidthLength = Rectangle.ByWidthLength(plane=XY, width=building_edge, length=building_edge)
translate = Geometry.Translate(geometry=byWidthLength, zTranslation=sequence)
floor = CreateObjectComponent(construction=construction, edges=translate, SerialisedCaller="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", lacing=Longest)

# group: Push floors
pushType = CreateEnumComponent(index=1, SerialisedCaller="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", lacing=Shortest)
boolean_2 = BoolSelector(false)
push = PushComponent(adapter=revitAdapter, objects=floor, pushType=pushType, active=boolean_2, SerialisedCaller="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", lacing=Shortest)

# group: Push levels
pushType_2 = CreateEnumComponent(index=1, SerialisedCaller="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", lacing=Shortest)
boolean_3 = BoolSelector(false)
push_2 = PushComponent(adapter=revitAdapter, objects=level, pushType=pushType_2, active=boolean_3, SerialisedCaller="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", lacing=Shortest)

# group: Create wall construction
code_block_4 = CodeBlock { "200 THK R.C. WALL"; }
construction_2 = CreateObjectComponent(name=code_block_4, SerialisedCaller="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", lacing=Shortest)

# group: Create walls
XY_2 = Plane.XY()
byWidthLength_2 = Rectangle.ByWidthLength(plane=XY_2, width=core_edge, length=core_edge)
code_block_5 = CodeBlock(x=sequence, a=level_height) { x-a; }
translate_2 = Geometry.Translate(geometry=byWidthLength_2, zTranslation=code_block_5)
curves = PolyCurve.Curves(polyCurve=translate_2)
flatten = List.Flatten(list=curves)
wall = CreateObjectComponent(construction=construction_2, bottomEdge=flatten, height=level_height, SerialisedCaller="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", lacing=Longest)

# group: Push walls
pushType_3 = CreateEnumComponent(index=1, SerialisedCaller="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", lacing=Shortest)
boolean_4 = BoolSelector(false)
push_3 = PushComponent(adapter=revitAdapter, objects=wall, pushType=pushType_3, active=boolean_4, SerialisedCaller="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", lacing=Shortest)

# group: Create framing property
code_block_6 = CodeBlock { "450x600 RC COL"; }
constantFramingProperty = CreateObjectComponent(Name=code_block_6, SerialisedCaller="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", lacing=Shortest)

# group: Create column
curves_2 = PolyCurve.Curves(polyCurve=translate)
flatten_2 = List.Flatten(list=curves_2)
startPoint = Curve.StartPoint(curve=flatten_2)
code_block_7 = CodeBlock(a=level_height) { a*-1; }
translate_3 = Geometry.Translate(geometry=startPoint, zTranslation=code_block_7)
byStartPointEndPoint = Line.ByStartPointEndPoint(startPoint=translate_3, endPoint=startPoint)
column = CreateObjectComponent(location=byStartPointEndPoint, property=constantFramingProperty, SerialisedCaller="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", lacing=Longest)

# group: Push columns
pushType_4 = CreateEnumComponent(index=1, SerialisedCaller="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", lacing=Shortest)
boolean_5 = BoolSelector(false)
push_4 = PushComponent(adapter=revitAdapter, objects=column, pushType=pushType_4, active=boolean_5, SerialisedCaller="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", lacing=Shortest)
