# Dynamo graph UpdateFamilyNames.dyn (Dynamo 2.0.2.6826)

# group: Revit adapter
boolean = BoolSelector(false)
revitAdapter = CreateAdapterComponent(active=boolean, SerialisedCaller="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", lacing=Shortest)

# group: Pull all families
filterFamilyByName = CreateObjectComponent(SerialisedCaller="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", lacing=Shortest)
boolean_2 = BoolSelector(false)
pull = PullComponent(adapter=revitAdapter, request=filterFamilyByName, active=boolean_2, SerialisedCaller="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", lacing=Shortest)  # unwired: pullType

# group: Update family name
code_block = CodeBlock { "Name"; }
code_block_2 = CodeBlock { "Prefix_"; }
getProperty = GetPropertyComponent(obj=pull, propName=code_block, SerialisedCaller="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", lacing=Longest)
code_block_3 = CodeBlock(a=code_block_2, b=getProperty) { a + b; }
setProperty = SetPropertyComponent(obj=pull, propName=code_block, value=code_block_3, SerialisedCaller="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", lacing=Longest)

# group: Update families
pushType = CreateEnumComponent(index=3, SerialisedCaller="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", lacing=Shortest)
boolean_3 = BoolSelector(false)
push = PushComponent(adapter=revitAdapter, objects=setProperty, pushType=pushType, active=boolean_3, SerialisedCaller="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", lacing=Shortest)
