# Dynamo graph RemovePinned.dyn "RemovePinnedDynamo" (Dynamo 2.0.2.6826)

# group: Revit adapter
boolean = BoolSelector(true)
revitAdapter = CreateAdapterComponent(active=boolean, SerialisedCaller="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", lacing=Shortest)

# group: Request
code_block = CodeBlock { "Generic Annotations"; }
filterByCategory = CreateObjectComponent(CategoryName=code_block, SerialisedCaller="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", lacing=Shortest)

# group: Action config
code_block_2 = CodeBlock { true; }
revitRemoveConfig = CreateObjectComponent(includeClosedWorksets=code_block_2, removePinned=code_block_2, SerialisedCaller="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", lacing=Shortest)

# group: Remove
boolean_2 = BoolSelector(false)
remove = RemoveComponent(adapter=revitAdapter, request=filterByCategory, actionConfig=revitRemoveConfig, active=boolean_2, SerialisedCaller="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", lacing=Shortest)
