# Grasshopper definition ComplexRequests.gh (Grasshopper 0.9.76)
# plug-ins: BH.UI.Grasshopper

# ---- group: Revit adapter
revitadapter = RevitAdapter(Active=Toggle(False), Component="{ ..ctor")

# ---- group: Filter plan views
revitviewtype = RevitViewType(
    {"Undefined": 0, "FloorPlan": 1, "CeilingPlan": 2, "Elevation": 3, "ThreeD": 4, "Schedule": 5, "DrawingSheet": 6, "ProjectBrowser": 7, "Report": 8, "DraftingView": 9, "Legend": 10, "SystemBrowser": 11, "EngineeringPlan": 12, "AreaPlan": 13, "Section": 14, "Detail": 15, "CostReport": 16, "LoadsReport": 17, "PresureLossReport": 18, "ColumnSchedule": 19, "PanelSchedule": 20, "Walkthrough": 21, "Rendering": 22, "SystemsAnalysisReport": 23, "Internal": 24}, selected="EngineeringPlan",
    Component="BH.oM.Adapters.Revit.Enums.RevitViewType",
    Selection=12)
filterviewsbytype = FilterViewsByType(RevitViewType=revitviewtype, Component="BH.oM.Adapters.Revit.Requests.FilterViewsByType")

# ---- group: Filter by name prefix
textcomparisontype = TextComparisonType(
    {"Equal": 0, "NotEqual": 1, "Contains": 2, "ContainsNot": 3, "StartsWith": 4, "EndsWith": 5}, selected="StartsWith",
    Component="BH.oM.Adapters.Revit.Enums.TextComparisonType",
    Selection=4)
filterbyparametertext = FilterByParameterText(
    ParameterName="View Name",
    TextComparisonType=textcomparisontype,
    Value="Structural",
    Component="BH.oM.Adapters.Revit.Requests.FilterByParameterText")

# ---- group: Revit adapter
revitadapter_2 = RevitAdapter(Active=Toggle(False), Component="{ ..ctor")

# ---- group: Filter by DB type
filterbydbtypename = FilterByDBTypeName(TypeName="Autodesk.Revit.DB.Mechanical.MechanicalSystem", Component="BH.oM.Adapters.Revit.Requests.FilterByDBTypeName")

# ---- group: Revit adapter
revitadapter_3 = RevitAdapter(Active=Toggle(False), Component="{ ..ctor")

# ---- group: Filter elements by family and type
filterbyfamilyandtypename = FilterByFamilyAndTypeName(
    FamilyName="HE wide flange beams",
    FamilyTypeName="HEA 300",
    CaseSensitive=Toggle(False),
    Component="BH.oM.Adapters.Revit.Requests.FilterByFamilyAndTypeName")

# ---- group: Revit adapter
revitadapter_4 = RevitAdapter(Active=Toggle(False), Component="{ ..ctor")

# ---- group: Filter structural bars
createtype = CreateType(Component="BH.oM.Structure.Elements.Bar")
filterbybhomtype = FilterByBHoMType(BHoMType=createtype, Component="{ .FilterByBHoMType")

# ---- group: Filter structural panels
createtype_2 = CreateType(Component="BH.oM.Structure.Elements.Panel")
filterbybhomtype_2 = FilterByBHoMType(BHoMType=createtype_2, Component="{ .FilterByBHoMType")

# ---- group: Structural parameter filter
filterbyparameterbool = FilterByParameterBool(
    ParameterName="Enable Analytical Model",
    Value=Toggle(True),
    Component="BH.oM.Adapters.Revit.Requests.FilterByParameterBool")

# ---- group: Revit adapter
revitadapter_5 = RevitAdapter(Active=Toggle(False), Component="{ ..ctor")

revitadapter_6 = RevitAdapter(Active=Toggle(False), Component="{ ..ctor")

# ---- group: Filter family
filterfamilybyname = FilterFamilyByName(FamilyName="UB Universal Beams", CaseSensitive=True, Component="BH.oM.Adapters.Revit.Requests.FilterFamilyByName")

# ---- group: Filter active view
filteractiveview = FilterActiveView(Component="BH.oM.Adapters.Revit.Requests.FilterActiveView")

# ---- group: Pull active view
pull = Pull(
    Adapter=revitadapter_6,
    Request=filteractiveview,
    PullType="{ \"_t\" : \"System.Enum\", \"TypeName\" : { \"_t\" : \"System.Type\", \"Name\" : \"BH.oM.Adapter.PullType\" }, \"Value\" : \"AdapterDefault\" }",
    Active=Toggle(False),
    Component="{ .Pull")

# ---- group: Logical statement
logicalorrequest = LogicalOrRequest(Request1=filterbybhomtype, Request2=filterbybhomtype_2, Component="{ .LogicalOrRequest")
logicalandrequest = LogicalAndRequest(Request1=logicalorrequest, Request2=filterbyparameterbool, Component="{ .LogicalAndRequest")

# ---- group: Pull UB Beam family
pull_2 = Pull(
    Adapter=revitadapter_5,
    Request=filterfamilybyname,
    PullType="{ \"_t\" : \"System.Enum\", \"TypeName\" : { \"_t\" : \"System.Type\", \"Name\" : \"BH.oM.Adapter.PullType\" }, \"Value\" : \"AdapterDefault\" }",
    Active=Toggle(False),
    Component="{ .Pull")

# ---- group: Pull HEA 300 elements
pull_3 = Pull(
    Adapter=revitadapter_3,
    Request=filterbyfamilyandtypename,
    PullType="{ \"_t\" : \"System.Enum\", \"TypeName\" : { \"_t\" : \"System.Type\", \"Name\" : \"BH.oM.Adapter.PullType\" }, \"Value\" : \"AdapterDefault\" }",
    Active=Toggle(False),
    Component="{ .Pull")

# ---- group: Logical and statement
logicalandrequest_2 = LogicalAndRequest(Request1=filterviewsbytype, Request2=filterbyparametertext, Component="{ .LogicalAndRequest")

# ---- group: Pull
pull_4 = Pull(
    Adapter=revitadapter,
    Request=filterbydbtypename,
    PullType="{ \"_t\" : \"System.Enum\", \"TypeName\" : { \"_t\" : \"System.Type\", \"Name\" : \"BH.oM.Adapter.PullType\" }, \"Value\" : \"AdapterDefault\" }",
    Active=Toggle(False),
    Component="{ .Pull")

pull_5 = Pull(
    Adapter=revitadapter_4,
    Request=logicalandrequest,
    PullType="{ \"_t\" : \"System.Enum\", \"TypeName\" : { \"_t\" : \"System.Type\", \"Name\" : \"BH.oM.Adapter.PullType\" }, \"Value\" : \"AdapterDefault\" }",
    Active=Toggle(False),
    Component="{ .Pull")

# ---- group: Pull views
pull_6 = Pull(
    Adapter=revitadapter_2,
    Request=logicalandrequest_2,
    PullType="{ \"_t\" : \"System.Enum\", \"TypeName\" : { \"_t\" : \"System.Type\", \"Name\" : \"BH.oM.Adapter.PullType\" }, \"Value\" : \"AdapterDefault\" }",
    Active=Toggle(False),
    Component="{ .Pull")

# ---- group: Filter view specific
filterbyviewspecific = FilterByViewSpecific(BHoMObject=pull, Component="{ .FilterByViewSpecific")

# ---- group: Filter detail items
filterbycategory = FilterByCategory(CategoryName="Detail Items", CaseSensitive=True, Component="BH.oM.Adapters.Revit.Requests.FilterByCategory")

# ---- group: Filter types of family
filtertypesoffamily = FilterTypesOfFamily(BHoMObject=pull_2, Component="{ .FilterTypesOfFamily")

# ---- group: Pull types of a family
pull_7 = Pull(
    Adapter=revitadapter_5,
    Request=filtertypesoffamily,
    PullType="{ \"_t\" : \"System.Enum\", \"TypeName\" : { \"_t\" : \"System.Type\", \"Name\" : \"BH.oM.Adapter.PullType\" }, \"Value\" : \"AdapterDefault\" }",
    Active=Toggle(False),
    Component="{ .Pull")

# ---- group: Logical and statement
logicalandrequest_3 = LogicalAndRequest(Request1=filterbyviewspecific, Request2=filterbycategory, Component="{ .LogicalAndRequest")

# ---- group: Pull detail items that belong to a view
pull_8 = Pull(
    Adapter=revitadapter_6,
    Request=logicalandrequest_3,
    PullType="{ \"_t\" : \"System.Enum\", \"TypeName\" : { \"_t\" : \"System.Type\", \"Name\" : \"BH.oM.Adapter.PullType\" }, \"Value\" : \"AdapterDefault\" }",
    Active=Toggle(False),
    Component="{ .Pull")
