# Grasshopper definition ParameterMappingOnPull.gh (Grasshopper 0.9.76)
# plug-ins: BH.UI.Grasshopper

# ---- group: Custom parameter settings
panel = Panel("ProfileHeight")
panel_2 = Panel("""Type: b
Type: Height""")
panel_3 = Panel("Name")
parameterlinks = ParameterLinks(PropertyName=panel_3, ParameterNames="Column Location Mark", Component="{ .ParameterLinks")
parameterlinks_2 = ParameterLinks(PropertyName=panel, ParameterNames=panel_2, Component="{ .ParameterLinks")
createtype = CreateType(Component="BH.oM.Physical.Elements.Column")
parametermap = ParameterMap(Type=createtype, ParameterLinks=[parameterlinks_2, parameterlinks], Component="{ .ParameterMap")
parametersettings = ParameterSettings(
    ParameterMaps=parametermap,
    TagsParameter="BHE_Tags",
    MaterialGradeParameter="BHE_Material Grade",
    Component="BH.oM.Adapters.Revit.Settings.ParameterSettings")
revitsettings = RevitSettings(
    ConnectionSettings="{ \"_t\" : \"BH.oM.Adapters.Revit.Settings.ConnectionSettings\", \"BHoM_Guid\" : \"b2e41e53-8b3b-4a7d-8b72-6516d610ec1b\", \"Name\" : \"\", \"Fragments\" : [], \"Tags\" : [], \"CustomData\" : { }, \"PushPort\" : 14128, \"PullPort\" : 14129, \"MaxMinutesToWait\" : 10 }",
    FamilyLoadSettings="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",
    ParameterSettings=parametersettings,
    DistanceTolerance=1e-06,
    AngleTolerance=1e-06,
    Component="BH.oM.Adapters.Revit.Settings.RevitSettings")

# ---- group: Revit adapter
revitadapter = RevitAdapter(RevitSettings=revitsettings, Active=Toggle(False), Component="{ ..ctor")

# ---- group: Request
createtype_2 = CreateType(Component="BH.oM.Physical.Elements.Column")

# ---- group: Pull
pull = Pull(
    Adapter=revitadapter,
    Request=createtype_2,
    PullType="{ \"_t\" : \"System.Enum\", \"TypeName\" : { \"_t\" : \"System.Type\", \"Name\" : \"BH.oM.Adapter.PullType\" }, \"Value\" : \"AdapterDefault\" }",
    Active=Toggle(False),
    Component="{ .Pull")

# ---- group: Mapped parameters
getrevitparametervalue = GetRevitParameterValue(BHoMObject=pull, ParameterName=panel, Component="{ .GetRevitParameterValue")
panel_4 = Panel(getrevitparametervalue)

# ---- group: Mapped property
getproperty = GetProperty(Obj=pull, PropName=panel_3, Component="{ .GetProperty")
panel_5 = Panel(getproperty)
