# Grasshopper definition PullDisciplines.gh (Grasshopper 0.9.76)
# plug-ins: BH.UI.Grasshopper

# ---- group: Environmental discipline
discipline = Discipline(
    {"Undefined": 0, "Environmental": 1, "Structural": 2, "Architecture": 3, "Physical": 4}, selected="Environmental",
    Component="BH.oM.Adapters.Revit.Enums.Discipline",
    Selection=1)
revitpullconfig = RevitPullConfig(Discipline=discipline, IncludeClosedWorksets=False, Component="{ .RevitPullConfig")

# ---- group: Physical discipline
# STRUCTURAL
discipline_2 = Discipline(
    {"Undefined": 0, "Environmental": 1, "Structural": 2, "Architecture": 3, "Physical": 4}, selected="Physical",
    Component="BH.oM.Adapters.Revit.Enums.Discipline",
    Selection=4)
revitpullconfig_2 = RevitPullConfig(Discipline=discipline_2, IncludeClosedWorksets=False, Component="{ .RevitPullConfig")

# ---- group: Revit adapter
# PHYSICAL
toggle = BooleanToggle(False)
revitadapter = RevitAdapter(Active=toggle, Component="{ ..ctor")

# ---- group: Category filter
filterbycategory = FilterByCategory(CategoryName="Walls", CaseSensitive=True, Component="BH.oM.Adapters.Revit.Requests.FilterByCategory")
filtermodelelements = FilterModelElements(Component="BH.oM.Adapters.Revit.Requests.FilterModelElements")
logicalandrequest = LogicalAndRequest(Request1=filtermodelelements, Request2=filterbycategory, Component="{ .LogicalAndRequest")

# ---- group: Structural discipline
# ENVIRONMENTAL
discipline_3 = Discipline(
    {"Undefined": 0, "Environmental": 1, "Structural": 2, "Architecture": 3, "Physical": 4}, selected="Structural",
    Component="BH.oM.Adapters.Revit.Enums.Discipline",
    Selection=2)
revitpullconfig_3 = RevitPullConfig(Discipline=discipline_3, IncludeClosedWorksets=False, Component="{ .RevitPullConfig")

# ---- group: Category filter
filterbycategory_2 = FilterByCategory(CategoryName="Walls", CaseSensitive=True, Component="BH.oM.Adapters.Revit.Requests.FilterByCategory")
filtermodelelements_2 = FilterModelElements(Component="BH.oM.Adapters.Revit.Requests.FilterModelElements")
logicalandrequest_2 = LogicalAndRequest(Request1=filtermodelelements_2, Request2=filterbycategory_2, Component="{ .LogicalAndRequest")

filterbycategory_3 = FilterByCategory(CategoryName="Walls", CaseSensitive=True, Component="BH.oM.Adapters.Revit.Requests.FilterByCategory")
filtermodelelements_3 = FilterModelElements(Component="BH.oM.Adapters.Revit.Requests.FilterModelElements")
logicalandrequest_3 = LogicalAndRequest(Request1=filtermodelelements_3, Request2=filterbycategory_2, Component="{ .LogicalAndRequest")

# ---- group: Pull physical
pull = Pull(
    Adapter=revitadapter,
    Request=logicalandrequest_2,
    PullType="{ \"_t\" : \"System.Enum\", \"TypeName\" : { \"_t\" : \"System.Type\", \"Name\" : \"BH.oM.Adapter.PullType\" }, \"Value\" : \"AdapterDefault\" }",
    ActionConfig=revitpullconfig_2,
    Active=Toggle(False),
    Component="{ .Pull")

# ---- group: Pull environmental
pull_2 = Pull(
    Adapter=revitadapter,
    Request=filterbycategory_3,
    PullType="{ \"_t\" : \"System.Enum\", \"TypeName\" : { \"_t\" : \"System.Type\", \"Name\" : \"BH.oM.Adapter.PullType\" }, \"Value\" : \"AdapterDefault\" }",
    ActionConfig=revitpullconfig,
    Active=Toggle(False),
    Component="{ .Pull")

# ---- group: Pull structural
pull_3 = Pull(
    Adapter=revitadapter,
    Request=logicalandrequest,
    PullType="{ \"_t\" : \"System.Enum\", \"TypeName\" : { \"_t\" : \"System.Type\", \"Name\" : \"BH.oM.Adapter.PullType\" }, \"Value\" : \"AdapterDefault\" }",
    ActionConfig=revitpullconfig_3,
    Active=Toggle(False),
    Component="{ .Pull")
