# Grasshopper definition PullParameters.gh (Grasshopper 0.9.76)
# plug-ins: BH.UI.Grasshopper

# ---- group: Revit adapter
revitadapter = RevitAdapter(Active=Toggle(False), Component="{ ..ctor")

# ---- group: Pull selected elements
filterbyselection = FilterBySelection(Component="{ .FilterBySelection")
pull = Pull(
    Adapter=revitadapter,
    Request=filterbyselection,
    PullType="{ \"_t\" : \"System.Enum\", \"TypeName\" : { \"_t\" : \"System.Type\", \"Name\" : \"BH.oM.Adapter.PullType\" }, \"Value\" : \"AdapterDefault\" }",
    Active=Toggle(False),
    Component="{ .Pull")

# ---- group: Get value of a chosen parameter
getrevitparametervalue = GetRevitParameterValue(BHoMObject=pull, ParameterName="Unconnected Height", Component="{ .GetRevitParameterValue")
panel = Panel(getrevitparametervalue)

# ---- group: Look up all parameters
getrevitparameters = GetRevitParameters(BHoMObject=pull, Component="{ .GetRevitParameters")
explode = Explode(Object=getrevitparameters, Component="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")  # -> Name, Value
panel_2 = Panel(explode.Name)
panel_3 = Panel(explode.Value)
