# Grasshopper definition PullRepresentations.gh (Grasshopper 0.9.76)
# plug-ins: BH.UI.Grasshopper

# ---- group: Pull config
detaillevel = DetailLevel({"Coarse": 0, "Medium": 1, "Fine": 2}, selected="Fine", Component="BH.oM.Adapters.Revit.Enums.DetailLevel", Selection=2)
pullrepresentationconfig = PullRepresentationConfig(
    PullRenderMesh=Toggle(True),
    DetailLevel=detaillevel,
    IncludeNonVisible=Toggle(False),
    Component="BH.oM.Adapters.Revit.PullRepresentationConfig")
revitpullconfig = RevitPullConfig(
    Discipline="{ \"_t\" : \"System.Enum\", \"TypeName\" : { \"_t\" : \"System.Type\", \"Name\" : \"BH.oM.Adapters.Revit.Enums.Discipline\" }, \"Value\" : \"Undefined\" }",
    IncludeClosedWorksets=False,
    RepresentationConfig=pullrepresentationconfig,
    Component="{ .RevitPullConfig")

# ---- group: Revit adapter
revitadapter = RevitAdapter(Active=Toggle(True), Component="{ ..ctor")

# ---- group: Selection request
filterbyselection = FilterBySelection(Component="{ .FilterBySelection")

# ---- group: Pull
pull = Pull(
    Adapter=revitadapter,
    Request=filterbyselection,
    PullType="{ \"_t\" : \"System.Enum\", \"TypeName\" : { \"_t\" : \"System.Type\", \"Name\" : \"BH.oM.Adapter.PullType\" }, \"Value\" : \"AdapterDefault\" }",
    ActionConfig=revitpullconfig,
    Active=Toggle(False),
    Component="{ .Pull")

# ---- group: Query RenderMeshes
rendermeshes = RenderMeshes(BHoMObject=pull, Component="{ .RenderMeshes")

# ---- group: Coloured preview
explode = Explode(Object=rendermeshes, Component="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")  # -> Vertices, Faces
item = ListItem(List=explode.Vertices, Index=0, Wrap=True)
explode_2 = Explode(Object=item, Component="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")  # -> Point, flatten(Color)
torhino = ToRhino(RFace=explode.Faces, Component="{ .ToRhino")
getproperty = GetProperty(Obj=explode_2.Color, PropName="R", Component="{ .GetProperty")
getproperty_2 = GetProperty(Obj=explode_2.Color, PropName="A", Component="{ .GetProperty")
getproperty_3 = GetProperty(Obj=explode_2.Color, PropName="G", Component="{ .GetProperty")
getproperty_4 = GetProperty(Obj=explode_2.Color, PropName="B", Component="{ .GetProperty")
conmesh = ConstructMesh(Vertices=explode.Vertices, Faces=torhino)
rgb = ColourRGB(Alpha=getproperty_2, Red=getproperty, Green=getproperty_3, Blue=getproperty_4)
mesh = Mesh(flatten(conmesh))
preview = CustomPreview(Geometry=mesh, Shader=rgb)
