# Grasshopper definition DetailLine.gh (Grasshopper 0.9.76)
# plug-ins: BH.UI.Grasshopper

# ---- group: Create the drafting instance
pt = ConstructPoint(XCoordinate=0, YCoordinate=0, ZCoordinate=0)
pt_2 = ConstructPoint(XCoordinate="2", YCoordinate=0, ZCoordinate=0)
ln = Line(StartPoint=pt, EndPoint=pt_2)
draftinginstance = DraftingInstance(Name="Detail Line Red", ViewName="Level 0 GA", Location=ln, Component="{ .DraftingInstance")

# ---- group: Revit adapter
revitadapter = RevitAdapter(Active=Toggle(False), Component="{ ..ctor")

# ---- group: Push detail line
pushtype = PushType(
    {"FullPush": 0, "CreateOnly": 1, "CreateNonExisting": 2, "UpdateOnly": 3, "DeleteThenCreate": 4, "AdapterDefault": 5}, selected="CreateOnly",
    Component="BH.oM.Adapter.PushType",
    Selection=1)
push = Push(Adapter=revitadapter, Objects=flatten(draftinginstance), PushType=pushtype, Active=Toggle(False), Component="{ .Push")  # -> Objects, Success
