# Grasshopper definition ModelInstance.gh (Grasshopper 0.9.76)
# plug-ins: BH.UI.Grasshopper

# ---- group: Revit adapter
revitadapter = RevitAdapter(Active=Toggle(False), Component="{ ..ctor")

# ---- group: Create model instance
series = Series(Start=0, Step=1, Count="50")
cos = Cosine(Value=series)
sin = Sine(Value=series)
pt = ConstructPoint(XCoordinate=sin, YCoordinate=cos, ZCoordinate=series)
intcrv = Interpolate(Vertices=pt, Degree=3, Periodic=False, KnotStyle=1)  # -> Curve, Length, Domain
divide = DivideCurve(Curve=intcrv.Curve, Count="100", Kinks=False)  # -> Points, Tangents, Parameters
pline = PolyLine(Vertices=divide.Points, Closed=False)
explode = Explode(Curve=pline, Recursive=True)  # -> Segments, Vertices
modelinstance = ModelInstance(FamilyName="Rectangular Duct", FamilyTypeName="Default", Location=explode.Segments, Component="{ .ModelInstance")

# ---- group: Push model instance
pushtype = PushType(
    {"FullPush": 0, "CreateOnly": 1, "CreateNonExisting": 2, "UpdateOnly": 3, "DeleteThenCreate": 4, "AdapterDefault": 5}, selected="CreateOnly",
    Component="BH.oM.Adapter.PushType",
    Selection=1)
push = Push(Adapter=revitadapter, Objects=flatten(modelinstance), PushType=pushtype, Active=Toggle(False), Component="{ .Push")  # -> Objects, Success
