# Grasshopper definition ParameterMappingOnPush.gh (Grasshopper 0.9.76)
# plug-ins: BH.UI.Grasshopper

# ---- group: Create parameter link
panel = Panel("Name")
parameterlinks = ParameterLinks(PropertyName=panel, ParameterNames="Mark", Component="{ .ParameterLinks")

# ---- group: Create wall
construction = Construction(Name="MyWallType", Component="{ .Construction")
crv = Curve(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)
wall = Wall(Construction=construction, BottomEdge=crv, Height="3", Component="{ .Wall")

# ---- group: Create parameter link
panel_2 = Panel("SingleParameter")
panel_3 = Panel("""Comments
Type: Type Comments""")
parameterlinks_2 = ParameterLinks(PropertyName=panel_2, ParameterNames=panel_3, Component="{ .ParameterLinks")

# ---- group: Set name
setproperty = SetProperty(Obj=wall, PropName=panel, Value="My custom name", Component="{ .PropertyValue")

# ---- group: Set Revit parameter to push
setrevitparameters = SetRevitParameters(BHoMObject=setproperty, Names=panel_2, Values="My comments", Component="{ .SetRevitParameters")

# ---- group: Custom parameter settings
createtype = CreateType(Component="BH.oM.Physical.Elements.Wall")
parametermap = ParameterMap(Type=createtype, ParameterLinks=[parameterlinks_2, parameterlinks], Component="{ .ParameterMap")
parametersettings = ParameterSettings(
    ParameterMaps=parametermap,
    TagsParameter="BHE_Tags",
    MaterialGradeParameter="BHE_Material Grade",
    Component="BH.oM.Adapters.Revit.Settings.ParameterSettings")
revitsettings = RevitSettings(
    ConnectionSettings="{ \"_t\" : \"BH.oM.Adapters.Revit.Settings.ConnectionSettings\", \"BHoM_Guid\" : \"b2e41e53-8b3b-4a7d-8b72-6516d610ec1b\", \"Name\" : \"\", \"Fragments\" : [], \"Tags\" : [], \"CustomData\" : { }, \"PushPort\" : 14128, \"PullPort\" : 14129, \"MaxMinutesToWait\" : 10 }",
    FamilyLoadSettings="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",
    ParameterSettings=parametersettings,
    DistanceTolerance=1e-06,
    AngleTolerance=1e-06,
    Component="BH.oM.Adapters.Revit.Settings.RevitSettings")

# ---- group: Revit adapter
revitadapter = RevitAdapter(RevitSettings=revitsettings, Active=Toggle(True), Component="{ ..ctor")

# ---- group: Push the wall - check its parameters Mark, Comments and type parameter Model
push = Push(
    Adapter=revitadapter,
    Objects=flatten(setrevitparameters),
    PushType="{ \"_t\" : \"System.Enum\", \"TypeName\" : { \"_t\" : \"System.Type\", \"Name\" : \"BH.oM.Adapter.PushType\" }, \"Value\" : \"AdapterDefault\" }",
    Active=Toggle(False),
    Component="{ .Push")  # -> Objects, Success
