# Grasshopper definition PushAdjustedFraming.gh (Grasshopper 0.9.76)
# plug-ins: BH.UI.Grasshopper

# ---- group: Revit adapter
revitadapter = RevitAdapter(Active=Toggle(False), Component="{ ..ctor")

# ---- group: Create beam
pt = ConstructPoint(XCoordinate=0, YCoordinate=0, ZCoordinate=0)
X = UnitX(Factor=1)
constantframingproperty = ConstantFramingProperty(OrientationAngle=0, Name="400x800 DP RC BEAM", Component="BH.oM.Physical.FramingProperties.ConstantFramingProperty")
line = LineSDL(Start=pt, Direction=X, Length=1)
beam = Beam(Location=line, Property=constantframingproperty, Component="{ .Beam")

# ---- group: Set parameters
# PUSH THE BEAM ALONG BHOM BEAM'S CENTERLINE
# WITH PRE-OVERWRITTEN PARAMETERS
panel = Panel("""z Justification
y Offset Value""")
# PUSH THE BEAM ALONG BHOM BEAM'S CENTERLINE
# AND THEN OVERWRITE PARAMETERS
panel_2 = Panel("""Bottom
0.666""")
setrevitparameters = SetRevitParameters(BHoMObject=beam, Names=panel, Values=panel_2, Component="{ .SetRevitParameters")

# ---- group: Push beam without parameters
push = Push(
    Adapter=revitadapter,
    Objects=flatten(beam),
    PushType="{ \"_t\" : \"System.Enum\", \"TypeName\" : { \"_t\" : \"System.Type\", \"Name\" : \"BH.oM.Adapter.PushType\" }, \"Value\" : \"AdapterDefault\" }",
    Active=Toggle(False),
    Component="{ .Push")  # -> Objects, Success

# ---- group: Push
push_2 = Push(
    Adapter=revitadapter,
    Objects=flatten(setrevitparameters),
    PushType="{ \"_t\" : \"System.Enum\", \"TypeName\" : { \"_t\" : \"System.Type\", \"Name\" : \"BH.oM.Adapter.PushType\" }, \"Value\" : \"AdapterDefault\" }",
    Active=Toggle(False),
    Component="{ .Push")  # -> Objects, Success

# ---- group: Set parameters
panel_3 = Panel("""z Justification
y Offset Value""")
panel_4 = Panel("""Bottom
0.666""")
setrevitparameters_2 = SetRevitParameters(BHoMObject=push.Objects, Names=panel_3, Values=panel_4, Component="{ .SetRevitParameters")

# ---- group: Update parameters without updating location
pushtype = PushType(
    {"FullPush": 0, "CreateOnly": 1, "CreateNonExisting": 2, "UpdateOnly": 3, "DeleteThenCreate": 4, "AdapterDefault": 5}, selected="UpdateOnly",
    Component="BH.oM.Adapter.PushType",
    Selection=3)
revitpushconfig = RevitPushConfig(
    SuppressFailureMessages=False,
    IncludeClosedWorksets=False,
    SetLocationOnUpdate=Toggle(False),
    Component="{ .RevitPushConfig")
push_3 = Push(
    Adapter=revitadapter,
    Objects=flatten(setrevitparameters_2),
    PushType=pushtype,
    Active=Toggle(False),
    Component="{ .Push")  # -> Objects, Success
