# Grasshopper definition PushElements.gh (Grasshopper 0.9.76)
# plug-ins: BH.UI.Grasshopper

# ---- group: Inputs
building_edge = Panel("20")
number_of_storeys = Panel("20")
storey_height = Panel("3.5")
core_edge = Panel("6")

# ---- group: Revit adapter
revitadapter = RevitAdapter(Active=Toggle(False), Component="{ ..ctor")

# ---- group: Create floor construction
construction = Construction(Name="300 THK RC SLAB", Component="{ .Construction")

# ---- group: Create wall construction
construction_2 = Construction(Name="200 THK R.C. WALL", Component="{ .Construction")

# ---- group: Create levels
series = Series(Start=storey_height, Step=storey_height, Count=number_of_storeys)
series_2 = Series(Start="1", Step=storey_height, Count="1")
int = Integer(series_2)
concat = Concatenate(FragmentA="Level ", FragmentB=int)
level = Level(Elevation=series, Name=concat, Component="{ .Level")

# ---- group: Create floors
multiplication = Multiplication(A=building_edge, B=-0.5)
multiplication_2 = Multiplication(A=building_edge, B=0.5)
dom = ConstructDomain(DomainStart=multiplication, DomainEnd=multiplication_2)
rectangle = Rectangle(Plane=PlaneXY(0, 0, 0), XSize=dom, YSize=dom, Radius=0)  # -> Rectangle, Length
Z = UnitZ(Factor=series)
move = Move(Geometry=rectangle.Rectangle, Motion=Z)  # -> Geometry, Transform
floor = Floor(Construction=construction, Edges=move.Geometry, Component="{ .Floor")

# ---- group: Create walls
multiplication_3 = Multiplication(A=core_edge, B=-0.5)
multiplication_4 = Multiplication(A=core_edge, B=0.5)
dom_2 = ConstructDomain(DomainStart=multiplication_3, DomainEnd=multiplication_4)
subtraction = Subtraction(A=series, B=storey_height)
rectangle_2 = Rectangle(Plane=PlaneXY(0, 0, 0), XSize=dom_2, YSize=dom_2, Radius=0)  # -> Rectangle, Length
Z_2 = UnitZ(Factor=subtraction)
move_2 = Move(Geometry=rectangle_2.Rectangle, Motion=Z_2)  # -> Geometry, Transform
explode = Explode(Curve=move_2.Geometry, Recursive=True)  # -> flatten(Segments), Vertices
wall = Wall(Construction=construction_2, BottomEdge=explode.Segments, Height=storey_height, Component="{ .Wall")

# ---- group: Create framing property
constantframingproperty = ConstantFramingProperty(OrientationAngle=0, Name="450x600 RC COL", Component="BH.oM.Physical.FramingProperties.ConstantFramingProperty")

# ---- group: Create column
explode_2 = Explode(Curve=move.Geometry, Recursive=True)  # -> flatten(Segments), Vertices
eval = EvaluateLength(Curve=explode_2.Segments, Length=0, Normalized=True)  # -> Point, Tangent, Parameter
multiplication_5 = Multiplication(A=storey_height, B=-1)
Z_3 = UnitZ(Factor=multiplication_5)
move_3 = Move(Geometry=eval.Point, Motion=Z_3)  # -> Geometry, Transform
ln = Line(StartPoint=move_3.Geometry, EndPoint=eval.Point)
column = Column(Location=ln, Property=constantframingproperty, Component="BH.oM.Physical.Elements.Column")

# ---- group: Push levels
pushtype = PushType(
    {"FullPush": 0, "CreateOnly": 1, "CreateNonExisting": 2, "UpdateOnly": 3, "DeleteThenCreate": 4, "AdapterDefault": 5}, selected="CreateOnly",
    Component="BH.oM.Adapter.PushType",
    Selection=1)
push = Push(Adapter=revitadapter, Objects=flatten(level), PushType=pushtype, Active=Toggle(False), Component="{ .Push")  # -> Objects, Success

# ---- group: Push floors
pushtype_2 = PushType(
    {"FullPush": 0, "CreateOnly": 1, "CreateNonExisting": 2, "UpdateOnly": 3, "DeleteThenCreate": 4, "AdapterDefault": 5}, selected="CreateOnly",
    Component="BH.oM.Adapter.PushType",
    Selection=1)
push_2 = Push(Adapter=revitadapter, Objects=flatten(floor), PushType=pushtype_2, Active=Toggle(False), Component="{ .Push")  # -> Objects, Success

# ---- group: Push walls
pushtype_3 = PushType(
    {"FullPush": 0, "CreateOnly": 1, "CreateNonExisting": 2, "UpdateOnly": 3, "DeleteThenCreate": 4, "AdapterDefault": 5}, selected="CreateOnly",
    Component="BH.oM.Adapter.PushType",
    Selection=1)
push_3 = Push(Adapter=revitadapter, Objects=flatten(wall), PushType=pushtype_3, Active=Toggle(False), Component="{ .Push")  # -> Objects, Success

# ---- group: Push columns
pushtype_4 = PushType(
    {"FullPush": 0, "CreateOnly": 1, "CreateNonExisting": 2, "UpdateOnly": 3, "DeleteThenCreate": 4, "AdapterDefault": 5}, selected="CreateOnly",
    Component="BH.oM.Adapter.PushType",
    Selection=1)
push_4 = Push(Adapter=revitadapter, Objects=flatten(column), PushType=pushtype_4, Active=Toggle(False), Component="{ .Push")  # -> Objects, Success
