# Grasshopper definition PushParameters.gh (Grasshopper 0.9.76)
# plug-ins: BH.UI.Grasshopper

# ---- group: Revit adapter
revitadapter = RevitAdapter(Active=Toggle(False), Component="{ ..ctor")

# ---- group: Column grid
Z = UnitZ(Factor="3")
recgrid = Rectangular(Plane=PlaneXY(0, 0, 0), SizeX="6", SizeY="6", ExtentX=10, ExtentY=5)  # -> Cells, Points
line = LineSDL(Start=flatten(recgrid.Points), Direction=Vector(0, 0, 1), Length=Z)

# ---- group: Create columns
constantframingproperty = ConstantFramingProperty(OrientationAngle=0, Name="UC305x305x118", Component="BH.oM.Physical.FramingProperties.ConstantFramingProperty")
column = Column(Location=line, Property=constantframingproperty, Component="BH.oM.Physical.Elements.Column")

# ---- group: Row labels
lng = ListLength(List=recgrid.Points)
series = Series(Start=1, Step=1, Count=lng)
int = Integer(series)
concat = Concatenate(FragmentA="Row", FragmentB=int)  # -> flatten(Result)

# ---- group: Number sequence
lng_2 = ListLength(List=line)
series_2 = Series(Start=1, Step=1, Count=lng_2)
int_2 = Integer(flatten(series_2))

# ---- group: Set number to Mark parameter
# SETTING PARAMETERS ONE BY ONE
panel = Panel("Mark")
setrevitparameter = SetRevitParameter(BHoMObject=column, ParamName=panel, Value=int_2, Component="{ .SetRevitParameter")

# ---- group: Set multiple parameters
# SETTING PARAMETERS IN BATCH
panel_2 = Panel("""Mark
Comments""")
merge = Merge(Data1=graft(int_2), Data2=graft(concat))
setrevitparameters = SetRevitParameters(BHoMObject=graft(column), ParamNames=panel_2, Values=merge, Component="{ .SetRevitParameters")  # -> flatten(I)

# ---- group: Set row number to Comments parameter
setrevitparameter_2 = SetRevitParameter(BHoMObject=setrevitparameter, ParamName="Comments", Value=int_2, Component="{ .SetRevitParameter")

# ---- group: Push
push = Push(
    Adapter=revitadapter,
    Objects=flatten(setrevitparameters),
    PushType="{ \"_t\" : \"System.Enum\", \"TypeName\" : { \"_t\" : \"System.Type\", \"Name\" : \"BH.oM.Adapter.PushType\" }, \"Value\" : \"AdapterDefault\" }",
    Active=Toggle(False),
    Component="{ .Push")  # -> Objects, Success

push_2 = Push(
    Adapter=revitadapter,
    Objects=flatten(setrevitparameter_2),
    PushType="{ \"_t\" : \"System.Enum\", \"TypeName\" : { \"_t\" : \"System.Type\", \"Name\" : \"BH.oM.Adapter.PushType\" }, \"Value\" : \"AdapterDefault\" }",
    Active=Toggle(False),
    Component="{ .Push")  # -> Objects, Success
