# Grasshopper definition UpdateFamilyNames.gh (Grasshopper 0.9.76)
# plug-ins: BH.UI.Grasshopper

# ---- group: Revit adapter
revitadapter = RevitAdapter(Active=Toggle(False), Component="{ ..ctor")

# ---- group: Pull all families
filterfamilybyname = FilterFamilyByName(CaseSensitive=True, Component="BH.oM.Adapters.Revit.Requests.FilterFamilyByName")
pull = Pull(
    Adapter=revitadapter,
    Request=filterfamilybyname,
    PullType="{ \"_t\" : \"System.Enum\", \"TypeName\" : { \"_t\" : \"System.Type\", \"Name\" : \"BH.oM.Adapter.PullType\" }, \"Value\" : \"AdapterDefault\" }",
    Active=Toggle(False),
    Component="{ .Pull")

# ---- group: Update family name
getproperty = GetProperty(Obj=pull, PropName="Name", Component="{ .GetProperty")
concat = Concatenate(FragmentA="Prefix_", FragmentB=getproperty)
setproperty = SetProperty(Obj=pull, PropName="Name", Value=concat, Component="{ .PropertyValue")

# ---- group: Update families
pushtype = PushType(
    {"FullPush": 0, "CreateOnly": 1, "CreateNonExisting": 2, "UpdateOnly": 3, "DeleteThenCreate": 4, "AdapterDefault": 5}, selected="UpdateOnly",
    Component="BH.oM.Adapter.PushType",
    Selection=3)
push = Push(Adapter=revitadapter, Objects=flatten(setproperty), PushType=pushtype, Active=Toggle(False), Component="{ .Push")  # -> Objects, Success
