# Grasshopper definition UpdateParameter.gh (Grasshopper 0.9.76)
# plug-ins: BH.UI.Grasshopper

# ---- group: Revit adapter
revitadapter = RevitAdapter(Active=Toggle(False), Component="{ ..ctor")

# ---- group: Pull selected elements
filterbyselection = FilterBySelection(Component="{ .FilterBySelection")
pull = Pull(
    Adapter=revitadapter,
    Request=filterbyselection,
    PullType="{ \"_t\" : \"System.Enum\", \"TypeName\" : { \"_t\" : \"System.Type\", \"Name\" : \"BH.oM.Adapter.PullType\" }, \"Value\" : \"AdapterDefault\" }",
    Active=Toggle(False),
    Component="{ .Pull")

# ---- group: Set property
setrevitparameter = SetRevitParameter(BHoMObject=pull, ParamName="Comments", Value="Hello World", Component="{ .SetRevitParameter")

# ---- group: Update element
pushtype = PushType(
    {"FullPush": 0, "CreateOnly": 1, "CreateNonExisting": 2, "UpdateOnly": 3, "DeleteThenCreate": 4, "AdapterDefault": 5}, selected="UpdateOnly",
    Component="BH.oM.Adapter.PushType",
    Selection=3)
push = Push(Adapter=revitadapter, Objects=flatten(setrevitparameter), PushType=pushtype, Active=Toggle(False), Component="{ .Push")  # -> Objects, Success
