# Grasshopper definition RemovePinned.gh (Grasshopper 0.9.76)
# plug-ins: BH.UI.Grasshopper

# ---- group: Revit adapter
revitadapter = RevitAdapter(Active=Toggle(False), Component="{ ..ctor")

# ---- group: Request
filterbycategory = FilterByCategory(CategoryName="Generic Annotations", CaseSensitive=True, Component="BH.oM.Adapters.Revit.Requests.FilterByCategory")

# ---- group: Action config
toggle = BooleanToggle(True)
revitremoveconfig = RevitRemoveConfig(SuppressFailureMessages=False, IncludeClosedWorksets=toggle, RemovePinned=toggle, Component="{ .RevitRemoveConfig")

# ---- group: Remove
remove = Remove(
    Adapter=revitadapter,
    Request=filterbycategory,
    ActionConfig=revitremoveconfig,
    Active=Toggle(False),
    Component="{ .Remove")
