# Dynamo graph CreateSchematicSpaces.dyn (Dynamo 1.3.3.4651)

string = StringInput("\\SRV-BATH03\Non_Project\Bath Region\Bath Building Services\Bath MEP Revit\Development Work (by permission only)\Addin\Files\2018\Projects\BH Schematic\1.0.5\res")
familyLibrary = CreateObjectComponent(string)
familyLoadSettings = CreateObjectComponent(familyLibrary)
revitSettings = CreateObjectComponent(familyLoadSettings)
boolean = BoolSelector(true)
revitAdapter = CreateAdapterComponent(revitSettings, boolean)
string_2 = StringInput("_BHm_DetailItem_SpaceVentilation")
string_3 = StringInput("Space")
code_block = CodeBlock { 1; }
selectionFilterQuery = CreateQueryComponent()
string_4 = StringInput("Spaces")
categoryFilterQuery = CreateQueryComponent(string_4)
logicalAndFilterQuery = CreateQueryComponent(selectionFilterQuery, categoryFilterQuery)
pull = PullComponent(revitAdapter, logicalAndFilterQuery, arg3=boolean)
count = List.Count(pull)
range = Range(start=code_block, end=count, step=code_block, lacing=Longest)
code_block_2 = CodeBlock(x=range) { x * 0.05; }
point = CreateObjectComponent(code_block_2)
string_5 = StringInput("Drafting 1")
draftingObject = CreateObjectComponent(string_2, string_3, point, string_5)
string_6 = StringInput("SPACE NAME")
watch = Watch(pull)
string_7 = StringInput("Name")
getProperty = GetPropertyComponent(watch, string_7)
setProperty = SetPropertyComponent(draftingObject, string_6, getProperty)
boolean_2 = BoolSelector(true)
push = PushComponent(revitAdapter, setProperty, arg4=boolean_2)
