# Grasshopper definition PullAnalyticalPushJSON.gh (Grasshopper 0.9.76)
# plug-ins: BH.UI.Grasshopper

createtype = CreateType(Component="BH.oM.Environment.Elements.Building")
revitadapter = RevitAdapter(Active=Toggle(True), Component="{ ..ctor")
filterrequest = FilterRequest(Type=createtype, Component="{ .FilterRequest")
pull = Pull(Adapter=revitadapter, Request=filterrequest, Active=Toggle(False), Component="{ .Pull")
fileadapter = FileAdapter(
    Folder="C:\Users\mdengusi\Desktop\SAM_Bath\2019-09-16 RevitPush",
    FileName="Model_C_analytical.json",
    Component="{ ..ctor")
push = Push(Adapter=fileadapter, Objects=flatten(pull), Active=Toggle(False), Component="{ .Push")  # -> Objects, Success
panel = Panel(push.Success)
