# Dynamo graph PullAndPushSelectedElement.dyn (Dynamo 1.3.3.4111)

# group: if you use Generic Filter Query you need to specify Discipline
# note: Option 1
discipline = CreateEnumComponent()
generalSettings = CreateObjectComponent(discipline)
revitSettings = CreateObjectComponent(arg2=generalSettings)

boolean = BoolSelector(false)
revitAdapter = CreateAdapterComponent(revitSettings, boolean)

# group: Generic
selectionFilterQuery = CreateQueryComponent()

pull = PullComponent(revitAdapter, selectionFilterQuery, arg3=boolean)

# group: this not is used to Remove Identifiers and therefore prohibit Revit from deleting object. If we modify same object as deafult there are repalced.
removeIdentifiers = ModifyComponent(pull)

boolean_2 = BoolSelector(false)
push = PushComponent(revitAdapter, removeIdentifiers, arg4=boolean_2)
boolean_3 = BoolSelector(false)
revitAdapter_2 = CreateAdapterComponent(arg1=boolean_3)

# group: if you define types you do not need to specify discipline, here all BuildingElement will be selected
# note: Option 2
createType = CreateTypeComponent()
filterQuery = CreateQueryComponent(createType)

pull_2 = PullComponent(revitAdapter_2, filterQuery, arg3=boolean_3)
removeIdentifiers_2 = ModifyComponent(pull_2)
boolean_4 = BoolSelector(false)
push_2 = PushComponent(revitAdapter_2, removeIdentifiers_2, arg4=boolean_4)
boolean_5 = BoolSelector(false)
revitAdapter_3 = CreateAdapterComponent(arg1=boolean_5)

# group: in this example we select item in Revit + specify type so discipline is recognized from type. Also please notice use of Logical Query
# note: Option 3
selectionFilterQuery_2 = CreateQueryComponent()
createType_2 = CreateTypeComponent()
filterQuery_2 = CreateQueryComponent(createType_2)
logicalAndFilterQuery = CreateQueryComponent(selectionFilterQuery_2, filterQuery_2)

pull_3 = PullComponent(revitAdapter_3, logicalAndFilterQuery, arg3=boolean_5)
removeIdentifiers_3 = ModifyComponent(pull_3)
boolean_6 = BoolSelector(false)
push_3 = PushComponent(revitAdapter_3, removeIdentifiers_3, arg4=boolean_6)
boolean_7 = BoolSelector(false)
revitAdapter_4 = CreateAdapterComponent(arg1=boolean_7)

# group: In this example we set deafult discipline when pulling selected item from Revit
# note: Option 4
selectionFilterQuery_3 = CreateQueryComponent()
discipline_2 = CreateEnumComponent()
setDefaultDiscipline = ModifyComponent(selectionFilterQuery_3, discipline_2)

pull_4 = PullComponent(revitAdapter_4, setDefaultDiscipline, arg3=boolean_7)
removeIdentifiers_4 = ModifyComponent(pull_4)
boolean_8 = BoolSelector(false)
push_4 = PushComponent(revitAdapter_4, removeIdentifiers_4, arg4=boolean_8)
