# Dynamo graph PullBuildingElementJSONAndPushRevit.dyn (Dynamo 1.3.3.4111)

boolean = BoolSelector(true)
revitAdapter = CreateAdapterComponent(arg1=boolean)

# group: Generate JSON name, use JSON generated in PullBuildingElementsPushJSON.dyn
# note: Option 1
file_path = Filename("..\..\..\..\..\Desktop\BuildingElement.json")
directoryName = FilePath.DirectoryName(file_path)
boolean_2 = BoolSelector(false)
fileName = FilePath.FileName(file_path, boolean_2)
boolean_3 = BoolSelector(true)
fileAdapter = CreateAdapterComponent(directoryName, fileName, boolean_3)

createType = CreateTypeComponent()
filterQuery = CreateQueryComponent(createType)
pull = PullComponent(fileAdapter, filterQuery, arg3=boolean)
boolean_4 = BoolSelector(true)
push = PushComponent(revitAdapter, pull, arg4=boolean_4)
