# Dynamo graph PullBuildingElementWithDetailItems_ver01.dyn (Dynamo 1.3.4.6666)

# note: Colour Coding Stategy
# note: Script Purpose:
# Pull data from Revit Element + Detail Items
# Version Information to create script:
# Dynamo 1.3.3.4111
# Revit 2018.8.3
# Date created: 23/01/2019
# Date updated: 23/01/2019

# group: Get Things
# note: Get Inputs from Revit etc.

# group: Chop / Change Things
# note: Managing List / Filter Lists etc

# group: Input Things
# note: User Inputs Required

# group: Calculate Things
# note: Calculations

# group: Export Things
# note: Export to external files / software

# group: See Things
# note: Dispay Outputs

# group: WIP Things
# note: Things still under progress

boolean = BoolSelector(true)
revitAdapter = CreateAdapterComponent(arg1=boolean)
code_block = CodeBlock { "SAM_Material"; }
familyFilterRequest = CreateRequestComponent(code_block)
code_block_2 = CodeBlock { "SAM_BuildingElement_Material"; }
familyFilterRequest_2 = CreateRequestComponent(code_block_2)
createType = CreateTypeComponent()
filterRequest = CreateRequestComponent(createType)
create = List.Create(familyFilterRequest, familyFilterRequest_2, filterRequest)
logicalOrFilterRequest = CreateRequestComponent(create)
boolean_2 = BoolSelector(true)
pull = PullComponent(revitAdapter, logicalOrFilterRequest, arg3=boolean_2)
spaces = QueryComponent(pull)
buildingElements = QueryComponent()
buildings = QueryComponent(pull)
levels = QueryComponent()
explodeobject_old = ExplodeObjectNode(outputcount=8)  # unwired: arg0
explodeobject_old_2 = ExplodeObjectNode(explodeobject_old.out0, outputcount=6)
code_block_3 = CodeBlock(l=explodeobject_old.out7) { List.GetItemAtIndex(l<1>,4); }
firstItem = List.FirstItem(pull)
createType_2 = CreateTypeComponent()
filterByType = QueryComponent(pull, createType_2)
explodeobject_old_3 = ExplodeObjectNode(filterByType, outputcount=6)
string = StringInput("SAM_Material_Name")
getProperty = GetPropertyComponent(filterByType, string)
