# Dynamo graph PullBuildingElementsPushJSON_ver01.dyn (Dynamo 1.3.4.6666)

# group: alternative method to define JSON name
# note: Option 2
directory_path = Directory("C:\Users\mdengusi\Desktop")
string = StringInput("BuildingElement")
boolean = BoolSelector(true)
fileAdapter = CreateAdapterComponent(directory_path, string, boolean)

boolean_2 = BoolSelector(true)
revitAdapter = CreateAdapterComponent(arg1=boolean_2)
createType = CreateTypeComponent()
filterRequest = CreateRequestComponent(createType)
pull = PullComponent(revitAdapter, filterRequest, arg3=boolean_2)
boolean_3 = BoolSelector(true)
push = PushComponent(fileAdapter, pull, arg4=boolean_3)
watch = Watch(push.out1)

# group: Generate JSON name
# note: Option 1
file_path = Filename("..\..\..\..\..\Desktop\BuildingElement.json")
directoryName = FilePath.DirectoryName(file_path)
boolean_4 = BoolSelector(false)
fileName = FilePath.FileName(file_path, boolean_4)
boolean_5 = BoolSelector(true)
fileAdapter_2 = CreateAdapterComponent(directoryName, fileName, boolean_5)
