# Dynamo graph PullFramingElements.dyn (Dynamo 1.3.3.4651)

file_path = Filename("..\..\..\..\..\Desktop\FramingElements.json")
directoryName = FilePath.DirectoryName(file_path)
boolean = BoolSelector(false)
fileName = FilePath.FileName(file_path, boolean)
boolean_2 = BoolSelector(true)
fileAdapter = CreateAdapterComponent(directoryName, fileName, boolean_2)
boolean_3 = BoolSelector(true)
revitAdapter = CreateAdapterComponent(arg1=boolean_3)
createType = CreateTypeComponent()
filterQuery = CreateQueryComponent(createType)
pull = PullComponent(revitAdapter, filterQuery, arg3=boolean_3)
boolean_4 = BoolSelector(true)
push = PushComponent(fileAdapter, pull, arg4=boolean_4)
