# Grasshopper definition PullPhysicalPushJSON_ver00.gh (Grasshopper 0.9.76)
# plug-ins: BH.UI.Grasshopper

createtype = CreateType(Component="BH.oM.Physical.Elements.Wall")
createtype_2 = CreateType(Component="BH.oM.Physical.Elements.Door")
createtype_3 = CreateType(Component="BH.oM.Physical.Elements.Roof")
createtype_4 = CreateType(Component="BH.oM.Physical.Elements.Floor")
createtype_5 = CreateType(Component="BH.oM.Physical.Elements.Window")
revitadapter = RevitAdapter(Active=Toggle(True), Component="{ ..ctor")
merge = Merge(Data1=createtype, Data2=createtype_4, Data3=createtype_3, Data4=createtype_5, Data5=createtype_2)
filterrequest = FilterRequest(Type=merge, Component="{ .FilterRequest")
pull = Pull(Adapter=revitadapter, Request=filterrequest, Active=Toggle(False), Component="{ .Pull")
fileadapter = FileAdapter(Folder="C:\Users\mdengusi\Desktop\SAM_Bath\2019-09-16 RevitPush", FileName="Model_physical.json", Component="{ ..ctor")
push = Push(Adapter=fileadapter, Objects=flatten(pull), Active=Toggle(False), Component="{ .Push")  # -> Objects, Success
panel = Panel(push.Success)
