# Dynamo graph PushFramingElements.dyn (Dynamo 1.3.3.4651)

boolean = BoolSelector(true)
revitAdapter = CreateAdapterComponent(arg1=boolean)
file_path = Filename("..\..\..\..\..\Desktop\FramingElements.json")
directoryName = FilePath.DirectoryName(file_path)
boolean_2 = BoolSelector(false)
fileName = FilePath.FileName(file_path, boolean_2)
boolean_3 = BoolSelector(true)
fileAdapter = CreateAdapterComponent(directoryName, fileName, boolean_3)
createType = CreateTypeComponent()
filterQuery = CreateQueryComponent(createType)
boolean_4 = BoolSelector(true)
pull = PullComponent(fileAdapter, filterQuery, arg3=boolean_4)
boolean_5 = BoolSelector(true)
push = PushComponent(revitAdapter, pull, arg4=boolean_5)
