# Dynamo graph RenameSheetFiles.dyn (Dynamo 1.3.3.4651)

directory_path = Directory("C:\Users\jziolkow\Desktop\Print")
fromPath = DirectoryObject(directory_path)  # "Directory.FromPath"
string = StringInput("*.pdf")
contents = Directory.Contents(fromPath, string)
boolean = BoolSelector(true)
revitAdapter = CreateAdapterComponent(arg1=boolean)
string_2 = StringInput("Sheets")
categoryFilterQuery = CreateQueryComponent(string_2)
pull = PullComponent(revitAdapter, categoryFilterQuery, arg3=boolean)
string_3 = StringInput("Sheet Number")
getProperty = GetPropertyComponent(pull, string_3)
boolean_2 = BoolSelector(false)
fileName = FilePath.FileName(contents, boolean_2)
string_4 = StringInput(" - ")
split = String.Split(fileName, string_4)
code_block = CodeBlock { 2; }
getItemAtIndex = List.GetItemAtIndex(list=split@L2, index=code_block)
firstIndexOf = List.FirstIndexOf(list=getProperty, item=getItemAtIndex)
code_block_2 = CodeBlock(x=firstIndexOf) { x != -1; }
filterByBoolMask = List.FilterByBoolMask(list=contents, mask=code_block_2)
fromPath_2 = FileObject(filterByBoolMask.in)  # "File.FromPath"
directoryName = FilePath.DirectoryName(filterByBoolMask.in)
string_5 = StringInput("\")
boolean_3 = BoolSelector(false)
fileName_2 = FilePath.FileName(filterByBoolMask.in, boolean_3)
filterByBoolMask_2 = List.FilterByBoolMask(list=firstIndexOf, mask=code_block_2)
getItemAtIndex_2 = List.GetItemAtIndex(list=pull, index=filterByBoolMask_2.in)
string_6 = StringInput("Sheet Issue Date")
getProperty_2 = GetPropertyComponent(getItemAtIndex_2, string_6)
string_7 = StringInput("/")
string_8 = StringInput("_")
replace = String.Replace(str=getProperty_2, searchFor=string_7, replaceWith=string_8)
extension = FilePath.Extension(filterByBoolMask.in)
code_block_3 = CodeBlock(a=directoryName, b=string_5, c=fileName_2, d=replace, e=extension) { a + b + c + " - " + d + e; }
boolean_4 = BoolSelector(true)
copy = File.Copy(fromPath_2, code_block_3, boolean_4)
