# Dynamo graph FilterQuery - ActiveWorksetFilterQuery.dyn (Dynamo 1.3.3.4651)

string = StringInput("L:\BH-Revit\Revit2018\Libraries\UK\_BH Library\BH MEP\Mechanical\AHU Plant")
boolean = BoolSelector(true)
familyLibrary = CreateObjectComponent(string, boolean)
string_2 = StringInput("Mechanical Equipment")
paths = QueryComponent(familyLibrary, string_2)
revitFilePreview = CreateObjectComponent(paths)
categoryName = QueryComponent(revitFilePreview)
watch = Watch(categoryName)
omniClass = QueryComponent(revitFilePreview)
watch_2 = Watch(omniClass)
familyTypeNames = QueryComponent(revitFilePreview)
watch_3 = Watch(familyTypeNames)
