# Dynamo graph FilterQuery - CategoryFilterQuery.dyn (Dynamo 1.3.3.4651)

discipline = CreateEnumComponent()
generalSettings = CreateObjectComponent(discipline)
revitSettings = CreateObjectComponent(arg2=generalSettings)
boolean = BoolSelector(true)
revitAdapter = CreateAdapterComponent(revitSettings, boolean)
string = StringInput("Windows")
categoryFilterQuery = CreateQueryComponent(string)
selectionFilterQuery = CreateQueryComponent()
logicalAndFilterQuery = CreateQueryComponent(categoryFilterQuery, selectionFilterQuery)
pull = PullComponent(revitAdapter, logicalAndFilterQuery, arg3=boolean)
