# Dynamo graph FilterQuery - Default Discipine.dyn (Dynamo 1.3.3.4651)

boolean = BoolSelector(true)
revitAdapter = CreateAdapterComponent(arg1=boolean)
string = StringInput("Walls")
categoryFilterQuery = CreateQueryComponent(string)
discipline = CreateEnumComponent()
setDefaultDiscipline = ModifyComponent(categoryFilterQuery, discipline)
string_2 = StringInput("Floors")
categoryFilterQuery_2 = CreateQueryComponent(string_2)
discipline_2 = CreateEnumComponent()
setDefaultDiscipline_2 = ModifyComponent(categoryFilterQuery_2, discipline_2)
logicalOrFilterQuery = CreateQueryComponent(setDefaultDiscipline, setDefaultDiscipline_2)
pull = PullComponent(revitAdapter, logicalOrFilterQuery, arg3=boolean)
