# Dynamo graph FilterQuery - FamilyFilterQuery.dyn (Dynamo 1.3.3.4651)

discipline = CreateEnumComponent()
generalSettings = CreateObjectComponent(discipline)
revitSettings = CreateObjectComponent(arg2=generalSettings)
boolean = BoolSelector(true)
revitAdapter = CreateAdapterComponent(revitSettings, boolean)
string = StringInput("BHE_Ducts_Galvanised_Reducing Bend / Shoe")
familyFilterQuery = CreateQueryComponent(arg1=string)
pull = PullComponent(revitAdapter, familyFilterQuery, arg3=boolean)
string_2 = StringInput("System Name")
propertyValue = GetPropertyComponent(pull, string_2)
watch = Watch(propertyValue)
