# Dynamo graph FilterQuery - LogicalAndFilterQuery.dyn (Dynamo 1.3.3.4651)

boolean = BoolSelector(true)
revitAdapter = CreateAdapterComponent(arg1=boolean)
string = StringInput("Rectangular Duct")
string_2 = StringInput("BHE_Ducts_Galvanised_Reducing Bend / Shoe")
familyFilterQuery = CreateQueryComponent(string, string_2)
string_3 = StringInput("Duct Fittings")
categoryFilterQuery = CreateQueryComponent(string_3)
string_4 = StringInput("Galvanised")
familyFilterQuery_2 = CreateQueryComponent(arg1=string_4)
logicalAndFilterQuery = CreateQueryComponent(categoryFilterQuery, familyFilterQuery_2)
logicalOrFilterQuery = CreateQueryComponent(familyFilterQuery, logicalAndFilterQuery)
pull = PullComponent(revitAdapter, logicalOrFilterQuery, arg3=boolean)
string_5 = StringInput("System Name")
propertyValue = GetPropertyComponent(pull, string_5)
watch = Watch(propertyValue)
