# Dynamo graph FilterQuery - LogicalOrFilterQuery.dyn (Dynamo 1.3.3.4651)

discipline = CreateEnumComponent()
generalSettings = CreateObjectComponent(discipline)
revitSettings = CreateObjectComponent(arg2=generalSettings)
boolean = BoolSelector(true)
revitAdapter = CreateAdapterComponent(revitSettings, boolean)
string = StringInput("Rectangular Duct")
familyFilterQuery = CreateQueryComponent(string)
string_2 = StringInput("Round Duct")
string_3 = StringInput("BHE_Ducts_PVC_Round / Tap")
familyFilterQuery_2 = CreateQueryComponent(string_2, string_3)
string_4 = StringInput("Round Duct")
string_5 = StringInput("BHE_Ducts_Galvanised_Pressed Bend / Spigot")
familyFilterQuery_3 = CreateQueryComponent(string_4, string_5)
create = List.Create(familyFilterQuery, familyFilterQuery_2, familyFilterQuery_3)
logicalOrFilterQuery = CreateQueryComponent(create)
pull = PullComponent(revitAdapter, logicalOrFilterQuery, arg3=boolean)
string_6 = StringInput("System Name")
propertyValue = GetPropertyComponent(pull, string_6)
watch = Watch(propertyValue)
