# Dynamo graph FilterQuery - Pull Edges.dyn (Dynamo 1.3.3.4651)

boolean = BoolSelector(true)
revitAdapter = CreateAdapterComponent(arg1=boolean)
string = StringInput("MEPCurve")
typeNameFilterQuery = CreateQueryComponent(string)
boolean_2 = BoolSelector(true)
setPullEdges = ModifyComponent(typeNameFilterQuery, boolean_2)
pull = PullComponent(revitAdapter, setPullEdges, arg3=boolean)
edges = QueryComponent(pull)
