# Dynamo graph FilterQuery - TypeNameFilterQuery.dyn (Dynamo 1.3.3.4651)

boolean = BoolSelector(true)
revitAdapter = CreateAdapterComponent(arg1=boolean)
selectionFilterQuery = CreateQueryComponent()
string = StringInput("TextNote")
typeNameFilterQuery = CreateQueryComponent(string)
logicalAndFilterQuery = CreateQueryComponent(selectionFilterQuery, typeNameFilterQuery)
pull = PullComponent(revitAdapter, logicalAndFilterQuery, arg3=boolean)
string_2 = StringInput("Keep Readable")
propertyValue = GetPropertyComponent(pull, string_2)
