# Dynamo graph FilterQuery - WorksetFilterQuery.dyn (Dynamo 1.3.3.4651)

boolean = BoolSelector(true)
revitAdapter = CreateAdapterComponent(arg1=boolean)
string = StringInput("MEP")
worksetFilterQuery = CreateQueryComponent(string)
string_2 = StringInput("MEPCurve")
typeNameFilterQuery = CreateQueryComponent(string_2)
logicalAndFilterQuery = CreateQueryComponent(worksetFilterQuery, typeNameFilterQuery)
pull = PullComponent(revitAdapter, logicalAndFilterQuery, arg3=boolean)
