# Grasshopper definition Pull Revit - Physical query Environment_ver00.gh (Grasshopper 0.9.76)
# plug-ins: BH.UI.Grasshopper

createtype = CreateType(Component="BH.oM.Physical.Elements.Window")
createtype_2 = CreateType(Component="BH.oM.Physical.Elements.Door")
createtype_3 = CreateType(Component="BH.oM.Physical.Elements.Roof")
createtype_4 = CreateType(Component="BH.oM.Physical.Elements.Wall")
createtype_5 = CreateType(Component="BH.oM.Physical.Elements.Floor")
filterrequest = FilterRequest(Type=createtype, Component="{ .FilterRequest")
filterrequest_2 = FilterRequest(Type=createtype_2, Component="{ .FilterRequest")
filterrequest_3 = FilterRequest(Type=createtype_3, Component="{ .FilterRequest")
filterrequest_4 = FilterRequest(Type=createtype_5, Component="{ .FilterRequest")
filterrequest_5 = FilterRequest(Type=createtype_4, Component="{ .FilterRequest")
merge = Merge(Data1=filterrequest_5, Data2=filterrequest_3, Data3=filterrequest_4, Data4=filterrequest_2, Data5=filterrequest)

filterrequest_6 = FilterRequest(Type="BH.oM.Environment.Elements.Building", Component="{ .FilterRequest")

logicalorfilterrequest = LogicalOrFilterRequest(FilterRequests=merge, Component="{ .LogicalOrFilterRequest")
selectionfilterrequest = SelectionFilterRequest(Component="{ .SelectionFilterRequest")
toggle = BooleanToggle(False)
revitadapter = RevitAdapter(Active=toggle, Component="{ ..ctor")
pull = Pull(Adapter=revitadapter, Request=logicalorfilterrequest, Active=toggle, Component="{ .Pull")
panel = Panel(pull)
roofs = Roofs(BhomObjects=pull, Component="{ .Roofs")
list_item = ListItem(List=roofs, Index=Slider(2, range=0..46), Wrap=True)
doors = Doors(BhomObjects=pull, Component="{ .Doors")
windows = Windows(BhomObjects=pull, Component="{ .Windows")
walls = Walls(BhomObjects=pull, Component="{ .Walls")
floors = Floors(BhomObjects=pull, Component="{ .Floors")
explode = Explode(Object=list_item, Component="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")  # -> Location, Construction, Openings, Offset, BHoM_Guid, Name, Fragments, Tags, CustomData
merge_2 = Merge(Data1=roofs, Data2=walls, Data3=floors)  # -> flatten(Result)
merge_3 = Merge(Data1=windows, Data2=doors)
panelsfromphysical = PanelsFromPhysical(PhysicalObjects=merge_2, Component="{ .PanelsFromPhysical")  # -> simplify(Panels)
explode_2 = Explode(Component="{ \"Outputs\" : [], \"BHoM_Guid\" : \"6c8b33b6-fd2c-4188-b6df-abb994120070\" }")
explode_3 = Explode(Object=explode.Location, Component="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")  # -> ExternalBoundary, InternalBoundaries
openingsfromphysical = OpeningsFromPhysical(PhysicalOpenings=merge_3, Component="{ .OpeningsFromPhysical")
polyline = Polyline(PhysicalObject=list_item, Component="{ .Polyline")
panel_2 = Panel(explode.Location)
addopenings = AddOpenings(Panels=panelsfromphysical, Openings=openingsfromphysical, Component="{ .AddOpenings")
explode_4 = Explode(Object=addopenings, Component="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")  # -> ExternalEdges, Openings, Construction, Type, ConnectedSpaces, BHoM_Guid, Name, Fragments, Tags, CustomData
polyline_2 = Polyline(Panel=addopenings, Component="{ .Polyline")
polyline_3 = Polyline(Opening=explode_4.Openings, Component="{ .Polyline")
