# Grasshopper definition Pull Revit - Push JSON.gh (Grasshopper 0.9.76)
# plug-ins: BH.UI.Grasshopper

toggle = BooleanToggle(False)

filterrequest = FilterRequest(Type="BH.oM.Environment.Elements.Building", Component="{ .FilterRequest")

revitadapter = RevitAdapter(Active=toggle, Component="{ ..ctor")
pull = Pull(Adapter=revitadapter, Query=filterrequest, Active=toggle, Component="{ .Pull")

buildings = Buildings(BhomObjects=pull, Component="{ .Buildings")
spaces = Spaces(BhomObjects=pull, Component="{ .Spaces")
levels = Levels(Objects=pull, Component="{ .Levels")
panels = Panels(Objects=pull, Component="{ .Panels")

tospaces = ToSpaces(Panels=panels, Component="{ .ToSpaces")
data = Data(tospaces)
data_2 = Data(pull)
daylightspaceperimeter = DaylightSpacePerimeter(PanelsAsSpaces=tospaces, Component="{ .DaylightSpacePerimeter")  # disabled
polyline = Polyline(Panel=tospaces, Component="{ .Polyline")
fileadapter = FileAdapter(Folder="C:\Users\mdengusi\Desktop\SAM_Bath\2019-07-04 BHoMtest", FileName="export1.json", Component="{ ..ctor")  # -> flatten(F)
panel = Panel(daylightspaceperimeter)
push = Push(Adapter=fileadapter, Objects=flatten(data_2), Active=Toggle(False), Component="{ .Push")  # -> Objects, Success
panel_2 = Panel(push.Success)
