# Dynamo graph Pushing TitleBlock.dyn (Dynamo 1.3.3.4651)

boolean = BoolSelector(true)
revitAdapter = CreateAdapterComponent(arg1=boolean)
code_block = CodeBlock { "BHE_TitleBlocks_DrawingSheetA1"; }
point = CreateObjectComponent()
string = StringInput("E02 - Electrical Detail")
draftingObject = CreateObjectComponent(code_block, code_block, point, string)
push = PushComponent(revitAdapter, draftingObject, arg4=boolean)
