# Dynamo graph Updating Parameters.dyn (Dynamo 1.3.3.4651)

boolean = BoolSelector(false)
generalSettings = CreateObjectComponent(arg1=boolean)  # unwired: arg0
revitSettings = CreateObjectComponent(arg2=generalSettings)
boolean_2 = BoolSelector(true)
revitAdapter = CreateAdapterComponent(revitSettings, boolean_2)
code_block = CodeBlock { 1250770; }
BHoMObject = CreateObjectComponent(code_block)
string = StringInput("Unconnected Height")
code_block_2 = CodeBlock { 3; }
propertyValue = SetPropertyComponent(BHoMObject, string, code_block_2)
push = PushComponent(revitAdapter, propertyValue, arg4=boolean_2)
