# Dynamo graph Updating TitleBlock Parameters.dyn (Dynamo 1.3.3.4651)

boolean = BoolSelector(false)
generalSettings = CreateObjectComponent(arg1=boolean)  # unwired: arg0
revitSettings = CreateObjectComponent(arg2=generalSettings)
boolean_2 = BoolSelector(true)
revitAdapter = CreateAdapterComponent(revitSettings, boolean_2)
string = StringInput("BHE_TitleBlocks_DrawingSheetA1")
familyFilterQuery = CreateQueryComponent(string, string)
pull = PullComponent(revitAdapter, familyFilterQuery, arg3=boolean_2)
string_2 = StringInput("ViewName")
propertyValue = GetPropertyComponent(pull, string_2)
string_3 = StringInput("Electrical Detail")
eq = propertyValue == string_3
filterByBoolMask = List.FilterByBoolMask(list=pull, mask=eq)
string_4 = StringInput("Drawn By")
string_5 = StringInput("J.Z.")
propertyValue_2 = SetPropertyComponent(filterByBoolMask.in, string_4, string_5)
push = PushComponent(revitAdapter, propertyValue_2, arg4=boolean_2)
