# Dynamo graph DraftingObject - Create Instance.dyn (Dynamo 1.3.3.4651)

boolean = BoolSelector(true)
revitAdapter = AdapterNode(arg1=boolean)  # unwired: arg0
string = StringInput("BHE_Detail_AhuComponent_AccessSection")
string_2 = StringInput("Access Section")
code_block = CodeBlock { 0; }
point = BHoMObjectNode(code_block, code_block, code_block)
string_3 = StringInput("Schematic")
draftingObject = CreateObjectComponent(string, string_2, point, string_3)
push = PushComponent(revitAdapter, draftingObject, arg4=boolean)
