# Dynamo graph FamilyLibrary - Load and Create Family Instance in Project.dyn (Dynamo 1.3.3.4651)

string = StringInput("L:\BH-Revit\Revit2018\Libraries\UK\_BH Library\BH MEP\Mechanical\AHU Plant")
familyLibrary = BHoMObjectNode(string)  # unwired: arg1
familyLoadSettings = BHoMObjectNode(familyLibrary)  # unwired: arg1, arg2
revitSettings = BHoMObjectNode(arg1=familyLoadSettings)  # unwired: arg0, arg2
boolean = BoolSelector(true)
revitAdapter = AdapterNode(revitSettings, boolean)
code_block = CodeBlock { 0; 5; }
point = BHoMObjectNode(code_block.out0, code_block.out1, code_block.out0)
string_2 = StringInput("BHE_MechanicalEquipment_AHUPlant_AHUSupplyOnly")
string_3 = StringInput("AHU Supply Only 2")
genericObject = BHoMObjectNode(point, string_2, string_3)
push_old = PushNode(revitAdapter, genericObject, arg4=boolean)  # unwired: arg2, arg3
