# Dynamo graph Sheet - Get Sheet Names.dyn (Dynamo 1.3.3.4651)

boolean = BoolSelector(true)
revitAdapter = AdapterNode(arg1=boolean)  # unwired: arg0
string = StringInput("Sheets")
categoryFilterQuery = CreateQueryComponent(string)
pull = PullComponent(revitAdapter, categoryFilterQuery, arg3=boolean)
explode = ExplodeComponent(pull)
watch = Watch(explode.out1)
