# Dynamo graph ViewPlan - Pull Parameter.dyn (Dynamo 1.3.3.4651)

boolean = BoolSelector(true)
revitAdapter = AdapterNode(arg1=boolean)  # unwired: arg0
createType = CreateTypeComponent()
filterQuery = CreateQueryComponent(createType)
pull = PullComponent(revitAdapter, filterQuery, arg3=boolean)
string = StringInput("BHE_View Group")
propertyValue = GetPropertyComponent(pull, string)
watch = Watch(propertyValue)
watch_2 = Watch(createType)
