# Grasshopper definition BHoM_v3.2.beta_Create_Read_Loads.gh (Grasshopper 1.0.7)
# plug-ins: BH.UI.Grasshopper

# Bar Loads
panels_as_meshes = BooleanToggle(False)

# ----
# Adapter
# Creates all various load types and pushes them to the package, where they can be inspected.
# 
# Then attempts to pull the loads back, to check that what was pushed in is the same as what is pulled back, and the same as what is in the software
filepath = Panel("")
# Create and read loads
# BHoM Version: 3.2β
list = ValueList({"Robot": 0, "ETABS17": 1, "ETABS2016": 2, "SAP2000": 3, "GSA": 4, "Lusas18": 5, "Lusas17": 6, "MidasCivil": 7, "RAM": 8}, selected="RAM")
cluster = Cluster(selectedadapter=list, S=Toggle(False), filepath=filepath)  # -> s_8, adapteridname
adapteridname = Text(cluster.adapteridname)
adapter = BHoMAdapter(
    cluster.s_8,
    ObjectType="{ \"_t\" : \"System.Type\", \"Name\" : \"System.Object, mscorlib, Version=4.0.0.0, Culture=neutral, PublicKeyToken=b77a5c561934e089\" }",
    m_ForcePreview=False,
    m_MaxItemsPreview=10000)

panels_as_meshes_2 = Boolean(panels_as_meshes)

# ---- group: Pull Loads
bool = Boolean(Toggle(False))

# ---- group: Push Elements
bool_2 = Boolean(Toggle(False))

# ----
# Non-Directional Loads
# Point Loads
create_panel = CreatePanel(panels_as_meshes=panels_as_meshes_2)
bhom = BHoMObject(
    create_panel,
    ObjectType="{ \"_t\" : \"System.Type\", \"Name\" : \"System.Object, mscorlib, Version=4.0.0.0, Culture=neutral, PublicKeyToken=b77a5c561934e089\" }",
    m_ForcePreview=False,
    m_MaxItemsPreview=10000)
adapter_2 = BHoMAdapter(
    adapter,
    ObjectType="{ \"_t\" : \"System.Type\", \"Name\" : \"System.Object, mscorlib, Version=4.0.0.0, Culture=neutral, PublicKeyToken=b77a5c561934e089\" }",
    m_ForcePreview=False,
    m_MaxItemsPreview=10000)
bool_3 = Boolean(bool_2)
push = Push(
    Adapter=adapter_2,
    Objects=flatten(bhom),
    PushType="{ \"_t\" : \"System.Enum\", \"TypeName\" : { \"_t\" : \"System.Type\", \"Name\" : \"BH.oM.Adapter.PushType\" }, \"Value\" : \"AdapterDefault\" }",
    Active=bool_3,
    Component="{ .Push")  # -> Objects, Success

# ----
# Panel Loads
# Global vs Local
# Creates two equivilant Loads on each pair of objects.
# 
# One defined in Global coordinates and one in Local
create_panels = CreatePanels(panels_as_meshes=panels_as_meshes_2)
bhom_2 = BHoMObject(
    create_panels,
    ObjectType="{ \"_t\" : \"System.Type\", \"Name\" : \"System.Object, mscorlib, Version=4.0.0.0, Culture=neutral, PublicKeyToken=b77a5c561934e089\" }",
    m_ForcePreview=False,
    m_MaxItemsPreview=10000)
adapter_3 = BHoMAdapter(
    adapter,
    ObjectType="{ \"_t\" : \"System.Type\", \"Name\" : \"System.Object, mscorlib, Version=4.0.0.0, Culture=neutral, PublicKeyToken=b77a5c561934e089\" }",
    m_ForcePreview=False,
    m_MaxItemsPreview=10000)
bool_4 = Boolean(bool_2)
push_2 = Push(
    Adapter=adapter_3,
    Objects=flatten(bhom_2),
    PushType="{ \"_t\" : \"System.Enum\", \"TypeName\" : { \"_t\" : \"System.Type\", \"Name\" : \"BH.oM.Adapter.PushType\" }, \"Value\" : \"AdapterDefault\" }",
    Active=bool_4,
    Component="{ .Push")  # -> Objects, Success

# ----
# Global vs Projected
# Creates two equivilant Loads on each pair of objects.
# 
# One defined in Global coordinates and one as a Projected Load
create_panels_2 = CreatePanels_2(panels_as_meshes=panels_as_meshes_2)
bhom_3 = BHoMObject(
    create_panels_2,
    ObjectType="{ \"_t\" : \"System.Type\", \"Name\" : \"System.Object, mscorlib, Version=4.0.0.0, Culture=neutral, PublicKeyToken=b77a5c561934e089\" }",
    m_ForcePreview=False,
    m_MaxItemsPreview=10000)
adapter_4 = BHoMAdapter(
    adapter,
    ObjectType="{ \"_t\" : \"System.Type\", \"Name\" : \"System.Object, mscorlib, Version=4.0.0.0, Culture=neutral, PublicKeyToken=b77a5c561934e089\" }",
    m_ForcePreview=False,
    m_MaxItemsPreview=10000)
bool_5 = Boolean(bool_2)
push_3 = Push(
    Adapter=adapter_4,
    Objects=flatten(bhom_3),
    PushType="{ \"_t\" : \"System.Enum\", \"TypeName\" : { \"_t\" : \"System.Type\", \"Name\" : \"BH.oM.Adapter.PushType\" }, \"Value\" : \"AdapterDefault\" }",
    Active=bool_5,
    Component="{ .Push")  # -> Objects, Success

# ----
# Just Nodes
create_nodes = CreateNodes()
bhom_4 = BHoMObject(
    create_nodes,
    ObjectType="{ \"_t\" : \"System.Type\", \"Name\" : \"System.Object, mscorlib, Version=4.0.0.0, Culture=neutral, PublicKeyToken=b77a5c561934e089\" }",
    m_ForcePreview=False,
    m_MaxItemsPreview=10000)
adapter_5 = BHoMAdapter(
    adapter,
    ObjectType="{ \"_t\" : \"System.Type\", \"Name\" : \"System.Object, mscorlib, Version=4.0.0.0, Culture=neutral, PublicKeyToken=b77a5c561934e089\" }",
    m_ForcePreview=False,
    m_MaxItemsPreview=10000)
bool_6 = Boolean(bool_2)
push_4 = Push(
    Adapter=adapter_5,
    Objects=flatten(bhom_4),
    PushType="{ \"_t\" : \"System.Enum\", \"TypeName\" : { \"_t\" : \"System.Type\", \"Name\" : \"BH.oM.Adapter.PushType\" }, \"Value\" : \"AdapterDefault\" }",
    Active=bool_6,
    Component="{ .Push")  # -> Objects, Success

# ----
# Non-Directional Loads
create_bars = CreateBars_3()
adapter_6 = BHoMAdapter(
    adapter,
    ObjectType="{ \"_t\" : \"System.Type\", \"Name\" : \"System.Object, mscorlib, Version=4.0.0.0, Culture=neutral, PublicKeyToken=b77a5c561934e089\" }",
    m_ForcePreview=False,
    m_MaxItemsPreview=10000)
bool_7 = Boolean(bool_2)
push_5 = Push(
    Adapter=adapter_6,
    Objects=flatten(create_bars),
    PushType="{ \"_t\" : \"System.Enum\", \"TypeName\" : { \"_t\" : \"System.Type\", \"Name\" : \"BH.oM.Adapter.PushType\" }, \"Value\" : \"AdapterDefault\" }",
    Active=bool_7,
    Component="{ .Push")  # -> Objects, Success

# ----
# Global vs Local
# Creates two equivilant Loads on each pair of objects.
# 
# One defined in Global coordinates and one in Local
create_bars_2 = CreateBars()
bhom_5 = BHoMObject(
    create_bars_2,
    ObjectType="{ \"_t\" : \"System.Type\", \"Name\" : \"System.Object, mscorlib, Version=4.0.0.0, Culture=neutral, PublicKeyToken=b77a5c561934e089\" }",
    m_ForcePreview=False,
    m_MaxItemsPreview=10000)
adapter_7 = BHoMAdapter(
    adapter,
    ObjectType="{ \"_t\" : \"System.Type\", \"Name\" : \"System.Object, mscorlib, Version=4.0.0.0, Culture=neutral, PublicKeyToken=b77a5c561934e089\" }",
    m_ForcePreview=False,
    m_MaxItemsPreview=10000)
bool_8 = Boolean(bool_2)
push_6 = Push(
    Adapter=adapter_7,
    Objects=flatten(bhom_5),
    PushType="{ \"_t\" : \"System.Enum\", \"TypeName\" : { \"_t\" : \"System.Type\", \"Name\" : \"BH.oM.Adapter.PushType\" }, \"Value\" : \"AdapterDefault\" }",
    Active=bool_8,
    Component="{ .Push")  # -> Objects, Success

# ----
# Global vs Projected
# Creates two equivilant Loads on each pair of objects.
# 
# One defined in Global coordinates and one as a Projected Load
create_bars_3 = CreateBars_2()
bhom_6 = BHoMObject(
    create_bars_3,
    ObjectType="{ \"_t\" : \"System.Type\", \"Name\" : \"System.Object, mscorlib, Version=4.0.0.0, Culture=neutral, PublicKeyToken=b77a5c561934e089\" }",
    m_ForcePreview=False,
    m_MaxItemsPreview=10000)
adapter_8 = BHoMAdapter(
    adapter,
    ObjectType="{ \"_t\" : \"System.Type\", \"Name\" : \"System.Object, mscorlib, Version=4.0.0.0, Culture=neutral, PublicKeyToken=b77a5c561934e089\" }",
    m_ForcePreview=False,
    m_MaxItemsPreview=10000)
bool_9 = Boolean(bool_2)
push_7 = Push(
    Adapter=adapter_8,
    Objects=flatten(bhom_6),
    PushType="{ \"_t\" : \"System.Enum\", \"TypeName\" : { \"_t\" : \"System.Type\", \"Name\" : \"BH.oM.Adapter.PushType\" }, \"Value\" : \"AdapterDefault\" }",
    Active=bool_9,
    Component="{ .Push")  # -> Objects, Success

# ---- group: Push Loads
bool_10 = Boolean(Toggle(False))

# ----
# Geometrical Loads
panel = Panel("ContourLoad")
Y = UnitY(Factor=1)
X = UnitX(Factor=1)
loadcase = Loadcase(
    Name=panel,
    Nature="{ \"_t\" : \"System.Enum\", \"TypeName\" : { \"_t\" : \"System.Type\", \"Name\" : \"BH.oM.Structure.Loads.LoadNature\" }, \"Value\" : \"Other\" }",
    Number="91",
    Component="BH.oM.Structure.Loads.Loadcase")
addition = Addition(A=Y, B=X)
crv = Curve(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)
contourload = ContourLoad(
    Loadcase=loadcase,
    Axis="{ \"_t\" : \"System.Enum\", \"TypeName\" : { \"_t\" : \"System.Type\", \"Name\" : \"BH.oM.Structure.Loads.LoadAxis\" }, \"Value\" : \"Global\" }",
    Projected=False,
    Force=addition,
    Contour=crv,
    Name=panel,
    Component="BH.oM.Structure.Loads.ContourLoad")
ivisualize = IVisualize(Load=contourload, ScaleFactor=1, DisplayForces=True, DisplayMoments=True, AsResultants=True, Component="{ .IVisualize")
adapter_9 = BHoMAdapter(
    adapter,
    ObjectType="{ \"_t\" : \"System.Type\", \"Name\" : \"System.Object, mscorlib, Version=4.0.0.0, Culture=neutral, PublicKeyToken=b77a5c561934e089\" }",
    m_ForcePreview=False,
    m_MaxItemsPreview=10000)
bool_11 = Boolean(bool_10)
push_8 = Push(
    Adapter=adapter_9,
    Objects=flatten(contourload),
    PushType="{ \"_t\" : \"System.Enum\", \"TypeName\" : { \"_t\" : \"System.Type\", \"Name\" : \"BH.oM.Adapter.PushType\" }, \"Value\" : \"AdapterDefault\" }",
    Active=bool_11,
    Component="{ .Push")  # -> Objects, Success

loadcase_2 = Loadcase(
    Name="GeometricalLineLoad",
    Nature="{ \"_t\" : \"System.Enum\", \"TypeName\" : { \"_t\" : \"System.Type\", \"Name\" : \"BH.oM.Structure.Loads.LoadNature\" }, \"Value\" : \"Other\" }",
    Number="92",
    Component="BH.oM.Structure.Loads.Loadcase")
line = Line(Line((-12.00969031, 1.191110401, 0), (-9.479151833, -9.444103203, 0)))
geometricallineload = GeometricalLineLoad(Location=line, Loadcase=loadcase_2, Force=addition, Name="GeometricalLineLoad", Component="{ .GeometricalLineLoad")
ivisualize_2 = IVisualize(
    Load=geometricallineload,
    ScaleFactor=1,
    DisplayForces=True,
    DisplayMoments=True,
    AsResultants=True,
    Component="{ .IVisualize")
adapter_10 = BHoMAdapter(
    adapter,
    ObjectType="{ \"_t\" : \"System.Type\", \"Name\" : \"System.Object, mscorlib, Version=4.0.0.0, Culture=neutral, PublicKeyToken=b77a5c561934e089\" }",
    m_ForcePreview=False,
    m_MaxItemsPreview=10000)
bool_12 = Boolean(bool_10)
push_9 = Push(
    Adapter=adapter_10,
    Objects=flatten(geometricallineload),
    PushType="{ \"_t\" : \"System.Enum\", \"TypeName\" : { \"_t\" : \"System.Type\", \"Name\" : \"BH.oM.Adapter.PushType\" }, \"Value\" : \"AdapterDefault\" }",
    Active=bool_12,
    Component="{ .Push")  # -> Objects, Success

# ----
# BarUniformLoad
apply_loads = ApplyLoads(L=push_6.Objects)  # -> loadcase_name_2, loadcase_number_2, R
visualize = Visualize(
    BarUDL=apply_loads.R,
    ScaleFactor=1,
    DisplayForces=True,
    DisplayMoments=True,
    AsResultants=True,
    Component="{ .Visualize")
adapter_11 = BHoMAdapter(
    adapter,
    ObjectType="{ \"_t\" : \"System.Type\", \"Name\" : \"System.Object, mscorlib, Version=4.0.0.0, Culture=neutral, PublicKeyToken=b77a5c561934e089\" }",
    m_ForcePreview=False,
    m_MaxItemsPreview=10000)
bool_13 = Boolean(bool_10)
push_10 = Push(
    Adapter=adapter_11,
    Objects=flatten(apply_loads.R),
    PushType="{ \"_t\" : \"System.Enum\", \"TypeName\" : { \"_t\" : \"System.Type\", \"Name\" : \"BH.oM.Adapter.PushType\" }, \"Value\" : \"AdapterDefault\" }",
    Active=bool_13,
    Component="{ .Push")  # -> Objects, Success

# ----
# BarVaryingLoad
apply_loads_2 = ApplyLoads_2(L=push_6.Objects)  # -> loadcase_name_2, loadcase_number_2, R
visualize_2 = Visualize(
    BarVaryingDistLoad=apply_loads_2.R,
    ScaleFactor=1,
    DisplayForces=True,
    DisplayMoments=True,
    AsResultants=True,
    Component="{ .Visualize")
adapter_12 = BHoMAdapter(
    adapter,
    ObjectType="{ \"_t\" : \"System.Type\", \"Name\" : \"System.Object, mscorlib, Version=4.0.0.0, Culture=neutral, PublicKeyToken=b77a5c561934e089\" }",
    m_ForcePreview=False,
    m_MaxItemsPreview=10000)
bool_14 = Boolean(bool_10)
push_11 = Push(
    Adapter=adapter_12,
    Objects=flatten(apply_loads_2.R),
    PushType="{ \"_t\" : \"System.Enum\", \"TypeName\" : { \"_t\" : \"System.Type\", \"Name\" : \"BH.oM.Adapter.PushType\" }, \"Value\" : \"AdapterDefault\" }",
    Active=bool_14,
    Component="{ .Push")  # -> Objects, Success

# ----
# BarPointLoad
applay_loads = ApplayLoads_2(L=push_6.Objects)  # -> loadcase_name_2, loadcase_number_2, R
ivisualize_3 = IVisualize(
    Load=applay_loads.R,
    ScaleFactor=1,
    DisplayForces=True,
    DisplayMoments=True,
    AsResultants=True,
    Component="{ .IVisualize")
adapter_13 = BHoMAdapter(
    adapter,
    ObjectType="{ \"_t\" : \"System.Type\", \"Name\" : \"System.Object, mscorlib, Version=4.0.0.0, Culture=neutral, PublicKeyToken=b77a5c561934e089\" }",
    m_ForcePreview=False,
    m_MaxItemsPreview=10000)
bool_15 = Boolean(bool_10)
push_12 = Push(
    Adapter=adapter_13,
    Objects=flatten(applay_loads.R),
    PushType="{ \"_t\" : \"System.Enum\", \"TypeName\" : { \"_t\" : \"System.Type\", \"Name\" : \"BH.oM.Adapter.PushType\" }, \"Value\" : \"AdapterDefault\" }",
    Active=bool_15,
    Component="{ .Push")  # -> Objects, Success

# ----
# BarUniformLoad
applay_loads_2 = ApplayLoads(L=push_7.Objects)  # -> loadcase_name_2, loadcase_number_2, R
visualize_3 = Visualize(
    BarUDL=applay_loads_2.R,
    ScaleFactor=1,
    DisplayForces=True,
    DisplayMoments=True,
    AsResultants=True,
    Component="{ .Visualize")
adapter_14 = BHoMAdapter(
    adapter,
    ObjectType="{ \"_t\" : \"System.Type\", \"Name\" : \"System.Object, mscorlib, Version=4.0.0.0, Culture=neutral, PublicKeyToken=b77a5c561934e089\" }",
    m_ForcePreview=False,
    m_MaxItemsPreview=10000)
bool_16 = Boolean(bool_10)
push_13 = Push(
    Adapter=adapter_14,
    Objects=flatten(applay_loads_2.R),
    PushType="{ \"_t\" : \"System.Enum\", \"TypeName\" : { \"_t\" : \"System.Type\", \"Name\" : \"BH.oM.Adapter.PushType\" }, \"Value\" : \"AdapterDefault\" }",
    Active=bool_16,
    Component="{ .Push")  # -> Objects, Success

# ----
# BarVaryingLoad
apply_loads_3 = ApplyLoads_3(L=push_7.Objects)  # -> loadcase_name_2, loadcase_number_2, R
visualize_4 = Visualize(
    BarVaryingDistLoad=apply_loads_3.R,
    ScaleFactor=1,
    DisplayForces=True,
    DisplayMoments=True,
    AsResultants=True,
    Component="{ .Visualize")
adapter_15 = BHoMAdapter(
    adapter,
    ObjectType="{ \"_t\" : \"System.Type\", \"Name\" : \"System.Object, mscorlib, Version=4.0.0.0, Culture=neutral, PublicKeyToken=b77a5c561934e089\" }",
    m_ForcePreview=False,
    m_MaxItemsPreview=10000)
bool_17 = Boolean(bool_10)
push_14 = Push(
    Adapter=adapter_15,
    Objects=flatten(apply_loads_3.R),
    PushType="{ \"_t\" : \"System.Enum\", \"TypeName\" : { \"_t\" : \"System.Type\", \"Name\" : \"BH.oM.Adapter.PushType\" }, \"Value\" : \"AdapterDefault\" }",
    Active=bool_17,
    Component="{ .Push")  # -> Objects, Success

# ----
# BarPreStressLoad
apply_loads_4 = ApplyLoads_6(L=push_5.Objects)  # -> loadcase_name_2, loadcase_number_2, barprestress
ivisualize_4 = IVisualize(
    Load=apply_loads_4.barprestress,
    ScaleFactor=1,
    DisplayForces=True,
    DisplayMoments=True,
    AsResultants=True,
    Component="{ .IVisualize")
adapter_16 = BHoMAdapter(
    adapter,
    ObjectType="{ \"_t\" : \"System.Type\", \"Name\" : \"System.Object, mscorlib, Version=4.0.0.0, Culture=neutral, PublicKeyToken=b77a5c561934e089\" }",
    m_ForcePreview=False,
    m_MaxItemsPreview=10000)
bool_18 = Boolean(bool_10)
push_15 = Push(
    Adapter=adapter_16,
    Objects=flatten(apply_loads_4.barprestress),
    PushType="{ \"_t\" : \"System.Enum\", \"TypeName\" : { \"_t\" : \"System.Type\", \"Name\" : \"BH.oM.Adapter.PushType\" }, \"Value\" : \"AdapterDefault\" }",
    Active=bool_18,
    Component="{ .Push")  # -> Objects, Success

# ----
# BarTempratureLoad
apply_loads_5 = ApplyLoads_9(L=push_5.Objects)  # -> loadcase_name_2, loadcase_number_2, bartempload
ivisualize_5 = IVisualize(
    Load=apply_loads_5.bartempload,
    ScaleFactor=1,
    DisplayForces=True,
    DisplayMoments=True,
    AsResultants=True,
    Component="{ .IVisualize")
adapter_17 = BHoMAdapter(
    adapter,
    ObjectType="{ \"_t\" : \"System.Type\", \"Name\" : \"System.Object, mscorlib, Version=4.0.0.0, Culture=neutral, PublicKeyToken=b77a5c561934e089\" }",
    m_ForcePreview=False,
    m_MaxItemsPreview=10000)
bool_19 = Boolean(bool_10)
push_16 = Push(
    Adapter=adapter_17,
    Objects=flatten(apply_loads_5.bartempload),
    PushType="{ \"_t\" : \"System.Enum\", \"TypeName\" : { \"_t\" : \"System.Type\", \"Name\" : \"BH.oM.Adapter.PushType\" }, \"Value\" : \"AdapterDefault\" }",
    Active=bool_19,
    Component="{ .Push")  # -> Objects, Success

# ----
# AreaUniformLoad
apply_loads_6 = ApplyLoads_4(L=push_2.Objects)  # -> loadcase_name_2, loadcase_number_2, R
visualize_5 = Visualize(
    AreaUDL=apply_loads_6.R,
    ScaleFactor=1,
    DisplayForces=True,
    DisplayMoments=True,
    AsResultants=True,
    EdgeDisplay=True,
    GridDisplay=False,
    Component="{ .Visualize")
adapter_18 = BHoMAdapter(
    adapter,
    ObjectType="{ \"_t\" : \"System.Type\", \"Name\" : \"System.Object, mscorlib, Version=4.0.0.0, Culture=neutral, PublicKeyToken=b77a5c561934e089\" }",
    m_ForcePreview=False,
    m_MaxItemsPreview=10000)
bool_20 = Boolean(bool_10)
push_17 = Push(
    Adapter=adapter_18,
    Objects=flatten(apply_loads_6.R),
    PushType="{ \"_t\" : \"System.Enum\", \"TypeName\" : { \"_t\" : \"System.Type\", \"Name\" : \"BH.oM.Adapter.PushType\" }, \"Value\" : \"AdapterDefault\" }",
    Active=bool_20,
    Component="{ .Push")  # -> Objects, Success

# ----
# AreaUniformLoad
apply_loads_7 = ApplyLoads_5(L=push_3.Objects)  # -> loadcase_name_2, loadcase_number_2, R
visualize_6 = Visualize(
    AreaUDL=apply_loads_7.R,
    ScaleFactor=1,
    DisplayForces=True,
    DisplayMoments=True,
    AsResultants=True,
    EdgeDisplay=True,
    GridDisplay=False,
    Component="{ .Visualize")
adapter_19 = BHoMAdapter(
    adapter,
    ObjectType="{ \"_t\" : \"System.Type\", \"Name\" : \"System.Object, mscorlib, Version=4.0.0.0, Culture=neutral, PublicKeyToken=b77a5c561934e089\" }",
    m_ForcePreview=False,
    m_MaxItemsPreview=10000)
bool_21 = Boolean(bool_10)
push_18 = Push(
    Adapter=adapter_19,
    Objects=flatten(apply_loads_7.R),
    PushType="{ \"_t\" : \"System.Enum\", \"TypeName\" : { \"_t\" : \"System.Type\", \"Name\" : \"BH.oM.Adapter.PushType\" }, \"Value\" : \"AdapterDefault\" }",
    Active=bool_21,
    Component="{ .Push")  # -> Objects, Success

# ----
# AreaTempratureLoad
apply_loads_8 = ApplyLoads_7(objects=push.Objects)  # -> loadcase_name_2, loadcase_number_2, areatempload
ivisualize_6 = IVisualize(
    Load=apply_loads_8.areatempload,
    ScaleFactor=1,
    DisplayForces=True,
    DisplayMoments=True,
    AsResultants=True,
    Component="{ .IVisualize")
adapter_20 = BHoMAdapter(
    adapter,
    ObjectType="{ \"_t\" : \"System.Type\", \"Name\" : \"System.Object, mscorlib, Version=4.0.0.0, Culture=neutral, PublicKeyToken=b77a5c561934e089\" }",
    m_ForcePreview=False,
    m_MaxItemsPreview=10000)
bool_22 = Boolean(bool_10)
push_19 = Push(
    Adapter=adapter_20,
    Objects=flatten(apply_loads_8.areatempload),
    PushType="{ \"_t\" : \"System.Enum\", \"TypeName\" : { \"_t\" : \"System.Type\", \"Name\" : \"BH.oM.Adapter.PushType\" }, \"Value\" : \"AdapterDefault\" }",
    Active=bool_22,
    Component="{ .Push")  # -> Objects, Success

# ----
# PointAcceleration
apply_loads_9 = ApplyLoads_8(bhom=push_4.Objects)  # -> loadcase_name_2, loadcase_number_2, R
ivisualize_7 = IVisualize(
    Load=apply_loads_9.R,
    ScaleFactor=Slider(0.2, range=0..1),
    DisplayForces=True,
    DisplayMoments=True,
    AsResultants=True,
    Component="{ .IVisualize")
adapter_21 = BHoMAdapter(
    adapter,
    ObjectType="{ \"_t\" : \"System.Type\", \"Name\" : \"System.Object, mscorlib, Version=4.0.0.0, Culture=neutral, PublicKeyToken=b77a5c561934e089\" }",
    m_ForcePreview=False,
    m_MaxItemsPreview=10000)
bool_23 = Boolean(bool_10)
push_20 = Push(
    Adapter=adapter_21,
    Objects=flatten(apply_loads_9.R),
    PushType="{ \"_t\" : \"System.Enum\", \"TypeName\" : { \"_t\" : \"System.Type\", \"Name\" : \"BH.oM.Adapter.PushType\" }, \"Value\" : \"AdapterDefault\" }",
    Active=bool_23,
    Component="{ .Push")  # -> Objects, Success

# ----
# PointDisplacment
apply_loads_10 = ApplyLoads_10(bhom=push_4.Objects)  # -> loadcase_name_2, loadcase_number_2, R
ivisualize_8 = IVisualize(
    Load=apply_loads_10.R,
    ScaleFactor=Slider(0.2, range=0..1),
    DisplayForces=True,
    DisplayMoments=True,
    AsResultants=True,
    Component="{ .IVisualize")
adapter_22 = BHoMAdapter(
    adapter,
    ObjectType="{ \"_t\" : \"System.Type\", \"Name\" : \"System.Object, mscorlib, Version=4.0.0.0, Culture=neutral, PublicKeyToken=b77a5c561934e089\" }",
    m_ForcePreview=False,
    m_MaxItemsPreview=10000)
bool_24 = Boolean(bool_10)
push_21 = Push(
    Adapter=adapter_22,
    Objects=flatten(apply_loads_10.R),
    PushType="{ \"_t\" : \"System.Enum\", \"TypeName\" : { \"_t\" : \"System.Type\", \"Name\" : \"BH.oM.Adapter.PushType\" }, \"Value\" : \"AdapterDefault\" }",
    Active=bool_24,
    Component="{ .Push")  # -> Objects, Success

# ----
# PointLoad
apply_loads_11 = ApplyLoads_11(bhom=push_4.Objects)  # -> loadcase_name_2, loadcase_number_2, R
ivisualize_9 = IVisualize(
    Load=apply_loads_11.R,
    ScaleFactor=Slider(0.2, range=0..1),
    DisplayForces=True,
    DisplayMoments=True,
    AsResultants=True,
    Component="{ .IVisualize")
adapter_23 = BHoMAdapter(
    adapter,
    ObjectType="{ \"_t\" : \"System.Type\", \"Name\" : \"System.Object, mscorlib, Version=4.0.0.0, Culture=neutral, PublicKeyToken=b77a5c561934e089\" }",
    m_ForcePreview=False,
    m_MaxItemsPreview=10000)
bool_25 = Boolean(bool_10)
push_22 = Push(
    Adapter=adapter_23,
    Objects=flatten(apply_loads_11.R),
    PushType="{ \"_t\" : \"System.Enum\", \"TypeName\" : { \"_t\" : \"System.Type\", \"Name\" : \"BH.oM.Adapter.PushType\" }, \"Value\" : \"AdapterDefault\" }",
    Active=bool_25,
    Component="{ .Push")  # -> Objects, Success

# ----
# PointVelocity
apply_loads_12 = ApplyLoads_12(bhom=push_4.Objects)  # -> loadcase_name_2, loadcase_number_2, R
ivisualize_10 = IVisualize(
    Load=apply_loads_12.R,
    ScaleFactor=Slider(0.2, range=0..1),
    DisplayForces=True,
    DisplayMoments=True,
    AsResultants=True,
    Component="{ .IVisualize")
adapter_24 = BHoMAdapter(
    adapter,
    ObjectType="{ \"_t\" : \"System.Type\", \"Name\" : \"System.Object, mscorlib, Version=4.0.0.0, Culture=neutral, PublicKeyToken=b77a5c561934e089\" }",
    m_ForcePreview=False,
    m_MaxItemsPreview=10000)
bool_26 = Boolean(bool_10)
push_23 = Push(
    Adapter=adapter_24,
    Objects=flatten(apply_loads_12.R),
    PushType="{ \"_t\" : \"System.Enum\", \"TypeName\" : { \"_t\" : \"System.Type\", \"Name\" : \"BH.oM.Adapter.PushType\" }, \"Value\" : \"AdapterDefault\" }",
    Active=bool_26,
    Component="{ .Push")  # -> Objects, Success

panel_2 = Panel(apply_loads.loadcase_name_2)
panel_3 = Panel(apply_loads.loadcase_number_2)
panel_4 = Panel(apply_loads_2.loadcase_name_2)
panel_5 = Panel(apply_loads_2.loadcase_number_2)
panel_6 = Panel(applay_loads.loadcase_name_2)
panel_7 = Panel(applay_loads.loadcase_number_2)
panel_8 = Panel(applay_loads_2.loadcase_name_2)
panel_9 = Panel(applay_loads_2.loadcase_number_2)
panel_10 = Panel(apply_loads_3.loadcase_name_2)
panel_11 = Panel(apply_loads_3.loadcase_number_2)
panel_12 = Panel(apply_loads_4.loadcase_name_2)
panel_13 = Panel(apply_loads_4.loadcase_number_2)
panel_14 = Panel(apply_loads_5.loadcase_name_2)
panel_15 = Panel(apply_loads_5.loadcase_number_2)

panel_16 = Panel(apply_loads_6.loadcase_name_2)
panel_17 = Panel(apply_loads_6.loadcase_number_2)
panel_18 = Panel(apply_loads_7.loadcase_name_2)
panel_19 = Panel(apply_loads_7.loadcase_number_2)
panel_20 = Panel(apply_loads_8.loadcase_name_2)
panel_21 = Panel(apply_loads_8.loadcase_number_2)

panel_22 = Panel(apply_loads_9.loadcase_name_2)
panel_23 = Panel(apply_loads_9.loadcase_number_2)
panel_24 = Panel(apply_loads_10.loadcase_name_2)
panel_25 = Panel(apply_loads_10.loadcase_number_2)
panel_26 = Panel(apply_loads_11.loadcase_name_2)
panel_27 = Panel(apply_loads_11.loadcase_number_2)
panel_28 = Panel(apply_loads_12.loadcase_name_2)
panel_29 = Panel(apply_loads_12.loadcase_number_2)

panel_30 = Panel(panel)
panel_31 = Panel("91")
panel_32 = Panel("GeometricalLineLoad")
panel_33 = Panel("92")

# ----
# Pulling Loads
# BarUniformLoad
createtype = CreateType(Component="BH.oM.Structure.Loads.BarUniformlyDistributedLoad")
bool_27 = Boolean(bool)
pull = Pull(
    Adapter=adapter,
    Request=createtype,
    PullType="{ \"_t\" : \"System.Enum\", \"TypeName\" : { \"_t\" : \"System.Type\", \"Name\" : \"BH.oM.Adapter.PullType\" }, \"Value\" : \"AdapterDefault\" }",
    Active=bool_27,
    Component="{ .Pull")
ivisualize_11 = IVisualize(Load=pull, ScaleFactor=1, DisplayForces=True, DisplayMoments=True, AsResultants=True, Component="{ .IVisualize")

# ----
# BarVaryingLoad
createtype_2 = CreateType(Component="BH.oM.Structure.Loads.BarVaryingDistributedLoad")
bool_28 = Boolean(bool)
pull_2 = Pull(
    Adapter=adapter,
    Request=createtype_2,
    PullType="{ \"_t\" : \"System.Enum\", \"TypeName\" : { \"_t\" : \"System.Type\", \"Name\" : \"BH.oM.Adapter.PullType\" }, \"Value\" : \"AdapterDefault\" }",
    Active=bool_28,
    Component="{ .Pull")
ivisualize_12 = IVisualize(Load=pull_2, ScaleFactor=1, DisplayForces=True, DisplayMoments=True, AsResultants=True, Component="{ .IVisualize")

# ----
# BarPointLoad
createtype_3 = CreateType(Component="BH.oM.Structure.Loads.BarPointLoad")
bool_29 = Boolean(bool)
pull_3 = Pull(
    Adapter=adapter,
    Request=createtype_3,
    PullType="{ \"_t\" : \"System.Enum\", \"TypeName\" : { \"_t\" : \"System.Type\", \"Name\" : \"BH.oM.Adapter.PullType\" }, \"Value\" : \"AdapterDefault\" }",
    Active=bool_29,
    Component="{ .Pull")
ivisualize_13 = IVisualize(Load=pull_3, ScaleFactor=1, DisplayForces=True, DisplayMoments=True, AsResultants=True, Component="{ .IVisualize")

# ----
# BarPrestress
createtype_4 = CreateType(Component="BH.oM.Structure.Loads.BarPrestressLoad")
bool_30 = Boolean(bool)
pull_4 = Pull(
    Adapter=adapter,
    Request=createtype_4,
    PullType="{ \"_t\" : \"System.Enum\", \"TypeName\" : { \"_t\" : \"System.Type\", \"Name\" : \"BH.oM.Adapter.PullType\" }, \"Value\" : \"AdapterDefault\" }",
    Active=bool_30,
    Component="{ .Pull")
ivisualize_14 = IVisualize(Load=pull_4, ScaleFactor=1, DisplayForces=True, DisplayMoments=True, AsResultants=True, Component="{ .IVisualize")

# ----
# BarTempratureLoad
createtype_5 = CreateType(Component="BH.oM.Structure.Loads.BarTemperatureLoad")
bool_31 = Boolean(bool)
pull_5 = Pull(
    Adapter=adapter,
    Request=createtype_5,
    PullType="{ \"_t\" : \"System.Enum\", \"TypeName\" : { \"_t\" : \"System.Type\", \"Name\" : \"BH.oM.Adapter.PullType\" }, \"Value\" : \"AdapterDefault\" }",
    Active=bool_31,
    Component="{ .Pull")
ivisualize_15 = IVisualize(Load=pull_5, ScaleFactor=1, DisplayForces=True, DisplayMoments=True, AsResultants=True, Component="{ .IVisualize")

# ----
# AreaUniformlyDistrubitedLoad
createtype_6 = CreateType(Component="BH.oM.Structure.Loads.AreaUniformlyDistributedLoad")
bool_32 = Boolean(bool)
pull_6 = Pull(
    Adapter=adapter,
    Request=createtype_6,
    PullType="{ \"_t\" : \"System.Enum\", \"TypeName\" : { \"_t\" : \"System.Type\", \"Name\" : \"BH.oM.Adapter.PullType\" }, \"Value\" : \"AdapterDefault\" }",
    Active=bool_32,
    Component="{ .Pull")
ivisualize_16 = IVisualize(Load=pull_6, ScaleFactor=1, DisplayForces=True, DisplayMoments=True, AsResultants=True, Component="{ .IVisualize")

# ----
# AreaTempratureLoad
createtype_7 = CreateType(Component="BH.oM.Structure.Loads.AreaTemperatureLoad")
bool_33 = Boolean(bool)
pull_7 = Pull(
    Adapter=adapter,
    Request=createtype_7,
    PullType="{ \"_t\" : \"System.Enum\", \"TypeName\" : { \"_t\" : \"System.Type\", \"Name\" : \"BH.oM.Adapter.PullType\" }, \"Value\" : \"AdapterDefault\" }",
    Active=bool_33,
    Component="{ .Pull")
ivisualize_17 = IVisualize(Load=pull_7, ScaleFactor=1, DisplayForces=True, DisplayMoments=True, AsResultants=True, Component="{ .IVisualize")

# ----
# PointAcceleration
createtype_8 = CreateType(Component="BH.oM.Structure.Loads.PointAcceleration")
bool_34 = Boolean(bool)
pull_8 = Pull(
    Adapter=adapter,
    Request=createtype_8,
    PullType="{ \"_t\" : \"System.Enum\", \"TypeName\" : { \"_t\" : \"System.Type\", \"Name\" : \"BH.oM.Adapter.PullType\" }, \"Value\" : \"AdapterDefault\" }",
    Active=bool_34,
    Component="{ .Pull")
ivisualize_18 = IVisualize(
    Load=pull_8,
    ScaleFactor=Slider(0.2, range=0..1),
    DisplayForces=True,
    DisplayMoments=True,
    AsResultants=True,
    Component="{ .IVisualize")

# ----
# PointDisplacment
createtype_9 = CreateType(Component="BH.oM.Structure.Loads.PointDisplacement")
bool_35 = Boolean(bool)
pull_9 = Pull(
    Adapter=adapter,
    Request=createtype_9,
    PullType="{ \"_t\" : \"System.Enum\", \"TypeName\" : { \"_t\" : \"System.Type\", \"Name\" : \"BH.oM.Adapter.PullType\" }, \"Value\" : \"AdapterDefault\" }",
    Active=bool_35,
    Component="{ .Pull")
ivisualize_19 = IVisualize(
    Load=pull_9,
    ScaleFactor=Slider(0.2, range=0..1),
    DisplayForces=True,
    DisplayMoments=True,
    AsResultants=True,
    Component="{ .IVisualize")

# ----
# PointLoad
createtype_10 = CreateType(Component="BH.oM.Structure.Loads.PointLoad")
bool_36 = Boolean(bool)
pull_10 = Pull(
    Adapter=adapter,
    Request=createtype_10,
    PullType="{ \"_t\" : \"System.Enum\", \"TypeName\" : { \"_t\" : \"System.Type\", \"Name\" : \"BH.oM.Adapter.PullType\" }, \"Value\" : \"AdapterDefault\" }",
    Active=bool_36,
    Component="{ .Pull")
ivisualize_20 = IVisualize(
    Load=pull_10,
    ScaleFactor=Slider(0.2, range=0..1),
    DisplayForces=True,
    DisplayMoments=True,
    AsResultants=True,
    Component="{ .IVisualize")

# ----
# PointVelocity
createtype_11 = CreateType(Component="BH.oM.Structure.Loads.PointVelocity")
bool_37 = Boolean(bool)
pull_11 = Pull(
    Adapter=adapter,
    Request=createtype_11,
    PullType="{ \"_t\" : \"System.Enum\", \"TypeName\" : { \"_t\" : \"System.Type\", \"Name\" : \"BH.oM.Adapter.PullType\" }, \"Value\" : \"AdapterDefault\" }",
    Active=bool_37,
    Component="{ .Pull")
ivisualize_21 = IVisualize(
    Load=pull_11,
    ScaleFactor=Slider(0.2, range=0..1),
    DisplayForces=True,
    DisplayMoments=True,
    AsResultants=True,
    Component="{ .IVisualize")

# ----
# GravityLoad
createtype_12 = CreateType(Component="BH.oM.Structure.Loads.GravityLoad")
bool_38 = Boolean(bool)
pull_12 = Pull(
    Adapter=adapter,
    Request=createtype_12,
    PullType="{ \"_t\" : \"System.Enum\", \"TypeName\" : { \"_t\" : \"System.Type\", \"Name\" : \"BH.oM.Adapter.PullType\" }, \"Value\" : \"AdapterDefault\" }",
    Active=bool_38,
    Component="{ .Pull")
ivisualize_22 = IVisualize(Load=pull_12, ScaleFactor=1, DisplayForces=True, DisplayMoments=True, AsResultants=True, Component="{ .IVisualize")

# ----
# ContourLoad
createtype_13 = CreateType(Component="BH.oM.Structure.Loads.ContourLoad")
bool_39 = Boolean(bool)
pull_13 = Pull(
    Adapter=adapter,
    Request=createtype_13,
    PullType="{ \"_t\" : \"System.Enum\", \"TypeName\" : { \"_t\" : \"System.Type\", \"Name\" : \"BH.oM.Adapter.PullType\" }, \"Value\" : \"AdapterDefault\" }",
    Active=bool_39,
    Component="{ .Pull")
ivisualize_23 = IVisualize(Load=pull_13, ScaleFactor=1, DisplayForces=True, DisplayMoments=True, AsResultants=True, Component="{ .IVisualize")

# ----
# GeometricalLineLoad
createtype_14 = CreateType(Component="BH.oM.Structure.Loads.GeometricalLineLoad")
bool_40 = Boolean(bool)
pull_14 = Pull(
    Adapter=adapter,
    Request=createtype_14,
    PullType="{ \"_t\" : \"System.Enum\", \"TypeName\" : { \"_t\" : \"System.Type\", \"Name\" : \"BH.oM.Adapter.PullType\" }, \"Value\" : \"AdapterDefault\" }",
    Active=bool_40,
    Component="{ .Pull")
ivisualize_24 = IVisualize(Load=pull_14, ScaleFactor=1, DisplayForces=True, DisplayMoments=True, AsResultants=True, Component="{ .IVisualize")

# ----
# Gravity Load
all_pushed_objects = Merge(
    Data1=push_6.Objects,
    Data2=push_7.Objects,
    Data3=push_5.Objects,
    Data4=push_2.Objects,
    Data5=push_3.Objects,
    Data6=push.Objects,
    Data7=push_4.Objects)  # -> flatten(Result)

# ----
# GravityLoad
apply_load = ApplyLoad(objects=all_pushed_objects)  # -> loadcase_name_2, loadcase_number_2, gravload
ivisualize_25 = IVisualize(
    Load=apply_load.gravload,
    ScaleFactor=1,
    DisplayForces=True,
    DisplayMoments=True,
    AsResultants=True,
    Component="{ .IVisualize")
adapter_25 = BHoMAdapter(
    adapter,
    ObjectType="{ \"_t\" : \"System.Type\", \"Name\" : \"System.Object, mscorlib, Version=4.0.0.0, Culture=neutral, PublicKeyToken=b77a5c561934e089\" }",
    m_ForcePreview=False,
    m_MaxItemsPreview=10000)
bool_41 = Boolean(bool_10)
push_24 = Push(
    Adapter=adapter_25,
    Objects=flatten(apply_load.gravload),
    PushType="{ \"_t\" : \"System.Enum\", \"TypeName\" : { \"_t\" : \"System.Type\", \"Name\" : \"BH.oM.Adapter.PushType\" }, \"Value\" : \"AdapterDefault\" }",
    Active=bool_41,
    Component="{ .Push")  # -> Objects, Success

panel_34 = Panel(apply_load.loadcase_name_2)
panel_35 = Panel(apply_load.loadcase_number_2)

# ==== cluster Cluster
filepath = ClusterInput()
selectedadapter = ClusterInput()
S = ClusterInput()
selectedadapter_2 = Integer(selectedadapter)
filepath_2 = Text(filepath)
gate = StreamGate(Stream=S, Gate=selectedadapter_2)  # -> Target0, Target1, Target2, Target3, Target4, Target5, Target6, Target7, Target8
gate_2 = StreamGate(Stream=filepath_2, Gate=selectedadapter_2)  # -> Target0, Target1, Target2, Target3, Target4, Target5, Target6, Target7, Target8
lusasv17adapter = LusasV17Adapter(FilePath=gate_2.Target6, Active=gate.Target6, Component="{ ..ctor")
lusasv18adapter = LusasV18Adapter(FilePath=gate_2.Target5, Active=gate.Target5, Component="{ ..ctor")
gsaadapter = GSAAdapter(FilePath=gate_2.Target4, Active=gate.Target4, Component="{ ..ctor")
# Adapter
robotadapter = RobotAdapter(FilePath=gate_2.Target0, Active=gate.Target0, Component="{ ..ctor")
etabs17adapter = ETABS17Adapter(FilePath=gate_2.Target1, Active=gate.Target1, Component="{ ..ctor")
etabs2016adapter = ETABS2016Adapter(FilePath=gate_2.Target2, Active=gate.Target2, Component="{ ..ctor")
ramadapter = RAMAdapter(FilePath=gate_2.Target8, Active=gate.Target8, Component="{ ..ctor")
midasciviladapter = MidasCivilAdapter(FilePath=gate_2.Target7, Active=gate.Target7, Component="{ ..ctor")
sap2000adapter = SAP2000Adapter(FilePath=gate_2.Target3, Active=gate.Target3, Component="{ ..ctor")
filter = StreamFilter(
    Gate=selectedadapter_2,
    Stream0=robotadapter,
    Stream1=etabs17adapter,
    Stream2=etabs2016adapter,
    Stream3=sap2000adapter,
    Stream4=gsaadapter,
    Stream5=lusasv18adapter,
    Stream6=lusasv17adapter,
    Stream7=midasciviladapter,
    Stream8=ramadapter)
getproperty = GetProperty(Obj=filter, PropName="AdapterIdName", Component="{ .GetProperty")
s_8 = ClusterOutput(filter)
txt = Text(getproperty)
adapteridname = ClusterOutput(txt)

# ==== cluster CreateBars
X = UnitX(Factor=1)
X_2 = UnitX(Factor=1)
Z = UnitZ(Factor=1)
pt = Point(Point(-6.656051256, 0.2304520414, 0))
pt_2 = Point(Point(0, 0, 0))
pt_3 = Point(Point(0, 0, 0))
line = LineSDL(Start=pt, Direction=X, Length=Slider(5, range=0..10))
line_2 = LineSDL(Start=pt_2, Direction=X_2, Length=Slider(5, range=0..10))
line_3 = LineSDL(Start=pt_3, Direction=Z, Length=Slider(5, range=0..10))
ub = UB(
    {"UB 1016x305x584": 0, "UB 1016x305x494": 1, "UB 1016x305x438": 2, "UB 1016x305x415": 3, "UB 1016x305x393": 4, "UB 1016x305x350": 5, "UB 1016x305x314": 6, "UB 1016x305x272": 7, "UB 1016x305x249": 8, "UB 1016x305x222": 9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}, selected="UB 610x178x92": 44,
    Component="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",
    Selection=44)
ub_2 = UB(
    {"UB 1016x305x584": 0, "UB 1016x305x494": 1, "UB 1016x305x438": 2, "UB 1016x305x415": 3, "UB 1016x305x393": 4, "UB 1016x305x350": 5, "UB 1016x305x314": 6, "UB 1016x305x272": 7, "UB 1016x305x249": 8, "UB 1016x305x222": 9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}, selected="UB 610x178x92": 44,
    Component="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",
    Selection=44)
number_slider = Slider(1.571, range=0..10)
number_slider_2 = Slider(1.571, range=0..10)
Y = UnitY(Factor=1)
Y_2 = UnitY(Factor=1)
Y_3 = UnitY(Factor=1)
move = Move(Geometry=line, Motion=Y)  # -> Geometry, Transform
move_2 = Move(Geometry=line_2, Motion=Y_2)  # -> Geometry, Transform
move_3 = Move(Geometry=line_3, Motion=Y_3)  # -> Geometry, Transform
bar = Bar(
    Line=line,
    Property=ub,
    OrientationAngle=number_slider_2,
    FeaType="{ \"_t\" : \"System.Enum\", \"TypeName\" : { \"_t\" : \"System.Type\", \"Name\" : \"BH.oM.Structure.Elements.BarFEAType\" }, \"Value\" : \"Flexural\" }",
    Component="{ .Bar")
bar_2 = Bar(
    Line=move.Geometry,
    Property=ub,
    OrientationAngle=number_slider_2,
    FeaType="{ \"_t\" : \"System.Enum\", \"TypeName\" : { \"_t\" : \"System.Type\", \"Name\" : \"BH.oM.Structure.Elements.BarFEAType\" }, \"Value\" : \"Flexural\" }",
    Component="{ .Bar")
bar_3 = Bar(
    Line=line_2,
    Property=ub_2,
    OrientationAngle=number_slider,
    FeaType="{ \"_t\" : \"System.Enum\", \"TypeName\" : { \"_t\" : \"System.Type\", \"Name\" : \"BH.oM.Structure.Elements.BarFEAType\" }, \"Value\" : \"Flexural\" }",
    Component="{ .Bar")
bar_4 = Bar(
    Line=move_2.Geometry,
    Property=ub_2,
    OrientationAngle=number_slider,
    FeaType="{ \"_t\" : \"System.Enum\", \"TypeName\" : { \"_t\" : \"System.Type\", \"Name\" : \"BH.oM.Structure.Elements.BarFEAType\" }, \"Value\" : \"Flexural\" }",
    Component="{ .Bar")
bar_5 = Bar(
    Line=line_3,
    OrientationAngle=0,
    FeaType="{ \"_t\" : \"System.Enum\", \"TypeName\" : { \"_t\" : \"System.Type\", \"Name\" : \"BH.oM.Structure.Elements.BarFEAType\" }, \"Value\" : \"Flexural\" }",
    Component="{ .Bar")
bar_6 = Bar(
    Line=move_3.Geometry,
    OrientationAngle=0,
    FeaType="{ \"_t\" : \"System.Enum\", \"TypeName\" : { \"_t\" : \"System.Type\", \"Name\" : \"BH.oM.Structure.Elements.BarFEAType\" }, \"Value\" : \"Flexural\" }",
    Component="{ .Bar")
merge = Merge(Data1=bar_6, Data2=bar_5, Data3=bar_4, Data4=bar_3, Data5=bar_2, Data6=bar)
R = ClusterOutput(merge)

# ==== cluster ApplyLoads

number_slider = Slider(2, range=0..10)
loadcase = Loadcase(
    Name="BarUniformLoad",
    Nature="{ \"_t\" : \"System.Enum\", \"TypeName\" : { \"_t\" : \"System.Type\", \"Name\" : \"BH.oM.Structure.Loads.LoadNature\" }, \"Value\" : \"Other\" }",
    Number=number_slider,
    Component="BH.oM.Structure.Loads.Loadcase")

loadcase_name = Text("BarUniformLoad")
L = ClusterInput()
loadcase_number = Number(number_slider)
item = ListItem(List=L, Index=0, Wrap=True)  # -> Item, Item1, Item2, Item3, Item4, Item5
loadcase_name_2 = ClusterOutput(loadcase_name)
loadcase_number_2 = ClusterOutput(loadcase_number)
number_slider_2 = Slider(-1000, range=-1000..-999)
number_slider_3 = Slider(-1000, range=-1000..-999)
Z = UnitZ(Factor=Slider(1000, range=0..1000))
X = UnitX(Factor=number_slider_2)
Z_2 = UnitZ(Factor=number_slider_2)
Z_3 = UnitZ(Factor=number_slider_3)
Y = UnitY(Factor=Slider(-1000, range=-1000..-999))
Y_2 = UnitY(Factor=number_slider_3)
loadaxis = LoadAxis({"Global": 0, "Local": 1}, selected="Local", Component="BH.oM.Structure.Loads.LoadAxis", Selection=1)
loadaxis_2 = LoadAxis({"Global": 0, "Local": 1}, selected="Local", Component="BH.oM.Structure.Loads.LoadAxis", Selection=1)
loadaxis_3 = LoadAxis({"Global": 0, "Local": 1}, selected="Local", Component="BH.oM.Structure.Loads.LoadAxis", Selection=1)
baruniformlydistributedload = BarUniformlyDistributedLoad(
    Loadcase=loadcase,
    Objects=item.Item5,
    Force=Y,
    Axis="{ \"_t\" : \"System.Enum\", \"TypeName\" : { \"_t\" : \"System.Type\", \"Name\" : \"BH.oM.Structure.Loads.LoadAxis\" }, \"Value\" : \"Global\" }",
    Projected=False,
    Name="BarUniformLoad",
    Component="{ .BarUniformlyDistributedLoad")
baruniformlydistributedload_2 = BarUniformlyDistributedLoad(
    Loadcase=loadcase,
    Objects=item.Item4,
    Force=Z,
    Axis=loadaxis,
    Projected=False,
    Name="BarUniformLoad",
    Component="{ .BarUniformlyDistributedLoad")
baruniformlydistributedload_3 = BarUniformlyDistributedLoad(
    Loadcase=loadcase,
    Objects=item.Item1,
    Force=Z_2,
    Axis="{ \"_t\" : \"System.Enum\", \"TypeName\" : { \"_t\" : \"System.Type\", \"Name\" : \"BH.oM.Structure.Loads.LoadAxis\" }, \"Value\" : \"Global\" }",
    Projected=False,
    Name="BarUniformLoad",
    Component="{ .BarUniformlyDistributedLoad")
baruniformlydistributedload_4 = BarUniformlyDistributedLoad(
    Loadcase=loadcase,
    Objects=item.Item3,
    Force=Z_3,
    Axis="{ \"_t\" : \"System.Enum\", \"TypeName\" : { \"_t\" : \"System.Type\", \"Name\" : \"BH.oM.Structure.Loads.LoadAxis\" }, \"Value\" : \"Global\" }",
    Projected=False,
    Component="{ .BarUniformlyDistributedLoad")
baruniformlydistributedload_5 = BarUniformlyDistributedLoad(
    Loadcase=loadcase,
    Objects=item.Item,
    Force=X,
    Axis=loadaxis_2,
    Projected=False,
    Name="BarUniformLoad",
    Component="{ .BarUniformlyDistributedLoad")
baruniformlydistributedload_6 = BarUniformlyDistributedLoad(
    Loadcase=loadcase,
    Objects=item.Item2,
    Force=Y_2,
    Axis=loadaxis_3,
    Projected=False,
    Name="BarUniformLoad",
    Component="{ .BarUniformlyDistributedLoad")
merge = Merge(
    Data1=baruniformlydistributedload_5,
    Data2=baruniformlydistributedload_3,
    Data3=baruniformlydistributedload_6,
    Data4=baruniformlydistributedload_4,
    Data5=baruniformlydistributedload_2,
    Data6=baruniformlydistributedload)
R = ClusterOutput(merge)

# ==== cluster CreateBars_2
Z = UnitZ(Factor=1)
X = UnitX(Factor=1)
X_2 = UnitX(Factor=1)
Y = UnitY(Factor=1)
addition = Addition(A=Y, B=X)
addition_2 = Addition(A=Z, B=X_2)
pt = Point(Point(25.79519519, 0.01658700839, 0))
pt_2 = Point(Point(20.47720528, 0, 0.1827313728))
line = LineSDL(Start=pt, Direction=addition, Length=Slider(5, range=0..10))
line_2 = LineSDL(Start=pt_2, Direction=addition_2, Length=Slider(5, range=0..10))
ub = UB(
    {"UB 1016x305x584": 0, "UB 1016x305x494": 1, "UB 1016x305x438": 2, "UB 1016x305x415": 3, "UB 1016x305x393": 4, "UB 1016x305x350": 5, "UB 1016x305x314": 6, "UB 1016x305x272": 7, "UB 1016x305x249": 8, "UB 1016x305x222": 9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}, selected="UB 610x178x92": 44,
    Component="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",
    Selection=44)
ub_2 = UB(
    {"UB 1016x305x584": 0, "UB 1016x305x494": 1, "UB 1016x305x438": 2, "UB 1016x305x415": 3, "UB 1016x305x393": 4, "UB 1016x305x350": 5, "UB 1016x305x314": 6, "UB 1016x305x272": 7, "UB 1016x305x249": 8, "UB 1016x305x222": 9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}, selected="UB 610x178x92": 44,
    Component="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",
    Selection=44)
number_slider = Slider(1.571, range=0..10)
number_slider_2 = Slider(1.571, range=0..10)
Y_2 = UnitY(Factor=1)
Y_3 = UnitY(Factor=1)
move = Move(Geometry=line, Motion=Y_2)  # -> Geometry, Transform
move_2 = Move(Geometry=line_2, Motion=Y_3)  # -> Geometry, Transform
bar = Bar(
    Line=line,
    Property=ub,
    OrientationAngle=number_slider_2,
    FeaType="{ \"_t\" : \"System.Enum\", \"TypeName\" : { \"_t\" : \"System.Type\", \"Name\" : \"BH.oM.Structure.Elements.BarFEAType\" }, \"Value\" : \"Flexural\" }",
    Component="{ .Bar")
bar_2 = Bar(
    Line=line_2,
    Property=ub_2,
    OrientationAngle=number_slider,
    FeaType="{ \"_t\" : \"System.Enum\", \"TypeName\" : { \"_t\" : \"System.Type\", \"Name\" : \"BH.oM.Structure.Elements.BarFEAType\" }, \"Value\" : \"Flexural\" }",
    Component="{ .Bar")
bar_3 = Bar(
    Line=move.Geometry,
    Property=ub,
    OrientationAngle=number_slider_2,
    FeaType="{ \"_t\" : \"System.Enum\", \"TypeName\" : { \"_t\" : \"System.Type\", \"Name\" : \"BH.oM.Structure.Elements.BarFEAType\" }, \"Value\" : \"Flexural\" }",
    Component="{ .Bar")
bar_4 = Bar(
    Line=move_2.Geometry,
    Property=ub_2,
    OrientationAngle=number_slider,
    FeaType="{ \"_t\" : \"System.Enum\", \"TypeName\" : { \"_t\" : \"System.Type\", \"Name\" : \"BH.oM.Structure.Elements.BarFEAType\" }, \"Value\" : \"Flexural\" }",
    Component="{ .Bar")
merge = Merge(Data1=bar_4, Data2=bar_2, Data3=bar_3, Data4=bar)
R = ClusterOutput(merge)

# ==== cluster ApplayLoads

number_slider = Slider(2, range=0..10)
loadcase = Loadcase(
    Name="BarUniformLoad",
    Nature="{ \"_t\" : \"System.Enum\", \"TypeName\" : { \"_t\" : \"System.Type\", \"Name\" : \"BH.oM.Structure.Loads.LoadNature\" }, \"Value\" : \"Other\" }",
    Number=number_slider,
    Component="BH.oM.Structure.Loads.Loadcase")

L = ClusterInput()
item = ListItem(List=L, Index=0, Wrap=True)  # -> Item, Item1, Item2, Item3
loadcase_name = Text("BarUniformLoad")
loadcase_number = Number(number_slider)
number_slider_2 = Slider(-1000, range=-1000..-999)
number_slider_3 = Slider(-1000, range=-1000..-999)
loadcase_name_2 = ClusterOutput(loadcase_name)
loadcase_number_2 = ClusterOutput(loadcase_number)
multiplication = Multiplication(A=number_slider_2, B=Slider(0.707, range=0..1))
multiplication_2 = Multiplication(A=number_slider_3, B=Slider(0.707, range=0..1))
Z = UnitZ(Factor=number_slider_3)
Y = UnitY(Factor=number_slider_2)
Y_2 = UnitY(Factor=multiplication)
Z_2 = UnitZ(Factor=multiplication_2)
baruniformlydistributedload = BarUniformlyDistributedLoad(
    Loadcase=loadcase,
    Objects=item.Item3,
    Force=Y_2,
    Axis="{ \"_t\" : \"System.Enum\", \"TypeName\" : { \"_t\" : \"System.Type\", \"Name\" : \"BH.oM.Structure.Loads.LoadAxis\" }, \"Value\" : \"Global\" }",
    Projected=False,
    Name="BarUniformLoad",
    Component="{ .BarUniformlyDistributedLoad")
baruniformlydistributedload_2 = BarUniformlyDistributedLoad(
    Loadcase=loadcase,
    Objects=item.Item1,
    Force=Z_2,
    Axis="{ \"_t\" : \"System.Enum\", \"TypeName\" : { \"_t\" : \"System.Type\", \"Name\" : \"BH.oM.Structure.Loads.LoadAxis\" }, \"Value\" : \"Global\" }",
    Projected=False,
    Name="BarUniformLoad",
    Component="{ .BarUniformlyDistributedLoad")
baruniformlydistributedload_3 = BarUniformlyDistributedLoad(
    Loadcase=loadcase,
    Objects=item.Item2,
    Force=Y,
    Axis="{ \"_t\" : \"System.Enum\", \"TypeName\" : { \"_t\" : \"System.Type\", \"Name\" : \"BH.oM.Structure.Loads.LoadAxis\" }, \"Value\" : \"Global\" }",
    Projected=Toggle(True),
    Name="BarUniformLoad",
    Component="{ .BarUniformlyDistributedLoad")
baruniformlydistributedload_4 = BarUniformlyDistributedLoad(
    Loadcase=loadcase,
    Objects=item.Item,
    Force=Z,
    Axis="{ \"_t\" : \"System.Enum\", \"TypeName\" : { \"_t\" : \"System.Type\", \"Name\" : \"BH.oM.Structure.Loads.LoadAxis\" }, \"Value\" : \"Global\" }",
    Projected=Toggle(True),
    Name="BarUniformLoad",
    Component="{ .BarUniformlyDistributedLoad")
merge = Merge(
    Data1=baruniformlydistributedload_4,
    Data2=baruniformlydistributedload_2,
    Data3=baruniformlydistributedload_3,
    Data4=baruniformlydistributedload)
R = ClusterOutput(merge)

# ==== cluster ApplyLoads_2
L = ClusterInput()
item = ListItem(List=L, Index=0, Wrap=True)  # -> Item, Item1, Item2, Item3, Item4, Item5

number_slider = Slider(3, range=0..10)
loadcase = Loadcase(
    Name="BarVariyingLoad",
    Nature="{ \"_t\" : \"System.Enum\", \"TypeName\" : { \"_t\" : \"System.Type\", \"Name\" : \"BH.oM.Structure.Loads.LoadNature\" }, \"Value\" : \"Other\" }",
    Number=number_slider,
    Component="BH.oM.Structure.Loads.Loadcase")

loadcase_name = Text("BarVariyingLoad")
bhom = BHoMObject(
    item.Item5,
    ObjectType="{ \"_t\" : \"System.Type\", \"Name\" : \"System.Object, mscorlib, Version=4.0.0.0, Culture=neutral, PublicKeyToken=b77a5c561934e089\" }",
    m_ForcePreview=False,
    m_MaxItemsPreview=10000)
loadcase_number = Number(number_slider)
bhom_2 = BHoMObject(
    item.Item4,
    ObjectType="{ \"_t\" : \"System.Type\", \"Name\" : \"System.Object, mscorlib, Version=4.0.0.0, Culture=neutral, PublicKeyToken=b77a5c561934e089\" }",
    m_ForcePreview=False,
    m_MaxItemsPreview=10000)
bhom_3 = BHoMObject(
    item.Item3,
    ObjectType="{ \"_t\" : \"System.Type\", \"Name\" : \"System.Object, mscorlib, Version=4.0.0.0, Culture=neutral, PublicKeyToken=b77a5c561934e089\" }",
    m_ForcePreview=False,
    m_MaxItemsPreview=10000)
bhom_4 = BHoMObject(
    item.Item2,
    ObjectType="{ \"_t\" : \"System.Type\", \"Name\" : \"System.Object, mscorlib, Version=4.0.0.0, Culture=neutral, PublicKeyToken=b77a5c561934e089\" }",
    m_ForcePreview=False,
    m_MaxItemsPreview=10000)
bhom_5 = BHoMObject(
    item.Item1,
    ObjectType="{ \"_t\" : \"System.Type\", \"Name\" : \"System.Object, mscorlib, Version=4.0.0.0, Culture=neutral, PublicKeyToken=b77a5c561934e089\" }",
    m_ForcePreview=False,
    m_MaxItemsPreview=10000)
bhom_6 = BHoMObject(
    item.Item,
    ObjectType="{ \"_t\" : \"System.Type\", \"Name\" : \"System.Object, mscorlib, Version=4.0.0.0, Culture=neutral, PublicKeyToken=b77a5c561934e089\" }",
    m_ForcePreview=False,
    m_MaxItemsPreview=10000)
number_slider_2 = Slider(-1000, range=-1000..-999)
loadcase_name_2 = ClusterOutput(loadcase_name)
loadcase_number_2 = ClusterOutput(loadcase_number)
number_slider_3 = Slider(-1000, range=-1000..-999)
X = UnitX(Factor=number_slider_2)
Z = UnitZ(Factor=Slider(1000, range=0..1000))
Z_2 = UnitZ(Factor=number_slider_3)
Z_3 = UnitZ(Factor=number_slider_2)
Y = UnitY(Factor=Slider(-1000, range=-1000..-999))
Y_2 = UnitY(Factor=number_slider_3)
loadaxis = LoadAxis({"Global": 0, "Local": 1}, selected="Local", Component="BH.oM.Structure.Loads.LoadAxis", Selection=1)
loadaxis_2 = LoadAxis({"Global": 0, "Local": 1}, selected="Local", Component="BH.oM.Structure.Loads.LoadAxis", Selection=1)
loadaxis_3 = LoadAxis({"Global": 0, "Local": 1}, selected="Local", Component="BH.oM.Structure.Loads.LoadAxis", Selection=1)
multiplication = Multiplication(A=X, B=2)
multiplication_2 = Multiplication(A=Z_3, B=2)
barvaryingdistributedload = BarVaryingDistributedLoad(
    Loadcase=loadcase,
    Objects=bhom_6,
    DistFromA=0,
    ForceA=X,
    DistFromB=0,
    ForceB=multiplication,
    Axis=loadaxis_3,
    Projected=False,
    Name="BarVariyingLoad",
    Component="{ .BarVaryingDistributedLoad")
barvaryingdistributedload_2 = BarVaryingDistributedLoad(
    Loadcase=loadcase,
    Objects=bhom_5,
    DistFromA=0,
    ForceA=Z_3,
    DistFromB=0,
    ForceB=multiplication_2,
    Axis="{ \"_t\" : \"System.Enum\", \"TypeName\" : { \"_t\" : \"System.Type\", \"Name\" : \"BH.oM.Structure.Loads.LoadAxis\" }, \"Value\" : \"Global\" }",
    Projected=False,
    Name="BarVariyingLoad",
    Component="{ .BarVaryingDistributedLoad")
multiplication_3 = Multiplication(A=Z, B=2)
multiplication_4 = Multiplication(A=Y, B=2)
multiplication_5 = Multiplication(A=Y_2, B=2)
multiplication_6 = Multiplication(A=Z_2, B=2)
barvaryingdistributedload_3 = BarVaryingDistributedLoad(
    Loadcase=loadcase,
    Objects=bhom_2,
    DistFromA=0,
    ForceA=Z,
    DistFromB=0,
    ForceB=multiplication_3,
    Axis=loadaxis_2,
    Projected=False,
    Name="BarVariyingLoad",
    Component="{ .BarVaryingDistributedLoad")
barvaryingdistributedload_4 = BarVaryingDistributedLoad(
    Loadcase=loadcase,
    Objects=bhom,
    DistFromA=0,
    ForceA=Y,
    DistFromB=0,
    ForceB=multiplication_4,
    Axis="{ \"_t\" : \"System.Enum\", \"TypeName\" : { \"_t\" : \"System.Type\", \"Name\" : \"BH.oM.Structure.Loads.LoadAxis\" }, \"Value\" : \"Global\" }",
    Projected=False,
    Name="BarVariyingLoad",
    Component="{ .BarVaryingDistributedLoad")
barvaryingdistributedload_5 = BarVaryingDistributedLoad(
    Loadcase=loadcase,
    Objects=bhom_4,
    DistFromA=0,
    ForceA=Y_2,
    DistFromB=0,
    ForceB=multiplication_5,
    Axis=loadaxis,
    Projected=False,
    Name="BarVariyingLoad",
    Component="{ .BarVaryingDistributedLoad")
barvaryingdistributedload_6 = BarVaryingDistributedLoad(
    Loadcase=loadcase,
    Objects=bhom_3,
    DistFromA=0,
    ForceA=Z_2,
    DistFromB=0,
    ForceB=multiplication_6,
    Axis="{ \"_t\" : \"System.Enum\", \"TypeName\" : { \"_t\" : \"System.Type\", \"Name\" : \"BH.oM.Structure.Loads.LoadAxis\" }, \"Value\" : \"Global\" }",
    Projected=False,
    Name="BarVariyingLoad",
    Component="{ .BarVaryingDistributedLoad")
merge = Merge(
    Data1=barvaryingdistributedload,
    Data2=barvaryingdistributedload_2,
    Data3=barvaryingdistributedload_5,
    Data4=barvaryingdistributedload_6,
    Data5=barvaryingdistributedload_3,
    Data6=barvaryingdistributedload_4)
R = ClusterOutput(merge)

# ==== cluster ApplyLoads_3

number_slider = Slider(3, range=0..10)
loadcase = Loadcase(
    Name="BarVariyingLoad",
    Nature="{ \"_t\" : \"System.Enum\", \"TypeName\" : { \"_t\" : \"System.Type\", \"Name\" : \"BH.oM.Structure.Loads.LoadNature\" }, \"Value\" : \"Other\" }",
    Number=number_slider,
    Component="BH.oM.Structure.Loads.Loadcase")

L = ClusterInput()
item = ListItem(List=L, Index=0, Wrap=True)  # -> Item, Item1, Item2, Item3
loadcase_name = Text("BarVariyingLoad")
loadcase_number = Number(number_slider)
loadcase_name_2 = ClusterOutput(loadcase_name)
loadcase_number_2 = ClusterOutput(loadcase_number)
bhom = BHoMObject(
    item.Item3,
    ObjectType="{ \"_t\" : \"System.Type\", \"Name\" : \"System.Object, mscorlib, Version=4.0.0.0, Culture=neutral, PublicKeyToken=b77a5c561934e089\" }",
    m_ForcePreview=False,
    m_MaxItemsPreview=10000)
bhom_2 = BHoMObject(
    item.Item1,
    ObjectType="{ \"_t\" : \"System.Type\", \"Name\" : \"System.Object, mscorlib, Version=4.0.0.0, Culture=neutral, PublicKeyToken=b77a5c561934e089\" }",
    m_ForcePreview=False,
    m_MaxItemsPreview=10000)
bhom_3 = BHoMObject(
    item.Item2,
    ObjectType="{ \"_t\" : \"System.Type\", \"Name\" : \"System.Object, mscorlib, Version=4.0.0.0, Culture=neutral, PublicKeyToken=b77a5c561934e089\" }",
    m_ForcePreview=False,
    m_MaxItemsPreview=10000)
bhom_4 = BHoMObject(
    item.Item,
    ObjectType="{ \"_t\" : \"System.Type\", \"Name\" : \"System.Object, mscorlib, Version=4.0.0.0, Culture=neutral, PublicKeyToken=b77a5c561934e089\" }",
    m_ForcePreview=False,
    m_MaxItemsPreview=10000)
number_slider_2 = Slider(-1000, range=-1000..-999)
number_slider_3 = Slider(-1000, range=-1000..-999)
multiplication = Multiplication(A=number_slider_3, B=Slider(0.707, range=0..1))
multiplication_2 = Multiplication(A=number_slider_2, B=Slider(0.707, range=0..1))
Z = UnitZ(Factor=number_slider_2)
Y = UnitY(Factor=number_slider_3)
Y_2 = UnitY(Factor=multiplication)
Z_2 = UnitZ(Factor=multiplication_2)
multiplication_3 = Multiplication(A=Y, B=2)
multiplication_4 = Multiplication(A=Y_2, B=2)
multiplication_5 = Multiplication(A=Z, B=2)
multiplication_6 = Multiplication(A=Z_2, B=2)
barvaryingdistributedload = BarVaryingDistributedLoad(
    Loadcase=loadcase,
    Objects=bhom_3,
    DistFromA=0,
    ForceA=Y,
    DistFromB=0,
    ForceB=multiplication_3,
    Axis="{ \"_t\" : \"System.Enum\", \"TypeName\" : { \"_t\" : \"System.Type\", \"Name\" : \"BH.oM.Structure.Loads.LoadAxis\" }, \"Value\" : \"Global\" }",
    Projected=Toggle(True),
    Name="BarVariyingLoad",
    Component="{ .BarVaryingDistributedLoad")
barvaryingdistributedload_2 = BarVaryingDistributedLoad(
    Loadcase=loadcase,
    Objects=bhom,
    DistFromA=0,
    ForceA=Y_2,
    DistFromB=0,
    ForceB=multiplication_4,
    Axis="{ \"_t\" : \"System.Enum\", \"TypeName\" : { \"_t\" : \"System.Type\", \"Name\" : \"BH.oM.Structure.Loads.LoadAxis\" }, \"Value\" : \"Global\" }",
    Projected=False,
    Name="BarVariyingLoad",
    Component="{ .BarVaryingDistributedLoad")
barvaryingdistributedload_3 = BarVaryingDistributedLoad(
    Loadcase=loadcase,
    Objects=bhom_4,
    DistFromA=0,
    ForceA=Z,
    DistFromB=0,
    ForceB=multiplication_5,
    Axis="{ \"_t\" : \"System.Enum\", \"TypeName\" : { \"_t\" : \"System.Type\", \"Name\" : \"BH.oM.Structure.Loads.LoadAxis\" }, \"Value\" : \"Global\" }",
    Projected=Toggle(True),
    Name="BarVariyingLoad",
    Component="{ .BarVaryingDistributedLoad")
barvaryingdistributedload_4 = BarVaryingDistributedLoad(
    Loadcase=loadcase,
    Objects=bhom_2,
    DistFromA=0,
    ForceA=Z_2,
    DistFromB=0,
    ForceB=multiplication_6,
    Axis="{ \"_t\" : \"System.Enum\", \"TypeName\" : { \"_t\" : \"System.Type\", \"Name\" : \"BH.oM.Structure.Loads.LoadAxis\" }, \"Value\" : \"Global\" }",
    Projected=False,
    Name="BarVariyingLoad",
    Component="{ .BarVaryingDistributedLoad")
merge = Merge(
    Data1=barvaryingdistributedload_3,
    Data2=barvaryingdistributedload_4,
    Data3=barvaryingdistributedload,
    Data4=barvaryingdistributedload_2)
R = ClusterOutput(merge)

# ==== cluster ApplayLoads_2
L = ClusterInput()
item = ListItem(List=L, Index=0, Wrap=True)  # -> Item, Item1, Item2, Item3, Item4, Item5

number_slider = Slider(4, range=0..10)
loadcase = Loadcase(
    Name="BarPointLoad",
    Nature="{ \"_t\" : \"System.Enum\", \"TypeName\" : { \"_t\" : \"System.Type\", \"Name\" : \"BH.oM.Structure.Loads.LoadNature\" }, \"Value\" : \"Other\" }",
    Number=number_slider,
    Component="BH.oM.Structure.Loads.Loadcase")

loadcase_name = Text("BarPointLoad")
loadcase_number = Number(number_slider)
bhom = BHoMObject(
    item.Item5,
    ObjectType="{ \"_t\" : \"System.Type\", \"Name\" : \"System.Object, mscorlib, Version=4.0.0.0, Culture=neutral, PublicKeyToken=b77a5c561934e089\" }",
    m_ForcePreview=False,
    m_MaxItemsPreview=10000)
bhom_2 = BHoMObject(
    item.Item4,
    ObjectType="{ \"_t\" : \"System.Type\", \"Name\" : \"System.Object, mscorlib, Version=4.0.0.0, Culture=neutral, PublicKeyToken=b77a5c561934e089\" }",
    m_ForcePreview=False,
    m_MaxItemsPreview=10000)
bhom_3 = BHoMObject(
    item.Item3,
    ObjectType="{ \"_t\" : \"System.Type\", \"Name\" : \"System.Object, mscorlib, Version=4.0.0.0, Culture=neutral, PublicKeyToken=b77a5c561934e089\" }",
    m_ForcePreview=False,
    m_MaxItemsPreview=10000)
bhom_4 = BHoMObject(
    item.Item2,
    ObjectType="{ \"_t\" : \"System.Type\", \"Name\" : \"System.Object, mscorlib, Version=4.0.0.0, Culture=neutral, PublicKeyToken=b77a5c561934e089\" }",
    m_ForcePreview=False,
    m_MaxItemsPreview=10000)
bhom_5 = BHoMObject(
    item.Item1,
    ObjectType="{ \"_t\" : \"System.Type\", \"Name\" : \"System.Object, mscorlib, Version=4.0.0.0, Culture=neutral, PublicKeyToken=b77a5c561934e089\" }",
    m_ForcePreview=False,
    m_MaxItemsPreview=10000)
bhom_6 = BHoMObject(
    item.Item,
    ObjectType="{ \"_t\" : \"System.Type\", \"Name\" : \"System.Object, mscorlib, Version=4.0.0.0, Culture=neutral, PublicKeyToken=b77a5c561934e089\" }",
    m_ForcePreview=False,
    m_MaxItemsPreview=10000)
loadcase_name_2 = ClusterOutput(loadcase_name)
loadcase_number_2 = ClusterOutput(loadcase_number)
number_slider_2 = Slider(-1000, range=-1000..-999)
number_slider_3 = Slider(-1000, range=-1000..-999)
Z = UnitZ(Factor=Slider(1000, range=0..1000))
Z_2 = UnitZ(Factor=number_slider_2)
Y = UnitY(Factor=Slider(-1000, range=-1000..-999))
Y_2 = UnitY(Factor=number_slider_2)
number_slider_4 = Slider(2, range=0..10)
number_slider_5 = Slider(2, range=0..10)
number_slider_6 = Slider(2, range=0..10)
X = UnitX(Factor=number_slider_3)
loadaxis = LoadAxis({"Global": 0, "Local": 1}, selected="Local", Component="BH.oM.Structure.Loads.LoadAxis", Selection=1)
loadaxis_2 = LoadAxis({"Global": 0, "Local": 1}, selected="Local", Component="BH.oM.Structure.Loads.LoadAxis", Selection=1)
Z_3 = UnitZ(Factor=number_slider_3)
loadaxis_3 = LoadAxis({"Global": 0, "Local": 1}, selected="Local", Component="BH.oM.Structure.Loads.LoadAxis", Selection=1)
barpointload = BarPointLoad(
    Loadcase=loadcase,
    DistFromA=number_slider_5,
    Objects=bhom_3,
    Force=Z_2,
    Axis="{ \"_t\" : \"System.Enum\", \"TypeName\" : { \"_t\" : \"System.Type\", \"Name\" : \"BH.oM.Structure.Loads.LoadAxis\" }, \"Value\" : \"Global\" }",
    Name="BarPointLoad",
    Component="{ .BarPointLoad")
barpointload_2 = BarPointLoad(
    Loadcase=loadcase,
    DistFromA=number_slider_6,
    Objects=bhom,
    Force=Y,
    Axis="{ \"_t\" : \"System.Enum\", \"TypeName\" : { \"_t\" : \"System.Type\", \"Name\" : \"BH.oM.Structure.Loads.LoadAxis\" }, \"Value\" : \"Global\" }",
    Name="BarPointLoad",
    Component="{ .BarPointLoad")
barpointload_3 = BarPointLoad(
    Loadcase=loadcase,
    DistFromA=number_slider_5,
    Objects=bhom_4,
    Force=Y_2,
    Axis=loadaxis,
    Name="BarPointLoad",
    Component="{ .BarPointLoad")
barpointload_4 = BarPointLoad(
    Loadcase=loadcase,
    DistFromA=number_slider_6,
    Objects=bhom_2,
    Force=Z,
    Axis=loadaxis_2,
    Name="BarPointLoad",
    Component="{ .BarPointLoad")
barpointload_5 = BarPointLoad(
    Loadcase=loadcase,
    DistFromA=number_slider_4,
    Objects=bhom_5,
    Force=Z_3,
    Axis="{ \"_t\" : \"System.Enum\", \"TypeName\" : { \"_t\" : \"System.Type\", \"Name\" : \"BH.oM.Structure.Loads.LoadAxis\" }, \"Value\" : \"Global\" }",
    Name="BarPointLoad",
    Component="{ .BarPointLoad")
barpointload_6 = BarPointLoad(
    Loadcase=loadcase,
    DistFromA=number_slider_4,
    Objects=bhom_6,
    Force=X,
    Axis=loadaxis_3,
    Name="BarPointLoad",
    Component="{ .BarPointLoad")
merge = Merge(
    Data1=barpointload_6,
    Data2=barpointload_5,
    Data3=barpointload_3,
    Data4=barpointload,
    Data5=barpointload_4,
    Data6=barpointload_2)
R = ClusterOutput(merge)

# ==== cluster CreatePanels
concrete = Concrete(
    {"C12/15": 0, "C16/20": 1, "C20/25": 2, "C25/30": 3, "C30/37": 4, "C35/45": 5, "C40/50": 6, "C45/55": 7, "C50/60": 8, "C55/67": 9, "C60/75": 10, "C70/85": 11, "C80/95": 12, "C90/105": 13}, selected="C12/15",
    Component="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",
    Selection=0)
setproperty = SetProperty(Obj=concrete, PropName="Name", Value="C12 15", Component="{ .PropertyValue")
constantthickness = ConstantThickness(
    Name="name",
    Thickness=Slider(0.2, range=0..1),
    Material=setproperty,
    PanelType="{ \"_t\" : \"System.Enum\", \"TypeName\" : { \"_t\" : \"System.Type\", \"Name\" : \"BH.oM.Structure.SurfaceProperties.PanelType\" }, \"Value\" : \"Slab\" }",
    Component="BH.oM.Structure.SurfaceProperties.ConstantThickness")
xz = XZPlane(Origin=Point(-22.4155926, -0.6886625428, 0))
yz = YZPlane(Origin=Point(-27.73980781, -2.408123212, 0))
rectangle = Rectangle(Plane=xz, XSize=Domain(-1, 1), YSize=Domain(-2, 2), Radius=0)  # -> Rectangle, Length
rectangle_2 = Rectangle(Plane=yz, XSize=Domain(-1, 1), YSize=Domain(-2, 2), Radius=0)  # -> Rectangle, Length
Y = UnitY(Factor=4)
Y_2 = UnitY(Factor=4)
move = Move(Geometry=rectangle_2.Rectangle, Motion=Y)  # -> Geometry, Transform
move_2 = Move(Geometry=rectangle.Rectangle, Motion=Y_2)  # -> Geometry, Transform
panel = Panel(Outline=move.Geometry, Property=constantthickness, Component="{ .Panel")
panel_2 = Panel(Outline=rectangle_2.Rectangle, Property=constantthickness, Component="{ .Panel")
panel_3 = Panel(Outline=rectangle.Rectangle, Property=constantthickness, Component="{ .Panel")
panel_4 = Panel(Outline=move_2.Geometry, Property=constantthickness, Component="{ .Panel")
panels_as_meshes = ClusterInput()
panels_as_meshes_2 = Boolean(panels_as_meshes)
merge = Merge(Data1=panel_3, Data2=panel_4, Data3=panel_2, Data4=panel)
cluster = Cluster_2(panels_as_meshes=panels_as_meshes_2, panels=merge)
areaelements = ClusterOutput(cluster)

# ==== cluster ApplyLoads_4
L = ClusterInput()

number_slider = Slider(11, range=0..30)
loadcase = Loadcase(
    Name="AreaUniformLoad",
    Nature="{ \"_t\" : \"System.Enum\", \"TypeName\" : { \"_t\" : \"System.Type\", \"Name\" : \"BH.oM.Structure.Loads.LoadNature\" }, \"Value\" : \"Other\" }",
    Number=number_slider,
    Component="BH.oM.Structure.Loads.Loadcase")

item = ListItem(List=L, Index=0, Wrap=True)  # -> Item, Item1, Item2, Item3
loadcase_name = Text("AreaUniformLoad")
loadcase_number = Number(number_slider)
loadcase_name_2 = ClusterOutput(loadcase_name)
loadcase_number_2 = ClusterOutput(loadcase_number)
neg = Negative(Value=Slider(10000, range=0..10000))
loadaxis = LoadAxis({"Global": 0, "Local": 1}, selected="Local", Component="BH.oM.Structure.Loads.LoadAxis", Selection=1)
Z = UnitZ(Factor=Slider(10000, range=0..10000))
Y = UnitY(Factor=neg)
loadaxis_2 = LoadAxis({"Global": 0, "Local": 1}, selected="Local", Component="BH.oM.Structure.Loads.LoadAxis", Selection=1)
Y_2 = UnitY(Factor=Slider(10000, range=0..10000))
X = UnitX(Factor=Slider(10000, range=0..10000))
areauniformlydistributedload = AreaUniformlyDistributedLoad(
    Loadcase=loadcase,
    Pressure=Y_2,
    Objects=item.Item2,
    Axis="{ \"_t\" : \"System.Enum\", \"TypeName\" : { \"_t\" : \"System.Type\", \"Name\" : \"BH.oM.Structure.Loads.LoadAxis\" }, \"Value\" : \"Global\" }",
    Projected=False,
    Name="AreaUniformLoad",
    Component="{ .AreaUniformlyDistributedLoad")
areauniformlydistributedload_2 = AreaUniformlyDistributedLoad(
    Loadcase=loadcase,
    Pressure=Y,
    Objects=item.Item,
    Axis="{ \"_t\" : \"System.Enum\", \"TypeName\" : { \"_t\" : \"System.Type\", \"Name\" : \"BH.oM.Structure.Loads.LoadAxis\" }, \"Value\" : \"Global\" }",
    Projected=False,
    Name="AreaUniformLoad",
    Component="{ .AreaUniformlyDistributedLoad")
areauniformlydistributedload_3 = AreaUniformlyDistributedLoad(
    Loadcase=loadcase,
    Pressure=Z,
    Objects=item.Item1,
    Axis=loadaxis,
    Projected=False,
    Name="AreaUniformLoad",
    Component="{ .AreaUniformlyDistributedLoad")
areauniformlydistributedload_4 = AreaUniformlyDistributedLoad(
    Loadcase=loadcase,
    Pressure=X,
    Objects=item.Item3,
    Axis=loadaxis_2,
    Projected=False,
    Name="AreaUniformLoad",
    Component="{ .AreaUniformlyDistributedLoad")
merge = Merge(
    Data1=areauniformlydistributedload_3,
    Data2=areauniformlydistributedload_2,
    Data3=areauniformlydistributedload_4,
    Data4=areauniformlydistributedload)
R = ClusterOutput(merge)

# ==== cluster CreatePanels_2
concrete = Concrete(
    {"C12/15": 0, "C16/20": 1, "C20/25": 2, "C25/30": 3, "C30/37": 4, "C35/45": 5, "C40/50": 6, "C45/55": 7, "C50/60": 8, "C55/67": 9, "C60/75": 10, "C70/85": 11, "C80/95": 12, "C90/105": 13}, selected="C12/15",
    Component="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",
    Selection=0)
setproperty = SetProperty(Obj=concrete, PropName="Name", Value="C12 15", Component="{ .PropertyValue")
Z = UnitZ(Factor=1)
X = UnitX(Factor=1)
X_2 = UnitX(Factor=1)
Y = UnitY(Factor=1)
addition = Addition(A=Z, B=X)
addition_2 = Addition(A=Y, B=X_2)
constantthickness = ConstantThickness(
    Name="name",
    Thickness=Slider(0.2, range=0..1),
    Material=setproperty,
    PanelType="{ \"_t\" : \"System.Enum\", \"TypeName\" : { \"_t\" : \"System.Type\", \"Name\" : \"BH.oM.Structure.SurfaceProperties.PanelType\" }, \"Value\" : \"Slab\" }",
    Component="BH.oM.Structure.SurfaceProperties.ConstantThickness")
pl = PlaneNormal(Origin=Point(-38.46515309, -4.370989815, 0), ZAxis=addition)
pl_2 = PlaneNormal(Origin=Point(-56.49646462, -4.483220787, 0), ZAxis=addition_2)
rectangle = Rectangle(Plane=pl, XSize=Domain(-1, 1), YSize=Domain(-2, 2), Radius=0)  # -> Rectangle, Length
rectangle_2 = Rectangle(Plane=pl_2, XSize=Domain(-1, 1), YSize=Domain(-2, 2), Radius=0)  # -> Rectangle, Length
Y_2 = UnitY(Factor=4)
Y_3 = UnitY(Factor=4)
move = Move(Geometry=rectangle_2.Rectangle, Motion=Y_2)  # -> Geometry, Transform
move_2 = Move(Geometry=rectangle.Rectangle, Motion=Y_3)  # -> Geometry, Transform
panel = Panel(Outline=move.Geometry, Property=constantthickness, Component="{ .Panel")
panel_2 = Panel(Outline=rectangle_2.Rectangle, Property=constantthickness, Component="{ .Panel")
panel_3 = Panel(Outline=rectangle.Rectangle, Property=constantthickness, Component="{ .Panel")
panel_4 = Panel(Outline=move_2.Geometry, Property=constantthickness, Component="{ .Panel")
panels_as_meshes = ClusterInput()
merge = Merge(Data1=panel_3, Data2=panel_4, Data3=panel_2, Data4=panel)
panels_as_meshes_2 = Boolean(panels_as_meshes)
cluster = Cluster_2(panels_as_meshes=panels_as_meshes_2, panels=merge)
areaelements = ClusterOutput(cluster)

# ==== cluster ApplyLoads_5

number_slider = Slider(11, range=0..30)
loadcase = Loadcase(
    Name="AreaUniformLoad",
    Nature="{ \"_t\" : \"System.Enum\", \"TypeName\" : { \"_t\" : \"System.Type\", \"Name\" : \"BH.oM.Structure.Loads.LoadNature\" }, \"Value\" : \"Other\" }",
    Number=number_slider,
    Component="BH.oM.Structure.Loads.Loadcase")

L = ClusterInput()
loadcase_name = Text("AreaUniformLoad")
loadcase_number = Number(number_slider)
item = ListItem(List=L, Index=0, Wrap=True)  # -> Item, Item1, Item2, Item3
loadcase_name_2 = ClusterOutput(loadcase_name)
loadcase_number_2 = ClusterOutput(loadcase_number)
number_slider_2 = Slider(10000, range=0..10000)
neg = Negative(Value=Slider(10000, range=0..10000))
X = UnitX(Factor=number_slider_2)
Z = UnitZ(Factor=neg)
Z_2 = UnitZ(Factor=neg)
X_2 = UnitX(Factor=number_slider_2)
multiplication = Multiplication(A=X, B=Slider(0.707, range=0..1))
multiplication_2 = Multiplication(A=Z_2, B=Slider(0.707, range=0..1))
areauniformlydistributedload = AreaUniformlyDistributedLoad(
    Loadcase=loadcase,
    Pressure=multiplication,
    Objects=item.Item2,
    Axis="{ \"_t\" : \"System.Enum\", \"TypeName\" : { \"_t\" : \"System.Type\", \"Name\" : \"BH.oM.Structure.Loads.LoadAxis\" }, \"Value\" : \"Global\" }",
    Projected=False,
    Name="AreaUniformLoad",
    Component="{ .AreaUniformlyDistributedLoad")
areauniformlydistributedload_2 = AreaUniformlyDistributedLoad(
    Loadcase=loadcase,
    Pressure=multiplication_2,
    Objects=item.Item,
    Axis="{ \"_t\" : \"System.Enum\", \"TypeName\" : { \"_t\" : \"System.Type\", \"Name\" : \"BH.oM.Structure.Loads.LoadAxis\" }, \"Value\" : \"Global\" }",
    Projected=False,
    Name="AreaUniformLoad",
    Component="{ .AreaUniformlyDistributedLoad")
areauniformlydistributedload_3 = AreaUniformlyDistributedLoad(
    Loadcase=loadcase,
    Pressure=Z,
    Objects=item.Item1,
    Axis="{ \"_t\" : \"System.Enum\", \"TypeName\" : { \"_t\" : \"System.Type\", \"Name\" : \"BH.oM.Structure.Loads.LoadAxis\" }, \"Value\" : \"Global\" }",
    Projected=Toggle(True),
    Name="AreaUniformLoad",
    Component="{ .AreaUniformlyDistributedLoad")
areauniformlydistributedload_4 = AreaUniformlyDistributedLoad(
    Loadcase=loadcase,
    Pressure=X_2,
    Objects=item.Item3,
    Axis="{ \"_t\" : \"System.Enum\", \"TypeName\" : { \"_t\" : \"System.Type\", \"Name\" : \"BH.oM.Structure.Loads.LoadAxis\" }, \"Value\" : \"Global\" }",
    Projected=Toggle(True),
    Name="AreaUniformLoad",
    Component="{ .AreaUniformlyDistributedLoad")
merge = Merge(
    Data1=areauniformlydistributedload_3,
    Data2=areauniformlydistributedload_2,
    Data3=areauniformlydistributedload_4,
    Data4=areauniformlydistributedload)
R = ClusterOutput(merge)

# ==== cluster CreateBars_3
series = Series(Start=Slider(5, range=0..10), Step=1, Count=Slider(2, range=0..10))
pt = ConstructPoint(XCoordinate=0, YCoordinate=series, ZCoordinate=0)
X = UnitX(Factor=1)
line = LineSDL(Start=pt, Direction=X, Length=1)
bar = Bar(
    Line=line,
    OrientationAngle=0,
    FeaType="{ \"_t\" : \"System.Enum\", \"TypeName\" : { \"_t\" : \"System.Type\", \"Name\" : \"BH.oM.Structure.Elements.BarFEAType\" }, \"Value\" : \"Flexural\" }",
    Component="{ .Bar")
bar_2 = ClusterOutput(bar)

# ==== cluster ApplyLoads_6
L = ClusterInput()

number_slider = Slider(6, range=0..10)
loadcase = Loadcase(
    Name="BarPreStressLoad",
    Nature="{ \"_t\" : \"System.Enum\", \"TypeName\" : { \"_t\" : \"System.Type\", \"Name\" : \"BH.oM.Structure.Loads.LoadNature\" }, \"Value\" : \"Other\" }",
    Number=number_slider,
    Component="BH.oM.Structure.Loads.Loadcase")

item = ListItem(List=L, Index=0, Wrap=True)  # -> Item, Item1
number_slider_2 = Slider(500, range=0..1000)
loadcase_name = Text("BarPreStressLoad")
loadcase_number = Number(number_slider)
loadcase_name_2 = ClusterOutput(loadcase_name)
loadcase_number_2 = ClusterOutput(loadcase_number)
neg = Negative(Value=number_slider_2)
barprestressload = BarPrestressLoad(
    Loadcase=loadcase,
    Prestress=graft([number_slider_2, neg]),
    Objects=graft([item.Item, item.Item1]),
    Name="BarPreStressLoad",
    Component="{ .BarPrestressLoad")  # -> flatten(BarPreStress)
barprestress = ClusterOutput(barprestressload)

# ==== cluster CreatePanel
concrete = Concrete(
    {"C12/15": 0, "C16/20": 1, "C20/25": 2, "C25/30": 3, "C30/37": 4, "C35/45": 5, "C40/50": 6, "C45/55": 7, "C50/60": 8, "C55/67": 9, "C60/75": 10, "C70/85": 11, "C80/95": 12, "C90/105": 13}, selected="C12/15",
    Component="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",
    Selection=0)
setproperty = SetProperty(Obj=concrete, PropName="Name", Value="C12 15", Component="{ .PropertyValue")
series = Series(Start="-6", Step="-6", Count=Slider(2, range=0..10))
pt = ConstructPoint(XCoordinate=0, YCoordinate=series, ZCoordinate=0)
constantthickness = ConstantThickness(
    Name="name",
    Thickness=Slider(0.2, range=0..1),
    Material=setproperty,
    PanelType="{ \"_t\" : \"System.Enum\", \"TypeName\" : { \"_t\" : \"System.Type\", \"Name\" : \"BH.oM.Structure.SurfaceProperties.PanelType\" }, \"Value\" : \"Slab\" }",
    Component="BH.oM.Structure.SurfaceProperties.ConstantThickness")
panels_as_meshes = ClusterInput()
rectangle = Rectangle(Plane=pt, XSize=Domain(-1, 1), YSize=Domain(-2, 2), Radius=0)  # -> Rectangle, Length
panels_as_meshes_2 = Boolean(panels_as_meshes)
panel = Panel(Outline=rectangle.Rectangle, Property=constantthickness, Component="{ .Panel")
cluster = Cluster_2(panels_as_meshes=panels_as_meshes_2, panels=panel)
areaelements = ClusterOutput(cluster)

# ==== cluster ApplyLoads_7

number_slider = Slider(12, range=0..30)
loadcase = Loadcase(
    Name="AreaTempratureLoad",
    Nature="{ \"_t\" : \"System.Enum\", \"TypeName\" : { \"_t\" : \"System.Type\", \"Name\" : \"BH.oM.Structure.Loads.LoadNature\" }, \"Value\" : \"Other\" }",
    Number=number_slider,
    Component="BH.oM.Structure.Loads.Loadcase")

objects = ClusterInput()
number_slider_2 = Slider(2, range=0..10)
loadcase_name = Text("AreaTempratureLoad")
loadcase_number = Number(number_slider)
loadcase_name_2 = ClusterOutput(loadcase_name)
loadcase_number_2 = ClusterOutput(loadcase_number)
neg = Negative(Value=number_slider_2)
areatemperatureload = AreaTemperatureLoad(
    Loadcase=loadcase,
    TemperatureChange=graft([number_slider_2, neg]),
    Objects=graft(objects),
    Axis="{ \"_t\" : \"System.Enum\", \"TypeName\" : { \"_t\" : \"System.Type\", \"Name\" : \"BH.oM.Structure.Loads.LoadAxis\" }, \"Value\" : \"Global\" }",
    Projected=False,
    Name="AreaTempratureLoad",
    Component="{ .AreaTemperatureLoad")  # -> flatten(AreaTempLoad)
areatempload = ClusterOutput(areatemperatureload)

# ==== cluster ApplyLoads_8
panel = Panel("""{10,0,0}
{0,10,0}
{0,0,10}
{0,0,0}
{0,0,0}
{0,0,0}
{-10,0,0}
{0,-10,0}
{0,0,-10}
{0,0,0}
{0,0,0}
{0,0,0}""")
panel_2 = Panel("""{0,0,0}
{0,0,0}
{0,0,0}
{10,0,0}
{0,10,0}
{0,0,10}
{0,0,0}
{0,0,0}
{0,0,0}
{-10,0,0}
{0,-10,0}
{0,0,-10}""")
bhom = ClusterInput()
bhom_2 = BHoMObject(
    bhom,
    ObjectType="{ \"_t\" : \"System.Type\", \"Name\" : \"System.Object, mscorlib, Version=4.0.0.0, Culture=neutral, PublicKeyToken=b77a5c561934e089\" }",
    m_ForcePreview=False,
    m_MaxItemsPreview=10000)
vec = Vector(panel_2)
vec_2 = Vector(panel)
loadcase_name = Text("PointAcceleration")
loadcase_number = Number("85")
loadcase = Loadcase(
    Name="PointAcceleration",
    Nature="{ \"_t\" : \"System.Enum\", \"TypeName\" : { \"_t\" : \"System.Type\", \"Name\" : \"BH.oM.Structure.Loads.LoadNature\" }, \"Value\" : \"Other\" }",
    Number="85",
    Component="BH.oM.Structure.Loads.Loadcase")
loadcase_name_2 = ClusterOutput(loadcase_name)
loadcase_number_2 = ClusterOutput(loadcase_number)
pointacceleration = PointAcceleration(
    Loadcase=loadcase,
    Objects=graft(bhom_2),
    TranslationAcc=graft(vec),
    RotationAcc=graft(vec_2),
    Axis="{ \"_t\" : \"System.Enum\", \"TypeName\" : { \"_t\" : \"System.Type\", \"Name\" : \"BH.oM.Structure.Loads.LoadAxis\" }, \"Value\" : \"Global\" }",
    Name="PointAcceleration",
    Component="{ .PointAcceleration")  # -> flatten(PtAcc)
merge = Merge(Data1=pointacceleration)
R = ClusterOutput(merge)

# ==== cluster CreateNodes
series = Series(Start=0, Step=Slider(2, range=0..10), Count=Slider(12, range=0..100))
pt = ConstructPoint(XCoordinate=series, YCoordinate="-3", ZCoordinate=0)
node = Node(Coordinates=pt, Component="{ .Node")
node_2 = ClusterOutput(node)

# ==== cluster ApplyLoad
Z = UnitZ(Factor="-1")
loadcase = Loadcase(
    Name="NewDeadLoad",
    Nature="{ \"_t\" : \"System.Enum\", \"TypeName\" : { \"_t\" : \"System.Type\", \"Name\" : \"BH.oM.Structure.Loads.LoadNature\" }, \"Value\" : \"Other\" }",
    Number="99",
    Component="BH.oM.Structure.Loads.Loadcase")
objects = ClusterInput()
loadcase_name = Text("NewDeadLoad")
loadcase_number = Number("99")
gravityload = GravityLoad(Loadcase=loadcase, GravityDirection=Z, Objects=objects, Name="NewDeadLoad", Component="{ .GravityLoad")
loadcase_name_2 = ClusterOutput(loadcase_name)
loadcase_number_2 = ClusterOutput(loadcase_number)
gravload = ClusterOutput(gravityload)

# ==== cluster ApplyLoads_9
L = ClusterInput()
item = ListItem(List=L, Index=0, Wrap=True)  # -> Item, Item1
number_slider = Slider(7, range=0..100)
number_slider_2 = Slider(2, range=0..10)
loadcase_name = Text("BarTempratureLoad")
loadcase_number = Number(number_slider)
loadcase = Loadcase(
    Name="BarTempratureLoad",
    Nature="{ \"_t\" : \"System.Enum\", \"TypeName\" : { \"_t\" : \"System.Type\", \"Name\" : \"BH.oM.Structure.Loads.LoadNature\" }, \"Value\" : \"Other\" }",
    Number=number_slider,
    Component="BH.oM.Structure.Loads.Loadcase")
neg = Negative(Value=number_slider_2)
loadcase_name_2 = ClusterOutput(loadcase_name)
loadcase_number_2 = ClusterOutput(loadcase_number)
bartemperatureload = BarTemperatureLoad(
    Loadcase=loadcase,
    TemperatureChange=graft([number_slider_2, neg]),
    Objects=graft([item.Item, item.Item1]),
    Axis="{ \"_t\" : \"System.Enum\", \"TypeName\" : { \"_t\" : \"System.Type\", \"Name\" : \"BH.oM.Structure.Loads.LoadAxis\" }, \"Value\" : \"Global\" }",
    Projected=False,
    Name="BarTempratureLoad",
    Component="{ .BarTemperatureLoad")  # -> flatten(BarTempLoad)
bartempload = ClusterOutput(bartemperatureload)

# ==== cluster ApplyLoads_10
panel = Panel("""{10,0,0}
{0,10,0}
{0,0,10}
{0,0,0}
{0,0,0}
{0,0,0}
{-10,0,0}
{0,-10,0}
{0,0,-10}
{0,0,0}
{0,0,0}
{0,0,0}""")
panel_2 = Panel("""{0,0,0}
{0,0,0}
{0,0,0}
{10,0,0}
{0,10,0}
{0,0,10}
{0,0,0}
{0,0,0}
{0,0,0}
{-10,0,0}
{0,-10,0}
{0,0,-10}""")
bhom = ClusterInput()
bhom_2 = BHoMObject(
    bhom,
    ObjectType="{ \"_t\" : \"System.Type\", \"Name\" : \"System.Object, mscorlib, Version=4.0.0.0, Culture=neutral, PublicKeyToken=b77a5c561934e089\" }",
    m_ForcePreview=False,
    m_MaxItemsPreview=10000)
vec = Vector(panel_2)
vec_2 = Vector(panel)
loadcase_name = Text("PointDisplacment")
loadcase_number = Number("86")
loadcase = Loadcase(
    Name="PointDisplacment",
    Nature="{ \"_t\" : \"System.Enum\", \"TypeName\" : { \"_t\" : \"System.Type\", \"Name\" : \"BH.oM.Structure.Loads.LoadNature\" }, \"Value\" : \"Other\" }",
    Number="86",
    Component="BH.oM.Structure.Loads.Loadcase")
loadcase_name_2 = ClusterOutput(loadcase_name)
loadcase_number_2 = ClusterOutput(loadcase_number)
pointdisplacement = PointDisplacement(
    Loadcase=loadcase,
    Objects=graft(bhom_2),
    Translation=graft(vec),
    Rotation=graft(vec_2),
    Axis="{ \"_t\" : \"System.Enum\", \"TypeName\" : { \"_t\" : \"System.Type\", \"Name\" : \"BH.oM.Structure.Loads.LoadAxis\" }, \"Value\" : \"Global\" }",
    Name="PointDisplacment",
    Component="{ .PointDisplacement")  # -> flatten(PtDisp)
merge = Merge(Data2=pointdisplacement)
R = ClusterOutput(merge)

# ==== cluster ApplyLoads_11
panel = Panel("""{10,0,0}
{0,10,0}
{0,0,10}
{0,0,0}
{0,0,0}
{0,0,0}
{-10,0,0}
{0,-10,0}
{0,0,-10}
{0,0,0}
{0,0,0}
{0,0,0}""")
panel_2 = Panel("""{0,0,0}
{0,0,0}
{0,0,0}
{10,0,0}
{0,10,0}
{0,0,10}
{0,0,0}
{0,0,0}
{0,0,0}
{-10,0,0}
{0,-10,0}
{0,0,-10}""")
bhom = ClusterInput()
bhom_2 = BHoMObject(
    bhom,
    ObjectType="{ \"_t\" : \"System.Type\", \"Name\" : \"System.Object, mscorlib, Version=4.0.0.0, Culture=neutral, PublicKeyToken=b77a5c561934e089\" }",
    m_ForcePreview=False,
    m_MaxItemsPreview=10000)
vec = Vector(panel_2)
vec_2 = Vector(panel)
number_slider = Slider(1000, range=0..1100)
loadcase_name = Text("PointLoad")
loadcase_number = Number("87")
loadcase = Loadcase(
    Name="PointLoad",
    Nature="{ \"_t\" : \"System.Enum\", \"TypeName\" : { \"_t\" : \"System.Type\", \"Name\" : \"BH.oM.Structure.Loads.LoadNature\" }, \"Value\" : \"Other\" }",
    Number="87",
    Component="BH.oM.Structure.Loads.Loadcase")
multiplication = Multiplication(A=vec, B=number_slider)
multiplication_2 = Multiplication(A=vec_2, B=number_slider)
loadcase_name_2 = ClusterOutput(loadcase_name)
loadcase_number_2 = ClusterOutput(loadcase_number)
pointload = PointLoad(
    Loadcase=loadcase,
    Objects=graft(bhom_2),
    Force=graft(multiplication),
    Moment=graft(multiplication_2),
    Axis="{ \"_t\" : \"System.Enum\", \"TypeName\" : { \"_t\" : \"System.Type\", \"Name\" : \"BH.oM.Structure.Loads.LoadAxis\" }, \"Value\" : \"Global\" }",
    Name="PointLoad",
    Component="{ .PointLoad")  # -> flatten(PtLoad)
merge = Merge(Data3=pointload)
R = ClusterOutput(merge)

# ==== cluster ApplyLoads_12
panel = Panel("""{10,0,0}
{0,10,0}
{0,0,10}
{0,0,0}
{0,0,0}
{0,0,0}
{-10,0,0}
{0,-10,0}
{0,0,-10}
{0,0,0}
{0,0,0}
{0,0,0}""")
panel_2 = Panel("""{0,0,0}
{0,0,0}
{0,0,0}
{10,0,0}
{0,10,0}
{0,0,10}
{0,0,0}
{0,0,0}
{0,0,0}
{-10,0,0}
{0,-10,0}
{0,0,-10}""")
bhom = ClusterInput()
bhom_2 = BHoMObject(
    bhom,
    ObjectType="{ \"_t\" : \"System.Type\", \"Name\" : \"System.Object, mscorlib, Version=4.0.0.0, Culture=neutral, PublicKeyToken=b77a5c561934e089\" }",
    m_ForcePreview=False,
    m_MaxItemsPreview=10000)
vec = Vector(panel_2)
vec_2 = Vector(panel)
loadcase_name = Text("PointVelocity")
loadcase_number = Number("88")
loadcase = Loadcase(
    Name="PointVelocity",
    Nature="{ \"_t\" : \"System.Enum\", \"TypeName\" : { \"_t\" : \"System.Type\", \"Name\" : \"BH.oM.Structure.Loads.LoadNature\" }, \"Value\" : \"Other\" }",
    Number="88",
    Component="BH.oM.Structure.Loads.Loadcase")
loadcase_name_2 = ClusterOutput(loadcase_name)
loadcase_number_2 = ClusterOutput(loadcase_number)
pointvelocity = PointVelocity(
    Loadcase=loadcase,
    Objects=graft(bhom_2),
    TranslationalVelocity=graft(vec),
    RotationalVelocity=graft(vec_2),
    Axis="{ \"_t\" : \"System.Enum\", \"TypeName\" : { \"_t\" : \"System.Type\", \"Name\" : \"BH.oM.Structure.Loads.LoadAxis\" }, \"Value\" : \"Global\" }",
    Name="PointVelocity",
    Component="{ .PointVelocity")  # -> flatten(PtVel)
merge = Merge(Data4=pointvelocity)
R = ClusterOutput(merge)

# ==== cluster Cluster_2
panels_as_meshes = ClusterInput()
panels = ClusterInput()
panels_as_meshes_2 = Boolean(panels_as_meshes)
panels_2 = BHoMObject(
    panels,
    ObjectType="{ \"_t\" : \"System.Type\", \"Name\" : \"System.Object, mscorlib, Version=4.0.0.0, Culture=neutral, PublicKeyToken=b77a5c561934e089\" }",
    m_ForcePreview=False,
    m_MaxItemsPreview=10000)
gate = StreamGate(Stream=panels_2, Gate=panels_as_meshes_2)  # -> Target0, Target1
geometry = Geometry(Panel=gate.Target1, Component="{ .Geometry")
getproperty = GetProperty(Obj=panels_2, PropName="Property", Component="{ .GetProperty")
getproperty_2 = GetProperty(Obj=panels_2, PropName="Name", Component="{ .GetProperty")
srf = Surface(geometry)
recomputeedges = RecomputeEdges(Element2D=gate.Target0, Tolerance=1e-06, Component="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")  # -> flatten(Elements)
mesh = MeshBrep(
    Brep=srf,
    Settings={GridMaxCount=0, GridMinCount=16, JaggedSeams=False, MaxEdgeLength=0, MinEdgeLength=0.0001, MinTolerance=0, Refine=True, RefineAngle=0, RelativeTolerance=0.65, SimplePlanes=True, Tolerance=0})
femesh = FEMesh(Mesh=mesh, Property=getproperty, Name=getproperty_2, Component="{ .FEMesh")
filter = StreamFilter(Gate=panels_as_meshes_2, Stream0=recomputeedges, Stream1=femesh)
areaelements = BHoMObject(
    filter,
    ObjectType="{ \"_t\" : \"System.Type\", \"Name\" : \"System.Object, mscorlib, Version=4.0.0.0, Culture=neutral, PublicKeyToken=b77a5c561934e089\" }",
    m_ForcePreview=False,
    m_MaxItemsPreview=10000)
areaelements_2 = ClusterOutput(areaelements)
