# Grasshopper definition BHoM_v3.2.beta_Create_Read_Update_Elements.gh (Grasshopper 1.0.7)
# plug-ins: BH.UI.Grasshopper

# ----
# Input
concrete = Concrete(
    {"C12/15": 0, "C16/20": 1, "C20/25": 2, "C25/30": 3, "C30/37": 4, "C35/45": 5, "C40/50": 6, "C45/55": 7, "C50/60": 8, "C55/67": 9, "C60/75": 10, "C70/85": 11, "C80/95": 12, "C90/105": 13}, selected="C40/50",
    Component="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",
    Selection=6)
concrete_2 = Concrete(
    {"C12/15": 0, "C16/20": 1, "C20/25": 2, "C25/30": 3, "C30/37": 4, "C35/45": 5, "C40/50": 6, "C45/55": 7, "C50/60": 8, "C55/67": 9, "C60/75": 10, "C70/85": 11, "C80/95": 12, "C90/105": 13}, selected="C35/45",
    Component="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",
    Selection=5)
concrete_3 = Concrete(
    {"C12/15": 0, "C16/20": 1, "C20/25": 2, "C25/30": 3, "C30/37": 4, "C35/45": 5, "C40/50": 6, "C45/55": 7, "C50/60": 8, "C55/67": 9, "C60/75": 10, "C70/85": 11, "C80/95": 12, "C90/105": 13}, selected="C25/30",
    Component="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",
    Selection=3)
# Update elements
# Pulls elements from the adapter. Changes the properties of the objects, moves it, and then pushes it again using the UpdateOnly push type.
new_slab_thickness = Slider(0.27, range=0..1)
new_wall_thickness = Slider(0.2, range=0..1)
new_square_column_side_length = Slider(0.33, range=0..1)
translation_x = Slider(3.3, range=0..10)
translation_y = Slider(5.9, range=0..10)
translation_z = Slider(10, range=0..10)
new_wall_and_beam_material = BHoMObject(
    concrete_2,
    ObjectType="{ \"_t\" : \"System.Type\", \"Name\" : \"System.Object, mscorlib, Version=4.0.0.0, Culture=neutral, PublicKeyToken=b77a5c561934e089\" }",
    m_ForcePreview=False,
    m_MaxItemsPreview=10000)
new_column_material = BHoMObject(
    concrete_3,
    ObjectType="{ \"_t\" : \"System.Type\", \"Name\" : \"System.Object, mscorlib, Version=4.0.0.0, Culture=neutral, PublicKeyToken=b77a5c561934e089\" }",
    m_ForcePreview=False,
    m_MaxItemsPreview=10000)
new_slab_material = BHoMObject(
    concrete,
    ObjectType="{ \"_t\" : \"System.Type\", \"Name\" : \"System.Object, mscorlib, Version=4.0.0.0, Culture=neutral, PublicKeyToken=b77a5c561934e089\" }",
    m_ForcePreview=False,
    m_MaxItemsPreview=10000)

# ----
# Input
floors = BHoMObject(
    [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],
    ObjectType="{ \"_t\" : \"System.Type\", \"Name\" : \"System.Object, mscorlib, Version=4.0.0.0, Culture=neutral, PublicKeyToken=b77a5c561934e089\" }",
    m_ForcePreview=False,
    m_MaxItemsPreview=10000)
walls = BHoMObject(
    [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],
    ObjectType="{ \"_t\" : \"System.Type\", \"Name\" : \"System.Object, mscorlib, Version=4.0.0.0, Culture=neutral, PublicKeyToken=b77a5c561934e089\" }",
    m_ForcePreview=False,
    m_MaxItemsPreview=10000)
columns = BHoMObject(
    [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],
    ObjectType="{ \"_t\" : \"System.Type\", \"Name\" : \"System.Object, mscorlib, Version=4.0.0.0, Culture=neutral, PublicKeyToken=b77a5c561934e089\" }",
    m_ForcePreview=False,
    m_MaxItemsPreview=10000)
beams = BHoMObject(
    [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],
    ObjectType="{ \"_t\" : \"System.Type\", \"Name\" : \"System.Object, mscorlib, Version=4.0.0.0, Culture=neutral, PublicKeyToken=b77a5c561934e089\" }",
    m_ForcePreview=False,
    m_MaxItemsPreview=10000)
slab_thickness = Slider(0.2, range=0..1)
wall_thickness = Slider(0.3, range=0..1)
column_diameter = Slider(0.4, range=0..1)
# NOTE: Meshing might not generate meshes fully suitable for FE software.
panels_as_meshes = BooleanToggle(False)

# ----
# Adapter
# Pushes a series of elements representing a building to the structural package.
filepath = Panel("")
# Create element
# BHoM Version: 3.2β
list = ValueList({"Robot": 0, "ETABS17": 1, "ETABS2016": 2, "SAP2000": 3, "GSA": 4, "Lusas18": 5, "Lusas17": 6, "MidasCivil": 7, "RAM": 8, "RFEM": 9}, selected="Robot")
cluster = Cluster(selectedadapter=list, S=Toggle(False), filepath=filepath)  # -> s_0, adapteridname
adapteridname = Text(cluster.adapteridname)
adapter = BHoMAdapter(
    cluster.s_0,
    ObjectType="{ \"_t\" : \"System.Type\", \"Name\" : \"System.Object, mscorlib, Version=4.0.0.0, Culture=neutral, PublicKeyToken=b77a5c561934e089\" }",
    m_ForcePreview=False,
    m_MaxItemsPreview=10000)

# ----
# Set up model
# Set FEMesh or Panel
panels_as_meshes_2 = Boolean(panels_as_meshes)
walls_2 = BHoMObject(
    walls,
    ObjectType="{ \"_t\" : \"System.Type\", \"Name\" : \"System.Object, mscorlib, Version=4.0.0.0, Culture=neutral, PublicKeyToken=b77a5c561934e089\" }",
    m_ForcePreview=False,
    m_MaxItemsPreview=10000)
floors_2 = BHoMObject(
    floors,
    ObjectType="{ \"_t\" : \"System.Type\", \"Name\" : \"System.Object, mscorlib, Version=4.0.0.0, Culture=neutral, PublicKeyToken=b77a5c561934e089\" }",
    m_ForcePreview=False,
    m_MaxItemsPreview=10000)
panels_as_meshes_3 = Boolean(panels_as_meshes)
cluster_2 = Cluster_2(panels_as_meshes=panels_as_meshes_2, panels=floors_2)
cluster_3 = Cluster_2(panels_as_meshes=panels_as_meshes_3, panels=walls_2)
floors_3 = BHoMObject(
    cluster_2,
    ObjectType="{ \"_t\" : \"System.Type\", \"Name\" : \"System.Object, mscorlib, Version=4.0.0.0, Culture=neutral, PublicKeyToken=b77a5c561934e089\" }",
    m_ForcePreview=False,
    m_MaxItemsPreview=10000)
walls_3 = BHoMObject(
    cluster_3,
    ObjectType="{ \"_t\" : \"System.Type\", \"Name\" : \"System.Object, mscorlib, Version=4.0.0.0, Culture=neutral, PublicKeyToken=b77a5c561934e089\" }",
    m_ForcePreview=False,
    m_MaxItemsPreview=10000)

# ----
# Set slab and wall thickness properties
wall_thickness_2 = Number(wall_thickness)
floors_4 = BHoMObject(
    floors_3,
    ObjectType="{ \"_t\" : \"System.Type\", \"Name\" : \"System.Object, mscorlib, Version=4.0.0.0, Culture=neutral, PublicKeyToken=b77a5c561934e089\" }",
    m_ForcePreview=False,
    m_MaxItemsPreview=10000)
slab_thickness_2 = Number(slab_thickness)
walls_4 = BHoMObject(
    walls_3,
    ObjectType="{ \"_t\" : \"System.Type\", \"Name\" : \"System.Object, mscorlib, Version=4.0.0.0, Culture=neutral, PublicKeyToken=b77a5c561934e089\" }",
    m_ForcePreview=False,
    m_MaxItemsPreview=10000)
cluster_4 = Cluster_5(obj=floors_4, thickness=slab_thickness_2)
cluster_5 = Cluster_5(obj=walls_4, thickness=wall_thickness_2)
walls_5 = BHoMObject(
    cluster_5,
    ObjectType="{ \"_t\" : \"System.Type\", \"Name\" : \"System.Object, mscorlib, Version=4.0.0.0, Culture=neutral, PublicKeyToken=b77a5c561934e089\" }",
    m_ForcePreview=False,
    m_MaxItemsPreview=10000)
floors_5 = BHoMObject(
    cluster_4,
    ObjectType="{ \"_t\" : \"System.Type\", \"Name\" : \"System.Object, mscorlib, Version=4.0.0.0, Culture=neutral, PublicKeyToken=b77a5c561934e089\" }",
    m_ForcePreview=False,
    m_MaxItemsPreview=10000)

# ----
# Set column and beam properties
column_diameter_2 = Number(column_diameter)
beams_2 = BHoMObject(
    beams,
    ObjectType="{ \"_t\" : \"System.Type\", \"Name\" : \"System.Object, mscorlib, Version=4.0.0.0, Culture=neutral, PublicKeyToken=b77a5c561934e089\" }",
    m_ForcePreview=False,
    m_MaxItemsPreview=10000)
columns_2 = BHoMObject(
    columns,
    ObjectType="{ \"_t\" : \"System.Type\", \"Name\" : \"System.Object, mscorlib, Version=4.0.0.0, Culture=neutral, PublicKeyToken=b77a5c561934e089\" }",
    m_ForcePreview=False,
    m_MaxItemsPreview=10000)
wall_thickness_3 = Number(wall_thickness)
cluster_6 = Cluster_7(obj=columns_2, column_diameter=column_diameter_2)
cluster_7 = Cluster_3(beams=beams_2, wall_thickness=wall_thickness_3)
columns_3 = BHoMObject(
    cluster_6,
    ObjectType="{ \"_t\" : \"System.Type\", \"Name\" : \"System.Object, mscorlib, Version=4.0.0.0, Culture=neutral, PublicKeyToken=b77a5c561934e089\" }",
    m_ForcePreview=False,
    m_MaxItemsPreview=10000)
beams_3 = BHoMObject(
    cluster_7,
    ObjectType="{ \"_t\" : \"System.Type\", \"Name\" : \"System.Object, mscorlib, Version=4.0.0.0, Culture=neutral, PublicKeyToken=b77a5c561934e089\" }",
    m_ForcePreview=False,
    m_MaxItemsPreview=10000)

# ----
# Visualize beam and column sections
columns_4 = BHoMObject(
    columns_3,
    ObjectType="{ \"_t\" : \"System.Type\", \"Name\" : \"System.Object, mscorlib, Version=4.0.0.0, Culture=neutral, PublicKeyToken=b77a5c561934e089\" }",
    m_ForcePreview=False,
    m_MaxItemsPreview=10000)
beams_4 = BHoMObject(
    beams_3,
    ObjectType="{ \"_t\" : \"System.Type\", \"Name\" : \"System.Object, mscorlib, Version=4.0.0.0, Culture=neutral, PublicKeyToken=b77a5c561934e089\" }",
    m_ForcePreview=False,
    m_MaxItemsPreview=10000)
cluster_8 = Cluster_8(bar=[columns_4, beams_4])

# ----
# Pull from analysis package
# Pull Panels or FEMeshes
panels_as_meshes_4 = Boolean(panels_as_meshes)
cluster_9 = Cluster_9(panels_as_meshes=panels_as_meshes_4)
adapter_2 = BHoMAdapter(
    adapter,
    ObjectType="{ \"_t\" : \"System.Type\", \"Name\" : \"System.Object, mscorlib, Version=4.0.0.0, Culture=neutral, PublicKeyToken=b77a5c561934e089\" }",
    m_ForcePreview=False,
    m_MaxItemsPreview=10000)
pull = Pull(
    Adapter=adapter_2,
    Request=cluster_9,
    PullType="{ \"_t\" : \"System.Enum\", \"TypeName\" : { \"_t\" : \"System.Type\", \"Name\" : \"BH.oM.Adapter.PullType\" }, \"Value\" : \"AdapterDefault\" }",
    Active=Toggle(False),
    Component="{ .Pull")

# ----
# Pull Bars
createtype = CreateType(Component="BH.oM.Structure.Elements.Bar")
filterrequest = FilterRequest(Type=createtype, Component="{ .FilterRequest")
adapter_3 = BHoMAdapter(
    adapter,
    ObjectType="{ \"_t\" : \"System.Type\", \"Name\" : \"System.Object, mscorlib, Version=4.0.0.0, Culture=neutral, PublicKeyToken=b77a5c561934e089\" }",
    m_ForcePreview=False,
    m_MaxItemsPreview=10000)
pull_2 = Pull(
    Adapter=adapter_3,
    Request=filterrequest,
    PullType="{ \"_t\" : \"System.Enum\", \"TypeName\" : { \"_t\" : \"System.Type\", \"Name\" : \"BH.oM.Adapter.PullType\" }, \"Value\" : \"AdapterDefault\" }",
    Active=Toggle(False),
    Component="{ .Pull")

# ----
# Push to analysis package
floors_6 = BHoMObject(
    floors_5,
    ObjectType="{ \"_t\" : \"System.Type\", \"Name\" : \"System.Object, mscorlib, Version=4.0.0.0, Culture=neutral, PublicKeyToken=b77a5c561934e089\" }",
    m_ForcePreview=False,
    m_MaxItemsPreview=10000)
columns_5 = BHoMObject(
    columns_3,
    ObjectType="{ \"_t\" : \"System.Type\", \"Name\" : \"System.Object, mscorlib, Version=4.0.0.0, Culture=neutral, PublicKeyToken=b77a5c561934e089\" }",
    m_ForcePreview=False,
    m_MaxItemsPreview=10000)
walls_6 = BHoMObject(
    walls_5,
    ObjectType="{ \"_t\" : \"System.Type\", \"Name\" : \"System.Object, mscorlib, Version=4.0.0.0, Culture=neutral, PublicKeyToken=b77a5c561934e089\" }",
    m_ForcePreview=False,
    m_MaxItemsPreview=10000)
beams_5 = BHoMObject(
    beams_3,
    ObjectType="{ \"_t\" : \"System.Type\", \"Name\" : \"System.Object, mscorlib, Version=4.0.0.0, Culture=neutral, PublicKeyToken=b77a5c561934e089\" }",
    m_ForcePreview=False,
    m_MaxItemsPreview=10000)
merge = Merge(Data1=floors_6, Data2=walls_6, Data3=columns_5, Data4=beams_5)
adapter_4 = BHoMAdapter(
    adapter,
    ObjectType="{ \"_t\" : \"System.Type\", \"Name\" : \"System.Object, mscorlib, Version=4.0.0.0, Culture=neutral, PublicKeyToken=b77a5c561934e089\" }",
    m_ForcePreview=False,
    m_MaxItemsPreview=10000)
push = Push(
    Adapter=adapter_4,
    Objects=flatten(merge),
    PushType="{ \"_t\" : \"System.Enum\", \"TypeName\" : { \"_t\" : \"System.Type\", \"Name\" : \"BH.oM.Adapter.PushType\" }, \"Value\" : \"AdapterDefault\" }",
    Active=Toggle(False),
    Component="{ .Push")  # -> Objects, Success

# ----
# Update the elements
# Filter elements
panels_as_meshes_5 = Boolean(panels_as_meshes)
area_elements = BHoMObject(
    pull,
    ObjectType="{ \"_t\" : \"System.Type\", \"Name\" : \"System.Object, mscorlib, Version=4.0.0.0, Culture=neutral, PublicKeyToken=b77a5c561934e089\" }",
    m_ForcePreview=False,
    m_MaxItemsPreview=10000)
bars = BHoMObject(
    pull_2,
    ObjectType="{ \"_t\" : \"System.Type\", \"Name\" : \"System.Object, mscorlib, Version=4.0.0.0, Culture=neutral, PublicKeyToken=b77a5c561934e089\" }",
    m_ForcePreview=False,
    m_MaxItemsPreview=10000)
filter_floors_and_walls = FilterFloorsAndWalls(panels_as_meshes=panels_as_meshes_5, area_elements=area_elements)  # -> floors_2, walls_2
filter_beams_and_columns = FilterBeamsAndColumns(bars=bars)  # -> columns_2, beams_2

# ----
# Set slab and wall thickness properties
floors_7 = BHoMObject(
    filter_floors_and_walls.floors_2,
    ObjectType="{ \"_t\" : \"System.Type\", \"Name\" : \"System.Object, mscorlib, Version=4.0.0.0, Culture=neutral, PublicKeyToken=b77a5c561934e089\" }",
    m_ForcePreview=False,
    m_MaxItemsPreview=10000)
new_slab_thickness_2 = Number(new_slab_thickness)
new_slab_material_2 = BHoMObject(
    new_slab_material,
    ObjectType="{ \"_t\" : \"System.Type\", \"Name\" : \"System.Object, mscorlib, Version=4.0.0.0, Culture=neutral, PublicKeyToken=b77a5c561934e089\" }",
    m_ForcePreview=False,
    m_MaxItemsPreview=10000)
walls_7 = BHoMObject(
    filter_floors_and_walls.walls_2,
    ObjectType="{ \"_t\" : \"System.Type\", \"Name\" : \"System.Object, mscorlib, Version=4.0.0.0, Culture=neutral, PublicKeyToken=b77a5c561934e089\" }",
    m_ForcePreview=False,
    m_MaxItemsPreview=10000)
new_wall_thickness_2 = Number(new_wall_thickness)
new_wall_and_beam_material_2 = BHoMObject(
    new_wall_and_beam_material,
    ObjectType="{ \"_t\" : \"System.Type\", \"Name\" : \"System.Object, mscorlib, Version=4.0.0.0, Culture=neutral, PublicKeyToken=b77a5c561934e089\" }",
    m_ForcePreview=False,
    m_MaxItemsPreview=10000)
cluster_10 = Cluster_11(obj=floors_7, slab_thickness=new_slab_thickness_2, material=new_slab_material_2)
cluster_11 = Cluster_11(obj=walls_7, slab_thickness=new_wall_thickness_2, material=new_wall_and_beam_material_2)
walls_8 = BHoMObject(
    cluster_11,
    ObjectType="{ \"_t\" : \"System.Type\", \"Name\" : \"System.Object, mscorlib, Version=4.0.0.0, Culture=neutral, PublicKeyToken=b77a5c561934e089\" }",
    m_ForcePreview=False,
    m_MaxItemsPreview=10000)
floors_8 = BHoMObject(
    cluster_10,
    ObjectType="{ \"_t\" : \"System.Type\", \"Name\" : \"System.Object, mscorlib, Version=4.0.0.0, Culture=neutral, PublicKeyToken=b77a5c561934e089\" }",
    m_ForcePreview=False,
    m_MaxItemsPreview=10000)

# ----
# Set column and beam properties
square_column_side_length = Number(new_square_column_side_length)
new_wall_thickness_3 = Number(new_wall_thickness)
new_column_material_2 = BHoMObject(
    new_column_material,
    ObjectType="{ \"_t\" : \"System.Type\", \"Name\" : \"System.Object, mscorlib, Version=4.0.0.0, Culture=neutral, PublicKeyToken=b77a5c561934e089\" }",
    m_ForcePreview=False,
    m_MaxItemsPreview=10000)
new_wall_and_beam_material_3 = BHoMObject(
    concrete_2,
    ObjectType="{ \"_t\" : \"System.Type\", \"Name\" : \"System.Object, mscorlib, Version=4.0.0.0, Culture=neutral, PublicKeyToken=b77a5c561934e089\" }",
    m_ForcePreview=False,
    m_MaxItemsPreview=10000)
columns_6 = BHoMObject(
    filter_beams_and_columns.columns_2,
    ObjectType="{ \"_t\" : \"System.Type\", \"Name\" : \"System.Object, mscorlib, Version=4.0.0.0, Culture=neutral, PublicKeyToken=b77a5c561934e089\" }",
    m_ForcePreview=False,
    m_MaxItemsPreview=10000)
beams_6 = BHoMObject(
    filter_beams_and_columns.beams_2,
    ObjectType="{ \"_t\" : \"System.Type\", \"Name\" : \"System.Object, mscorlib, Version=4.0.0.0, Culture=neutral, PublicKeyToken=b77a5c561934e089\" }",
    m_ForcePreview=False,
    m_MaxItemsPreview=10000)
cluster_12 = Cluster_12(obj=columns_6, column_side_length=square_column_side_length, material=new_column_material_2)
cluster_13 = Cluster_10(beams=beams_6, wall_thickness=new_wall_thickness_3, material=new_wall_and_beam_material_3)
columns_7 = BHoMObject(
    cluster_12,
    ObjectType="{ \"_t\" : \"System.Type\", \"Name\" : \"System.Object, mscorlib, Version=4.0.0.0, Culture=neutral, PublicKeyToken=b77a5c561934e089\" }",
    m_ForcePreview=False,
    m_MaxItemsPreview=10000)
beams_7 = BHoMObject(
    cluster_13,
    ObjectType="{ \"_t\" : \"System.Type\", \"Name\" : \"System.Object, mscorlib, Version=4.0.0.0, Culture=neutral, PublicKeyToken=b77a5c561934e089\" }",
    m_ForcePreview=False,
    m_MaxItemsPreview=10000)

# ----
# Move the model
translation_x_2 = Number(translation_x)
translation_y_2 = Number(translation_y)
translation_z_2 = Number(translation_z)
vec = VectorXYZ(XComponent=translation_x_2, YComponent=translation_y_2, ZComponent=translation_z_2)  # -> Vector, Length
translation_vector = Vector(vec.Vector)
translation_vector_2 = Vector(vec.Vector)
translation_vector_3 = Vector(vec.Vector)
panels_as_meshes_6 = Boolean(panels_as_meshes)
translation_vector_4 = Vector(vec.Vector)
panels_as_meshes_7 = Boolean(panels_as_meshes)
columns_8 = BHoMObject(
    cluster_12,
    ObjectType="{ \"_t\" : \"System.Type\", \"Name\" : \"System.Object, mscorlib, Version=4.0.0.0, Culture=neutral, PublicKeyToken=b77a5c561934e089\" }",
    m_ForcePreview=False,
    m_MaxItemsPreview=10000)
floors_9 = BHoMObject(
    floors_8,
    ObjectType="{ \"_t\" : \"System.Type\", \"Name\" : \"System.Object, mscorlib, Version=4.0.0.0, Culture=neutral, PublicKeyToken=b77a5c561934e089\" }",
    m_ForcePreview=False,
    m_MaxItemsPreview=10000)
beams_8 = BHoMObject(
    beams_7,
    ObjectType="{ \"_t\" : \"System.Type\", \"Name\" : \"System.Object, mscorlib, Version=4.0.0.0, Culture=neutral, PublicKeyToken=b77a5c561934e089\" }",
    m_ForcePreview=False,
    m_MaxItemsPreview=10000)
walls_9 = BHoMObject(
    walls_8,
    ObjectType="{ \"_t\" : \"System.Type\", \"Name\" : \"System.Object, mscorlib, Version=4.0.0.0, Culture=neutral, PublicKeyToken=b77a5c561934e089\" }",
    m_ForcePreview=False,
    m_MaxItemsPreview=10000)
cluster_14 = Cluster_13(panels_as_meshes=panels_as_meshes_6, area_elements=floors_9, translation_vector=translation_vector_3)
cluster_15 = Cluster_13(panels_as_meshes=panels_as_meshes_7, area_elements=walls_9, translation_vector=translation_vector_4)
translate = Translate(Element1D=beams_8, Transform=translation_vector, Component="{ .Translate")
translate_2 = Translate(Element1D=columns_8, Transform=translation_vector_2, Component="{ .Translate")
columns_9 = BHoMObject(
    translate_2,
    ObjectType="{ \"_t\" : \"System.Type\", \"Name\" : \"System.Object, mscorlib, Version=4.0.0.0, Culture=neutral, PublicKeyToken=b77a5c561934e089\" }",
    m_ForcePreview=False,
    m_MaxItemsPreview=10000)
floors_10 = BHoMObject(
    cluster_14,
    ObjectType="{ \"_t\" : \"System.Type\", \"Name\" : \"System.Object, mscorlib, Version=4.0.0.0, Culture=neutral, PublicKeyToken=b77a5c561934e089\" }",
    m_ForcePreview=False,
    m_MaxItemsPreview=10000)
walls_10 = BHoMObject(
    cluster_15,
    ObjectType="{ \"_t\" : \"System.Type\", \"Name\" : \"System.Object, mscorlib, Version=4.0.0.0, Culture=neutral, PublicKeyToken=b77a5c561934e089\" }",
    m_ForcePreview=False,
    m_MaxItemsPreview=10000)
beams_9 = BHoMObject(
    translate,
    ObjectType="{ \"_t\" : \"System.Type\", \"Name\" : \"System.Object, mscorlib, Version=4.0.0.0, Culture=neutral, PublicKeyToken=b77a5c561934e089\" }",
    m_ForcePreview=False,
    m_MaxItemsPreview=10000)

# ----
# Visualize beam and column sections
columns_10 = BHoMObject(
    columns_9,
    ObjectType="{ \"_t\" : \"System.Type\", \"Name\" : \"System.Object, mscorlib, Version=4.0.0.0, Culture=neutral, PublicKeyToken=b77a5c561934e089\" }",
    m_ForcePreview=False,
    m_MaxItemsPreview=10000)
beams_10 = BHoMObject(
    beams_9,
    ObjectType="{ \"_t\" : \"System.Type\", \"Name\" : \"System.Object, mscorlib, Version=4.0.0.0, Culture=neutral, PublicKeyToken=b77a5c561934e089\" }",
    m_ForcePreview=False,
    m_MaxItemsPreview=10000)
cluster_16 = Cluster_8(bar=[columns_10, beams_10])

# ----
# Extract the nodes
panels_as_meshes_8 = Boolean(panels_as_meshes)
floors_11 = BHoMObject(
    floors_10,
    ObjectType="{ \"_t\" : \"System.Type\", \"Name\" : \"System.Object, mscorlib, Version=4.0.0.0, Culture=neutral, PublicKeyToken=b77a5c561934e089\" }",
    m_ForcePreview=False,
    m_MaxItemsPreview=10000)
walls_11 = BHoMObject(
    walls_10,
    ObjectType="{ \"_t\" : \"System.Type\", \"Name\" : \"System.Object, mscorlib, Version=4.0.0.0, Culture=neutral, PublicKeyToken=b77a5c561934e089\" }",
    m_ForcePreview=False,
    m_MaxItemsPreview=10000)
extract_nodes = ExtractNodes(panels_as_meshes=panels_as_meshes_8, floors=floors_11, walls=walls_11, columns=columns_9, beams=beams_9)

# ----
# Push Update to analysis package
walls_12 = BHoMObject(
    walls_10,
    ObjectType="{ \"_t\" : \"System.Type\", \"Name\" : \"System.Object, mscorlib, Version=4.0.0.0, Culture=neutral, PublicKeyToken=b77a5c561934e089\" }",
    m_ForcePreview=False,
    m_MaxItemsPreview=10000)
columns_11 = BHoMObject(
    columns_9,
    ObjectType="{ \"_t\" : \"System.Type\", \"Name\" : \"System.Object, mscorlib, Version=4.0.0.0, Culture=neutral, PublicKeyToken=b77a5c561934e089\" }",
    m_ForcePreview=False,
    m_MaxItemsPreview=10000)
floors_12 = BHoMObject(
    floors_10,
    ObjectType="{ \"_t\" : \"System.Type\", \"Name\" : \"System.Object, mscorlib, Version=4.0.0.0, Culture=neutral, PublicKeyToken=b77a5c561934e089\" }",
    m_ForcePreview=False,
    m_MaxItemsPreview=10000)
beams_11 = BHoMObject(
    beams_9,
    ObjectType="{ \"_t\" : \"System.Type\", \"Name\" : \"System.Object, mscorlib, Version=4.0.0.0, Culture=neutral, PublicKeyToken=b77a5c561934e089\" }",
    m_ForcePreview=False,
    m_MaxItemsPreview=10000)
nodes = BHoMObject(
    extract_nodes,
    ObjectType="{ \"_t\" : \"System.Type\", \"Name\" : \"System.Object, mscorlib, Version=4.0.0.0, Culture=neutral, PublicKeyToken=b77a5c561934e089\" }",
    m_ForcePreview=False,
    m_MaxItemsPreview=10000)
merge_2 = Merge(
    Data1=flatten(nodes),
    Data2=flatten(floors_12),
    Data3=flatten(walls_12),
    Data4=flatten(columns_11),
    Data5=flatten(beams_11))
pushtype = PushType(
    {"FullPush": 0, "CreateOnly": 1, "CreateNonExisting": 2, "UpdateOnly": 3, "DeleteThenCreate": 4, "AdapterDefault": 5}, selected="UpdateOnly",
    Component="BH.oM.Adapter.PushType",
    Selection=3)
adapter_5 = BHoMAdapter(
    adapter,
    ObjectType="{ \"_t\" : \"System.Type\", \"Name\" : \"System.Object, mscorlib, Version=4.0.0.0, Culture=neutral, PublicKeyToken=b77a5c561934e089\" }",
    m_ForcePreview=False,
    m_MaxItemsPreview=10000)
push_2 = Push(Adapter=adapter_5, Objects=flatten(merge_2), PushType=pushtype, Active=Toggle(False), Component="{ .Push")  # -> Objects, Success

# ==== cluster Cluster
filepath = ClusterInput()
selectedadapter = ClusterInput()
S = ClusterInput()
selectedadapter_2 = Integer(selectedadapter)
filepath_2 = Text(filepath)
gate = StreamGate(Stream=S, Gate=selectedadapter_2)  # -> Target0, Target1, Target2, Target3, Target4, Target5, Target6, Target7, Target8, Target9
gate_2 = StreamGate(Stream=filepath_2, Gate=selectedadapter_2)  # -> Target0, Target1, Target2, Target3, Target4, Target5, Target6, Target7, Target8, Target9
rfemadapter = RFEMAdapter(FilePath=gate_2.Target9, Active=gate.Target9, Component="{ ..ctor")
lusasv17adapter = LusasV17Adapter(FilePath=gate_2.Target6, Active=gate.Target6, Component="{ ..ctor")
etabs17adapter = ETABS17Adapter(FilePath=gate_2.Target1, Active=gate.Target1, Component="{ ..ctor")
etabs2016adapter = ETABS2016Adapter(FilePath=gate_2.Target2, Active=gate.Target2, Component="{ ..ctor")
lusasv18adapter = LusasV18Adapter(FilePath=gate_2.Target5, Active=gate.Target5, Component="{ ..ctor")
# Adapter
robotadapter = RobotAdapter(FilePath=gate_2.Target0, Active=gate.Target0, Component="{ ..ctor")
gsaadapter = GSAAdapter(FilePath=gate_2.Target4, Active=gate.Target4, Component="{ ..ctor")
midasciviladapter = MidasCivilAdapter(FilePath=gate_2.Target7, Active=gate.Target7, Component="{ ..ctor")
ramadapter = RAMAdapter(FilePath=gate_2.Target8, Active=gate.Target8, Component="{ ..ctor")
sap2000adapter = SAP2000Adapter(FilePath=gate_2.Target3, Active=gate.Target3, Component="{ ..ctor")
filter = StreamFilter(
    Gate=selectedadapter_2,
    Stream0=robotadapter,
    Stream1=etabs17adapter,
    Stream2=etabs2016adapter,
    Stream3=sap2000adapter,
    Stream4=gsaadapter,
    Stream5=lusasv18adapter,
    Stream6=lusasv17adapter,
    Stream7=midasciviladapter,
    Stream8=ramadapter,
    Stream9=rfemadapter)
getproperty = GetProperty(Obj=filter, PropName="AdapterIdName", Component="{ .GetProperty")
s_0 = ClusterOutput(filter)
txt = Text(getproperty)
adapteridname = ClusterOutput(txt)

# ==== cluster Cluster_2
panels_as_meshes = ClusterInput()
panels = ClusterInput()
panels_as_meshes_2 = Boolean(panels_as_meshes)
panels_2 = BHoMObject(
    panels,
    ObjectType="{ \"_t\" : \"System.Type\", \"Name\" : \"System.Object, mscorlib, Version=4.0.0.0, Culture=neutral, PublicKeyToken=b77a5c561934e089\" }",
    m_ForcePreview=False,
    m_MaxItemsPreview=10000)
gate = StreamGate(Stream=panels_2, Gate=panels_as_meshes_2)  # -> Target0, Target1
geometry = Geometry(Panel=gate.Target1, Component="{ .Geometry")
getproperty = GetProperty(Obj=panels_2, PropName="Property", Component="{ .GetProperty")
getproperty_2 = GetProperty(Obj=panels_2, PropName="Name", Component="{ .GetProperty")
srf = Surface(geometry)
mesh = MeshBrep(
    Brep=srf,
    Settings={GridMaxCount=0, GridMinCount=16, JaggedSeams=False, MaxEdgeLength=0, MinEdgeLength=0.0001, MinTolerance=0, Refine=True, RefineAngle=0, RelativeTolerance=0.65, SimplePlanes=True, Tolerance=0})
femesh = FEMesh(Mesh=mesh, Property=getproperty, Name=getproperty_2, Component="{ .FEMesh")
filter = StreamFilter(Gate=panels_as_meshes_2, Stream0=gate.Target0, Stream1=femesh)
areaelements = BHoMObject(
    filter,
    ObjectType="{ \"_t\" : \"System.Type\", \"Name\" : \"System.Object, mscorlib, Version=4.0.0.0, Culture=neutral, PublicKeyToken=b77a5c561934e089\" }",
    m_ForcePreview=False,
    m_MaxItemsPreview=10000)
areaelements_2 = ClusterOutput(areaelements)

# ==== cluster Cluster_3
wall_thickness = ClusterInput()
beams = ClusterInput()
wall_thickness_2 = Number(wall_thickness)
beams_2 = BHoMObject(
    beams,
    ObjectType="{ \"_t\" : \"System.Type\", \"Name\" : \"System.Object, mscorlib, Version=4.0.0.0, Culture=neutral, PublicKeyToken=b77a5c561934e089\" }",
    m_ForcePreview=False,
    m_MaxItemsPreview=10000)
getproperty = GetProperty(Obj=beams_2, PropName="SectionProperty.Material", Component="{ .GetProperty")
getproperty_2 = GetProperty(Obj=beams_2, PropName="SectionProperty.SectionProfile.Height", Component="{ .GetProperty")
multiplication = Multiplication(A=wall_thickness_2, B="1000")
multiplication_2 = Multiplication(A=getproperty_2, B="1000")
int = Integer(multiplication_2)
int_2 = Integer(multiplication)
concat = Concatenate(FragmentA="R ", FragmentB=int, FragmentC="x", FragmentD=int_2)
concreterectanglesection = ConcreteRectangleSection(
    Height=getproperty_2,
    Width=wall_thickness_2,
    Material=getproperty,
    Name=concat,
    MinimumCover=0,
    Component="{ .ConcreteRectangleSection")
setproperty = SetProperty(Obj=beams_2, PropName="SectionProperty", Value=concreterectanglesection, Component="{ .PropertyValue")
result = ClusterOutput(setproperty)

# ==== cluster Cluster_5
thickness = ClusterInput()
cluster = Cluster_4(slab_thickness=thickness)
obj = ClusterInput()
setproperty = SetProperty(Obj=obj, PropName="Property", Value=cluster, Component="{ .PropertyValue")
result = ClusterOutput(setproperty)

# ==== cluster Cluster_7
column_diameter = ClusterInput()
cluster = Cluster_6(column_diameter=column_diameter)
obj = ClusterInput()
setproperty = SetProperty(Obj=obj, PropName="SectionProperty", Value=cluster, Component="{ .PropertyValue")
result = ClusterOutput(setproperty)

# ==== cluster Cluster_8
bar = ClusterInput()
extrude = Extrude(Bar=bar, Simple=False, Component="{ .Extrude")
explode = Explode(Object=extrude, Component="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")  # -> Curve, Direction, Capped
crv = Curve(explode.Curve)
extr = Extrude(Base=crv, Direction=explode.Direction)

# ==== cluster Cluster_9
panels_as_meshes = ClusterInput()
panels_as_meshes_2 = Boolean(panels_as_meshes)
createtype = CreateType(Component="BH.oM.Structure.Elements.FEMesh")
createtype_2 = CreateType(Component="BH.oM.Structure.Elements.Panel")
filter = StreamFilter(Gate=panels_as_meshes_2, Stream0=createtype_2, Stream1=createtype)
filterrequest = FilterRequest(Type=filter, Component="{ .FilterRequest")
request = ClusterOutput(filterrequest)

# ==== cluster Cluster_10
wall_thickness = ClusterInput()
beams = ClusterInput()
material = ClusterInput()
wall_thickness_2 = Number(wall_thickness)
beams_2 = BHoMObject(
    beams,
    ObjectType="{ \"_t\" : \"System.Type\", \"Name\" : \"System.Object, mscorlib, Version=4.0.0.0, Culture=neutral, PublicKeyToken=b77a5c561934e089\" }",
    m_ForcePreview=False,
    m_MaxItemsPreview=10000)
getproperty = GetProperty(Obj=beams_2, PropName="SectionProperty.SectionProfile.Height", Component="{ .GetProperty")
multiplication = Multiplication(A=wall_thickness_2, B="1000")
multiplication_2 = Multiplication(A=getproperty, B="1000")
int = Integer(multiplication_2)
int_2 = Integer(multiplication)
concat = Concatenate(FragmentA="R ", FragmentB=int, FragmentC="x", FragmentD=int_2)
concreterectanglesection = ConcreteRectangleSection(
    Height=getproperty,
    Width=wall_thickness_2,
    Material=material,
    Name=concat,
    MinimumCover=0,
    Component="{ .ConcreteRectangleSection")
setproperty = SetProperty(Obj=beams_2, PropName="SectionProperty", Value=concreterectanglesection, Component="{ .PropertyValue")
result = ClusterOutput(setproperty)

# ==== cluster Cluster_11
slab_thickness = ClusterInput()
material = ClusterInput()
obj = ClusterInput()

# ---- group: Create new thickness proeprty
slab_thickness_2 = Number(slab_thickness)
multiplication = Multiplication(A=slab_thickness_2, B=1000)
int = Integer(multiplication)
concat = Concatenate(FragmentA="THK ", FragmentB=int)
constantthickness = ConstantThickness(
    Name=concat,
    Thickness=slab_thickness_2,
    Material=material,
    PanelType="{ \"_t\" : \"System.Enum\", \"TypeName\" : { \"_t\" : \"System.Type\", \"Name\" : \"BH.oM.Structure.SurfaceProperties.PanelType\" }, \"Value\" : \"Slab\" }",
    Component="BH.oM.Structure.SurfaceProperties.ConstantThickness")

# ---- group: Update the elements
setproperty = SetProperty(Obj=obj, PropName="Property", Value=constantthickness, Component="{ .PropertyValue")

# ----
result = ClusterOutput(setproperty)

# ==== cluster Cluster_12
column_side_length = ClusterInput()
obj = ClusterInput()
material = ClusterInput()

# ---- group: Create new section
column_side_length_2 = Number(column_side_length)
multiplication = Multiplication(A=column_side_length_2, B=1000)
int = Integer(multiplication)
concat = Concatenate(FragmentA="R ", FragmentB=int, FragmentC="x", FragmentD=int)
concreterectanglesection = ConcreteRectangleSection(
    Height=column_side_length_2,
    Width=column_side_length_2,
    Material=material,
    Name=concat,
    MinimumCover=0,
    Component="{ .ConcreteRectangleSection")

# ---- group: Update elements
setproperty = SetProperty(Obj=obj, PropName="SectionProperty", Value=concreterectanglesection, Component="{ .PropertyValue")

# ----
result = ClusterOutput(setproperty)

# ==== cluster FilterFloorsAndWalls
area_elements = ClusterInput()
panels_as_meshes = ClusterInput()
area_elements_2 = BHoMObject(
    area_elements,
    ObjectType="{ \"_t\" : \"System.Type\", \"Name\" : \"System.Object, mscorlib, Version=4.0.0.0, Culture=neutral, PublicKeyToken=b77a5c561934e089\" }",
    m_ForcePreview=False,
    m_MaxItemsPreview=10000)
panels_as_meshes_2 = Boolean(panels_as_meshes)
gate = StreamGate(Stream=area_elements_2, Gate=panels_as_meshes_2)  # -> Target0, Target1

# ---- group: Filter panels
panels = BHoMObject(
    gate.Target0,
    ObjectType="{ \"_t\" : \"System.Type\", \"Name\" : \"System.Object, mscorlib, Version=4.0.0.0, Culture=neutral, PublicKeyToken=b77a5c561934e089\" }",
    m_ForcePreview=False,
    m_MaxItemsPreview=10000)
normal = Normal(Element2D=panels, Component="{ .Normal")
Z = UnitZ(Factor=1)
isparallel = IsParallel(V1=normal, V2=Z, AngleTolerance=1e-06, Component="{ .IsParallel")
equals = Equality(FirstNumber=isparallel, SecondNumber=Slider(0, range=0..100))  # -> Equality, Inequality
cull = CullPattern(List=panels, CullPattern=equals.Inequality)
cull_2 = CullPattern(List=panels, CullPattern=equals.Equality)

# ---- group: Filter FEMeshes
femeshes = BHoMObject(
    gate.Target1,
    ObjectType="{ \"_t\" : \"System.Type\", \"Name\" : \"System.Object, mscorlib, Version=4.0.0.0, Culture=neutral, PublicKeyToken=b77a5c561934e089\" }",
    m_ForcePreview=False,
    m_MaxItemsPreview=10000)
explode = Explode(Object=femeshes, Component="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")  # -> simplify(Nodes), Faces, Property, BHoM_Guid, Name, Fragments, Tags, CustomData
explode_2 = Explode(Object=explode.Nodes, Component="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")  # -> Position, Orientation, Support, BHoM_Guid, Name, Fragments, Tags, CustomData
fitplane = FitPlane(Points=explode_2.Position, Tolerance=1e-06, Component="{ .FitPlane")
explode_3 = Explode(Object=fitplane, Component="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")  # -> Origin, flatten(Normal)
Z_2 = UnitZ(Factor=1)
isparallel_2 = IsParallel(V1=explode_3.Normal, V2=Z_2, AngleTolerance=1e-06, Component="{ .IsParallel")
equals_2 = Equality(FirstNumber=isparallel_2, SecondNumber=Slider(0, range=0..100))  # -> Equality, Inequality
cull_3 = CullPattern(List=femeshes, CullPattern=equals_2.Inequality)
cull_4 = CullPattern(List=femeshes, CullPattern=equals_2.Equality)

# ----
filter = StreamFilter(Gate=panels_as_meshes_2, Stream0=cull_2, Stream1=cull_4)
filter_2 = StreamFilter(Gate=panels_as_meshes_2, Stream0=cull, Stream1=cull_3)
floors = BHoMObject(
    filter_2,
    ObjectType="{ \"_t\" : \"System.Type\", \"Name\" : \"System.Object, mscorlib, Version=4.0.0.0, Culture=neutral, PublicKeyToken=b77a5c561934e089\" }",
    m_ForcePreview=False,
    m_MaxItemsPreview=10000)
walls = BHoMObject(
    filter,
    ObjectType="{ \"_t\" : \"System.Type\", \"Name\" : \"System.Object, mscorlib, Version=4.0.0.0, Culture=neutral, PublicKeyToken=b77a5c561934e089\" }",
    m_ForcePreview=False,
    m_MaxItemsPreview=10000)
walls_2 = ClusterOutput(walls)
floors_2 = ClusterOutput(floors)

# ==== cluster FilterBeamsAndColumns
bars = ClusterInput()
bars_2 = BHoMObject(
    bars,
    ObjectType="{ \"_t\" : \"System.Type\", \"Name\" : \"System.Object, mscorlib, Version=4.0.0.0, Culture=neutral, PublicKeyToken=b77a5c561934e089\" }",
    m_ForcePreview=False,
    m_MaxItemsPreview=10000)

# ---- group: Filter bars on tangent
tangent = Tangent(Bar=bars_2, Normalise=False, Component="{ .Tangent")
Z = UnitZ(Factor=1)
isparallel = IsParallel(V1=tangent, V2=Z, AngleTolerance=1e-06, Component="{ .IsParallel")
equals = Equality(FirstNumber=isparallel, SecondNumber=Slider(0, range=0..100))  # -> Equality, Inequality
cull = CullPattern(List=bars_2, CullPattern=equals.Inequality)
cull_2 = CullPattern(List=bars_2, CullPattern=equals.Equality)

# ----
columns = BHoMObject(
    cull,
    ObjectType="{ \"_t\" : \"System.Type\", \"Name\" : \"System.Object, mscorlib, Version=4.0.0.0, Culture=neutral, PublicKeyToken=b77a5c561934e089\" }",
    m_ForcePreview=False,
    m_MaxItemsPreview=10000)
beams = BHoMObject(
    cull_2,
    ObjectType="{ \"_t\" : \"System.Type\", \"Name\" : \"System.Object, mscorlib, Version=4.0.0.0, Culture=neutral, PublicKeyToken=b77a5c561934e089\" }",
    m_ForcePreview=False,
    m_MaxItemsPreview=10000)
columns_2 = ClusterOutput(columns)
beams_2 = ClusterOutput(beams)

# ==== cluster Cluster_13
translation_vector = ClusterInput()
panels_as_meshes = ClusterInput()
area_elements = ClusterInput()
translation_vector_2 = Vector(translation_vector)
panels_as_meshes_2 = Boolean(panels_as_meshes)
area_elements_2 = BHoMObject(
    area_elements,
    ObjectType="{ \"_t\" : \"System.Type\", \"Name\" : \"System.Object, mscorlib, Version=4.0.0.0, Culture=neutral, PublicKeyToken=b77a5c561934e089\" }",
    m_ForcePreview=False,
    m_MaxItemsPreview=10000)
panels_as_meshes_3 = Boolean(panels_as_meshes_2)
gate = StreamGate(Stream=area_elements_2, Gate=panels_as_meshes_3)  # -> Target0, Target1
meshes = BHoMObject(
    graft(gate.Target1),
    ObjectType="{ \"_t\" : \"System.Type\", \"Name\" : \"System.Object, mscorlib, Version=4.0.0.0, Culture=neutral, PublicKeyToken=b77a5c561934e089\" }",
    m_ForcePreview=False,
    m_MaxItemsPreview=10000)
panels = BHoMObject(
    gate.Target0,
    ObjectType="{ \"_t\" : \"System.Type\", \"Name\" : \"System.Object, mscorlib, Version=4.0.0.0, Culture=neutral, PublicKeyToken=b77a5c561934e089\" }",
    m_ForcePreview=False,
    m_MaxItemsPreview=10000)
getproperty = GetProperty(Obj=meshes, PropName="Nodes", Component="{ .GetProperty")
translate = Translate(Element2D=panels, Transform=translation_vector_2, Component="{ .Translate")
translate_2 = Translate(Element0D=getproperty, Transform=translation_vector_2, Component="{ .Translate")  # -> simplify(Element0D)
setproperty = SetProperty(Obj=meshes, PropName="Nodes", Value=translate_2, Component="{ .PropertyValue")  # -> flatten(Result)
filter = StreamFilter(Gate=panels_as_meshes_3, Stream0=translate, Stream1=setproperty)
area_elements_3 = BHoMObject(
    filter,
    ObjectType="{ \"_t\" : \"System.Type\", \"Name\" : \"System.Object, mscorlib, Version=4.0.0.0, Culture=neutral, PublicKeyToken=b77a5c561934e089\" }",
    m_ForcePreview=False,
    m_MaxItemsPreview=10000)
area_elements_4 = ClusterOutput(area_elements_3)

# ==== cluster ExtractNodes
panels_as_meshes = ClusterInput()
floors = ClusterInput()
walls = ClusterInput()
columns = ClusterInput()
beams = ClusterInput()
panels_as_meshes_2 = Boolean(panels_as_meshes)
floors_2 = BHoMObject(
    floors,
    ObjectType="{ \"_t\" : \"System.Type\", \"Name\" : \"System.Object, mscorlib, Version=4.0.0.0, Culture=neutral, PublicKeyToken=b77a5c561934e089\" }",
    m_ForcePreview=False,
    m_MaxItemsPreview=10000)
columns_2 = BHoMObject(
    columns,
    ObjectType="{ \"_t\" : \"System.Type\", \"Name\" : \"System.Object, mscorlib, Version=4.0.0.0, Culture=neutral, PublicKeyToken=b77a5c561934e089\" }",
    m_ForcePreview=False,
    m_MaxItemsPreview=10000)
walls_2 = BHoMObject(
    walls,
    ObjectType="{ \"_t\" : \"System.Type\", \"Name\" : \"System.Object, mscorlib, Version=4.0.0.0, Culture=neutral, PublicKeyToken=b77a5c561934e089\" }",
    m_ForcePreview=False,
    m_MaxItemsPreview=10000)
beams_2 = BHoMObject(
    beams,
    ObjectType="{ \"_t\" : \"System.Type\", \"Name\" : \"System.Object, mscorlib, Version=4.0.0.0, Culture=neutral, PublicKeyToken=b77a5c561934e089\" }",
    m_ForcePreview=False,
    m_MaxItemsPreview=10000)
getproperty = GetProperty(Obj=[columns_2, beams_2], PropName="EndNode", Component="{ .GetProperty")
getproperty_2 = GetProperty(Obj=[columns_2, beams_2], PropName="StartNode", Component="{ .GetProperty")
gate = StreamGate(Stream=[floors_2, walls_2], Gate=panels_as_meshes_2)  # -> Target0, Target1
getproperty_3 = GetProperty(Obj=gate.Target1, PropName="Nodes", Component="{ .GetProperty")  # -> flatten(Value)
merge = Merge(Data1=flatten(getproperty_3), Data2=flatten(getproperty_2), Data3=flatten(getproperty))
nodes = BHoMObject(
    merge,
    ObjectType="{ \"_t\" : \"System.Type\", \"Name\" : \"System.Object, mscorlib, Version=4.0.0.0, Culture=neutral, PublicKeyToken=b77a5c561934e089\" }",
    m_ForcePreview=False,
    m_MaxItemsPreview=10000)
nodes_2 = ClusterOutput(nodes)

# ==== cluster Cluster_4
slab_thickness = ClusterInput()
slab_thickness_2 = Number(slab_thickness)
multiplication = Multiplication(A=slab_thickness_2, B=1000)
int = Integer(multiplication)
concrete = Concrete(
    {"C12/15": 0, "C16/20": 1, "C20/25": 2, "C25/30": 3, "C30/37": 4, "C35/45": 5, "C40/50": 6, "C45/55": 7, "C50/60": 8, "C55/67": 9, "C60/75": 10, "C70/85": 11, "C80/95": 12, "C90/105": 13}, selected="C30/37",
    Component="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",
    Selection=4)
concat = Concatenate(FragmentA="THK ", FragmentB=int)
constantthickness = ConstantThickness(
    Name=concat,
    Thickness=slab_thickness_2,
    Material=concrete,
    PanelType="{ \"_t\" : \"System.Enum\", \"TypeName\" : { \"_t\" : \"System.Type\", \"Name\" : \"BH.oM.Structure.SurfaceProperties.PanelType\" }, \"Value\" : \"Slab\" }",
    Component="BH.oM.Structure.SurfaceProperties.ConstantThickness")
thicknessproeprty = BHoMObject(
    constantthickness,
    ObjectType="{ \"_t\" : \"System.Type\", \"Name\" : \"System.Object, mscorlib, Version=4.0.0.0, Culture=neutral, PublicKeyToken=b77a5c561934e089\" }",
    m_ForcePreview=False,
    m_MaxItemsPreview=10000)
thicknessproeprty_2 = ClusterOutput(thicknessproeprty)

# ==== cluster Cluster_6
column_diameter = ClusterInput()
column_diameter_2 = Number(column_diameter)
multiplication = Multiplication(A=column_diameter_2, B=1000)
int = Integer(multiplication)
concrete = Concrete(
    {"C12/15": 0, "C16/20": 1, "C20/25": 2, "C25/30": 3, "C30/37": 4, "C35/45": 5, "C40/50": 6, "C45/55": 7, "C50/60": 8, "C55/67": 9, "C60/75": 10, "C70/85": 11, "C80/95": 12, "C90/105": 13}, selected="C30/37",
    Component="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",
    Selection=4)
concat = Concatenate(FragmentA="C Dia ", FragmentB=int)
concretecircularsection = ConcreteCircularSection(Diameter=column_diameter_2, Material=concrete, Name=concat, MinimumCover=0, Component="{ .ConcreteCircularSection")
section = BHoMObject(
    concretecircularsection,
    ObjectType="{ \"_t\" : \"System.Type\", \"Name\" : \"System.Object, mscorlib, Version=4.0.0.0, Culture=neutral, PublicKeyToken=b77a5c561934e089\" }",
    m_ForcePreview=False,
    m_MaxItemsPreview=10000)
section_2 = ClusterOutput(section)
