# Grasshopper definition BHoM_v3.2.beta_Create_Read_Update_Structural properties.gh (Grasshopper 1.0.7)
# plug-ins: BH.UI.Grasshopper

# ----
# Input
new_steelsections = BHoMObject(
    [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],
    ObjectType="{ \"_t\" : \"System.Type\", \"Name\" : \"System.Object, mscorlib, Version=4.0.0.0, Culture=neutral, PublicKeyToken=b77a5c561934e089\" }",
    m_ForcePreview=False,
    m_MaxItemsPreview=10000)
# SteelSections
new_steel = BHoMObject(
    "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",
    ObjectType="{ \"_t\" : \"System.Type\", \"Name\" : \"System.Object, mscorlib, Version=4.0.0.0, Culture=neutral, PublicKeyToken=b77a5c561934e089\" }",
    m_ForcePreview=False,
    m_MaxItemsPreview=10000)
# Materials
scalefactor = Slider(1.5, range=0.5..2)
newuz_stiffness = Slider(2095, range=0..10000)
# Support
newrx_stiffness = Slider(8083, range=0..10000)
newux_fixity = BooleanToggle(False)
newrz_fixity = BooleanToggle(True)
scalefactor_2 = Number(scalefactor)
newuz_stiffness_2 = Number(newuz_stiffness)
newrx_stiffness_2 = Number(newrx_stiffness)
newux_fixity_2 = Boolean(newux_fixity)
newrz_fixity_2 = Boolean(newrz_fixity)

# ----
# Adapter
# Creates a set of:
# -SteelSection
# -Materials
# -Supports
# 
# Then pulls them back, makes modifications to them and finally updates them
filepath = Panel("")
# Create properties
# BHoM Version: 3.2β
list = ValueList({"Robot": 0, "ETABS17": 1, "ETABS2016": 2, "SAP2000": 3, "GSA": 4, "Lusas18": 5, "Lusas17": 6, "MidasCivil": 7, "RAM": 8}, selected="Robot")
cluster = Cluster(selectedadapter=list, S=Toggle(False), filepath=filepath)  # -> s_0, adapteridname
adapteridname = Text(cluster.adapteridname)
adapter = BHoMAdapter(
    cluster.s_0,
    ObjectType="{ \"_t\" : \"System.Type\", \"Name\" : \"System.Object, mscorlib, Version=4.0.0.0, Culture=neutral, PublicKeyToken=b77a5c561934e089\" }",
    m_ForcePreview=False,
    m_MaxItemsPreview=10000)

# ----
# Input
# SteelSections
steelsections = BHoMObject(
    [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],
    ObjectType="{ \"_t\" : \"System.Type\", \"Name\" : \"System.Object, mscorlib, Version=4.0.0.0, Culture=neutral, PublicKeyToken=b77a5c561934e089\" }",
    m_ForcePreview=False,
    m_MaxItemsPreview=10000)
# Materials
materials = BHoMObject(
    [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],
    ObjectType="{ \"_t\" : \"System.Type\", \"Name\" : \"System.Object, mscorlib, Version=4.0.0.0, Culture=neutral, PublicKeyToken=b77a5c561934e089\" }",
    m_ForcePreview=False,
    m_MaxItemsPreview=10000)
# Support
# Update properties
constraint6dof = BHoMObject(
    "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",
    ObjectType="{ \"_t\" : \"System.Type\", \"Name\" : \"System.Object, mscorlib, Version=4.0.0.0, Culture=neutral, PublicKeyToken=b77a5c561934e089\" }",
    m_ForcePreview=False,
    m_MaxItemsPreview=10000)

# ----
# Push to analysis package
steelsections_2 = BHoMObject(
    steelsections,
    ObjectType="{ \"_t\" : \"System.Type\", \"Name\" : \"System.Object, mscorlib, Version=4.0.0.0, Culture=neutral, PublicKeyToken=b77a5c561934e089\" }",
    m_ForcePreview=False,
    m_MaxItemsPreview=10000)
adapter_2 = BHoMAdapter(
    adapter,
    ObjectType="{ \"_t\" : \"System.Type\", \"Name\" : \"System.Object, mscorlib, Version=4.0.0.0, Culture=neutral, PublicKeyToken=b77a5c561934e089\" }",
    m_ForcePreview=False,
    m_MaxItemsPreview=10000)
push = Push(
    Adapter=adapter_2,
    Objects=flatten(steelsections_2),
    PushType="{ \"_t\" : \"System.Enum\", \"TypeName\" : { \"_t\" : \"System.Type\", \"Name\" : \"BH.oM.Adapter.PushType\" }, \"Value\" : \"AdapterDefault\" }",
    Active=Toggle(False),
    Component="{ .Push")  # -> Objects, Success

constraint6dof_2 = BHoMObject(
    constraint6dof,
    ObjectType="{ \"_t\" : \"System.Type\", \"Name\" : \"System.Object, mscorlib, Version=4.0.0.0, Culture=neutral, PublicKeyToken=b77a5c561934e089\" }",
    m_ForcePreview=False,
    m_MaxItemsPreview=10000)
adapter_3 = BHoMAdapter(
    adapter,
    ObjectType="{ \"_t\" : \"System.Type\", \"Name\" : \"System.Object, mscorlib, Version=4.0.0.0, Culture=neutral, PublicKeyToken=b77a5c561934e089\" }",
    m_ForcePreview=False,
    m_MaxItemsPreview=10000)
push_2 = Push(
    Adapter=adapter_3,
    Objects=flatten(constraint6dof_2),
    PushType="{ \"_t\" : \"System.Enum\", \"TypeName\" : { \"_t\" : \"System.Type\", \"Name\" : \"BH.oM.Adapter.PushType\" }, \"Value\" : \"AdapterDefault\" }",
    Active=Toggle(False),
    Component="{ .Push")  # -> Objects, Success

materials_2 = BHoMObject(
    materials,
    ObjectType="{ \"_t\" : \"System.Type\", \"Name\" : \"System.Object, mscorlib, Version=4.0.0.0, Culture=neutral, PublicKeyToken=b77a5c561934e089\" }",
    m_ForcePreview=False,
    m_MaxItemsPreview=10000)
adapter_4 = BHoMAdapter(
    adapter,
    ObjectType="{ \"_t\" : \"System.Type\", \"Name\" : \"System.Object, mscorlib, Version=4.0.0.0, Culture=neutral, PublicKeyToken=b77a5c561934e089\" }",
    m_ForcePreview=False,
    m_MaxItemsPreview=10000)
push_3 = Push(
    Adapter=adapter_4,
    Objects=flatten(materials_2),
    PushType="{ \"_t\" : \"System.Enum\", \"TypeName\" : { \"_t\" : \"System.Type\", \"Name\" : \"BH.oM.Adapter.PushType\" }, \"Value\" : \"AdapterDefault\" }",
    Active=Toggle(False),
    Component="{ .Push")  # -> Objects, Success

createtype = CreateType(Component="BH.oM.Structure.SectionProperties.ISectionProperty")
# Pull from analysis package
adapter_5 = BHoMAdapter(
    adapter,
    ObjectType="{ \"_t\" : \"System.Type\", \"Name\" : \"System.Object, mscorlib, Version=4.0.0.0, Culture=neutral, PublicKeyToken=b77a5c561934e089\" }",
    m_ForcePreview=False,
    m_MaxItemsPreview=10000)
pull = Pull(
    Adapter=adapter_5,
    Request=createtype,
    PullType="{ \"_t\" : \"System.Enum\", \"TypeName\" : { \"_t\" : \"System.Type\", \"Name\" : \"BH.oM.Adapter.PullType\" }, \"Value\" : \"AdapterDefault\" }",
    Active=Toggle(False),
    Component="{ .Pull")

createtype_2 = CreateType(Component="BH.oM.Structure.Constraints.Constraint6DOF")
adapter_6 = BHoMAdapter(
    adapter,
    ObjectType="{ \"_t\" : \"System.Type\", \"Name\" : \"System.Object, mscorlib, Version=4.0.0.0, Culture=neutral, PublicKeyToken=b77a5c561934e089\" }",
    m_ForcePreview=False,
    m_MaxItemsPreview=10000)
pull_2 = Pull(
    Adapter=adapter_6,
    Request=createtype_2,
    PullType="{ \"_t\" : \"System.Enum\", \"TypeName\" : { \"_t\" : \"System.Type\", \"Name\" : \"BH.oM.Adapter.PullType\" }, \"Value\" : \"AdapterDefault\" }",
    Active=Toggle(False),
    Component="{ .Pull")

createtype_3 = CreateType(Component="BH.oM.Structure.MaterialFragments.IMaterialFragment")
adapter_7 = BHoMAdapter(
    adapter,
    ObjectType="{ \"_t\" : \"System.Type\", \"Name\" : \"System.Object, mscorlib, Version=4.0.0.0, Culture=neutral, PublicKeyToken=b77a5c561934e089\" }",
    m_ForcePreview=False,
    m_MaxItemsPreview=10000)
pull_3 = Pull(
    Adapter=adapter_7,
    Request=createtype_3,
    PullType="{ \"_t\" : \"System.Enum\", \"TypeName\" : { \"_t\" : \"System.Type\", \"Name\" : \"BH.oM.Adapter.PullType\" }, \"Value\" : \"AdapterDefault\" }",
    Active=Toggle(False),
    Component="{ .Pull")

# ----
# Update the properties
originalsteelsections = BHoMObject(
    steelsections,
    ObjectType="{ \"_t\" : \"System.Type\", \"Name\" : \"System.Object, mscorlib, Version=4.0.0.0, Culture=neutral, PublicKeyToken=b77a5c561934e089\" }",
    m_ForcePreview=False,
    m_MaxItemsPreview=10000)

# ----
# Replace sections
pulled_sections = BHoMObject(
    pull,
    ObjectType="{ \"_t\" : \"System.Type\", \"Name\" : \"System.Object, mscorlib, Version=4.0.0.0, Culture=neutral, PublicKeyToken=b77a5c561934e089\" }",
    m_ForcePreview=False,
    m_MaxItemsPreview=10000)
new_steelsections_2 = BHoMObject(
    new_steelsections,
    ObjectType="{ \"_t\" : \"System.Type\", \"Name\" : \"System.Object, mscorlib, Version=4.0.0.0, Culture=neutral, PublicKeyToken=b77a5c561934e089\" }",
    m_ForcePreview=False,
    m_MaxItemsPreview=10000)
new_steel_2 = BHoMObject(
    new_steel,
    ObjectType="{ \"_t\" : \"System.Type\", \"Name\" : \"System.Object, mscorlib, Version=4.0.0.0, Culture=neutral, PublicKeyToken=b77a5c561934e089\" }",
    m_ForcePreview=False,
    m_MaxItemsPreview=10000)
adapteridname_2 = Text(adapteridname)
cluster_2 = Cluster_2(
    originalsteelsections=originalsteelsections,
    old_sections=pulled_sections,
    new_steelsections=new_steelsections_2,
    new_steel=new_steel_2,
    adapteridname=adapteridname_2)
updated_sections = BHoMObject(
    cluster_2,
    ObjectType="{ \"_t\" : \"System.Type\", \"Name\" : \"System.Object, mscorlib, Version=4.0.0.0, Culture=neutral, PublicKeyToken=b77a5c561934e089\" }",
    m_ForcePreview=False,
    m_MaxItemsPreview=10000)

# ----
# Filter out previously pushed materials
cluster_3 = Cluster_3(originalmaterials=materials, pulledmaterials=pull_3)

# ----
# Filter out previously pushed supports
cluster_4 = Cluster_3(originalmaterials=constraint6dof, pulledmaterials=pull_2)

filteredpulledsupperts = BHoMObject(
    cluster_4,
    ObjectType="{ \"_t\" : \"System.Type\", \"Name\" : \"System.Object, mscorlib, Version=4.0.0.0, Culture=neutral, PublicKeyToken=b77a5c561934e089\" }",
    m_ForcePreview=False,
    m_MaxItemsPreview=10000)
newuz_stiffness_3 = Number(newuz_stiffness_2)
newrx_stiffness_3 = Number(newrx_stiffness_2)
newux_fixity_3 = Boolean(newux_fixity_2)
newrz_fixity_3 = Boolean(newrz_fixity_2)

# ----
# Scale material properties
scalefactor_3 = Number(scalefactor_2)
cluster_5 = Cluster_5(filteredpulledmaterials=cluster_3, scalefactor=scalefactor_3)
updatedmaterials = BHoMObject(
    cluster_5,
    ObjectType="{ \"_t\" : \"System.Type\", \"Name\" : \"System.Object, mscorlib, Version=4.0.0.0, Culture=neutral, PublicKeyToken=b77a5c561934e089\" }",
    m_ForcePreview=False,
    m_MaxItemsPreview=10000)

cluster_6 = Cluster_6(
    filteredpulledsupperts=filteredpulledsupperts,
    newuz_stiffness=newuz_stiffness_3,
    newrx_stiffness=newrx_stiffness_3,
    newux_fixity=newux_fixity_3,
    newrz_fixity=newrz_fixity_3)

pushtype = PushType(
    {"FullPush": 0, "CreateOnly": 1, "CreateNonExisting": 2, "UpdateOnly": 3, "DeleteThenCreate": 4, "AdapterDefault": 5}, selected="UpdateOnly",
    Component="BH.oM.Adapter.PushType",
    Selection=3)
# Push Update to analysis package
updated_sections_2 = BHoMObject(
    updated_sections,
    ObjectType="{ \"_t\" : \"System.Type\", \"Name\" : \"System.Object, mscorlib, Version=4.0.0.0, Culture=neutral, PublicKeyToken=b77a5c561934e089\" }",
    m_ForcePreview=False,
    m_MaxItemsPreview=10000)
adapter_8 = BHoMAdapter(
    adapter,
    ObjectType="{ \"_t\" : \"System.Type\", \"Name\" : \"System.Object, mscorlib, Version=4.0.0.0, Culture=neutral, PublicKeyToken=b77a5c561934e089\" }",
    m_ForcePreview=False,
    m_MaxItemsPreview=10000)
push_4 = Push(Adapter=adapter_8, Objects=flatten(updated_sections_2), PushType=pushtype, Active=Toggle(False), Component="{ .Push")  # -> Objects, Success

updatedmaterials_2 = BHoMObject(
    updatedmaterials,
    ObjectType="{ \"_t\" : \"System.Type\", \"Name\" : \"System.Object, mscorlib, Version=4.0.0.0, Culture=neutral, PublicKeyToken=b77a5c561934e089\" }",
    m_ForcePreview=False,
    m_MaxItemsPreview=10000)

pushtype_2 = PushType(
    {"FullPush": 0, "CreateOnly": 1, "CreateNonExisting": 2, "UpdateOnly": 3, "DeleteThenCreate": 4, "AdapterDefault": 5}, selected="UpdateOnly",
    Component="BH.oM.Adapter.PushType",
    Selection=3)
adapter_9 = BHoMAdapter(
    adapter,
    ObjectType="{ \"_t\" : \"System.Type\", \"Name\" : \"System.Object, mscorlib, Version=4.0.0.0, Culture=neutral, PublicKeyToken=b77a5c561934e089\" }",
    m_ForcePreview=False,
    m_MaxItemsPreview=10000)
push_5 = Push(Adapter=adapter_9, Objects=flatten(updatedmaterials_2), PushType=pushtype_2, Active=Toggle(False), Component="{ .Push")  # -> Objects, Success

updatedsupports = BHoMObject(
    cluster_6,
    ObjectType="{ \"_t\" : \"System.Type\", \"Name\" : \"System.Object, mscorlib, Version=4.0.0.0, Culture=neutral, PublicKeyToken=b77a5c561934e089\" }",
    m_ForcePreview=False,
    m_MaxItemsPreview=10000)

pushtype_3 = PushType(
    {"FullPush": 0, "CreateOnly": 1, "CreateNonExisting": 2, "UpdateOnly": 3, "DeleteThenCreate": 4, "AdapterDefault": 5}, selected="UpdateOnly",
    Component="BH.oM.Adapter.PushType",
    Selection=3)
adapter_10 = BHoMAdapter(
    adapter,
    ObjectType="{ \"_t\" : \"System.Type\", \"Name\" : \"System.Object, mscorlib, Version=4.0.0.0, Culture=neutral, PublicKeyToken=b77a5c561934e089\" }",
    m_ForcePreview=False,
    m_MaxItemsPreview=10000)
push_6 = Push(Adapter=adapter_10, Objects=flatten(updatedsupports), PushType=pushtype_3, Active=Toggle(False), Component="{ .Push")  # -> Objects, Success

# ==== cluster Cluster
filepath = ClusterInput()
selectedadapter = ClusterInput()
S = ClusterInput()
selectedadapter_2 = Integer(selectedadapter)
filepath_2 = Text(filepath)
gate = StreamGate(Stream=S, Gate=selectedadapter_2)  # -> Target0, Target1, Target2, Target3, Target4, Target5, Target6, Target7, Target8
gate_2 = StreamGate(Stream=filepath_2, Gate=selectedadapter_2)  # -> Target0, Target1, Target2, Target3, Target4, Target5, Target6, Target7, Target8
lusasv17adapter = LusasV17Adapter(FilePath=gate_2.Target6, Active=gate.Target6, Component="{ ..ctor")
lusasv18adapter = LusasV18Adapter(FilePath=gate_2.Target5, Active=gate.Target5, Component="{ ..ctor")
gsaadapter = GSAAdapter(FilePath=gate_2.Target4, Active=gate.Target4, Component="{ ..ctor")
# Adapter
robotadapter = RobotAdapter(FilePath=gate_2.Target0, Active=gate.Target0, Component="{ ..ctor")
etabs17adapter = ETABS17Adapter(FilePath=gate_2.Target1, Active=gate.Target1, Component="{ ..ctor")
etabs2016adapter = ETABS2016Adapter(FilePath=gate_2.Target2, Active=gate.Target2, Component="{ ..ctor")
ramadapter = RAMAdapter(FilePath=gate_2.Target8, Active=gate.Target8, Component="{ ..ctor")
midasciviladapter = MidasCivilAdapter(FilePath=gate_2.Target7, Active=gate.Target7, Component="{ ..ctor")
sap2000adapter = SAP2000Adapter(FilePath=gate_2.Target3, Active=gate.Target3, Component="{ ..ctor")
filter = StreamFilter(
    Gate=selectedadapter_2,
    Stream0=robotadapter,
    Stream1=etabs17adapter,
    Stream2=etabs2016adapter,
    Stream3=sap2000adapter,
    Stream4=gsaadapter,
    Stream5=lusasv18adapter,
    Stream6=lusasv17adapter,
    Stream7=midasciviladapter,
    Stream8=ramadapter)
getproperty = GetProperty(Obj=filter, PropName="AdapterIdName", Component="{ .GetProperty")
s_0 = ClusterOutput(filter)
txt = Text(getproperty)
adapteridname = ClusterOutput(txt)

# ==== cluster Cluster_2
originalsteelsections = ClusterInput()
old_sections = ClusterInput()
new_steelsections = ClusterInput()
new_steel = ClusterInput()
adapteridname = ClusterInput()
originalsteelsections_2 = BHoMObject(
    originalsteelsections,
    ObjectType="{ \"_t\" : \"System.Type\", \"Name\" : \"System.Object, mscorlib, Version=4.0.0.0, Culture=neutral, PublicKeyToken=b77a5c561934e089\" }",
    m_ForcePreview=False,
    m_MaxItemsPreview=10000)
adapteridname_2 = Text(adapteridname)
new_steel_2 = BHoMObject(
    new_steel,
    ObjectType="{ \"_t\" : \"System.Type\", \"Name\" : \"System.Object, mscorlib, Version=4.0.0.0, Culture=neutral, PublicKeyToken=b77a5c561934e089\" }",
    m_ForcePreview=False,
    m_MaxItemsPreview=10000)
old_sections_2 = BHoMObject(
    old_sections,
    ObjectType="{ \"_t\" : \"System.Type\", \"Name\" : \"System.Object, mscorlib, Version=4.0.0.0, Culture=neutral, PublicKeyToken=b77a5c561934e089\" }",
    m_ForcePreview=False,
    m_MaxItemsPreview=10000)
new_steelsections_2 = BHoMObject(
    new_steelsections,
    ObjectType="{ \"_t\" : \"System.Type\", \"Name\" : \"System.Object, mscorlib, Version=4.0.0.0, Culture=neutral, PublicKeyToken=b77a5c561934e089\" }",
    m_ForcePreview=False,
    m_MaxItemsPreview=10000)

# ---- group: Filter out previously pushed sections
getproperty = GetProperty(Obj=originalsteelsections_2, PropName="Name", Component="{ .GetProperty")
getproperty_2 = GetProperty(Obj=old_sections_2, PropName="Name", Component="{ .GetProperty")
keysearch = KeyValueSearch(Keys=getproperty_2, Values=old_sections_2, Search=getproperty)

# ---- group: Replace old sections with new of the same name
getproperty_3 = GetProperty(Obj=keysearch, PropName="Name", Component="{ .GetProperty")
getproperty_4 = GetProperty(Obj=new_steelsections_2, PropName="Name", Component="{ .GetProperty")
mindex = MemberIndex(Set=getproperty_3, Member=getproperty_4)  # -> flatten(Index), Count
replace = ReplaceItems(List=keysearch, Item=new_steelsections_2, Indices=mindex.Index, Wrap=False)

# ---- group: Asign adapter ids from old sections
getproperty_5 = GetProperty(Obj=keysearch, PropName=adapteridname_2, Component="{ .GetProperty")
setproperty = SetProperty(Obj=replace, PropName=adapteridname_2, Value=getproperty_5, Component="{ .PropertyValue")

# ---- group: Update the material
setproperty_2 = SetProperty(Obj=setproperty, PropName="Material", Value=new_steel_2, Component="{ .PropertyValue")

# ----
new_section_properties = BHoMObject(
    setproperty_2,
    ObjectType="{ \"_t\" : \"System.Type\", \"Name\" : \"System.Object, mscorlib, Version=4.0.0.0, Culture=neutral, PublicKeyToken=b77a5c561934e089\" }",
    m_ForcePreview=False,
    m_MaxItemsPreview=10000)
new_section_properties_2 = ClusterOutput(new_section_properties)

# ==== cluster Cluster_3
originalmaterials = ClusterInput()
pulledmaterials = ClusterInput()
originalmaterials_2 = BHoMObject(
    originalmaterials,
    ObjectType="{ \"_t\" : \"System.Type\", \"Name\" : \"System.Object, mscorlib, Version=4.0.0.0, Culture=neutral, PublicKeyToken=b77a5c561934e089\" }",
    m_ForcePreview=False,
    m_MaxItemsPreview=10000)
pulledmaterials_2 = BHoMObject(
    pulledmaterials,
    ObjectType="{ \"_t\" : \"System.Type\", \"Name\" : \"System.Object, mscorlib, Version=4.0.0.0, Culture=neutral, PublicKeyToken=b77a5c561934e089\" }",
    m_ForcePreview=False,
    m_MaxItemsPreview=10000)
getproperty = GetProperty(Obj=originalmaterials_2, PropName="Name", Component="{ .GetProperty")
getproperty_2 = GetProperty(Obj=pulledmaterials_2, PropName="Name", Component="{ .GetProperty")
keysearch = KeyValueSearch(Keys=getproperty_2, Values=pulledmaterials_2, Search=getproperty)
filteredpulledmaterials = BHoMObject(
    keysearch,
    ObjectType="{ \"_t\" : \"System.Type\", \"Name\" : \"System.Object, mscorlib, Version=4.0.0.0, Culture=neutral, PublicKeyToken=b77a5c561934e089\" }",
    m_ForcePreview=False,
    m_MaxItemsPreview=10000)
filteredpulledmaterials_2 = ClusterOutput(filteredpulledmaterials)

# ==== cluster Cluster_5
filteredpulledmaterials = ClusterInput()
scalefactor = ClusterInput()
filteredpulledmaterials_2 = BHoMObject(
    filteredpulledmaterials,
    ObjectType="{ \"_t\" : \"System.Type\", \"Name\" : \"System.Object, mscorlib, Version=4.0.0.0, Culture=neutral, PublicKeyToken=b77a5c561934e089\" }",
    m_ForcePreview=False,
    m_MaxItemsPreview=10000)
scalefactor_2 = Number(scalefactor)
cluster = Cluster_4(material=filteredpulledmaterials_2, propname="YoungsModulus", scalefactor=scalefactor_2)
cluster_2 = Cluster_4(material=cluster, propname="PoissonsRatio", scalefactor=scalefactor_2)
cluster_3 = Cluster_4(material=cluster_2, propname="Density", scalefactor=scalefactor_2)
cluster_4 = Cluster_4(material=cluster_3, propname="ThermalExpansionCoeff", scalefactor=scalefactor_2)
updatedmaterials = BHoMObject(
    cluster_4,
    ObjectType="{ \"_t\" : \"System.Type\", \"Name\" : \"System.Object, mscorlib, Version=4.0.0.0, Culture=neutral, PublicKeyToken=b77a5c561934e089\" }",
    m_ForcePreview=False,
    m_MaxItemsPreview=10000)
updatedmaterials_2 = ClusterOutput(updatedmaterials)

# ==== cluster Cluster_6
filteredpulledsupperts = ClusterInput()
newuz_stiffness = ClusterInput()
newrx_stiffness = ClusterInput()
newux_fixity = ClusterInput()
newrz_fixity = ClusterInput()
doftype = DOFType(
    {"Free": 0, "Fixed": 1, "FixedNegative": 2, "FixedPositive": 3, "Spring": 4, "SpringNegative": 5, "SpringPositive": 6, "SpringRelative": 7, "SpringRelativeNegative": 8, "SpringRelativePositive": 9, "NonLinear": 10, "Friction": 11, "Damped": 12, "Gap": 13}, selected="Free",
    Component="BH.oM.Structure.Constraints.DOFType",
    Selection=0)
doftype_2 = DOFType(
    {"Free": 0, "Fixed": 1, "FixedNegative": 2, "FixedPositive": 3, "Spring": 4, "SpringNegative": 5, "SpringPositive": 6, "SpringRelative": 7, "SpringRelativeNegative": 8, "SpringRelativePositive": 9, "NonLinear": 10, "Friction": 11, "Damped": 12, "Gap": 13}, selected="Fixed",
    Component="BH.oM.Structure.Constraints.DOFType",
    Selection=1)
filteredpulledsupperts_2 = BHoMObject(
    filteredpulledsupperts,
    ObjectType="{ \"_t\" : \"System.Type\", \"Name\" : \"System.Object, mscorlib, Version=4.0.0.0, Culture=neutral, PublicKeyToken=b77a5c561934e089\" }",
    m_ForcePreview=False,
    m_MaxItemsPreview=10000)
newuz_stiffness_2 = Number(newuz_stiffness)
newrx_stiffness_2 = Number(newrx_stiffness)
newux_fixity_2 = Boolean(newux_fixity)
newrz_fixity_2 = Boolean(newrz_fixity)
explode = Explode(Object=filteredpulledsupperts_2, Component="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")  # -> Name, TranslationalStiffnessX, TranslationalStiffnessY, TranslationalStiffnessZ, RotationalStiffnessX, RotationalStiffnessY, RotationalStiffnessZ, TranslationX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
filter = StreamFilter(Gate=newux_fixity_2, Stream0=doftype, Stream1=doftype_2)
filter_2 = StreamFilter(Gate=newrz_fixity_2, Stream0=doftype, Stream1=doftype_2)
setproperty = SetProperty(Obj=filteredpulledsupperts_2, PropName="TranslationalStiffnessZ", Value=newuz_stiffness_2, Component="{ .PropertyValue")
setproperty_2 = SetProperty(Obj=setproperty, PropName="RotationalStiffnessX", Value=newrx_stiffness_2, Component="{ .PropertyValue")
setproperty_3 = SetProperty(Obj=setproperty_2, PropName="TranslationX", Value=filter, Component="{ .PropertyValue")
setproperty_4 = SetProperty(Obj=setproperty_3, PropName="RotationZ", Value=filter_2, Component="{ .PropertyValue")
updatedsupports = BHoMObject(
    setproperty_4,
    ObjectType="{ \"_t\" : \"System.Type\", \"Name\" : \"System.Object, mscorlib, Version=4.0.0.0, Culture=neutral, PublicKeyToken=b77a5c561934e089\" }",
    m_ForcePreview=False,
    m_MaxItemsPreview=10000)
updatedsupports_2 = ClusterOutput(updatedsupports)

# ==== cluster Cluster_4
scalefactor = ClusterInput()
propname = ClusterInput()
material = ClusterInput()
scalefactor_2 = Number(scalefactor)
material_2 = BHoMObject(
    material,
    ObjectType="{ \"_t\" : \"System.Type\", \"Name\" : \"System.Object, mscorlib, Version=4.0.0.0, Culture=neutral, PublicKeyToken=b77a5c561934e089\" }",
    m_ForcePreview=False,
    m_MaxItemsPreview=10000)
getproperty = GetProperty(Obj=material_2, PropName=propname, Component="{ .GetProperty")
bhomgeo = BHoMGeometry(
    getproperty,
    ObjectType="{ \"_t\" : \"System.Type\", \"Name\" : \"System.Object, mscorlib, Version=4.0.0.0, Culture=neutral, PublicKeyToken=b77a5c561934e089\" }",
    m_ForcePreview=False,
    m_MaxItemsPreview=10000)
vec = Vector(bhomgeo)
null = NullItem(Item=vec)  # -> NullFlags, InvalidFlags, Description
cull = CullPattern(List=vec, CullPattern=invert(null.NullFlags))
cull_2 = CullPattern(List=material_2, CullPattern=invert(null.NullFlags))
cull_3 = CullPattern(List=getproperty, CullPattern=null.NullFlags)
cull_4 = CullPattern(List=material_2, CullPattern=null.NullFlags)
multiplication = Multiplication(A=cull, B=scalefactor_2)
multiplication_2 = Multiplication(A=cull_3, B=scalefactor_2)
setproperty = SetProperty(Obj=cull_4, PropName=propname, Value=multiplication_2, Component="{ .PropertyValue")
setproperty_2 = SetProperty(Obj=cull_2, PropName=propname, Value=multiplication, Component="{ .PropertyValue")
merge = Merge(Data1=setproperty, Data2=setproperty_2)
material_3 = BHoMObject(
    merge,
    ObjectType="{ \"_t\" : \"System.Type\", \"Name\" : \"System.Object, mscorlib, Version=4.0.0.0, Culture=neutral, PublicKeyToken=b77a5c561934e089\" }",
    m_ForcePreview=False,
    m_MaxItemsPreview=10000)
material_4 = ClusterOutput(material_3)
