# Grasshopper definition BHoM_v3.2.beta_Read_Results.gh (Grasshopper 1.0.7)
# plug-ins: BH.UI.Grasshopper

# ----
# Deformation Controls
scalefactordeformation = Slider(76, range=0..200)
loadcasedeformation = Text("3")
# BarResults
scalefactordeformation_2 = Number(scalefactordeformation)

# ----
# Adapter
# Pulls all available result types, and visualises them using BHoM methods.
filepath = Panel("")
# Read results
# BHoM Version: 3.2β
list = ValueList({"Robot": 0, "ETABS17": 1, "ETABS2016": 2, "SAP2000": 3, "GSA": 4, "Lusas18": 5, "Lusas17": 6, "MidasCivil": 7, "RAM": 8}, selected="Robot")
cluster = Cluster(selectedadapter=list, S=Toggle(False), filepath=filepath)  # -> s_0, adapteridname
adapteridname = Text(cluster.adapteridname)
# Loadcases
adapter = BHoMAdapter(
    cluster.s_0,
    ObjectType="{ \"_t\" : \"System.Type\", \"Name\" : \"System.Object, mscorlib, Version=4.0.0.0, Culture=neutral, PublicKeyToken=b77a5c561934e089\" }",
    m_ForcePreview=False,
    m_MaxItemsPreview=10000)

# ----
# NodeReaction
noderesulttype = NodeResultType(
    {"NodeReaction": 0, "NodeDisplacement": 1, "NodeVelocity": 2, "NodeAcceleration": 3, "NodeModalMass": 4}, selected="NodeReaction",
    Component="BH.oM.Structure.Requests.NodeResultType",
    Selection=0)
loadaxis = LoadAxis({"Global": 0, "Local": 1}, selected="Local", Component="BH.oM.Structure.Loads.LoadAxis", Selection=1)
panel = Panel("""1
2
3""")
noderesultrequest = NodeResultRequest(ResultType=noderesulttype, Axis=loadaxis, Component="BH.oM.Structure.Requests.NodeResultRequest")
adapter_2 = Data(adapter)
pull = Pull(
    Adapter=adapter_2,
    Request=noderesultrequest,
    PullType="{ \"_t\" : \"System.Enum\", \"TypeName\" : { \"_t\" : \"System.Type\", \"Name\" : \"BH.oM.Adapter.PullType\" }, \"Value\" : \"AdapterDefault\" }",
    Active=Toggle(False),
    Component="{ .Pull")
result = BHIObject(
    pull,
    ObjectType="{ \"_t\" : \"System.Type\", \"Name\" : \"System.Object, mscorlib, Version=4.0.0.0, Culture=neutral, PublicKeyToken=b77a5c561934e089\" }",
    m_ForcePreview=False,
    m_MaxItemsPreview=10000)
result_2 = BHIObject(
    result,
    ObjectType="{ \"_t\" : \"System.Type\", \"Name\" : \"System.Object, mscorlib, Version=4.0.0.0, Culture=neutral, PublicKeyToken=b77a5c561934e089\" }",
    m_ForcePreview=False,
    m_MaxItemsPreview=10000)

# ----
# NodeDisplacement
noderesulttype_2 = NodeResultType(
    {"NodeReaction": 0, "NodeDisplacement": 1, "NodeVelocity": 2, "NodeAcceleration": 3, "NodeModalMass": 4}, selected="NodeDisplacement",
    Component="BH.oM.Structure.Requests.NodeResultType",
    Selection=1)
loadaxis_2 = LoadAxis({"Global": 0, "Local": 1}, selected="Global", Component="BH.oM.Structure.Loads.LoadAxis", Selection=0)
panel_2 = Panel("55")
noderesultrequest_2 = NodeResultRequest(ResultType=noderesulttype_2, Axis=loadaxis_2, Component="BH.oM.Structure.Requests.NodeResultRequest")
adapter_3 = Data(adapter)
pull_2 = Pull(
    Adapter=adapter_3,
    Request=noderesultrequest_2,
    PullType="{ \"_t\" : \"System.Enum\", \"TypeName\" : { \"_t\" : \"System.Type\", \"Name\" : \"BH.oM.Adapter.PullType\" }, \"Value\" : \"AdapterDefault\" }",
    Active=Toggle(False),
    Component="{ .Pull")
result_3 = BHIObject(
    pull_2,
    ObjectType="{ \"_t\" : \"System.Type\", \"Name\" : \"System.Object, mscorlib, Version=4.0.0.0, Culture=neutral, PublicKeyToken=b77a5c561934e089\" }",
    m_ForcePreview=False,
    m_MaxItemsPreview=10000)
result_4 = BHIObject(
    result_3,
    ObjectType="{ \"_t\" : \"System.Type\", \"Name\" : \"System.Object, mscorlib, Version=4.0.0.0, Culture=neutral, PublicKeyToken=b77a5c561934e089\" }",
    m_ForcePreview=False,
    m_MaxItemsPreview=10000)

# ----
# NodeVelocity
noderesulttype_3 = NodeResultType(
    {"NodeReaction": 0, "NodeDisplacement": 1, "NodeVelocity": 2, "NodeAcceleration": 3, "NodeModalMass": 4}, selected="NodeVelocity",
    Component="BH.oM.Structure.Requests.NodeResultType",
    Selection=2)
loadaxis_3 = LoadAxis({"Global": 0, "Local": 1}, selected="Global", Component="BH.oM.Structure.Loads.LoadAxis", Selection=0)
noderesultrequest_3 = NodeResultRequest(ResultType=noderesulttype_3, Axis=loadaxis_3, Component="BH.oM.Structure.Requests.NodeResultRequest")
adapter_4 = Data(adapter)
pull_3 = Pull(
    Adapter=adapter_4,
    Request=noderesultrequest_3,
    PullType="{ \"_t\" : \"System.Enum\", \"TypeName\" : { \"_t\" : \"System.Type\", \"Name\" : \"BH.oM.Adapter.PullType\" }, \"Value\" : \"AdapterDefault\" }",
    Active=Toggle(False),
    Component="{ .Pull")
result_5 = BHIObject(
    pull_3,
    ObjectType="{ \"_t\" : \"System.Type\", \"Name\" : \"System.Object, mscorlib, Version=4.0.0.0, Culture=neutral, PublicKeyToken=b77a5c561934e089\" }",
    m_ForcePreview=False,
    m_MaxItemsPreview=10000)
result_6 = BHIObject(
    result_5,
    ObjectType="{ \"_t\" : \"System.Type\", \"Name\" : \"System.Object, mscorlib, Version=4.0.0.0, Culture=neutral, PublicKeyToken=b77a5c561934e089\" }",
    m_ForcePreview=False,
    m_MaxItemsPreview=10000)

# ----
# NodeAcceleration
noderesulttype_4 = NodeResultType(
    {"NodeReaction": 0, "NodeDisplacement": 1, "NodeVelocity": 2, "NodeAcceleration": 3, "NodeModalMass": 4}, selected="NodeAcceleration",
    Component="BH.oM.Structure.Requests.NodeResultType",
    Selection=3)
loadaxis_4 = LoadAxis({"Global": 0, "Local": 1}, selected="Global", Component="BH.oM.Structure.Loads.LoadAxis", Selection=0)
noderesultrequest_4 = NodeResultRequest(ResultType=noderesulttype_4, Axis=loadaxis_4, Component="BH.oM.Structure.Requests.NodeResultRequest")
adapter_5 = Data(adapter)
pull_4 = Pull(
    Adapter=adapter_5,
    Request=noderesultrequest_4,
    PullType="{ \"_t\" : \"System.Enum\", \"TypeName\" : { \"_t\" : \"System.Type\", \"Name\" : \"BH.oM.Adapter.PullType\" }, \"Value\" : \"AdapterDefault\" }",
    Active=Toggle(False),
    Component="{ .Pull")
result_7 = BHIObject(
    pull_4,
    ObjectType="{ \"_t\" : \"System.Type\", \"Name\" : \"System.Object, mscorlib, Version=4.0.0.0, Culture=neutral, PublicKeyToken=b77a5c561934e089\" }",
    m_ForcePreview=False,
    m_MaxItemsPreview=10000)
result_8 = BHIObject(
    result_7,
    ObjectType="{ \"_t\" : \"System.Type\", \"Name\" : \"System.Object, mscorlib, Version=4.0.0.0, Culture=neutral, PublicKeyToken=b77a5c561934e089\" }",
    m_ForcePreview=False,
    m_MaxItemsPreview=10000)

# ----
# BarDisplacement
barresulttype = BarResultType(
    {"BarForce": 0, "BarDeformation": 1, "BarStress": 2, "BarStrain": 3, "BarDisplacement": 4}, selected="BarDisplacement",
    Component="BH.oM.Structure.Requests.BarResultType",
    Selection=4)
divisiontype = DivisionType(
    {"EvenlyDistributed": 0, "ExtremeValues": 1}, selected="EvenlyDistributed",
    Component="BH.oM.Structure.Requests.DivisionType",
    Selection=0)
barresultrequest = BarResultRequest(
    ResultType=barresulttype,
    DivisionType=divisiontype,
    Divisions=Slider(20, range=0..100),
    Component="BH.oM.Structure.Requests.BarResultRequest")
adapter_6 = Data(adapter)
pull_5 = Pull(
    Adapter=adapter_6,
    Request=barresultrequest,
    PullType="{ \"_t\" : \"System.Enum\", \"TypeName\" : { \"_t\" : \"System.Type\", \"Name\" : \"BH.oM.Adapter.PullType\" }, \"Value\" : \"AdapterDefault\" }",
    Active=Toggle(False),
    Component="{ .Pull")

# ----
# BarDeformation
barresulttype_2 = BarResultType(
    {"BarForce": 0, "BarDeformation": 1, "BarStress": 2, "BarStrain": 3, "BarDisplacement": 4}, selected="BarDeformation",
    Component="BH.oM.Structure.Requests.BarResultType",
    Selection=1)
divisiontype_2 = DivisionType(
    {"EvenlyDistributed": 0, "ExtremeValues": 1}, selected="EvenlyDistributed",
    Component="BH.oM.Structure.Requests.DivisionType",
    Selection=0)
barresultrequest_2 = BarResultRequest(
    ResultType=barresulttype_2,
    DivisionType=divisiontype_2,
    Divisions=Slider(20, range=0..100),
    Component="BH.oM.Structure.Requests.BarResultRequest")
adapter_7 = Data(adapter)
pull_6 = Pull(
    Adapter=adapter_7,
    Request=barresultrequest_2,
    PullType="{ \"_t\" : \"System.Enum\", \"TypeName\" : { \"_t\" : \"System.Type\", \"Name\" : \"BH.oM.Adapter.PullType\" }, \"Value\" : \"AdapterDefault\" }",
    Active=Toggle(False),
    Component="{ .Pull")
result_9 = BHIObject(
    pull_6,
    ObjectType="{ \"_t\" : \"System.Type\", \"Name\" : \"System.Object, mscorlib, Version=4.0.0.0, Culture=neutral, PublicKeyToken=b77a5c561934e089\" }",
    m_ForcePreview=False,
    m_MaxItemsPreview=10000)
result_10 = BHIObject(
    result_9,
    ObjectType="{ \"_t\" : \"System.Type\", \"Name\" : \"System.Object, mscorlib, Version=4.0.0.0, Culture=neutral, PublicKeyToken=b77a5c561934e089\" }",
    m_ForcePreview=False,
    m_MaxItemsPreview=10000)

# ----
# BarForce
barresulttype_3 = BarResultType(
    {"BarForce": 0, "BarDeformation": 1, "BarStress": 2, "BarStrain": 3, "BarDisplacement": 4}, selected="BarForce",
    Component="BH.oM.Structure.Requests.BarResultType",
    Selection=0)
divisiontype_3 = DivisionType(
    {"EvenlyDistributed": 0, "ExtremeValues": 1}, selected="EvenlyDistributed",
    Component="BH.oM.Structure.Requests.DivisionType",
    Selection=0)
barresultrequest_3 = BarResultRequest(
    ResultType=barresulttype_3,
    DivisionType=divisiontype_3,
    Divisions=Slider(20, range=0..100),
    Component="BH.oM.Structure.Requests.BarResultRequest")
adapter_8 = Data(adapter)
pull_7 = Pull(
    Adapter=adapter_8,
    Request=barresultrequest_3,
    PullType="{ \"_t\" : \"System.Enum\", \"TypeName\" : { \"_t\" : \"System.Type\", \"Name\" : \"BH.oM.Adapter.PullType\" }, \"Value\" : \"AdapterDefault\" }",
    Active=Toggle(False),
    Component="{ .Pull")
result_11 = BHIObject(
    pull_7,
    ObjectType="{ \"_t\" : \"System.Type\", \"Name\" : \"System.Object, mscorlib, Version=4.0.0.0, Culture=neutral, PublicKeyToken=b77a5c561934e089\" }",
    m_ForcePreview=False,
    m_MaxItemsPreview=10000)
result_12 = BHIObject(
    result_11,
    ObjectType="{ \"_t\" : \"System.Type\", \"Name\" : \"System.Object, mscorlib, Version=4.0.0.0, Culture=neutral, PublicKeyToken=b77a5c561934e089\" }",
    m_ForcePreview=False,
    m_MaxItemsPreview=10000)

# ----
# BarStress
barresulttype_4 = BarResultType(
    {"BarForce": 0, "BarDeformation": 1, "BarStress": 2, "BarStrain": 3, "BarDisplacement": 4}, selected="BarStress",
    Component="BH.oM.Structure.Requests.BarResultType",
    Selection=2)
divisiontype_4 = DivisionType(
    {"EvenlyDistributed": 0, "ExtremeValues": 1}, selected="EvenlyDistributed",
    Component="BH.oM.Structure.Requests.DivisionType",
    Selection=0)
barresultrequest_4 = BarResultRequest(
    ResultType=barresulttype_4,
    DivisionType=divisiontype_4,
    Divisions=Slider(37, range=0..100),
    Cases="A100",
    Component="BH.oM.Structure.Requests.BarResultRequest")
adapter_9 = Data(adapter)
pull_8 = Pull(
    Adapter=adapter_9,
    Request=barresultrequest_4,
    PullType="{ \"_t\" : \"System.Enum\", \"TypeName\" : { \"_t\" : \"System.Type\", \"Name\" : \"BH.oM.Adapter.PullType\" }, \"Value\" : \"AdapterDefault\" }",
    Active=Toggle(False),
    Component="{ .Pull")
result_13 = BHIObject(
    pull_8,
    ObjectType="{ \"_t\" : \"System.Type\", \"Name\" : \"System.Object, mscorlib, Version=4.0.0.0, Culture=neutral, PublicKeyToken=b77a5c561934e089\" }",
    m_ForcePreview=False,
    m_MaxItemsPreview=10000)
result_14 = BHIObject(
    result_13,
    ObjectType="{ \"_t\" : \"System.Type\", \"Name\" : \"System.Object, mscorlib, Version=4.0.0.0, Culture=neutral, PublicKeyToken=b77a5c561934e089\" }",
    m_ForcePreview=False,
    m_MaxItemsPreview=10000)

# ----
# BarStrain
barresulttype_5 = BarResultType(
    {"BarForce": 0, "BarDeformation": 1, "BarStress": 2, "BarStrain": 3, "BarDisplacement": 4}, selected="BarStrain",
    Component="BH.oM.Structure.Requests.BarResultType",
    Selection=3)
divisiontype_5 = DivisionType(
    {"EvenlyDistributed": 0, "ExtremeValues": 1}, selected="EvenlyDistributed",
    Component="BH.oM.Structure.Requests.DivisionType",
    Selection=0)
barresultrequest_5 = BarResultRequest(
    ResultType=barresulttype_5,
    DivisionType=divisiontype_5,
    Divisions=Slider(8, range=0..100),
    Component="BH.oM.Structure.Requests.BarResultRequest")
adapter_10 = Data(adapter)
pull_9 = Pull(
    Adapter=adapter_10,
    Request=barresultrequest_5,
    PullType="{ \"_t\" : \"System.Enum\", \"TypeName\" : { \"_t\" : \"System.Type\", \"Name\" : \"BH.oM.Adapter.PullType\" }, \"Value\" : \"AdapterDefault\" }",
    Active=Toggle(False),
    Component="{ .Pull")
result_15 = BHIObject(
    pull_9,
    ObjectType="{ \"_t\" : \"System.Type\", \"Name\" : \"System.Object, mscorlib, Version=4.0.0.0, Culture=neutral, PublicKeyToken=b77a5c561934e089\" }",
    m_ForcePreview=False,
    m_MaxItemsPreview=10000)
result_16 = BHIObject(
    result_15,
    ObjectType="{ \"_t\" : \"System.Type\", \"Name\" : \"System.Object, mscorlib, Version=4.0.0.0, Culture=neutral, PublicKeyToken=b77a5c561934e089\" }",
    m_ForcePreview=False,
    m_MaxItemsPreview=10000)

# ----
# Request
# Loadcases
createtype = CreateType(Component="BH.oM.Structure.Loads.Loadcase")
filterrequest = FilterRequest(Type=createtype, Component="{ .FilterRequest")
# Pull
adapter_11 = Data(adapter)
pull_10 = Pull(
    Adapter=adapter_11,
    Request=filterrequest,
    PullType="{ \"_t\" : \"System.Enum\", \"TypeName\" : { \"_t\" : \"System.Type\", \"Name\" : \"BH.oM.Adapter.PullType\" }, \"Value\" : \"AdapterDefault\" }",
    Active=Toggle(False),
    Component="{ .Pull")
loadcases = BHoMObject(
    pull_10,
    ObjectType="{ \"_t\" : \"System.Type\", \"Name\" : \"System.Object, mscorlib, Version=4.0.0.0, Culture=neutral, PublicKeyToken=b77a5c561934e089\" }",
    m_ForcePreview=False,
    m_MaxItemsPreview=10000)
# Visualisation and inspection
loadcases_2 = BHoMObject(
    loadcases,
    ObjectType="{ \"_t\" : \"System.Type\", \"Name\" : \"System.Object, mscorlib, Version=4.0.0.0, Culture=neutral, PublicKeyToken=b77a5c561934e089\" }",
    m_ForcePreview=False,
    m_MaxItemsPreview=10000)
explode = Explode(Object=loadcases_2, Component="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")  # -> Name, Nature, Number, BHoM_Guid, Fragments, Tags, CustomData
panel_5 = Panel(explode.Name)
panel_6 = Panel(explode.Number)

# ----
# Request
# Panel
createtype_2 = CreateType(Component="BH.oM.Structure.Elements.Panel")
filterrequest_2 = FilterRequest(Type=createtype_2, Component="{ .FilterRequest")
# Pull
adapter_12 = Data(adapter)
pull_11 = Pull(
    Adapter=adapter_12,
    Request=filterrequest_2,
    PullType="{ \"_t\" : \"System.Enum\", \"TypeName\" : { \"_t\" : \"System.Type\", \"Name\" : \"BH.oM.Adapter.PullType\" }, \"Value\" : \"AdapterDefault\" }",
    Active=Toggle(False),
    Component="{ .Pull")
panels = BHoMObject(
    pull_11,
    ObjectType="{ \"_t\" : \"System.Type\", \"Name\" : \"System.Object, mscorlib, Version=4.0.0.0, Culture=neutral, PublicKeyToken=b77a5c561934e089\" }",
    m_ForcePreview=False,
    m_MaxItemsPreview=10000)
# Visualisation and inspection
panels_2 = BHoMObject(
    panels,
    ObjectType="{ \"_t\" : \"System.Type\", \"Name\" : \"System.Object, mscorlib, Version=4.0.0.0, Culture=neutral, PublicKeyToken=b77a5c561934e089\" }",
    m_ForcePreview=False,
    m_MaxItemsPreview=10000)

# ----
# MeshDisplacement
meshresultsmoothingtype = MeshResultSmoothingType(
    {"None": 0, "ByPanel": 1, "BySelection": 2, "Global": 3, "ByFiniteElementCentres": 4}, selected="ByPanel",
    Component="BH.oM.Structure.Results.MeshResultSmoothingType",
    Selection=1)
meshresulttype = MeshResultType(
    {"Forces": 0, "Stresses": 1, "Displacements": 2, "VonMises": 3}, selected="Displacements",
    Component="BH.oM.Structure.Results.MeshResultType",
    Selection=2)
X = UnitX(Factor=1)
Z = UnitZ(Factor=1)
basis = Basis(X=X, Y=Z, Component="{ .Basis")
panels_3 = BHoMObject(
    panels,
    ObjectType="{ \"_t\" : \"System.Type\", \"Name\" : \"System.Object, mscorlib, Version=4.0.0.0, Culture=neutral, PublicKeyToken=b77a5c561934e089\" }",
    m_ForcePreview=False,
    m_MaxItemsPreview=10000)
meshresultrequest = MeshResultRequest(
    ResultType=meshresulttype,
    Smoothing=meshresultsmoothingtype,
    Layer="{ \"_t\" : \"System.Enum\", \"TypeName\" : { \"_t\" : \"System.Type\", \"Name\" : \"BH.oM.Structure.Results.MeshResultLayer\" }, \"Value\" : \"AbsoluteMaximum\" }",
    LayerPosition=0,
    Orientation=basis,
    Component="BH.oM.Structure.Requests.MeshResultRequest")
adapter_13 = Data(adapter)
pull_12 = Pull(
    Adapter=adapter_13,
    Request=meshresultrequest,
    PullType="{ \"_t\" : \"System.Enum\", \"TypeName\" : { \"_t\" : \"System.Type\", \"Name\" : \"BH.oM.Adapter.PullType\" }, \"Value\" : \"AdapterDefault\" }",
    Active=Toggle(False),
    Component="{ .Pull")
result_17 = BHIObject(
    pull_12,
    ObjectType="{ \"_t\" : \"System.Type\", \"Name\" : \"System.Object, mscorlib, Version=4.0.0.0, Culture=neutral, PublicKeyToken=b77a5c561934e089\" }",
    m_ForcePreview=False,
    m_MaxItemsPreview=10000)
result_18 = BHIObject(
    result_17,
    ObjectType="{ \"_t\" : \"System.Type\", \"Name\" : \"System.Object, mscorlib, Version=4.0.0.0, Culture=neutral, PublicKeyToken=b77a5c561934e089\" }",
    m_ForcePreview=False,
    m_MaxItemsPreview=10000)

# ----
# MeshForce
meshresultsmoothingtype_2 = MeshResultSmoothingType(
    {"None": 0, "ByPanel": 1, "BySelection": 2, "Global": 3, "ByFiniteElementCentres": 4}, selected="None",
    Component="BH.oM.Structure.Results.MeshResultSmoothingType",
    Selection=0)
meshresulttype_2 = MeshResultType(
    {"Forces": 0, "Stresses": 1, "Displacements": 2, "VonMises": 3}, selected="Forces",
    Component="BH.oM.Structure.Results.MeshResultType",
    Selection=0)
panel_7 = Panel("1")
panels_4 = BHoMObject(
    panels,
    ObjectType="{ \"_t\" : \"System.Type\", \"Name\" : \"System.Object, mscorlib, Version=4.0.0.0, Culture=neutral, PublicKeyToken=b77a5c561934e089\" }",
    m_ForcePreview=False,
    m_MaxItemsPreview=10000)
meshresultrequest_2 = MeshResultRequest(
    ResultType=meshresulttype_2,
    Smoothing=meshresultsmoothingtype_2,
    Layer="{ \"_t\" : \"System.Enum\", \"TypeName\" : { \"_t\" : \"System.Type\", \"Name\" : \"BH.oM.Structure.Results.MeshResultLayer\" }, \"Value\" : \"AbsoluteMaximum\" }",
    LayerPosition=0,
    Orientation="null",
    Component="BH.oM.Structure.Requests.MeshResultRequest")
adapter_14 = Data(adapter)
pull_13 = Pull(
    Adapter=adapter_14,
    Request=meshresultrequest_2,
    PullType="{ \"_t\" : \"System.Enum\", \"TypeName\" : { \"_t\" : \"System.Type\", \"Name\" : \"BH.oM.Adapter.PullType\" }, \"Value\" : \"AdapterDefault\" }",
    Active=Toggle(False),
    Component="{ .Pull")
result_19 = BHIObject(
    pull_13,
    ObjectType="{ \"_t\" : \"System.Type\", \"Name\" : \"System.Object, mscorlib, Version=4.0.0.0, Culture=neutral, PublicKeyToken=b77a5c561934e089\" }",
    m_ForcePreview=False,
    m_MaxItemsPreview=10000)
result_20 = BHIObject(
    result_19,
    ObjectType="{ \"_t\" : \"System.Type\", \"Name\" : \"System.Object, mscorlib, Version=4.0.0.0, Culture=neutral, PublicKeyToken=b77a5c561934e089\" }",
    m_ForcePreview=False,
    m_MaxItemsPreview=10000)

# ----
# MeshStress
meshresultsmoothingtype_3 = MeshResultSmoothingType(
    {"None": 0, "ByPanel": 1, "BySelection": 2, "Global": 3, "ByFiniteElementCentres": 4}, selected="ByPanel",
    Component="BH.oM.Structure.Results.MeshResultSmoothingType",
    Selection=1)
meshresultlayer = MeshResultLayer(
    {"Middle": 0, "Upper": 1, "Minimum": 2, "Maximum": 3, "AbsoluteMaximum": 4, "Arbitrary": 5, "Lower": 6}, selected="Upper",
    Component="BH.oM.Structure.Results.MeshResultLayer",
    Selection=1)
meshresulttype_3 = MeshResultType(
    {"Forces": 0, "Stresses": 1, "Displacements": 2, "VonMises": 3}, selected="Stresses",
    Component="BH.oM.Structure.Results.MeshResultType",
    Selection=1)
panels_5 = BHoMObject(
    panels,
    ObjectType="{ \"_t\" : \"System.Type\", \"Name\" : \"System.Object, mscorlib, Version=4.0.0.0, Culture=neutral, PublicKeyToken=b77a5c561934e089\" }",
    m_ForcePreview=False,
    m_MaxItemsPreview=10000)
meshresultrequest_3 = MeshResultRequest(
    ResultType=meshresulttype_3,
    Smoothing=meshresultsmoothingtype_3,
    Layer=meshresultlayer,
    LayerPosition=0,
    Orientation="null",
    Component="BH.oM.Structure.Requests.MeshResultRequest")
adapter_15 = Data(adapter)
pull_14 = Pull(
    Adapter=adapter_15,
    Request=meshresultrequest_3,
    PullType="{ \"_t\" : \"System.Enum\", \"TypeName\" : { \"_t\" : \"System.Type\", \"Name\" : \"BH.oM.Adapter.PullType\" }, \"Value\" : \"AdapterDefault\" }",
    Active=Toggle(False),
    Component="{ .Pull")
result_21 = BHIObject(
    pull_14,
    ObjectType="{ \"_t\" : \"System.Type\", \"Name\" : \"System.Object, mscorlib, Version=4.0.0.0, Culture=neutral, PublicKeyToken=b77a5c561934e089\" }",
    m_ForcePreview=False,
    m_MaxItemsPreview=10000)
result_22 = BHIObject(
    result_21,
    ObjectType="{ \"_t\" : \"System.Type\", \"Name\" : \"System.Object, mscorlib, Version=4.0.0.0, Culture=neutral, PublicKeyToken=b77a5c561934e089\" }",
    m_ForcePreview=False,
    m_MaxItemsPreview=10000)

# ----
# MeshVonMises
meshresultsmoothingtype_4 = MeshResultSmoothingType(
    {"None": 0, "ByPanel": 1, "BySelection": 2, "Global": 3, "ByFiniteElementCentres": 4}, selected="ByPanel",
    Component="BH.oM.Structure.Results.MeshResultSmoothingType",
    Selection=1)
meshresulttype_4 = MeshResultType(
    {"Forces": 0, "Stresses": 1, "Displacements": 2, "VonMises": 3}, selected="VonMises",
    Component="BH.oM.Structure.Results.MeshResultType",
    Selection=3)
panels_6 = BHoMObject(
    panels,
    ObjectType="{ \"_t\" : \"System.Type\", \"Name\" : \"System.Object, mscorlib, Version=4.0.0.0, Culture=neutral, PublicKeyToken=b77a5c561934e089\" }",
    m_ForcePreview=False,
    m_MaxItemsPreview=10000)
meshresultrequest_4 = MeshResultRequest(
    ResultType=meshresulttype_4,
    Smoothing=meshresultsmoothingtype_4,
    Layer="{ \"_t\" : \"System.Enum\", \"TypeName\" : { \"_t\" : \"System.Type\", \"Name\" : \"BH.oM.Structure.Results.MeshResultLayer\" }, \"Value\" : \"AbsoluteMaximum\" }",
    LayerPosition=0,
    Orientation="null",
    Component="BH.oM.Structure.Requests.MeshResultRequest")
adapter_16 = Data(adapter)
pull_15 = Pull(
    Adapter=adapter_16,
    Request=meshresultrequest_4,
    PullType="{ \"_t\" : \"System.Enum\", \"TypeName\" : { \"_t\" : \"System.Type\", \"Name\" : \"BH.oM.Adapter.PullType\" }, \"Value\" : \"AdapterDefault\" }",
    Active=Toggle(False),
    Component="{ .Pull")
result_23 = BHIObject(
    pull_15,
    ObjectType="{ \"_t\" : \"System.Type\", \"Name\" : \"System.Object, mscorlib, Version=4.0.0.0, Culture=neutral, PublicKeyToken=b77a5c561934e089\" }",
    m_ForcePreview=False,
    m_MaxItemsPreview=10000)
result_24 = BHIObject(
    result_23,
    ObjectType="{ \"_t\" : \"System.Type\", \"Name\" : \"System.Object, mscorlib, Version=4.0.0.0, Culture=neutral, PublicKeyToken=b77a5c561934e089\" }",
    m_ForcePreview=False,
    m_MaxItemsPreview=10000)

# ----
# FEMesh
createtype_3 = CreateType(Component="BH.oM.Structure.Elements.FEMesh")
filterrequest_3 = FilterRequest(Type=createtype_3, Component="{ .FilterRequest")
adapter_17 = Data(adapter)
pull_16 = Pull(
    Adapter=adapter_17,
    Request=filterrequest_3,
    PullType="{ \"_t\" : \"System.Enum\", \"TypeName\" : { \"_t\" : \"System.Type\", \"Name\" : \"BH.oM.Adapter.PullType\" }, \"Value\" : \"AdapterDefault\" }",
    Active=Toggle(False),
    Component="{ .Pull")
meshes = BHoMObject(
    pull_16,
    ObjectType="{ \"_t\" : \"System.Type\", \"Name\" : \"System.Object, mscorlib, Version=4.0.0.0, Culture=neutral, PublicKeyToken=b77a5c561934e089\" }",
    m_ForcePreview=False,
    m_MaxItemsPreview=10000)
meshes_2 = BHoMObject(
    meshes,
    ObjectType="{ \"_t\" : \"System.Type\", \"Name\" : \"System.Object, mscorlib, Version=4.0.0.0, Culture=neutral, PublicKeyToken=b77a5c561934e089\" }",
    m_ForcePreview=False,
    m_MaxItemsPreview=10000)

# ----
# NodeResults
# Pull
# Request
# Visualisation and inspection
adapter_18 = Data(adapter)

# ----
# Nodes
createtype_4 = CreateType(Component="BH.oM.Structure.Elements.Node")
filterrequest_4 = FilterRequest(Type=createtype_4, Component="{ .FilterRequest")
pull_17 = Pull(
    Adapter=adapter_18,
    Request=filterrequest_4,
    PullType="{ \"_t\" : \"System.Enum\", \"TypeName\" : { \"_t\" : \"System.Type\", \"Name\" : \"BH.oM.Adapter.PullType\" }, \"Value\" : \"AdapterDefault\" }",
    Active=Toggle(False),
    Component="{ .Pull")
nodes = BHoMObject(
    pull_17,
    ObjectType="{ \"_t\" : \"System.Type\", \"Name\" : \"System.Object, mscorlib, Version=4.0.0.0, Culture=neutral, PublicKeyToken=b77a5c561934e089\" }",
    m_ForcePreview=False,
    m_MaxItemsPreview=10000)
nodes_2 = BHoMObject(
    nodes,
    ObjectType="{ \"_t\" : \"System.Type\", \"Name\" : \"System.Object, mscorlib, Version=4.0.0.0, Culture=neutral, PublicKeyToken=b77a5c561934e089\" }",
    m_ForcePreview=False,
    m_MaxItemsPreview=10000)

result_25 = BHIObject(
    pull_5,
    ObjectType="{ \"_t\" : \"System.Type\", \"Name\" : \"System.Object, mscorlib, Version=4.0.0.0, Culture=neutral, PublicKeyToken=b77a5c561934e089\" }",
    m_ForcePreview=False,
    m_MaxItemsPreview=10000)
result_26 = BHIObject(
    result_25,
    ObjectType="{ \"_t\" : \"System.Type\", \"Name\" : \"System.Object, mscorlib, Version=4.0.0.0, Culture=neutral, PublicKeyToken=b77a5c561934e089\" }",
    m_ForcePreview=False,
    m_MaxItemsPreview=10000)
adapteridname_2 = Text(adapteridname)

scalefactordeformation_3 = Number(scalefactordeformation_2)
loadcasedeformation_2 = Text(loadcasedeformation)
meshes_3 = BHoMObject(
    meshes,
    ObjectType="{ \"_t\" : \"System.Type\", \"Name\" : \"System.Object, mscorlib, Version=4.0.0.0, Culture=neutral, PublicKeyToken=b77a5c561934e089\" }",
    m_ForcePreview=False,
    m_MaxItemsPreview=10000)
deformedshape = DeformedShape(
    Meshes=meshes_3,
    MeshDeformations=result_18,
    AdapterId=adapteridname_2,
    LoadCase=loadcasedeformation_2,
    ScaleFactor=scalefactordeformation_3,
    Component="{ .DeformedShape")

adapteridname_3 = Text(adapteridname)
adapteridname_4 = Text(adapteridname)

# ----
# Global Results
# Request
# GlobalReactions
globalresulttype = GlobalResultType(
    {"Reactions": 0, "ModalDynamics": 1}, selected="Reactions",
    Component="BH.oM.Structure.Requests.GlobalResultType",
    Selection=0)
globalresultrequest = GlobalResultRequest(ResultType=globalresulttype, Component="BH.oM.Structure.Requests.GlobalResultRequest")
# Pull
adapter_19 = Data(adapter)
pull_18 = Pull(
    Adapter=adapter_19,
    Request=globalresultrequest,
    PullType="{ \"_t\" : \"System.Enum\", \"TypeName\" : { \"_t\" : \"System.Type\", \"Name\" : \"BH.oM.Adapter.PullType\" }, \"Value\" : \"AdapterDefault\" }",
    Active=Toggle(False),
    Component="{ .Pull")

result_27 = BHIObject(
    pull_18,
    ObjectType="{ \"_t\" : \"System.Type\", \"Name\" : \"System.Object, mscorlib, Version=4.0.0.0, Culture=neutral, PublicKeyToken=b77a5c561934e089\" }",
    m_ForcePreview=False,
    m_MaxItemsPreview=10000)
result_28 = BHIObject(
    result_27,
    ObjectType="{ \"_t\" : \"System.Type\", \"Name\" : \"System.Object, mscorlib, Version=4.0.0.0, Culture=neutral, PublicKeyToken=b77a5c561934e089\" }",
    m_ForcePreview=False,
    m_MaxItemsPreview=10000)

# ----
# Visualisation and inspection
explode_2 = Explode(Object=result_28, Component="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")  # -> FX, FY, FZ, MX, MY, MZ, ObjectId, ResultCase, ModeNumber, TimeStep
vec = VectorXYZ(XComponent=explode_2.FX, YComponent=explode_2.FY, ZComponent=explode_2.FZ)  # -> Vector, Length
vec_2 = VectorXYZ(XComponent=explode_2.MX, YComponent=explode_2.MY, ZComponent=explode_2.MZ)  # -> Vector, Length
panel_9 = Panel(vec.Vector)
panel_10 = Panel(explode_2.ResultCase)
panel_11 = Panel(vec_2.Vector)

# ----
# ModalDynamics
# MeshResults
globalresulttype_2 = GlobalResultType(
    {"Reactions": 0, "ModalDynamics": 1}, selected="ModalDynamics",
    Component="BH.oM.Structure.Requests.GlobalResultType",
    Selection=1)
globalresultrequest_2 = GlobalResultRequest(ResultType=globalresulttype_2, Modes="1", Component="BH.oM.Structure.Requests.GlobalResultRequest")
adapter_20 = Data(adapter)
pull_19 = Pull(
    Adapter=adapter_20,
    Request=globalresultrequest_2,
    PullType="{ \"_t\" : \"System.Enum\", \"TypeName\" : { \"_t\" : \"System.Type\", \"Name\" : \"BH.oM.Adapter.PullType\" }, \"Value\" : \"AdapterDefault\" }",
    Active=Toggle(False),
    Component="{ .Pull")

result_29 = BHIObject(
    pull_19,
    ObjectType="{ \"_t\" : \"System.Type\", \"Name\" : \"System.Object, mscorlib, Version=4.0.0.0, Culture=neutral, PublicKeyToken=b77a5c561934e089\" }",
    m_ForcePreview=False,
    m_MaxItemsPreview=10000)
result_30 = BHIObject(
    result_29,
    ObjectType="{ \"_t\" : \"System.Type\", \"Name\" : \"System.Object, mscorlib, Version=4.0.0.0, Culture=neutral, PublicKeyToken=b77a5c561934e089\" }",
    m_ForcePreview=False,
    m_MaxItemsPreview=10000)

explode_3 = Explode(Object=result_30, Component="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")  # -> Frequency, ModalMass, ModalStiffness, ModalDamping, MassRatioX, MassRatioY, MassRatioZ, InertiaRatioX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

# ----
# Request
# Bar
createtype_5 = CreateType(Component="BH.oM.Structure.Elements.Bar")
filterrequest_5 = FilterRequest(Type=createtype_5, Component="{ .FilterRequest")
# Pull
adapter_21 = Data(adapter)
pull_20 = Pull(
    Adapter=adapter_21,
    Request=filterrequest_5,
    PullType="{ \"_t\" : \"System.Enum\", \"TypeName\" : { \"_t\" : \"System.Type\", \"Name\" : \"BH.oM.Adapter.PullType\" }, \"Value\" : \"AdapterDefault\" }",
    Active=Toggle(False),
    Component="{ .Pull")

bars = BHoMObject(
    pull_20,
    ObjectType="{ \"_t\" : \"System.Type\", \"Name\" : \"System.Object, mscorlib, Version=4.0.0.0, Culture=neutral, PublicKeyToken=b77a5c561934e089\" }",
    m_ForcePreview=False,
    m_MaxItemsPreview=10000)

# ----
# Visualisation and inspection
bars_2 = BHoMObject(
    bars,
    ObjectType="{ \"_t\" : \"System.Type\", \"Name\" : \"System.Object, mscorlib, Version=4.0.0.0, Culture=neutral, PublicKeyToken=b77a5c561934e089\" }",
    m_ForcePreview=False,
    m_MaxItemsPreview=10000)
localaxis = LocalAxis(bhom=bars_2)

# ---- group: Draw deformed shape
bars_3 = BHoMObject(
    pull_20,
    ObjectType="{ \"_t\" : \"System.Type\", \"Name\" : \"System.Object, mscorlib, Version=4.0.0.0, Culture=neutral, PublicKeyToken=b77a5c561934e089\" }",
    m_ForcePreview=False,
    m_MaxItemsPreview=10000)
scalefactordeformation_4 = Number(scalefactordeformation_2)
loadcasedeformation_3 = Text(loadcasedeformation)
deformedshape_2 = DeformedShape(
    Bars=bars_3,
    BarDeformations=result_26,
    AdapterId=adapteridname_4,
    LoadCase=loadcasedeformation_3,
    ScaleFactor=scalefactordeformation_4,
    DrawSections=False,
    Component="{ .DeformedShape")
preview = CustomPreview(Geometry=deformedshape_2, Shader=ColourSwatch(SwatchColor=RGB(74, 161, 74)))

# ---- group: Draw deformed shape with sections (slow due to slow loft)
bars_4 = BHoMObject(
    pull_20,
    ObjectType="{ \"_t\" : \"System.Type\", \"Name\" : \"System.Object, mscorlib, Version=4.0.0.0, Culture=neutral, PublicKeyToken=b77a5c561934e089\" }",
    m_ForcePreview=False,
    m_MaxItemsPreview=10000)
scalefactordeformation_5 = Number(scalefactordeformation)
loadcasedeformation_4 = Text(loadcasedeformation)
deformedshape_3 = DeformedShape(
    Bars=bars_4,
    BarDeformations=result_26,
    AdapterId=adapteridname_3,
    LoadCase=loadcasedeformation_4,
    ScaleFactor=scalefactordeformation_5,
    DrawSections=Toggle(True),
    Component="{ .DeformedShape")
explode_4 = Explode(Object=deformedshape_3, Component="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")  # -> simplify(Curves); disabled
loft = Loft(Curves=explode_4, Options={Adjust=False, Closed=False, LoftEnds=0, LoftSimp=0, LoftType=0, Rebuild=10, Refit=0.01})  # disabled
preview_2 = CustomPreview(Geometry=loft, Shader=ColourSwatch(SwatchColor=RGB(74, 161, 74)))  # disabled

# ==== cluster LocalAxis
bhom = ClusterInput()
bhom_2 = BHoMObject(
    bhom,
    ObjectType="{ \"_t\" : \"System.Type\", \"Name\" : \"System.Object, mscorlib, Version=4.0.0.0, Culture=neutral, PublicKeyToken=b77a5c561934e089\" }",
    m_ForcePreview=False,
    m_MaxItemsPreview=10000)
centreline = Centreline(Bar=bhom_2, Component="{ .Centreline")
coordinatesystem = CoordinateSystem(Bar=bhom_2, Component="{ .CoordinateSystem")
crv = Curve(centreline)
eval = EvaluateLength(Curve=crv, Length=Slider(0.5, range=0..1), Normalized=True)  # -> Point, Tangent, Parameter
explode = Explode(Object=coordinatesystem, Component="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")  # -> X, Y, Z, Origin
vdisex = VectorDisplayEx(Point=eval.Point, Vector=explode.Y, Colour=ColourSwatch(SwatchColor=RGB(0, 255, 0)), Width=2)
vdisex_2 = VectorDisplayEx(Point=eval.Point, Vector=explode.X, Colour=ColourSwatch(SwatchColor=RGB(0, 0, 255)), Width=2)
vdisex_3 = VectorDisplayEx(Point=eval.Point, Vector=explode.Z, Colour=ColourSwatch(SwatchColor=RGB(255, 0, 0)), Width=2)

# ==== cluster Cluster
filepath = ClusterInput()
selectedadapter = ClusterInput()
S = ClusterInput()
selectedadapter_2 = Integer(selectedadapter)
filepath_2 = Text(filepath)
gate = StreamGate(Stream=S, Gate=selectedadapter_2)  # -> Target0, Target1, Target2, Target3, Target4, Target5, Target6, Target7, Target8
gate_2 = StreamGate(Stream=filepath_2, Gate=selectedadapter_2)  # -> Target0, Target1, Target2, Target3, Target4, Target5, Target6, Target7, Target8
lusasv17adapter = LusasV17Adapter(FilePath=gate_2.Target6, Active=gate.Target6, Component="{ ..ctor")
lusasv18adapter = LusasV18Adapter(FilePath=gate_2.Target5, Active=gate.Target5, Component="{ ..ctor")
gsaadapter = GSAAdapter(FilePath=gate_2.Target4, Active=gate.Target4, Component="{ ..ctor")
# Adapter
robotadapter = RobotAdapter(FilePath=gate_2.Target0, Active=gate.Target0, Component="{ ..ctor")
etabs17adapter = ETABS17Adapter(FilePath=gate_2.Target1, Active=gate.Target1, Component="{ ..ctor")
etabs2016adapter = ETABS2016Adapter(FilePath=gate_2.Target2, Active=gate.Target2, Component="{ ..ctor")
ramadapter = RAMAdapter(FilePath=gate_2.Target8, Active=gate.Target8, Component="{ ..ctor")
midasciviladapter = MidasCivilAdapter(FilePath=gate_2.Target7, Active=gate.Target7, Component="{ ..ctor")
sap2000adapter = SAP2000Adapter(FilePath=gate_2.Target3, Active=gate.Target3, Component="{ ..ctor")
filter = StreamFilter(
    Gate=selectedadapter_2,
    Stream0=robotadapter,
    Stream1=etabs17adapter,
    Stream2=etabs2016adapter,
    Stream3=sap2000adapter,
    Stream4=gsaadapter,
    Stream5=lusasv18adapter,
    Stream6=lusasv17adapter,
    Stream7=midasciviladapter,
    Stream8=ramadapter)
getproperty = GetProperty(Obj=filter, PropName="AdapterIdName", Component="{ .GetProperty")
s_0 = ClusterOutput(filter)
txt = Text(getproperty)
adapteridname = ClusterOutput(txt)
