# Grasshopper definition AssignTags.gh (Grasshopper 0.9.76)
# plug-ins: BH.UI.Grasshopper

# ----
# Adapter
path = FilePath()
bhom = BHoMObject()

# ----
# Assign Tags
panel = Panel("""Steel Elements
Group_1
Test_Group""")
bhom_2 = BHoMObject([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])
txt = Text(panel)
propertyvalue = PropertyValue(Obj=bhom_2, PropName="Tags", Value=txt, Component="{ .PropertyValue")

igeometry = IGeometry(Obj=bhom_2, Component="{ .IGeometry")
bhomgeo = BHoMGeometry(igeometry)
bhomgeo_2 = BHoMGeometry(["{ \"_t\" : \"BH.oM.Geometry.Point\", \"X\" : 0.0, \"Y\" : 85.425527846168293, \"Z\" : -1.57837487694592 }", "{ \"_t\" : \"BH.oM.Geometry.Point\", \"X\" : 0.0, \"Y\" : 86.137494868873702, \"Z\" : 0.43886502071964001 }", "{ \"_t\" : \"BH.oM.Geometry.Line\", \"Start\" : { \"_t\" : \"BH.oM.Geometry.Point\", \"X\" : 0.0, \"Y\" : 116.464493508782, \"Z\" : 5.8137580930842097 }, \"End\" : { \"_t\" : \"BH.oM.Geometry.Point\", \"X\" : 0.0, \"Y\" : 116.48983841942101, \"Z\" : 4.5211676505154204 }, \"Infinite\" : false }", "{ \"_t\" : \"BH.oM.Geometry.Line\", \"Start\" : { \"_t\" : \"BH.oM.Geometry.Point\", \"X\" : 0.0, \"Y\" : 116.48983841942101, \"Z\" : 4.5211676505154204 }, \"End\" : { \"_t\" : \"BH.oM.Geometry.Point\", \"X\" : 0.0, \"Y\" : 117.22484082794, \"Z\" : 4.5211676505154204 }, \"Infinite\" : false }"])
bhomgeo_3 = BHoMGeometry(bhomgeo_2)
bhom_3 = BHoMObject(bhom_2)

# ----
# Push
toggle = BooleanToggle(False)
bhom_4 = BHoMObject(propertyvalue)
push = Push(Adapter=bhom, Objects=bhom_4, Active=toggle, Component="{ .Push")  # -> Objects, Success

null = NullItem(Item=bhomgeo_3)  # -> NullFlags, InvalidFlags, Description
cull = CullPattern(List=bhom_3, CullPattern=invert(null.NullFlags))
cull_2 = CullPattern(List=bhomgeo_3, CullPattern=invert(null.NullFlags))
cull_3 = CullPattern(List=bhom_3, CullPattern=null.NullFlags)
isetgeometry = ISetGeometry(Element1D=cull, Curve=cull_2, Component="{ .ISetGeometry")
isetgeometry_2 = ISetGeometry(Element0D=cull, Point=cull_2, Component="{ .ISetGeometry")
isetgeometry_3 = ISetGeometry(Obj=cull, Geometry=cull_2, Component="{ .ISetGeometry")
merge = Merge(Data1=isetgeometry_2, Data2=isetgeometry)
clean = CleanTree(RemoveNulls=True, RemoveInvalid=True, RemoveEmpty=False, Tree=merge)
merge_2 = Merge(Data1=cull_3, Data2=clean)
bhom_5 = BHoMObject(merge_2)
