# Grasshopper definition CreateBars.gh (Grasshopper 0.9.76)
# plug-ins: Alligator

# ----
# Create Adapter Here
# File Path to reference model file
# Plug structural adapter in to this component.
path = FilePath("C:\Users\pnugent\Desktop\wgsdgh.mdl")
bhom = BHoMObject()

line = Line([Line((0, -0.09581336744, 0.5748802047), (0, -0.09581336744, 4.790668372)), Line((0, -0.09581336744, 4.790668372), (0, -0.09581336744, 12.0724843)), Line((0, -0.09581336744, 4.790668372), (0, 3.73672133, 4.790668372)), Line((0, 3.73672133, 4.790668372), (0, 3.73672133, -0.09581336744)), Line((0, 5.365548577, 2.970214391), (0, 8.431576335, 2.970214391)), Line((0, 8.431576335, 2.970214391), (0, 8.335762968, 4.599041637))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])

# ----
# Create Bars
bar = Bar(
    Line=line,
    OrientationAngle=0,
    FeaType="{ \"_t\" : \"System.Enum\", \"TypeName\" : { \"_t\" : \"System.Type\", \"Name\" : \"BH.oM.Structure.Elements.BarFEAType\" }, \"Value\" : \"Flexural\" }",
    Component="{ .Bar")

bhom_2 = BHoMObject(bar)
push = Push(Adapter=bhom, Objects=bhom_2, Active=Toggle(False), Component="{ .Push")  # -> Objects, Success
