# Grasshopper definition CreateNodes.gh (Grasshopper 0.9.76)
# plug-ins: Alligator

# ----
# Create Adapter Here
# File Path to reference model file
# Plug structural adapter in to this component.
path = FilePath("C:\Users\pnugent\Desktop\wgsdgh.mdl")
bhom = BHoMObject()

pt = Point([Point(0, 48.87958545, 15.08731906), Point(0, 51.07010597, 15.08731906), Point(0, 53.84476529, 15.08731906), Point(0, 54.7209735, 13.91904145), Point(0, 53.69873059, 12.02059033), Point(0, 52.82252238, 10.12213922)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])

# ----
# Create Nodes
node = Node(Position=pt, Component="{ .Node")

push = Push(Adapter=bhom, Objects=node, Active=Toggle(False), Component="{ .Push")  # -> Objects, Success
