# Grasshopper definition CreatePlanarPanels.gh (Grasshopper 0.9.76)
# plug-ins: Alligator

# ----
# Create Adapter Here
# File Path to reference model file
# Plug structural adapter in to this component.
path = FilePath("C:\Users\pnugent\Desktop\wgsdgh.mdl")
bhom = BHoMObject()

brep = Brep([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])

# ----
# Create Planar Panels
edges = BrepEdges(Brep=brep)  # -> Naked, Interior, NonManifold
join = JoinCurves(Curves=edges.Naked, Preserve=False)  # -> flatten(Curves)

crv = Curve(join)

panelplanar = PanelPlanar(Outlines=crv, Component="{ .PanelPlanar")

bhom_2 = BHoMObject(panelplanar)
push = Push(Adapter=bhom, Objects=bhom_2, Active=Toggle(False), Component="{ .Push")  # -> Objects, Success
