# Grasshopper definition BHoM Samples - Interop - Revit_Robot.gh (Grasshopper 0.9.76)
# plug-ins: BH.UI.Grasshopper

createtype = CreateType(Component="{ \"_t\" : \"System.Type\", \"Name\" : \"BH.oM.Structure.Elements.Panel\" }")
createtype_2 = CreateType(Component="{ \"_t\" : \"System.Type\", \"Name\" : \"BH.oM.Physical.Elements.IFramingElement\" }")

# ----
# Pulling Revit Data Script
# Revit Adapter Script
# Toggle on to activate connection to Revit
toggle = BooleanToggle(True)
revitadapter = RevitAdapter(Active=toggle, Component="{ ..ctor")
data_revit_adapter = Data(revitadapter)

# ----
# Revit Framing Element Pull Script
toggle_2 = BooleanToggle(True)
data_revit_adapter_2 = Data(data_revit_adapter)

# ----
# Revit Panel Pull Script
toggle_3 = BooleanToggle(True)
data_revit_adapter_3 = Data(data_revit_adapter)

filterrequest = FilterRequest(Type=createtype_2, Component="{ .FilterRequest")
filterrequest_2 = FilterRequest(Type=createtype, Component="{ .FilterRequest")
pull = Pull(Adapter=data_revit_adapter_2, Request=filterrequest, Active=toggle_2, Component="{ .Pull")
pull_2 = Pull(Adapter=data_revit_adapter_3, Query=filterrequest_2, Active=toggle_3, Component="{ .Pull")
bhom = BHoMObject(pull, m_ForcePreview=False, m_MaxItemsPreview=10000)
bhom_2 = BHoMObject(pull_2, m_ForcePreview=False, m_MaxItemsPreview=10000)

# ----
# Internalise Data & Preview
bhom_object_revit_framing_elements = BHoMObject(bhom, m_ForcePreview=False, m_MaxItemsPreview=10000)
bhom_object_revit_panels = BHoMObject(bhom_2, m_ForcePreview=False, m_MaxItemsPreview=10000)
alledgecurves = AllEdgeCurves(Panel=bhom_object_revit_panels, Component="{ .AllEdgeCurves")
analyticalbars = AnalyticalBars(
    Elements=bhom_object_revit_framing_elements,
    AngleTolerance=0.1570796327,
    MaxNbBarsPerArc=10,
    Component="{ .AnalyticalBars")
boundary = BoundarySurfaces(Edges=alledgecurves)

# ----
# Adapter Script
# Create Adapter for Robot/ETabs / Lusas
toggle_4 = BooleanToggle(False)

path = FilePath()
createadapter = CreateAdapter()

# ----
# Pushing Data to Robot/ETabs/Lusas Script
# Pushing Object to Robot/ETabs/Lusas Script
bhom_3 = BHoMObject(m_ForcePreview=False, m_MaxItemsPreview=10000)
data_robot_adapter = Data(bhom_3)

# ----
# BHoM - Slab & Wall Split
bhom_object_revit_panels_2 = BHoMObject(bhom_object_revit_panels, m_ForcePreview=False, m_MaxItemsPreview=10000)
bhom_panels = BHoMObject(bhom_object_revit_panels_2, m_ForcePreview=False, m_MaxItemsPreview=10000)
bhom_panels_2 = BHoMObject(bhom_object_revit_panels_2, m_ForcePreview=False, m_MaxItemsPreview=10000)

alledgecurves_2 = AllEdgeCurves(Panel=bhom_object_revit_panels_2, Component="{ .AllEdgeCurves")

cp = ControlPoints(Curve=alledgecurves_2)  # -> Points, Weights, Knots
trim = TrimTree(Tree=cp.Points, Depth=1)
fitplane = FitPlane(Points=trim, Tolerance=1e-06, Component="{ .FitPlane")
deplane = DeconstructPlane(Plane=fitplane)  # -> Origin, XAxis, YAxis, ZAxis
pdecon = Deconstruct(Point=deplane.ZAxis)  # -> XComponent, YComponent, ZComponent
abs = Absolute(Value=pdecon.ZComponent)  # -> flatten(Result)
smaller = SmallerThan(FirstNumber=abs, SecondNumber="1e-5")  # -> SmallerThan, OrEqualTo
bool = Boolean(invert(smaller.SmallerThan))
bool_2 = Boolean(smaller.SmallerThan)
cull = CullPattern(List=bhom_panels, CullPattern=bool)
cull_2 = CullPattern(List=bhom_panels_2, CullPattern=bool_2)
clean = CleanTree(RemoveNulls=True, RemoveInvalid=True, RemoveEmpty=True, Tree=cull)
clean_2 = CleanTree(RemoveNulls=True, RemoveInvalid=True, RemoveEmpty=True, Tree=cull_2)
bhom_slabs = BHoMObject(clean, m_ForcePreview=False, m_MaxItemsPreview=10000)
bhom_walls = BHoMObject(clean_2, m_ForcePreview=False, m_MaxItemsPreview=10000)

# ----
# Convert from BHoM Framing Elements to BHoM Bars Script
bhom_object_revit_framing_elements_2 = BHoMObject(bhom_object_revit_framing_elements, m_ForcePreview=False, m_MaxItemsPreview=10000)

analyticalbars_2 = AnalyticalBars(
    Elements=bhom_object_revit_framing_elements_2,
    AngleTolerance=0.1570796327,
    MaxNbBarsPerArc=10,
    Component="{ .AnalyticalBars")

bhom_object_bar_elements = BHoMObject(analyticalbars_2, m_ForcePreview=False, m_MaxItemsPreview=10000)

# ----
# Collecting Member Components
bhom_object_bar_elements_2 = BHoMObject(bhom_object_bar_elements, m_ForcePreview=False, m_MaxItemsPreview=10000)
bhom_slabs_2 = BHoMObject(bhom_slabs, m_ForcePreview=False, m_MaxItemsPreview=10000)
bhom_walls_2 = BHoMObject(bhom_walls, m_ForcePreview=False, m_MaxItemsPreview=10000)

# ----
# Adding Supports to Base Nodes Script
bhom_object_bar_elements_3 = BHoMObject(bhom_object_bar_elements_2, m_ForcePreview=False, m_MaxItemsPreview=10000)

# ----
# Extracting Bar Nodes Script
panel = Panel("""StartNode
EndNode""")
propertyvalue = PropertyValue(Obj=bhom_object_bar_elements_3, PropName=panel, Component="{ .PropertyValue")  # -> flatten(Value)
bhom_object_bar_nodes = BHoMObject(propertyvalue, m_ForcePreview=False, m_MaxItemsPreview=10000)

bhom_walls_3 = BHoMObject(bhom_walls_2, m_ForcePreview=False, m_MaxItemsPreview=10000)

# ----
# Extracting Wall Nodes Script
explode = Explode(Object=bhom_walls_3, Component="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")  # -> ExternalEdges, Openings, Property, BHoM_Guid, Name, Fragments, Tags, CustomData
explode_2 = Explode(Object=explode.ExternalEdges, Component="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")  # -> Curve, Release, Support, BHoM_Guid, Name, Fragments, Tags, CustomData
explode_3 = Explode(Curve=explode_2.Curve, Recursive=True)  # -> Segments, Vertices
data_wall_nodes = Data(explode_3.Vertices)

bhom_slabs_3 = BHoMObject(bhom_slabs_2, m_ForcePreview=False, m_MaxItemsPreview=10000)

# ----
# Editting Slab Properties Script
# Revit slabs are 250mm THK C30/37 concrete
# Edit to 300mm THK C40/50 concrete
panel_2 = Panel("0.3")
concrete = Concrete(
    {"C12/15": JustDoIt, "C16/20": JustDoIt, "C20/25": JustDoIt, "C25/30": JustDoIt, "C30/37": JustDoIt, "C35/45": JustDoIt, "C40/50": JustDoIt, "C45/55": JustDoIt, "C50/60": JustDoIt, "C55/67": JustDoIt, "C60/75": JustDoIt, "C70/85": JustDoIt, "C80/95": JustDoIt, "C90/105": JustDoIt}, selected="C40/50",
    FileName="Materials\MaterialsEurope\Concrete")
constantthickness = ConstantThickness(Thickness=panel_2, Material=concrete, Name="300mm THK R.C. Slab", Type=null, Component="{ .ConstantThickness")
propertyvalue_2 = PropertyValue(Obj=bhom_slabs_3, PropName="Property", Value=constantthickness, Component="{ .PropertyValue")
edited_bhom_slabs = BHoMObject(propertyvalue_2, m_ForcePreview=False, m_MaxItemsPreview=10000)

edited_bhom_object = BHoMObject(edited_bhom_slabs, m_ForcePreview=False, m_MaxItemsPreview=10000)

# ----
# Extracting Wall Base Nodes Script
data_wall_nodes_2 = Data(data_wall_nodes)
pdecon_2 = Deconstruct(Point=data_wall_nodes_2)  # -> XComponent, YComponent, ZComponent
smaller_2 = SmallerThan(FirstNumber=pdecon_2.ZComponent, SecondNumber="1e-6")  # -> SmallerThan, OrEqualTo
cull_3 = CullPattern(List=data_wall_nodes_2, CullPattern=smaller_2.SmallerThan)  # -> flatten(List)
data_wall_support_nodes = Data(cull_3)

# ----
# Preview Slab Property Updates Script
explode_4 = Explode(Object=edited_bhom_object, Component="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")  # -> ExternalEdges, Openings, Property, BHoM_Guid, Name, Fragments, Tags, CustomData
explode_5 = Explode(Object=explode_4.Property, Component="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")  # -> Thickness, Material, PanelType, BHoM_Guid, Name, Fragments, Tags, CustomData
panel_3 = Panel(explode_5.Thickness)
panel_4 = Panel(explode_5.Name)
explode_6 = Explode(Object=explode_5.Material, Component="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")  # -> Density, DampingRatio, PoissonsRatio, ThermalExpansionCoeff, YoungsModulus, CylinderStrength, CubeStrength, BHoM_Guid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
panel_5 = Panel(explode_6.CustomData)

# ----
# Extracting Base Nodes Script
bhom_object_bar_nodes_2 = BHoMObject(bhom_object_bar_nodes, m_ForcePreview=False, m_MaxItemsPreview=10000)
bhom_object_bar_nodes_3 = BHoMObject(bhom_object_bar_nodes_2, m_ForcePreview=False, m_MaxItemsPreview=10000)

position = Position(Node=bhom_object_bar_nodes_2, Component="{ .Position")

pdecon_3 = Deconstruct(Point=position)  # -> XComponent, YComponent, ZComponent
smaller_3 = SmallerThan(FirstNumber=pdecon_3.ZComponent, SecondNumber="1e-6")  # -> SmallerThan, OrEqualTo
cull_4 = CullPattern(List=bhom_object_bar_nodes_3, CullPattern=smaller_3.SmallerThan)
bhom_object_support_nodes = BHoMObject(cull_4, m_ForcePreview=False, m_MaxItemsPreview=10000)

# ----
# Setting Bar Support Property Script
toggle_5 = BooleanToggle(True)
toggle_6 = BooleanToggle(False)
bhom_object_support_nodes_2 = BHoMObject(bhom_object_support_nodes, m_ForcePreview=False, m_MaxItemsPreview=10000)
constraint6dof = Constraint6DOF(X=toggle_5, Y=toggle_5, Z=toggle_5, Xx=toggle_6, Yy=toggle_6, Zz=toggle_6, Name="Pinned", Component="{ .Constraint6DOF")

setproperty = SetProperty(Obj=bhom_object_support_nodes_2, PropName="Support", Value=constraint6dof, Component="{ .SetProperty")
bhom_object_bar_support_nodes = BHoMObject(setproperty, m_ForcePreview=False, m_MaxItemsPreview=10000)

# ----
# Creating Wall Nodes with Support Property Script
boolean_toggle = BooleanToggle(True)
boolean_toggle_2 = BooleanToggle(True)
data_wall_support_nodes_2 = Data(data_wall_support_nodes)
cullpt = CullDuplicates(Points=data_wall_support_nodes_2, Tolerance=0.1, CullMode=3)  # -> Points, Indices, Valence

constraint6dof_2 = Constraint6DOF(
    X=boolean_toggle,
    Y=boolean_toggle,
    Z=boolean_toggle,
    Xx=boolean_toggle_2,
    Yy=boolean_toggle_2,
    Zz=boolean_toggle_2,
    Name="Fixed",
    Component="{ .Constraint6DOF")

node = Node(Coordinates=cullpt.Points, Support=constraint6dof_2, Component="{ .Node")

bhom_object_wall_support_nodes = BHoMObject(node, m_ForcePreview=False, m_MaxItemsPreview=10000)

# ----
# Combine Support Nodes Script
bhom_object_bar_support_nodes_2 = BHoMObject(bhom_object_bar_support_nodes, m_ForcePreview=False, m_MaxItemsPreview=10000)
bhom_object_wall_support_nodes_2 = BHoMObject(bhom_object_wall_support_nodes, m_ForcePreview=False, m_MaxItemsPreview=10000)
bhom_object_support_nodes_3 = BHoMObject([bhom_object_bar_support_nodes_2, bhom_object_wall_support_nodes_2], m_ForcePreview=False, m_MaxItemsPreview=10000)

# ----
# Combing All BHoM Data Script
bhom_object_support_nodes_4 = BHoMObject(bhom_object_support_nodes_3, m_ForcePreview=False, m_MaxItemsPreview=10000)
bhom_object_bar_elements_4 = BHoMObject(bhom_object_bar_elements_2, m_ForcePreview=False, m_MaxItemsPreview=10000)
edited_bhom_slabs_2 = BHoMObject(edited_bhom_slabs, m_ForcePreview=False, m_MaxItemsPreview=10000)
bhom_walls_4 = BHoMObject(bhom_walls_2, m_ForcePreview=False, m_MaxItemsPreview=10000)
bhom_object_combined = BHoMObject(
    [bhom_object_support_nodes_4, bhom_object_bar_elements_4, bhom_walls_4, edited_bhom_slabs_2],
    m_ForcePreview=False,
    m_MaxItemsPreview=10000)

bhom_object_combined_2 = BHoMObject(bhom_object_combined, m_ForcePreview=False, m_MaxItemsPreview=10000)

push = Push(Adapter=data_robot_adapter, Objects=bhom_object_combined_2, Active=Toggle(True), Component="{ .Push")  # -> Objects, Success
