# Grasshopper definition BHoM Samples - Interop - Revit_Robot.gh (Grasshopper 0.9.76)
# plug-ins: BH.UI.Grasshopper

createtype = CreateType(Component="{ \"_t\" : \"System.Type\", \"Name\" : \"BH.oM.Structure.Elements.PanelPlanar\" }")
createtype_2 = CreateType(Component="{ \"_t\" : \"System.Type\", \"Name\" : \"BH.oM.Structure.Elements.FramingElement\" }")

# ----
# Pulling Revit Data Script
# Revit Adapter Script
# Toggle on to activate connection to Revit
toggle = BooleanToggle(False)
revitadapter = RevitAdapter(Active=toggle, Component="{ ..ctor")
data_revit_adapter = Data(revitadapter)

filterquery = FilterQuery(Type=createtype_2, Component="{ .FilterQuery")
filterquery_2 = FilterQuery(Type=createtype, Component="{ .FilterQuery")

# ----
# Revit Framing Element Pull Script
toggle_2 = BooleanToggle(True)
data_revit_adapter_2 = Data(data_revit_adapter)

pull = Pull(Adapter=data_revit_adapter_2, Active=False, Component="{ .Pull")
pull_2 = Pull(Adapter=data_revit_adapter_2, Query=filterquery, Active=toggle_2, Component="{ .Pull")

bhom_object_revit_framing_elements = BHoMObject(pull_2)

# ----
# Revit Panel Pull Script
toggle_3 = BooleanToggle(True)
data_revit_adapter_3 = Data(data_revit_adapter)

pull_3 = Pull(Adapter=data_revit_adapter_3, Query=filterquery_2, Active=toggle_3, Component="{ .Pull")

bhom_object_revit_panels = BHoMObject(pull_3)

# ----
# Internalise Data & Preview
bhom_object_revit_framing_elements_2 = BHoMObject(bhom_object_revit_framing_elements)
bhom_object_revit_panels_2 = BHoMObject(bhom_object_revit_panels)
alledgecurves = AllEdgeCurves(Panel=bhom_object_revit_panels_2, Component="{ .AllEdgeCurves")
analyticalbars = AnalyticalBars(Element=bhom_object_revit_framing_elements_2, Component="{ .AnalyticalBars")
boundary = BoundarySurfaces(Edges=alledgecurves)

# ----
# BHoM - Slab & Wall Split
bhom_object_revit_panels_3 = BHoMObject(bhom_object_revit_panels_2)
alledgecurves_2 = AllEdgeCurves(Panel=bhom_object_revit_panels_3, Component="{ .AllEdgeCurves")
cp = ControlPoints(Curve=alledgecurves_2)  # -> Points, Weights, Knots
trim = TrimTree(Tree=cp.Points, Depth=1)
fitplane = FitPlane(Points=trim, Tolerance=1e-06, Component="{ .FitPlane")
deplane = DeconstructPlane(Plane=fitplane)  # -> Origin, XAxis, YAxis, ZAxis
pdecon = Deconstruct(Point=deplane.ZAxis)  # -> XComponent, YComponent, ZComponent
abs = Absolute(Value=pdecon.ZComponent)  # -> flatten(Result)
smaller = SmallerThan(FirstNumber=abs, SecondNumber="1e-5")  # -> SmallerThan, OrEqualTo
bhom_panels = BHoMObject(bhom_object_revit_panels_3)
bhom_panels_2 = BHoMObject(bhom_object_revit_panels_3)
bool = Boolean(invert(smaller.SmallerThan))
bool_2 = Boolean(smaller.SmallerThan)
cull = CullPattern(List=bhom_panels, CullPattern=bool)
cull_2 = CullPattern(List=bhom_panels_2, CullPattern=bool_2)
clean = CleanTree(RemoveNulls=True, RemoveInvalid=True, RemoveEmpty=True, Tree=cull)
clean_2 = CleanTree(RemoveNulls=True, RemoveInvalid=True, RemoveEmpty=True, Tree=cull_2)
bhom_walls = BHoMObject(clean_2)
bhom_slabs = BHoMObject(clean)

# ----
# Convert from BHoM Framing Elements to BHoM Bars Script
bhom_object_revit_framing_elements_3 = BHoMObject(bhom_object_revit_framing_elements_2)
analyticalbars_2 = AnalyticalBars(Element=bhom_object_revit_framing_elements_3, Component="{ .AnalyticalBars")
bhom_object_bar_elements = BHoMObject(analyticalbars_2)

# ----
# Collecting Member Components
bhom_object_bar_elements_2 = BHoMObject(bhom_object_bar_elements)
bhom_slabs_2 = BHoMObject(bhom_slabs)
bhom_walls_2 = BHoMObject(bhom_walls)

# ----
# Adding Supports to Base Nodes Script
# Extracting Bar Nodes Script
bhom_object_bar_elements_3 = BHoMObject(bhom_object_bar_elements_2)
panel = Panel("""StartNode
EndNode""")
propertyvalue = PropertyValue(Obj=bhom_object_bar_elements_3, PropName=panel, Component="{ .PropertyValue")  # -> flatten(Value)
bhom_object_bar_nodes = BHoMObject(propertyvalue)

# ----
# Editting Slab Properties Script
# Revit slabs are 250mm THK C30/37 concrete
# Edit to 300mm THK C40/50 concrete
panel_2 = Panel("0.3")
concrete = Concrete(
    {"C12/15": JustDoIt, "C16/20": JustDoIt, "C20/25": JustDoIt, "C25/30": JustDoIt, "C30/37": JustDoIt, "C35/45": JustDoIt, "C40/50": JustDoIt, "C45/55": JustDoIt, "C50/60": JustDoIt, "C55/67": JustDoIt, "C60/75": JustDoIt, "C70/85": JustDoIt, "C80/95": JustDoIt, "C90/105": JustDoIt}, selected="C40/50",
    FileName="Materials\MaterialsEurope\Concrete")
bhom_slabs_3 = BHoMObject(bhom_slabs_2)
constantthickness = ConstantThickness(
    Thickness=panel_2,
    Material=concrete,
    Name="300mm THK R.C. Slab",
    Type="{ \"_t\" : \"System.Enum\", \"TypeName\" : { \"_t\" : \"System.Type\", \"Name\" : \"BH.oM.Structure.Properties.Surface.PanelType\" }, \"Value\" : \"Undefined\" }",
    Component="{ .ConstantThickness")
propertyvalue_2 = PropertyValue(Obj=bhom_slabs_3, PropName="Property", Value=constantthickness, Component="{ .PropertyValue")
editted_bhom_slabs = BHoMObject(propertyvalue_2)

# ----
# Extracting Wall Nodes Script
bhom_walls_3 = BHoMObject(bhom_walls_2)
explode = Explode(Object=bhom_walls_3, Component="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")  # -> ExternalEdges, Openings, Property, BHoM_Guid, Name, Tags, CustomData
explode_2 = Explode(Object=explode.ExternalEdges, Component="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")  # -> Curve, Constraint, BHoM_Guid, Name, Tags, CustomData
explode_3 = Explode(Curve=explode_2.Curve, Recursive=True)  # -> Segments, Vertices
data_wall_nodes = Data(explode_3.Vertices)

# ----
# Extracting Base Nodes Script
panel_3 = Panel("Position")
bhom_object_bar_nodes_2 = BHoMObject(bhom_object_bar_nodes)
propertyvalue_3 = PropertyValue(Obj=bhom_object_bar_nodes_2, PropName=panel_3, Component="{ .PropertyValue")  # -> flatten(Value)
pdecon_2 = Deconstruct(Point=propertyvalue_3)  # -> XComponent, YComponent, ZComponent
bhom_object_bar_nodes_3 = BHoMObject(bhom_object_bar_nodes_2)
smaller_2 = SmallerThan(FirstNumber=pdecon_2.ZComponent, SecondNumber="1e-6")  # -> SmallerThan, OrEqualTo
cull_3 = CullPattern(List=bhom_object_bar_nodes_3, CullPattern=smaller_2.SmallerThan)
bhom_object_support_nodes = BHoMObject(cull_3)

# ----
# Preview Slab Property Updates Script
editted_bhom_object = BHoMObject(editted_bhom_slabs)
explode_4 = Explode(Object=editted_bhom_object, Component="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")  # -> ExternalEdges, Openings, Property, BHoM_Guid, Name, Tags, CustomData
explode_5 = Explode(Object=explode_4.Property, Component="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")  # -> Thickness, Material, PanelType, BHoM_Guid, Name, Tags, CustomData
panel_4 = Panel(explode_5.Thickness)
panel_5 = Panel(explode_5.Name)
explode_6 = Explode(Object=explode_5.Material, Component="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")  # -> Type, YoungsModulus, PoissonsRatio, DryDensity, CoeffThermalExpansion, DampingRatio, Density, CompressiveYieldStrength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
panel_6 = Panel(explode_6.Name)

# ----
# Extracting Wall Base Nodes Script
data_wall_nodes_2 = Data(data_wall_nodes)
pdecon_3 = Deconstruct(Point=data_wall_nodes_2)  # -> XComponent, YComponent, ZComponent
smaller_3 = SmallerThan(FirstNumber=pdecon_3.ZComponent, SecondNumber="1e-6")  # -> SmallerThan, OrEqualTo
cull_4 = CullPattern(List=data_wall_nodes_2, CullPattern=smaller_3.SmallerThan)  # -> flatten(List)
data_wall_support_nodes = Data(cull_4)

# ----
# Setting Bar Support Property Script
toggle_4 = BooleanToggle(True)
toggle_5 = BooleanToggle(False)
bhom_object_support_nodes_2 = BHoMObject(bhom_object_support_nodes)
constraint6dof = Constraint6DOF(X=toggle_4, Y=toggle_4, Z=toggle_4, Xx=toggle_5, Yy=toggle_5, Zz=toggle_5, Name="Pinned", Component="{ .Constraint6DOF")
setproperty = SetProperty(BHoMObject=bhom_object_support_nodes_2, Key="Constraint", Value=constraint6dof)
bhom_object_bar_support_nodes = BHoMObject(setproperty)

# ----
# Creating Wall Nodes with Support Property Script
boolean_toggle = BooleanToggle(True)
boolean_toggle_2 = BooleanToggle(True)
data_wall_support_nodes_2 = Data(data_wall_support_nodes)
cullpt = CullDuplicates(Points=data_wall_support_nodes_2, Tolerance=0.1, CullMode=3)  # -> Points, Indices, Valence

constraint6dof_2 = Constraint6DOF(
    X=boolean_toggle,
    Y=boolean_toggle,
    Z=boolean_toggle,
    Xx=boolean_toggle_2,
    Yy=boolean_toggle_2,
    Zz=boolean_toggle_2,
    Name="Fixed",
    Component="{ .Constraint6DOF")

node = Node(Position=cullpt.Points, Constraint=constraint6dof_2, Component="{ .Node")
bhom_object_wall_support_nodes = BHoMObject(node)

# ----
# Combine Support Nodes Script
bhom_object_wall_support_nodes_2 = BHoMObject(bhom_object_wall_support_nodes)
bhom_object_bar_support_nodes_2 = BHoMObject(bhom_object_bar_support_nodes)
bhom_object_support_nodes_3 = BHoMObject([bhom_object_bar_support_nodes_2, bhom_object_wall_support_nodes_2])

# ----
# Combing All BHoM Data Script
bhom_object_bar_elements_4 = BHoMObject(flatten(bhom_object_bar_elements_2))
bhom_object_support_nodes_4 = BHoMObject(bhom_object_support_nodes_3)
editted_bhom_slabs_2 = BHoMObject(editted_bhom_slabs)
bhom_walls_4 = BHoMObject(bhom_walls_2)
bhom_object_combined = BHoMObject(flatten([bhom_object_support_nodes_4, bhom_object_bar_elements_4, bhom_walls_4, editted_bhom_slabs_2]))

# ----
# Robot Adapter Script
# Toggle on to activate connection to Robot
toggle_6 = BooleanToggle(False)

robotadapter = RobotAdapter(Active=toggle_6, Component="{ ..ctor")

data_robot_adapter = Data(robotadapter)

# ----
# Pushing Data to Robot Script
# Pushing Object to Robot Script
data_robot_adapter_2 = Data(data_robot_adapter)

bhom_object_combined_2 = BHoMObject(flatten(bhom_object_combined))
push = Push(Adapter=data_robot_adapter_2, Objects=bhom_object_combined_2, Active=Toggle(True), Component="{ .Push")  # -> Objects, Success
