# Dynamo graph 181220_S_BHoM Samples - Push to ETABS - Dynamo.dyn (Dynamo 1.3.3.4651)

# group: Pull from Revit
boolean = BoolSelector(true)
revitAdapter = CreateAdapterComponent(arg1=boolean)
createType = CreateTypeComponent()
filterQuery = CreateQueryComponent(createType)
boolean_2 = BoolSelector(true)
pull = PullComponent(revitAdapter, filterQuery, arg3=boolean_2)

# group: Push to ETABS
boolean_3 = BoolSelector(true)
ETABSAdapter = CreateAdapterComponent(arg2=boolean_3)
boolean_4 = BoolSelector(true)
push = PushComponent(ETABSAdapter, pull, arg4=boolean_4)
