# Dynamo graph BHoM Samples - Push to Robot - Dynamo.dyn (Dynamo 1.3.4.6666)

# group: Pull from Revit
boolean = BoolSelector(true)
revitAdapter = CreateAdapterComponent(arg1=boolean)
createType = CreateTypeComponent()
filterRequest = CreateRequestComponent(createType)
boolean_2 = BoolSelector(true)
pull = PullComponent(revitAdapter, filterRequest, arg3=boolean_2)

# group: Push to Robot
boolean_3 = BoolSelector(true)
robotAdapter = CreateAdapterComponent(arg2=boolean_3)
analyticalBars = QueryComponent(pull)
boolean_4 = BoolSelector(true)
push = PushComponent(robotAdapter, analyticalBars, arg4=boolean_4)
