# Grasshopper definition CreateBarVaryingDistributedLoads.gh (Grasshopper 0.9.76)
# plug-ins: BH.UI.Grasshopper

# ----
# Adapter
path = FilePath()
bhom = BHoMObject()

# ----
# Create Loadcase
panel = Panel("Loadcase1")
loadcase = Loadcase(
    Name=panel,
    Number=Slider(1, range=0..10),
    Nature="{ \"_t\" : \"System.Enum\", \"TypeName\" : { \"_t\" : \"System.Type\", \"Name\" : \"BH.oM.Structure.Loads.LoadNature\" }, \"Value\" : \"Other\" }",
    Component="{ .Loadcase")

# ----
# Push
toggle = BooleanToggle(False)
bhom_2 = BHoMObject([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])
push = Push(Adapter=bhom, Objects=bhom_2, Active=toggle, Component="{ .Push")  # -> Objects, Success

igeometry = IGeometry(Obj=bhom_2, Component="{ .IGeometry")
bhomgeo = BHoMGeometry(igeometry)
bhomgeo_2 = BHoMGeometry(["{ \"_t\" : \"BH.oM.Geometry.Line\", \"Start\" : { \"_t\" : \"BH.oM.Geometry.Point\", \"X\" : 0.0, \"Y\" : -0.095813367444838232, \"Z\" : 0.57488020466902945 }, \"End\" : { \"_t\" : \"BH.oM.Geometry.Point\", \"X\" : 0.0, \"Y\" : -0.095813367444838232, \"Z\" : 4.7906683722419041 }, \"Infinite\" : false }", "{ \"_t\" : \"BH.oM.Geometry.Line\", \"Start\" : { \"_t\" : \"BH.oM.Geometry.Point\", \"X\" : 0.0, \"Y\" : -0.095813367444838232, \"Z\" : 4.7906683722419041 }, \"End\" : { \"_t\" : \"BH.oM.Geometry.Point\", \"X\" : 0.0, \"Y\" : -0.095813367444838232, \"Z\" : 12.072484298049597 }, \"Infinite\" : false }", "{ \"_t\" : \"BH.oM.Geometry.Line\", \"Start\" : { \"_t\" : \"BH.oM.Geometry.Point\", \"X\" : 0.0, \"Y\" : -0.095813367444838232, \"Z\" : 4.7906683722419041 }, \"End\" : { \"_t\" : \"BH.oM.Geometry.Point\", \"X\" : 0.0, \"Y\" : 3.7367213303486837, \"Z\" : 4.7906683722419041 }, \"Infinite\" : false }", "{ \"_t\" : \"BH.oM.Geometry.Line\", \"Start\" : { \"_t\" : \"BH.oM.Geometry.Point\", \"X\" : 0.0, \"Y\" : 3.7367213303486837, \"Z\" : 4.7906683722419041 }, \"End\" : { \"_t\" : \"BH.oM.Geometry.Point\", \"X\" : 0.0, \"Y\" : 3.7367213303486837, \"Z\" : -0.095813367444836928 }, \"Infinite\" : false }", "{ \"_t\" : \"BH.oM.Geometry.Line\", \"Start\" : { \"_t\" : \"BH.oM.Geometry.Point\", \"X\" : 0.0, \"Y\" : 5.3655485769109337, \"Z\" : 2.9702143907899803 }, \"End\" : { \"_t\" : \"BH.oM.Geometry.Point\", \"X\" : 0.0, \"Y\" : 8.4315763351457491, \"Z\" : 2.9702143907899803 }, \"Infinite\" : false }", "{ \"_t\" : \"BH.oM.Geometry.Line\", \"Start\" : { \"_t\" : \"BH.oM.Geometry.Point\", \"X\" : 0.0, \"Y\" : 8.4315763351457491, \"Z\" : 2.9702143907899803 }, \"End\" : { \"_t\" : \"BH.oM.Geometry.Point\", \"X\" : 0.0, \"Y\" : 8.3357629677009122, \"Z\" : 4.5990416373522276 }, \"Infinite\" : false }"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])
bhom_3 = BHoMObject(push.Objects)
bhomgeo_3 = BHoMGeometry(bhomgeo_2)
bhom_4 = BHoMObject(bhom_2)
bhom_5 = BHoMObject(loadcase)

# ----
# Create BHoM Load
number_slider = Slider(0, range=0..10)
vec = VectorXYZ(XComponent=Slider(0, range=0..10), YComponent=Slider(0, range=0..10), ZComponent=Slider(0, range=0..10))  # -> Vector, Length
vec_2 = VectorXYZ(XComponent=Slider(0, range=0..10), YComponent=Slider(0, range=0..10), ZComponent=Slider(0, range=0..10))  # -> Vector, Length
vec_3 = VectorXYZ(XComponent=Slider(0, range=0..10), YComponent=Slider(0, range=0..10), ZComponent=Slider(0, range=0..10))  # -> Vector, Length
vec_4 = VectorXYZ(XComponent=number_slider, YComponent=Slider(0, range=0..10), ZComponent=Slider(0, range=0..10))  # -> Vector, Length
vec_5 = Vector(vec_4.Vector)
vec_6 = Vector(vec.Vector)
vec_7 = Vector(vec_2.Vector)
vec_8 = Vector(vec_3.Vector)
loadaxis = LoadAxis(
    {"Global": 0, "Local": 1}, selected="Global",
    Component="{ \"_t\" : \"System.Type\", \"Name\" : \"BH.oM.Structure.Loads.LoadAxis\" }",
    Selection=0)
barvaryingdistributedload = BarVaryingDistributedLoad(
    Loadcase=bhom_5,
    Objects=bhom_3,
    DistFromA=Slider(0, range=0..1),
    ForceA=vec_5,
    MomentA=vec_6,
    DistFromB=Slider(0, range=0..1),
    ForceB=vec_7,
    MomentB=vec_8,
    Axis=loadaxis,
    Projected=False,
    Name="Bar Varying Distributed Load",
    Component="{ .BarVaryingDistributedLoad")

null = NullItem(Item=bhomgeo_3)  # -> NullFlags, InvalidFlags, Description
cull = CullPattern(List=bhom_4, CullPattern=invert(null.NullFlags))
cull_2 = CullPattern(List=bhomgeo_3, CullPattern=invert(null.NullFlags))
cull_3 = CullPattern(List=bhom_4, CullPattern=null.NullFlags)
isetgeometry = ISetGeometry(Element1D=cull, Curve=cull_2, Component="{ .ISetGeometry")
isetgeometry_2 = ISetGeometry(Element0D=cull, Point=cull_2, Component="{ .ISetGeometry")
isetgeometry_3 = ISetGeometry(Obj=cull, Geometry=cull_2, Component="{ .ISetGeometry")
merge = Merge(Data1=isetgeometry_2, Data2=isetgeometry)
clean = CleanTree(RemoveNulls=True, RemoveInvalid=True, RemoveEmpty=False, Tree=merge)
merge_2 = Merge(Data1=cull_3, Data2=clean)
bhom_6 = BHoMObject(merge_2)

# ----
# Push
bhom_7 = BHoMObject(barvaryingdistributedload)
push_2 = Push(Adapter=bhom, Objects=bhom_7, Active=push.Success, Component="{ .Push")  # -> Objects, Success
