# Grasshopper definition CreateGravityLoads.gh (Grasshopper 0.9.76)
# plug-ins: BH.UI.Grasshopper

# ----
# Adapter
path = FilePath()
bhom = BHoMObject()

# ----
# Create Loadcase
number_slider = Slider(1, range=0..10)
loadcase = Loadcase(
    Name="Loadcase1",
    Number=number_slider,
    Nature="{ \"_t\" : \"System.Enum\", \"TypeName\" : { \"_t\" : \"System.Type\", \"Name\" : \"BH.oM.Structure.Loads.LoadNature\" }, \"Value\" : \"Other\" }",
    Component="{ .Loadcase")

# ----
# Push
toggle = BooleanToggle(False)
bhom_2 = BHoMObject(flatten(Tree({0}: [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], {0;0}: [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])))
push = Push(Adapter=bhom, Objects=bhom_2, Active=toggle, Component="{ .Push")  # -> Objects, Success

igeometry = IGeometry(Obj=bhom_2, Component="{ .IGeometry")
bhomgeo = BHoMGeometry(igeometry)
bhomgeo_2 = BHoMGeometry(["{ \"_t\" : \"BH.oM.Geometry.Line\", \"Start\" : { \"_t\" : \"BH.oM.Geometry.Point\", \"X\" : 0.0, \"Y\" : -0.095813367444838232, \"Z\" : 0.57488020466902945 }, \"End\" : { \"_t\" : \"BH.oM.Geometry.Point\", \"X\" : 0.0, \"Y\" : -0.095813367444838232, \"Z\" : 4.7906683722419041 }, \"Infinite\" : false }", "{ \"_t\" : \"BH.oM.Geometry.Line\", \"Start\" : { \"_t\" : \"BH.oM.Geometry.Point\", \"X\" : 0.0, \"Y\" : -0.095813367444838232, \"Z\" : 4.7906683722419041 }, \"End\" : { \"_t\" : \"BH.oM.Geometry.Point\", \"X\" : 0.0, \"Y\" : -0.095813367444838232, \"Z\" : 12.072484298049597 }, \"Infinite\" : false }", "{ \"_t\" : \"BH.oM.Geometry.Line\", \"Start\" : { \"_t\" : \"BH.oM.Geometry.Point\", \"X\" : 0.0, \"Y\" : -0.095813367444838232, \"Z\" : 4.7906683722419041 }, \"End\" : { \"_t\" : \"BH.oM.Geometry.Point\", \"X\" : 0.0, \"Y\" : 3.7367213303486837, \"Z\" : 4.7906683722419041 }, \"Infinite\" : false }", "{ \"_t\" : \"BH.oM.Geometry.Line\", \"Start\" : { \"_t\" : \"BH.oM.Geometry.Point\", \"X\" : 0.0, \"Y\" : 3.7367213303486837, \"Z\" : 4.7906683722419041 }, \"End\" : { \"_t\" : \"BH.oM.Geometry.Point\", \"X\" : 0.0, \"Y\" : 3.7367213303486837, \"Z\" : -0.095813367444836928 }, \"Infinite\" : false }", "{ \"_t\" : \"BH.oM.Geometry.Line\", \"Start\" : { \"_t\" : \"BH.oM.Geometry.Point\", \"X\" : 0.0, \"Y\" : 5.3655485769109337, \"Z\" : 2.9702143907899803 }, \"End\" : { \"_t\" : \"BH.oM.Geometry.Point\", \"X\" : 0.0, \"Y\" : 8.4315763351457491, \"Z\" : 2.9702143907899803 }, \"Infinite\" : false }", "{ \"_t\" : \"BH.oM.Geometry.Line\", \"Start\" : { \"_t\" : \"BH.oM.Geometry.Point\", \"X\" : 0.0, \"Y\" : 8.4315763351457491, \"Z\" : 2.9702143907899803 }, \"End\" : { \"_t\" : \"BH.oM.Geometry.Point\", \"X\" : 0.0, \"Y\" : 8.3357629677009122, \"Z\" : 4.5990416373522276 }, \"Infinite\" : false }"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])
bhomgeo_3 = BHoMGeometry(bhomgeo_2)
bhom_3 = BHoMObject(bhom_2)
bhom_4 = BHoMObject(loadcase)
bhom_5 = BHoMObject(push.Objects)

# ----
# Create Load
number_slider_2 = Slider(-1, range=-1..1)
vec = VectorXYZ(XComponent=0, YComponent=0, ZComponent=number_slider_2)  # -> Vector, Length
vec_2 = Vector(vec.Vector)
gravityload = GravityLoad(Loadcase=bhom_4, Direction=vec_2, Objects=bhom_5, Name="GravityLoad", Component="{ .GravityLoad")

null = NullItem(Item=bhomgeo_3)  # -> NullFlags, InvalidFlags, Description
cull = CullPattern(List=bhom_3, CullPattern=invert(null.NullFlags))
cull_2 = CullPattern(List=bhomgeo_3, CullPattern=invert(null.NullFlags))
cull_3 = CullPattern(List=bhom_3, CullPattern=null.NullFlags)
isetgeometry = ISetGeometry(Element1D=cull, Curve=cull_2, Component="{ .ISetGeometry")
isetgeometry_2 = ISetGeometry(Element0D=cull, Point=cull_2, Component="{ .ISetGeometry")
isetgeometry_3 = ISetGeometry(Obj=cull, Geometry=cull_2, Component="{ .ISetGeometry")
merge = Merge(Data1=isetgeometry_2, Data2=isetgeometry)
clean = CleanTree(RemoveNulls=True, RemoveInvalid=True, RemoveEmpty=False, Tree=merge)
merge_2 = Merge(Data1=cull_3, Data2=clean)
bhom_6 = BHoMObject(merge_2)

# ----
# Push
bhom_7 = BHoMObject(gravityload)
push_2 = Push(Adapter=bhom, Objects=bhom_7, Active=push.Success, Component="{ .Push")  # -> Objects, Success
