# Grasshopper definition CreateLoadCombinations.gh (Grasshopper 0.9.76)
# plug-ins: Alligator

# ----
# Create Adapter Here
# File Path to reference model file
# Plug structural adapter in to this component.
path = FilePath("C:\Users\pnugent\Desktop\wgsdgh.mdl")

bhom = BHoMObject()
panel = Panel("BHoM Loadcases")
bhom_2 = BHoMObject(["{ \"_t\" : \"BH.oM.Structure.Loads.Loadcase\", \"BHoM_Guid\" : \"ef1e497e-3b77-479a-b2bb-801f289c88bb\", \"Name\" : \"Loadcase1\", \"Tags\" : [], \"CustomData\" : { }, \"Nature\" : \"Other\", \"Number\" : 1 }", "{ \"_t\" : \"BH.oM.Structure.Loads.Loadcase\", \"BHoM_Guid\" : \"58626bb8-f4ed-42b5-b41c-ad25ce882029\", \"Name\" : \"Loadcase2\", \"Tags\" : [], \"CustomData\" : { }, \"Nature\" : \"Other\", \"Number\" : 2 }", "{ \"_t\" : \"BH.oM.Structure.Loads.Loadcase\", \"BHoM_Guid\" : \"08b212e3-78fe-4c60-876a-603f23aa7712\", \"Name\" : \"Loadcase3\", \"Tags\" : [], \"CustomData\" : { }, \"Nature\" : \"Other\", \"Number\" : 3 }", "{ \"_t\" : \"BH.oM.Structure.Loads.Loadcase\", \"BHoM_Guid\" : \"fa0f109d-fce0-47e5-8688-a22a06c17900\", \"Name\" : \"Loadcase4\", \"Tags\" : [], \"CustomData\" : { }, \"Nature\" : \"Other\", \"Number\" : 4 }", "{ \"_t\" : \"BH.oM.Structure.Loads.Loadcase\", \"BHoM_Guid\" : \"e790b2fc-2822-4f82-b15c-eb96424b96f1\", \"Name\" : \"Loadcase5\", \"Tags\" : [], \"CustomData\" : { }, \"Nature\" : \"Other\", \"Number\" : 5 }", "{ \"_t\" : \"BH.oM.Structure.Loads.Loadcase\", \"BHoM_Guid\" : \"4547c34f-3849-41c3-8af5-612275db4cc2\", \"Name\" : \"Loadcase6\", \"Tags\" : [], \"CustomData\" : { }, \"Nature\" : \"Other\", \"Number\" : 6 }", "{ \"_t\" : \"BH.oM.Structure.Loads.Loadcase\", \"BHoM_Guid\" : \"49f01012-f8f9-4a13-97f4-53fc70eaa2dc\", \"Name\" : \"Loadcase7\", \"Tags\" : [], \"CustomData\" : { }, \"Nature\" : \"Other\", \"Number\" : 7 }", "{ \"_t\" : \"BH.oM.Structure.Loads.Loadcase\", \"BHoM_Guid\" : \"648ca096-6f67-4364-833a-0019ac7e9a88\", \"Name\" : \"Loadcase8\", \"Tags\" : [], \"CustomData\" : { }, \"Nature\" : \"Other\", \"Number\" : 8 }"])

# ----
# Create LoadCombination
number_slider = Slider(1.35, range=0..10)

loadcombination = LoadCombination(
    Name="Load Combination_1",
    Number=Slider(9, range=0..100),
    Cases=bhom_2,
    Factors=[number_slider, Slider(2, range=0..10), Slider(1.2, range=0..10), Slider(1.1, range=0..10), Slider(1.7, range=0..10), Slider(2.5, range=0..10), Slider(1.1, range=0..10), Slider(1, range=0..10)],
    ExcludeZeroFactorCases=True,
    Component="{ .LoadCombination")
bhom_3 = BHoMObject(loadcombination)
push = Push(Adapter=bhom, Objects=bhom_3, Active=Toggle(False), Component="{ .Push")  # -> Objects, Success
