# Grasshopper definition CreateLoadcase.gh (Grasshopper 0.9.76)
# plug-ins: Alligator

# ----
# Create Adapter Here
# File Path to reference model file
# Plug structural adapter in to this component.
path = FilePath("C:\Users\pnugent\Desktop\wgsdgh.mdl")

bhom = BHoMObject()

# ----
# Create Loadcases
number_slider = Slider(1, range=0..10)

txt = Text(["Loadcase1", "Loadcase2", "Loadcase3", "Loadcase4", "Loadcase5", "Loadcase6", "Loadcase7", "Loadcase8"])
num = Number([number_slider, Slider(2, range=0..10), Slider(3, range=0..10), Slider(4, range=0..10), Slider(5, range=0..10), Slider(6, range=0..10), Slider(7, range=0..10), Slider(8, range=0..10)])

loadcase = Loadcase(
    Name=txt,
    Number=num,
    Nature="{ \"_t\" : \"System.Enum\", \"TypeName\" : { \"_t\" : \"System.Type\", \"Name\" : \"BH.oM.Structure.Loads.LoadNature\" }, \"Value\" : \"Other\" }",
    Component="{ .Loadcase")

bhom_2 = BHoMObject(loadcase)
push = Push(Adapter=bhom, Objects=bhom_2, Active=Toggle(False), Component="{ .Push")  # -> Objects, Success
