# Grasshopper definition CreatePointDisplacement.gh (Grasshopper 0.9.76)
# plug-ins: BH.UI.Grasshopper

# ----
# Adapter
path = FilePath()
bhom = BHoMObject()

# ----
# Create Loadcase
panel = Panel("Loadcase1")
loadcase = Loadcase(
    Name=panel,
    Number=Slider(1, range=0..10),
    Nature="{ \"_t\" : \"System.Enum\", \"TypeName\" : { \"_t\" : \"System.Type\", \"Name\" : \"BH.oM.Structure.Loads.LoadNature\" }, \"Value\" : \"Other\" }",
    Component="{ .Loadcase")

# ----
# Push
toggle = BooleanToggle(False)
bhom_2 = BHoMObject(["{ \"_t\" : \"BH.oM.Structure.Elements.Node\", \"BHoM_Guid\" : \"8e43e4d4-d9a6-4a47-b878-4eed2235bb5c\", \"Name\" : \"\", \"Tags\" : [\"Sin_Curve\", \"0 to 3*pi\"], \"CustomData\" : { }, \"Position\" : { \"_t\" : \"BH.oM.Geometry.Point\", \"X\" : 0.0, \"Y\" : 85.425527846168251, \"Z\" : -1.578374876945916 }, \"Constraint\" : null }", "{ \"_t\" : \"BH.oM.Structure.Elements.Node\", \"BHoM_Guid\" : \"f7b60697-4932-4915-afa3-a2caf99282c7\", \"Name\" : \"\", \"Tags\" : [\"Sin_Curve\", \"0 to 3*pi\"], \"CustomData\" : { }, \"Position\" : { \"_t\" : \"BH.oM.Geometry.Point\", \"X\" : 0.0, \"Y\" : 86.137494868873731, \"Z\" : 0.43886502071964006 }, \"Constraint\" : null }", "{ \"_t\" : \"BH.oM.Structure.Elements.Node\", \"BHoM_Guid\" : \"ced83f13-f033-43b7-ad57-6f6d4ec692c3\", \"Name\" : \"\", \"Tags\" : [\"Sin_Curve\", \"0 to 3*pi\"], \"CustomData\" : { }, \"Position\" : { \"_t\" : \"BH.oM.Geometry.Point\", \"X\" : 0.0, \"Y\" : 86.968123062030145, \"Z\" : 2.218782577483366 }, \"Constraint\" : null }", "{ \"_t\" : \"BH.oM.Structure.Elements.Node\", \"BHoM_Guid\" : \"73e52042-1d96-4e1b-9e6b-f6d297a8c679\", \"Name\" : \"\", \"Tags\" : [\"Sin_Curve\", \"0 to 3*pi\"], \"CustomData\" : { }, \"Position\" : { \"_t\" : \"BH.oM.Geometry.Point\", \"X\" : 0.0, \"Y\" : 88.273395936990212, \"Z\" : 3.5240554524434318 }, \"Constraint\" : null }", "{ \"_t\" : \"BH.oM.Structure.Elements.Node\", \"BHoM_Guid\" : \"94c86ed6-9d54-4053-8b7b-48a640b0fef1\", \"Name\" : \"\", \"Tags\" : [\"Sin_Curve\", \"0 to 3*pi\"], \"CustomData\" : { }, \"Position\" : { \"_t\" : \"BH.oM.Geometry.Point\", \"X\" : 0.0, \"Y\" : 89.341346471048439, \"Z\" : 3.880038963796177 }, \"Constraint\" : null }", "{ \"_t\" : \"BH.oM.Structure.Elements.Node\", \"BHoM_Guid\" : \"8ca4c553-34ce-43cd-b96d-2189ea58da6b\", \"Name\" : \"\", \"Tags\" : [\"Sin_Curve\", \"0 to 3*pi\"], \"CustomData\" : { }, \"Position\" : { \"_t\" : \"BH.oM.Geometry.Point\", \"X\" : 0.0, \"Y\" : 90.40929700510668, \"Z\" : 3.0494107706397715 }, \"Constraint\" : null }"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])
push = Push(Adapter=bhom, Objects=bhom_2, Active=toggle, Component="{ .Push")  # -> Objects, Success

bhom_3 = BHoMObject(push.Objects)
bhom_4 = BHoMObject(loadcase)

# ----
# Create BHoM Load
number_slider = Slider(4.99, range=0..20)
vec = VectorXYZ(XComponent=Slider(9.6, range=0..20), YComponent=Slider(8.45, range=0..20), ZComponent=Slider(7.68, range=0..20))  # -> Vector, Length
vec_2 = VectorXYZ(XComponent=number_slider, YComponent=Slider(15.23, range=0..20), ZComponent=Slider(0, range=0..20))  # -> Vector, Length
pointdisplacement = PointDisplacement(
    Loadcase=bhom_4,
    Objects=bhom_3,
    Translation=vec_2.Vector,
    Rotation=vec.Vector,
    Axis="{ \"_t\" : \"System.Enum\", \"TypeName\" : { \"_t\" : \"System.Type\", \"Name\" : \"BH.oM.Structure.Loads.LoadAxis\" }, \"Value\" : \"Global\" }",
    Name="Point Displacement",
    Component="{ .PointDisplacement")

# ----
# Push
bhom_5 = BHoMObject(pointdisplacement)
push_2 = Push(Adapter=bhom, Objects=bhom_5, Active=push.Success, Component="{ .Push")  # -> Objects, Success
