# Grasshopper definition Lusas-mesh-settings.gh (Grasshopper 0.9.76)
# plug-ins: BH.UI.Grasshopper

path = FilePath("C:\Users\pnugent\Desktop\wgsdgh.mdl")

# ----
# Create Adapter Here
lusasadapter = LusasAdapter(FilePath=path, Active=Toggle(False), Component="{ ..ctor")
bhom = BHoMObject(lusasadapter)

# ----
# Create Mesh Settings
number_slider = Slider(10, range=0..10)
split1d = Split1D(
    {"Divisions": 0, "Length": 1, "Automatic": 2}, selected="Divisions",
    Component="{ \"_t\" : \"System.Type\", \"Name\" : \"BH.oM.Adapters.Lusas.Split1D\" }",
    Selection=0)
meshsettings1d = MeshSettings1D(SplitMethod=split1d, SplitParameter=number_slider, Name="Bar Mesh", Component="{ .MeshSettings1D")

# ----
# Push Mesh
toggle = BooleanToggle(False)
push = Push(Adapter=bhom, Objects=meshsettings1d, Active=toggle)  # -> Objects, Success
