# Grasshopper definition Lusas-Truss_Model.gh (Grasshopper 0.9.76)
# plug-ins: BH.UI.Grasshopper

# ----
# Create Adapter Here
# File Path to reference model file
# Plug structural adapter in to this component.
path = FilePath("C:\Users\pnugent\Desktop\wgsdgh.mdl")

lusasadapter = LusasAdapter(FilePath=path, Active=Toggle(False), Component="{ ..ctor")

# ----
# Create Truss Elements with Properties
# Plug in properties to bar BHoM object
# Specify material BHoM object
toggle = BooleanToggle(True)
toggle_2 = BooleanToggle(False)
# Specify bar release BHoM object via Constraint6DOF
panel = Panel("Steel")
number_slider = Slider(0.5, range=0..1)
# Specify steel section BHoM object
panel_2 = Panel("150x20 CHS")
panel_3 = Panel("500x500x30 SHS")

materialtype = MaterialType(
    {"Aluminium": 0, "Steel": 1, "Concrete": 2, "Timber": 3, "Rebar": 4, "Tendon": 5, "Glass": 6, "Cable": 7}, selected="Steel",
    Component="{ \"_t\" : \"System.Type\", \"Name\" : \"BH.oM.Common.Materials.MaterialType\" }",
    Selection=1)
constraint6dof = Constraint6DOF(X=toggle, Y=toggle, Z=toggle, Xx=toggle_2, Yy=toggle_2, Zz=toggle_2, Component="{ .Constraint6DOF")
material = Material(Name=panel, Type=materialtype, E=2.1e+11, V=0.3, TC=1.2e-05, Density=7850, Component="{ .Material")
barrelease = BarRelease(StartConstraint=constraint6dof, EndConstraint=constraint6dof, Name="Bar Release", Component="{ .BarRelease")
line = Line([Line((0, 0, 2), (3.48066779, 0, 2.619002167)), Line((3.48066779, 0, 2.619002167), (7.835801315, 0, 3.160455225)), Line((7.835801315, 0, 3.160455225), (12.83141828, 0, 3.468952405)), Line((12.83141828, 0, 3.468952405), (18.03700537, 0, 3.439094977)), Line((18.03700537, 0, 3.439094977), (22.95069632, 0, 3.08159316)), Line((22.95069632, 0, 3.08159316), (27.16891284, 0, 2.516169223)), Line((27.16891284, 0, 2.516169223), (30, 0, 2))])
line_2 = Line([Line((0, 0, 0), (1.5071081, 0, 0)), Line((1.5071081, 0, 0), (5.45422748, 0, 0)), Line((5.45422748, 0, 0), (10.21737515, 0, 0)), Line((10.21737515, 0, 0), (15.44546142, 0, 0)), Line((15.44546142, 0, 0), (20.62854932, 0, 0)), Line((20.62854932, 0, 0), (25.27284333, 0, 0)), Line((25.27284333, 0, 0), (29.06498235, 0, 0)), Line((29.06498235, 0, 0), (30, 0, 0))])
line_3 = Line([Line((0, 0, 0), (0, 0, 2)), Line((0, 0, 2), (1.5071081, 0, 0)), Line((1.5071081, 0, 0), (3.48066779, 0, 2.619002167)), Line((3.48066779, 0, 2.619002167), (5.45422748, 0, 0)), Line((5.45422748, 0, 0), (7.835801315, 0, 3.160455225)), Line((7.835801315, 0, 3.160455225), (10.21737515, 0, 0))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])
pt = Point([Point(0, 0, 0), Point(0, 0, 2), Point(1.5071081, 0, 0), Point(3.48066779, 0, 2.619002167), Point(5.45422748, 0, 0), Point(7.835801315, 0, 3.160455225), Point(10.21737515, 0, 0), Point(12.83141828, 0, 3.468952405), Point(15.44546142, 0, 0), Point(18.03700537, 0, 3.439094977), Point(20.62854932, 0, 0), Point(22.95069632, 0, 3.08159316), Point(25.27284333, 0, 0), Point(27.16891284, 0, 2.516169223), Point(29.06498235, 0, 0), Point(30, 0, 2), Point(30, 0, 0)])
barfeatype = BarFEAType(
    {"Flexural": 0, "Axial": 1, "CompressionOnly": 2, "TensionOnly": 3}, selected="Axial",
    Component="{ \"_t\" : \"System.Type\", \"Name\" : \"BH.oM.Structure.Elements.BarFEAType\" }",
    Selection=1)
steelboxsection = SteelBoxSection(
    Height=number_slider,
    Width=number_slider,
    Thickness=Slider(0.03, range=0..0.1),
    InnerRadius=0,
    OuterRadius=0,
    Material=material,
    Component="{ .SteelBoxSection")
steeltubesection = SteelTubeSection(
    Diameter=Slider(0.15, range=0..1),
    Thickness=Slider(0.02, range=0..0.1),
    Material=material,
    Name=panel_2,
    Component="{ .SteelTubeSection")
barreleasefixfix = BarReleaseFixFix(Name="FixFix", Component="{ .BarReleaseFixFix")
bar = Bar(
    Line=line_2,
    Property=steelboxsection,
    OrientationAngle=0,
    Release=barreleasefixfix,
    FeaType=barfeatype,
    Component="{ .Bar")
bar_2 = Bar(
    Line=line_3,
    Property=[steelboxsection, steeltubesection],
    OrientationAngle=0,
    Release=barrelease,
    FeaType=barfeatype,
    Component="{ .Bar")
bar_3 = Bar(
    Line=line,
    Property=steelboxsection,
    OrientationAngle=0,
    Release=barreleasefixfix,
    FeaType=barfeatype,
    Component="{ .Bar")

# ----
# Assign Tags
# Assign Tags to different members
# Assign Tag to loaded element (easier to do this BEFORE pushing)
panel_4 = Panel("Top Chord")
propertyvalue = PropertyValue(Obj=bar_2, PropName="Tags", Value="Bracing", Component="{ .PropertyValue")
propertyvalue_2 = PropertyValue(Obj=bar, PropName="Tags", Value="Bottom Chord", Component="{ .PropertyValue")
item = ListItem(List=propertyvalue, Index=0, Wrap=True)
panel_5 = Panel("""Bracing
Wind Loaded""")
cull_i = CullIndex(List=propertyvalue, Indices=Slider(0, range=0..100), Wrap=True)
propertyvalue_3 = PropertyValue(Obj=item, PropName="Tags", Value=panel_5, Component="{ .PropertyValue")

propertyvalue_4 = PropertyValue(Obj=bar_3, PropName="Tags", Value=panel_4, Component="{ .PropertyValue")

# ----
# Assign Mesh
number_slider_2 = Slider(10, range=0..10)
split1d = Split1D(
    {"Divisions": 0, "Length": 1, "Automatic": 2}, selected="Divisions",
    TypeName="BH.oM.Adapters.Lusas.Split1D, Lusas_oM, Version=2.0.0.0, Culture=neutral, PublicKeyToken=null")
meshsettings1d = MeshSettings1D(SplitMethod=split1d, SplitParameter=number_slider_2, Name="Bar Mesh", Component="{ .MeshSettings1D")
c_script = CSharpScript(x="Mesh", y=meshsettings1d)  # -> out, A; inputs x: String
# ---------- c_script: C# ----------
    A = new GH_ObjectWrapper(new Dictionary<string,object>(){{x,y}});
# ---------- end c_script ----------
propertyvalue_5 = PropertyValue(
    Obj=flatten([propertyvalue_4, propertyvalue_2, cull_i, propertyvalue_3]),
    PropName="CustomData",
    Value=c_script.A,
    Component="{ .PropertyValue")

explode = Explode(Object=propertyvalue_5, Component="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")  # -> StartNode, EndNode, SectionProperty, OrientationAngle, Release, FEAType, Spring, Offset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

# ----
# Create Supports
# Specify Constraint6DOF BHoM object
toggle_3 = BooleanToggle(True)
toggle_4 = BooleanToggle(False)
toggle_5 = BooleanToggle(False)
rev = ReverseList(List=pt)
item_2 = ListItem(List=pt, Index=0, Wrap=True)
item_3 = ListItem(List=rev, Index=0, Wrap=True)

constraint6dof_2 = Constraint6DOF(X=toggle_5, Y=toggle_5, Z=toggle_5, Xx=toggle_5, Yy=Toggle(True), Zz=toggle_5, Name="Pin", Component="{ .Constraint6DOF")
# Plug in constraint to BHoM Nodes
constraint6dof_3 = Constraint6DOF(X=toggle_3, Y=toggle_4, Z=toggle_4, Xx=toggle_4, Yy=toggle_3, Zz=toggle_4, Name="Roller", Component="{ .Constraint6DOF")

node = Node(Position=item_2, Constraint=constraint6dof_2, Component="{ .Node")
node_2 = Node(Position=item_3, Constraint=constraint6dof_3, Component="{ .Node")

# ----
# Push Supports
toggle_6 = BooleanToggle(False)
push = Push(Adapter=lusasadapter, Objects=[node, node_2], Active=toggle_6, Component="{ .Push")  # -> Objects, Success

# ----
# Push Bars
# (Bars pushed upon success of supports)
push_2 = Push(Adapter=lusasadapter, Objects=propertyvalue_5, Active=push.Success, Component="{ .Push")  # -> Objects, Success

# ----
# Assign Loads
# Filter pushed bars via tags to get objects to load
# Create BHoM Loads from Loadcases and BHoM objects
# Create BHoM Loadcases (number = 0 is used when both loadcases and combinations are to be pushed)
panel_6 = Panel("Bottom Chord")
number_slider_3 = Slider(0, range=0..100)
c_script_2 = CSharpScript(Tags=explode.Tags, Filter=panel_6)  # -> out, Indices; inputs Tags: tree of String, Filter: list of String
# ---------- c_script_2: C# ----------
    DataTree<int> matches = new DataTree<int>();

    for (int t = 0; t < Filter.Count; t++)
    {
      for (int i = 0; i < Tags.BranchCount; i++)
      {
        for (int j = 0; j < Tags.Branch(i).Count; j++)
        {
          if (Tags.Branch(i)[j] == Filter[t])
          {
            GH_Path pth = new GH_Path(t);
            matches.Add(i, pth);
          }
        }
      }
    }

    Indices = matches;
# ---------- end c_script_2 ----------
c_script_3 = CSharpScript(Tags=explode.Tags, Filter="Wind Loaded")  # -> out, Indices; inputs Tags: tree of String, Filter: list of String; same code as c_script_2
item_4 = ListItem(List=flatten(push_2.Objects), Index=c_script_3.Indices, Wrap=True)
item_5 = ListItem(List=flatten(push_2.Objects), Index=c_script_2.Indices, Wrap=True)
vec = Vector(Vector(0, 0, -10))
vec_2 = Vector(Vector(5, 0, 0))
vec_3 = Vector(Vector(0, 0, -1))

loadcase = Loadcase(
    Name="Gravity",
    Number=number_slider_3,
    Nature="{ \"_t\" : \"System.Enum\", \"TypeName\" : { \"_t\" : \"System.Type\", \"Name\" : \"BH.oM.Structure.Loads.LoadNature\" }, \"Value\" : \"Other\" }",
    Component="{ .Loadcase")
loadcase_2 = Loadcase(
    Name="Wind",
    Number=number_slider_3,
    Nature="{ \"_t\" : \"System.Enum\", \"TypeName\" : { \"_t\" : \"System.Type\", \"Name\" : \"BH.oM.Structure.Loads.LoadNature\" }, \"Value\" : \"Other\" }",
    Component="{ .Loadcase")
loadcase_3 = Loadcase(
    Name="Live Load",
    Number=number_slider_3,
    Nature="{ \"_t\" : \"System.Enum\", \"TypeName\" : { \"_t\" : \"System.Type\", \"Name\" : \"BH.oM.Structure.Loads.LoadNature\" }, \"Value\" : \"Other\" }",
    Component="{ .Loadcase")
push_3 = Push(Adapter=lusasadapter, Objects=[loadcase, loadcase_2, loadcase_3], Active=push_2.Success, Component="{ .Push")  # -> Objects, Success
item_6 = ListItem(List=push_3.Objects, Index=0, Wrap=True)  # -> Item, Item1, Item2

gravityload = GravityLoad(Loadcase=item_6.Item, Direction=vec_3, Objects=push_2.Objects, Name="Gravity", Component="{ .GravityLoad")
baruniformlydistributedload = BarUniformlyDistributedLoad(
    Loadcase=item_6.Item2,
    Objects=item_5,
    Force=vec,
    Axis="{ \"_t\" : \"System.Enum\", \"TypeName\" : { \"_t\" : \"System.Type\", \"Name\" : \"BH.oM.Structure.Loads.LoadAxis\" }, \"Value\" : \"Global\" }",
    Projected=False,
    Name="Pedestrian Load",
    Component="{ .BarUniformlyDistributedLoad")
baruniformlydistributedload_2 = BarUniformlyDistributedLoad(
    Loadcase=item_6.Item1,
    Objects=item_4,
    Force=vec_2,
    Axis="{ \"_t\" : \"System.Enum\", \"TypeName\" : { \"_t\" : \"System.Type\", \"Name\" : \"BH.oM.Structure.Loads.LoadAxis\" }, \"Value\" : \"Global\" }",
    Projected=False,
    Name="Wind Load",
    Component="{ .BarUniformlyDistributedLoad")

# ----
# Push Loads
# (Loads pushed on success of bars)
push_4 = Push(Adapter=lusasadapter, Objects=baruniformlydistributedload_2, Active=push_3.Success, Component="{ .Push")  # -> Objects, Success
push_5 = Push(Adapter=lusasadapter, Objects=baruniformlydistributedload, Active=push_4.Success, Component="{ .Push")  # -> Objects, Success
push_6 = Push(Adapter=lusasadapter, Objects=gravityload, Active=push_5.Success, Component="{ .Push")  # -> Objects, Success

# ----
# Create Load
# Combination
# Create BHoM Loadcombination from Loadcases
panel_7 = Panel("LC 1")
panel_8 = Panel("""1.35
1.35
1""")
loadcombination = LoadCombination(
    Name=panel_7,
    Number=Slider(0, range=0..100),
    Cases=flatten([item_6.Item, item_6.Item1, item_6.Item2]),
    Factors=panel_8,
    ExcludeZeroFactorCases=True,
    Component="{ .LoadCombination")

# ----
# Push Load
# Combination
# (Combinations pushed upon success of loads)
push_7 = Push(Adapter=lusasadapter, Objects=loadcombination, Active=push_6.Success, Component="{ .Push")  # -> Objects, Success
