# Grasshopper definition CreateConstraint4DOF.gh (Grasshopper 0.9.76)
# plug-ins: Alligator

# ----
# Create Adapter Here
# File Path to reference model file
# Plug structural adapter in to this component.
path = FilePath("C:\Users\pnugent\Desktop\wgsdgh.mdl")

bhom = BHoMObject()

# ----
# Create Constraint4DOF
number_slider = Slider(0, range=0..100)
constraint4dof = Constraint4DOF(
    TranslationX=Toggle(False),
    TranslationY=Toggle(False),
    TranslationZ=Toggle(False),
    RotationX=Toggle(False),
    TranslationalStiffnessX=Slider(0, range=0..100),
    TranslationalStiffnessY=Slider(0, range=0..100),
    TranslationalStiffnessZ=Slider(0, range=0..100),
    RotationalStiffnessX=number_slider,
    Name="Bar_Support",
    Component="{ \"_t\" : \"System.Type\", \"Name\" : \"BH.oM.Structure.Properties.Constraint.Constraint4DOF\" }")

bhom_2 = BHoMObject(constraint4dof)
push = Push(Adapter=bhom, Objects=bhom_2, Active=Toggle(False), Component="{ .Push")  # -> Objects, Success
