# Grasshopper definition CreateAngleSection.gh (Grasshopper 0.9.76)
# plug-ins: BH.UI.Grasshopper

# ----
# Adapter
path = FilePath()
bhom = BHoMObject(m_ForcePreview=False, m_MaxItemsPreview=10000)

# ----
# Create SteelSection
number_slider = Slider(0.9, range=0..2)

steelanglesection = SteelAngleSection(
    Height=Slider(1.6, range=0..2),
    WebThickness=Slider(0.01, range=0..0.1),
    Width=number_slider,
    FlangeThickness=Slider(0.03, range=0..0.1),
    RootRadius=0,
    ToeRadius=0,
    Name="Angle Section",
    Component="{ .SteelAngleSection")

# ----
# Push
toggle = BooleanToggle(False)
bhom_2 = BHoMObject(steelanglesection, m_ForcePreview=False, m_MaxItemsPreview=10000)
push = Push(Adapter=bhom, Objects=bhom_2, Active=toggle, Component="{ .Push")  # -> Objects, Success
