# Grasshopper definition CreateBoxSection.gh (Grasshopper 0.9.76)
# plug-ins: BH.UI.Grasshopper

# ----
# Adapter
path = FilePath()
bhom = BHoMObject(m_ForcePreview=False, m_MaxItemsPreview=10000)

# ----
# Create SteelSection
number_slider = Slider(0.02, range=0..0.1)
steelboxsection = SteelBoxSection(
    Height=Slider(1.2, range=0..2),
    Width=Slider(0.6, range=0..2),
    Thickness=number_slider,
    InnerRadius=0,
    OuterRadius=0,
    Name="Box Section",
    Component="{ .SteelBoxSection")

# ----
# Push
toggle = BooleanToggle(False)
bhom_2 = BHoMObject(steelboxsection, m_ForcePreview=False, m_MaxItemsPreview=10000)
push = Push(Adapter=bhom, Objects=bhom_2, Active=toggle, Component="{ .Push")  # -> Objects, Success
