# Grasshopper definition CreateChannelSection.gh (Grasshopper 0.9.76)
# plug-ins: BH.UI.Grasshopper

# ----
# Adapter
path = FilePath()
bhom = BHoMObject(m_ForcePreview=False, m_MaxItemsPreview=10000)

# ----
# Create Profile
number_slider = Slider(0.03, range=0..0.1)

channelprofile = ChannelProfile(
    Height=Slider(1, range=0..2),
    Width=Slider(0.3, range=0..2),
    Webthickness=Slider(0.02, range=0..0.1),
    FlangeThickness=number_slider,
    RootRadius=Slider(0, range=0..0.1),
    ToeRadius=Slider(0, range=0..0.1),
    MirrorAboutLocalZ=Toggle(False),
    Component="{ .ChannelProfile")

# ----
# Create SteelSection
bhom_2 = BHoMObject(channelprofile, m_ForcePreview=False, m_MaxItemsPreview=10000)
steelsectionfromprofile = SteelSectionFromProfile(Profile=bhom_2, Name="Channel Section", Component="{ .SteelSectionFromProfile")

# ----
# Push
toggle = BooleanToggle(False)
bhom_3 = BHoMObject(steelsectionfromprofile, m_ForcePreview=False, m_MaxItemsPreview=10000)
push = Push(Adapter=bhom, Objects=bhom_3, Active=toggle, Component="{ .Push")  # -> Objects, Success
