# Grasshopper definition CreateCircularSection.gh (Grasshopper 0.9.76)
# plug-ins: BH.UI.Grasshopper

# ----
# Adapter
path = FilePath()
bhom = BHoMObject(m_ForcePreview=False, m_MaxItemsPreview=10000)

# ----
# Create SteelSection
number_slider = Slider(0.9, range=0..2)

steelcircularsection = SteelCircularSection(Diameter=number_slider, Name="Circular Section", Component="{ .SteelCircularSection")

# ----
# Push
toggle = BooleanToggle(False)
bhom_2 = BHoMObject(steelcircularsection, m_ForcePreview=False, m_MaxItemsPreview=10000)
push = Push(Adapter=bhom, Objects=bhom_2, Active=toggle, Component="{ .Push")  # -> Objects, Success
