# Grasshopper definition CreateFabricatedISection.gh (Grasshopper 0.9.76)
# plug-ins: BH.UI.Grasshopper

# ----
# Adapter
path = FilePath()
bhom = BHoMObject(m_ForcePreview=False, m_MaxItemsPreview=10000)

# ----
# Create FabricatedISection
number_slider = Slider(0.02, range=0..0.1)
steelfabricatedisection = SteelFabricatedISection(
    Height=Slider(1.3, range=0..2),
    WebThickness=Slider(0.06, range=0..0.1),
    TopFlangeWidth=Slider(0.7, range=0..2),
    TopFlangeThickness=number_slider,
    BotFlangeWidth=Slider(1.3, range=0..2),
    BotFlangeThickness=Slider(0.02, range=0..0.1),
    WeldSize=Slider(0, range=0..0.1),
    Name="Fabricated I Section",
    Component="{ .SteelFabricatedISection")

# ----
# Push
toggle = BooleanToggle(False)
bhom_2 = BHoMObject(steelfabricatedisection, m_ForcePreview=False, m_MaxItemsPreview=10000)
push = Push(Adapter=bhom, Objects=bhom_2, Active=toggle, Component="{ .Push")  # -> Objects, Success
