# Grasshopper definition CreateGeneralisedFabricatedBoxSection.gh (Grasshopper 0.9.76)
# plug-ins: BH.UI.Grasshopper

# ----
# Adapter
path = FilePath()
bhom = BHoMObject(m_ForcePreview=False, m_MaxItemsPreview=10000)

# ----
# Create Profile
number_slider = Slider(0.03, range=0..0.1)
generalisedfabricatedboxprofile = GeneralisedFabricatedBoxProfile(
    Height=Slider(1.1, range=0..2),
    Width=Slider(0.6, range=0..2),
    WebThickness=Slider(0.01, range=0..0.1),
    TopFlangeThickness=number_slider,
    BotFlangeThickness=Slider(0.03, range=0..0.1),
    TopCorbelWidth=Slider(0.1, range=0..0.1),
    BotCorbelWidth=Slider(0.08, range=0..0.1),
    Component="{ .GeneralisedFabricatedBoxProfile")

# ----
# Create Steel Section
panel = Panel("FabricatedBoxProfile")
steelsectionfromprofile = SteelSectionFromProfile(Profile=generalisedfabricatedboxprofile, Name=panel, Component="{ .SteelSectionFromProfile")

# ----
# Push
toggle = BooleanToggle(False)
bhom_2 = BHoMObject(steelsectionfromprofile, m_ForcePreview=False, m_MaxItemsPreview=10000)
push = Push(Adapter=bhom, Objects=bhom_2, Active=toggle, Component="{ .Push")  # -> Objects, Success
