# Grasshopper definition CreateISection.gh (Grasshopper 0.9.76)
# plug-ins: BH.UI.Grasshopper

# ----
# Adapter
path = FilePath()
bhom = BHoMObject(m_ForcePreview=False, m_MaxItemsPreview=10000)

# ----
# Create Steel Section
number_slider = Slider(0.02, range=0..0.1)

steelisection = SteelISection(
    Height=Slider(1, range=0..2),
    WebThickness=Slider(0.03, range=0..0.1),
    FlangeWidth=Slider(1.2, range=0..2),
    FlangeThickness=number_slider,
    RootRadius=0,
    ToeRadius=0,
    Name="I Section",
    Component="{ .SteelISection")

# ----
# Push
bhom_2 = BHoMObject(steelisection, m_ForcePreview=False, m_MaxItemsPreview=10000)
push = Push(Adapter=bhom, Objects=bhom_2, Active=Toggle(False), Component="{ .Push")  # -> Objects, Success
