# Grasshopper definition CreateTSection.gh (Grasshopper 0.9.76)
# plug-ins: BH.UI.Grasshopper

# ----
# Adapter
path = FilePath()
bhom = BHoMObject(m_ForcePreview=False, m_MaxItemsPreview=10000)

# ----
# Create Steel Section
number_slider = Slider(0.02, range=0..0.1)
steeltsection = SteelTSection(
    Height=Slider(1, range=0..2),
    WebThickness=Slider(0.02, range=0..0.1),
    FlangeWidth=Slider(1.3, range=0..2),
    FlangeThickness=number_slider,
    RootRadius=0,
    ToeRadius=0,
    Name="T Section",
    Component="{ .SteelTSection")

# ----
# Push
bhom_2 = BHoMObject(steeltsection, m_ForcePreview=False, m_MaxItemsPreview=10000)
push = Push(Adapter=bhom, Objects=bhom_2, Active=Toggle(False), Component="{ .Push")  # -> Objects, Success
