# Grasshopper definition CreateTubeSection.gh (Grasshopper 0.9.76)
# plug-ins: BH.UI.Grasshopper

# ----
# Adapter
path = FilePath()
bhom = BHoMObject(m_ForcePreview=False, m_MaxItemsPreview=10000)

# ----
# Create Steel Section
number_slider = Slider(0.02, range=0..0.1)

steeltubesection = SteelTubeSection(Diameter=Slider(1, range=0..2), Thickness=number_slider, Name="Tube Section", Component="{ .SteelTubeSection")

# ----
# Push
toggle = BooleanToggle(False)
bhom_2 = BHoMObject(steeltubesection, m_ForcePreview=False, m_MaxItemsPreview=10000)
push = Push(Adapter=bhom, Objects=bhom_2, Active=toggle, Component="{ .Push")  # -> Objects, Success
