# Grasshopper definition CreateConstantThickness.gh (Grasshopper 0.9.76)
# plug-ins: BH.UI.Grasshopper

# ----
# Adapter
path = FilePath()
bhom = BHoMObject(m_ForcePreview=False, m_MaxItemsPreview=10000)

# ----
# Create SurfaceProperty
number_slider = Slider(0.01, range=0..0.01)
constantthickness = ConstantThickness(Thickness=number_slider, Name="Constant_Thickness", Type=null, Component="{ .ConstantThickness")

# ----
# Push
toggle = BooleanToggle(False)
bhom_2 = BHoMObject(constantthickness, m_ForcePreview=False, m_MaxItemsPreview=10000)
push = Push(Adapter=bhom, Objects=bhom_2, Active=toggle, Component="{ .Push")  # -> Objects, Success
