# Grasshopper definition CreateLoadingPanel.gh (Grasshopper 0.9.76)
# plug-ins: BH.UI.Grasshopper

# ----
# Adapter
path = FilePath()
bhom = BHoMObject(m_ForcePreview=False, m_MaxItemsPreview=10000)

# ----
# Create SurfaceProperty
loadingpanelproperty = LoadingPanelProperty(SupportCondition=null, ReferenceEdge=1, Component="{ .LoadingPanelProperty")

# ----
# Push
toggle = BooleanToggle(False)
bhom_2 = BHoMObject(loadingpanelproperty, m_ForcePreview=False, m_MaxItemsPreview=10000)
push = Push(Adapter=bhom, Objects=bhom_2, Active=toggle, Component="{ .Push")  # -> Objects, Success
