# Grasshopper definition CreateWaffleThickness.gh (Grasshopper 0.9.76)
# plug-ins: Alligator

# ----
# Create Adapter Here
# File Path to reference model file
# Plug structural adapter in to this component.
path = FilePath("C:\Users\pnugent\Desktop\wgsdgh.mdl")

bhom = BHoMObject()

# ----
# Create Waffle Thickness
number_slider = Slider(1.2, range=0..2)
waffle = Waffle(
    Name="Waffle",
    SlabDepth=Slider(1.3, range=0..2),
    DepthX=Slider(1.5, range=0..2),
    DepthY=Slider(1.7, range=0..2),
    StemWidthX=Slider(1, range=0..2),
    StemWidthY=number_slider,
    SpacingX=Slider(1.5, range=0..2),
    SpacingY=Slider(1.5, range=0..2),
    Type=null,
    Component="{ .Waffle")

push = Push(Adapter=bhom, Objects=waffle, Active=Toggle(False), Component="{ .Push")  # -> Objects, Success
