# Grasshopper definition BHoM FEA - Example Workflow.gh (Grasshopper 1.0.7)
# plug-ins: BH.UI.Grasshopper

# ----
# Created using BHoM
# Get latest installers from http://bhom.xyz
# BHoM Workflow
# export and analyse an Arch structure
# 0. Geometry preparation
# Geometry input
# You can either:
# - draw your geometry in Rhino and reference it
# - generate a parametric model of your geometry.
rationalised_arch = Curve(flatten([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]))

# ----
# Create Adapter
# Choose the CreateAdapter component and
# instantiate the Adapter for the software you want to use!
# TIP:
# always keep only one adapter of a certain software type per Grasshopper script
# (e.g. only one GSAAdapter and only one RobotAdapter).
toggle = BooleanToggle(True)
robotadapter = RobotAdapter(Active=toggle, Component="{ ..ctor")
adapter = Data(robotadapter)

# ----
# Define constraint
toggle_2 = BooleanToggle(False)
toggle_3 = BooleanToggle(True)
toggle_4 = BooleanToggle(True)
constraint6dof = Constraint6DOF(X=toggle_4, Y=toggle_4, Z=toggle_4, Xx=toggle_3, Yy=toggle_2, Zz=toggle_3, Component="{ .Constraint6DOF")

# ----
# Define Nodes
# Define support Nodes
rationalised_arch_2 = Curve(flatten(rationalised_arch))
join = JoinCurves(Curves=rationalised_arch_2, Preserve=False)
end = EndPoints(Curve=join)  # -> Start, End
support_points = Point([end.Start, end.End])
node = Node(Position=support_points, Support=constraint6dof, Component="{ .Node")
support_nodes = Data(node)

# ----
# Push Nodes
# PRO TIP:
# You can chain Push and Pull components
# by using the output "success" boolean.
panel = Panel("Supports")
adapter_2 = Data(adapter)
push = Push(
    Adapter=adapter_2,
    Objects=flatten(support_nodes),
    Tag=panel,
    PushType="{ \"_t\" : \"System.Enum\", \"TypeName\" : { \"_t\" : \"System.Type\", \"Name\" : \"BH.oM.Adapter.PushType\" }, \"Value\" : \"AdapterDefault\" }",
    Active=Toggle(True),
    Component="{ .Push")  # -> Objects, Success

chained_toggle = Boolean(push.Success)
toggle_5 = BooleanToggle(True)

# ----
# Define the hinge release for the middle line:
# released on start of bar,
# fixed on end of bar.
toggle_6 = BooleanToggle(True)
toggle_7 = BooleanToggle(False)
# This is fully connected.
constraint6dof_2 = Constraint6DOF(X=toggle_6, Y=toggle_6, Z=toggle_6, Xx=toggle_6, Yy=toggle_6, Zz=toggle_6, Component="{ .Constraint6DOF")
constraint6dof_3 = Constraint6DOF(X=toggle_5, Y=toggle_5, Z=toggle_5, Xx=toggle_7, Yy=toggle_7, Zz=toggle_7, Component="{ .Constraint6DOF")
# This is pin-released.
barrelease = BarRelease(StartConstraint=constraint6dof_3, EndConstraint=constraint6dof_2, Component="{ .BarRelease")
bar_release_pin_on_start_node = Data(barrelease)

# ----
# Define Bars
# Pick the bar that needs to be released
# to make a hinge in the middle of the arch
# Splitting list at half:
# this will ensure we will always select the bar after the middle.
# So we should release its start point but not the end point.
rationalised_curve = Curve(rationalised_arch)
lng = ListLength(List=rationalised_curve)
division = Division(A=lng, B="2")
cull_i = CullIndex(List=rationalised_curve, Indices=division, Wrap=True)
item = ListItem(List=rationalised_curve, Index=division, Wrap=True)
mid_line_with_release = Curve(item)
lines_with_no_releases = Curve(cull_i)

# ----
# Or define custom material
number_slider = Slider(0.2, range=0..1)
concrete = Concrete(
    Density=0,
    DampingRatio=0,
    PoissonsRatio=number_slider,
    ThermalExpansionCoeff=0,
    YoungsModulus="2400e6",
    CylinderStrength=0,
    CubeStrength="12e6",
    EmbodiedCarbon=0,
    Name="Concrete01",
    Component="BH.oM.Structure.MaterialFragments.Concrete")

# ----
# Define cross section
# NOTE: All units are SI in BHoM! See:
# https://github.com/BHoM/documentation/wiki/BHoM-Units-conventions
number_slider_2 = Slider(0.03, range=0..0.1)
concrete_2 = Concrete(
    {"C12/15": 0, "C16/20": 1, "C20/25": 2, "C25/30": 3, "C30/37": 4, "C35/45": 5, "C40/50": 6, "C45/55": 7, "C50/60": 8, "C55/67": 9, "C60/75": 10, "C70/85": 11, "C80/95": 12, "C90/105": 13}, selected="C35/45",
    Component="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",
    Selection=5)
concreterectanglesection = ConcreteRectangleSection(Height=number_slider_2, Width=number_slider_2, Material=concrete_2, Component="{ .ConcreteRectangleSection")
cross_section = Data(concreterectanglesection)

# ----
# ALWAYS
# Double check that his is the middle point!
# It might change depending on how you've drawn your arch.
end_2 = EndPoints(Curve=mid_line_with_release)  # -> Start, End
pt = Point(end_2.Start)

ub = UB(
    {"UB 1016x305x584": 0, "UB 1016x305x494": 1, "UB 1016x305x438": 2, "UB 1016x305x415": 3, "UB 1016x305x393": 4, "UB 1016x305x350": 5, "UB 1016x305x314": 6, "UB 1016x305x272": 7, "UB 1016x305x249": 8, "UB 1016x305x222": 9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}, selected="UB 1016x305x584",
    Component="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",
    Selection=0)
rhs = RHS(
    {"RHS 50x30x2.9": 0, "RHS 50x30x3.0": 1, "RHS 50x30x3.2": 2, "RHS 50x30x3.6": 3, "RHS 50x30x4.0": 4, "RHS 50x30x5.0": 5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}, selected="RHS 100x50x8.8": 46,
    Component="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",
    Selection=46)
L = L(
    {"L 200x150x18.0": 0, "L 200x150x15.0": 1, "L 200x150x12.0": 2, "L 200x100x15.0": 3, "L 200x100x12.0": 4, "L 200x100x10.0": 5, "L 150x90x15.0": 6, "L 150x90x12.0": 7, "L 150x90x10.0": 8, "L 150x75x15.0": 9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}, selected="L 200x150x18.0",
    Component="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",
    Selection=0)
cross_section_2 = Data(cross_section)

bar_release_pin_on_start_node_2 = Data(bar_release_pin_on_start_node)
mid_line_with_release_2 = Curve(mid_line_with_release)
cross_section_3 = Data(cross_section)
bar = Bar(
    Line=flatten(mid_line_with_release_2),
    Property=cross_section_3,
    OrientationAngle=0,
    Release=bar_release_pin_on_start_node_2,
    FeaType="{ \"_t\" : \"System.Enum\", \"TypeName\" : { \"_t\" : \"System.Type\", \"Name\" : \"BH.oM.Structure.Elements.BarFEAType\" }, \"Value\" : \"Flexural\" }",
    Component="{ .Bar")

lines_with_no_releases_2 = Curve(lines_with_no_releases)
bar_2 = Bar(
    Line=flatten(lines_with_no_releases_2),
    Property=cross_section_2,
    OrientationAngle=0,
    FeaType="{ \"_t\" : \"System.Enum\", \"TypeName\" : { \"_t\" : \"System.Type\", \"Name\" : \"BH.oM.Structure.Elements.BarFEAType\" }, \"Value\" : \"Flexural\" }",
    Component="{ .Bar")

# ----
# Create the bars
merge = Merge(Data1=bar, Data2=bar_2)

# ----
# Push Bars
toggle_8 = BooleanToggle(False)
chained_toggle_2 = Boolean(chained_toggle)
adapter_3 = Data(adapter)
push_2 = Push(
    Adapter=adapter_3,
    Objects=flatten(merge),
    Tag="Bars",
    PushType="{ \"_t\" : \"System.Enum\", \"TypeName\" : { \"_t\" : \"System.Type\", \"Name\" : \"BH.oM.Adapter.PushType\" }, \"Value\" : \"AdapterDefault\" }",
    Active=chained_toggle_2,
    Component="{ .Push")  # -> Objects, Success
chained_toggle_3 = Boolean(push_2.Success)

# ----
# Define Loadcase
loadnature = LoadNature(
    {"Dead": 0, "SuperDead": 1, "Live": 2, "Wind": 3, "Seismic": 4, "Temperature": 5, "Snow": 6, "Accidental": 7, "Prestress": 8, "Notional": 9, "Other": 10}, selected="Dead",
    Component="BH.oM.Structure.Loads.LoadNature",
    Selection=0)
# 2. Apply Loads to Structure
panel_2 = Panel("BarLoad")
loadcase = Loadcase(Name=panel_2, Number="1", Nature=loadnature, Component="{ .Loadcase")
loadcase_2 = Data(loadcase)

adapter_4 = Data(adapter)

# ----
# Define and push Loadcase
toggle_9 = BooleanToggle(False)
chained_toggle_4 = Boolean(chained_toggle_3)
push_3 = Push(
    Adapter=adapter_4,
    Objects=flatten(loadcase_2),
    PushType="{ \"_t\" : \"System.Enum\", \"TypeName\" : { \"_t\" : \"System.Type\", \"Name\" : \"BH.oM.Adapter.PushType\" }, \"Value\" : \"AdapterDefault\" }",
    Active=chained_toggle_4,
    Component="{ .Push")  # -> Objects, Success
chained_toggle_5 = Boolean(push_3.Success)

# ----
# Pull Nodes
createtype = CreateType(Component="BH.oM.Structure.Elements.Node")
filterrequest = FilterRequest(Type=createtype, Component="{ .FilterRequest")
toggle_10 = BooleanToggle(True)
adapter_5 = Data(adapter)
chained_toggle_6 = Boolean(chained_toggle_5)
pull = Pull(
    Adapter=adapter_5,
    Request=filterrequest,
    PullType="{ \"_t\" : \"System.Enum\", \"TypeName\" : { \"_t\" : \"System.Type\", \"Name\" : \"BH.oM.Adapter.PullType\" }, \"Value\" : \"AdapterDefault\" }",
    Active=chained_toggle_6,
    Component="{ .Pull")
pulled_nodes = Data(pull)

chained_toggle_7 = Boolean(chained_toggle_5)

adapter_6 = Data(adapter)

# ----
# Pull all the elements
# you want to to apply Loads to
# Pull Bars
# If we want to apply loads to nodes,
# we need to pull nodes too,
# then somehow select which ones to apply the load to.
# This is left as excercise.
createtype_2 = CreateType(Component="BH.oM.Structure.Elements.Bar")
filterrequest_2 = FilterRequest(Type=createtype_2, Component="{ .FilterRequest")
toggle_11 = BooleanToggle(False)
pull_2 = Pull(
    Adapter=adapter_6,
    Request=filterrequest_2,
    PullType="{ \"_t\" : \"System.Enum\", \"TypeName\" : { \"_t\" : \"System.Type\", \"Name\" : \"BH.oM.Adapter.PullType\" }, \"Value\" : \"AdapterDefault\" }",
    Active=chained_toggle_7,
    Component="{ .Pull")
pulled_bars = Data(pull_2)

# ----
# Filter only the node
# you need to assign the load to
explode = Explode(Object=pulled_nodes, Component="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")  # -> Position, Orientation, Support, BHoM_Guid, Name, Fragments, Tags, CustomData
_1_4_point = Point()
dist = Distance(PointA=_1_4_point, PointB=explode.Position)
smaller = SmallerThan(FirstNumber=dist, SecondNumber=Slider(0.001, range=0..0.001))  # -> SmallerThan, OrEqualTo
cull = CullPattern(List=pulled_nodes, CullPattern=smaller.SmallerThan)
filtered_pulled_nodes = Data(cull)

# ----
# Define Node Load
number_slider_3 = Slider(100, range=0..100)
filtered_pulled_nodes_2 = Data(filtered_pulled_nodes)
loadcase_3 = Data(loadcase_2)
Z = UnitZ(Factor=number_slider_3)
pointload = PointLoad(
    Loadcase=loadcase_3,
    Objects=filtered_pulled_nodes_2,
    Force=Z,
    Axis="{ \"_t\" : \"System.Enum\", \"TypeName\" : { \"_t\" : \"System.Type\", \"Name\" : \"BH.oM.Structure.Loads.LoadAxis\" }, \"Value\" : \"Global\" }",
    Component="{ .PointLoad")

chained_toggle_8 = Boolean(chained_toggle_5)
chained_toggle_9 = Boolean(chained_toggle_5)

# ----
# Node Loads
toggle_12 = BooleanToggle(False)
adapter_7 = Data(adapter)
push_4 = Push(
    Adapter=adapter_7,
    Objects=flatten(pointload),
    PushType="{ \"_t\" : \"System.Enum\", \"TypeName\" : { \"_t\" : \"System.Type\", \"Name\" : \"BH.oM.Adapter.PushType\" }, \"Value\" : \"AdapterDefault\" }",
    Active=chained_toggle_9,
    Component="{ .Push")  # -> Objects, Success

# ----
# Define sample Load Combination
# with all factors put to one.
panel_3 = Panel("1")
# 3. Define and push Load Combination
panel_4 = Panel("SampleCombination")
loadcase_4 = Data(loadcase_2)
loadcombination = LoadCombination(
    Name=panel_4,
    Number=panel_3,
    Cases=loadcase_4,
    Factors="1.0",
    ExcludeZeroFactorCases=True,
    Component="{ .LoadCombination")

# ----
# Pull support nodes Reaction Results
createtype_3 = CreateType(Component="BH.oM.Structure.Results.NodeReaction")
filterrequest_3 = FilterRequest(Type=createtype_3, Component="{ .FilterRequest")
adapter_8 = Data(adapter)
pull_3 = Pull(
    Adapter=adapter_8,
    Request=filterrequest_3,
    PullType="{ \"_t\" : \"System.Enum\", \"TypeName\" : { \"_t\" : \"System.Type\", \"Name\" : \"BH.oM.Adapter.PullType\" }, \"Value\" : \"AdapterDefault\" }",
    Active=Toggle(False),
    Component="{ .Pull")
explode_2 = Explode(Object=pull_3, Component="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")  # -> FX, FY, FZ, MX, MY, MZ, ObjectId, ResultCase, TimeStep, Orientation

# ----
# 5. (Optional) Pull Results, visualise and query
createtype_4 = CreateType(Component="BH.oM.Structure.Results.BarForce")
panel_5 = Panel(createtype_3)

# ----
# Pull Bar Deformations
createtype_5 = CreateType(Component="BH.oM.Structure.Results.BarDeformation")
filterrequest_4 = FilterRequest(Type=createtype_5, Component="{ .FilterRequest")
adapter_9 = Data(adapter)
pull_4 = Pull(
    Adapter=adapter_9,
    Request=filterrequest_4,
    PullType="{ \"_t\" : \"System.Enum\", \"TypeName\" : { \"_t\" : \"System.Type\", \"Name\" : \"BH.oM.Adapter.PullType\" }, \"Value\" : \"AdapterDefault\" }",
    Active=Toggle(False),
    Component="{ .Pull")
explode_3 = Explode(Object=pull_4, Component="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")  # -> UX, UY, UZ, RX, RY, RZ, ObjectId, ResultCase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

# ----
# Pull Bar Forces
filterrequest_5 = FilterRequest(Type=createtype_4, Component="{ .FilterRequest")
adapter_10 = Data(adapter)
pull_5 = Pull(
    Adapter=adapter_10,
    Request=filterrequest_5,
    PullType="{ \"_t\" : \"System.Enum\", \"TypeName\" : { \"_t\" : \"System.Type\", \"Name\" : \"BH.oM.Adapter.PullType\" }, \"Value\" : \"AdapterDefault\" }",
    Active=Toggle(False),
    Component="{ .Pull")
explode_4 = Explode(Object=pull_5, Component="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")  # -> FX, FY, FZ, MX, MY, MZ, ObjectId, ResultCase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

# ----
# Visualise bar deformations
number_slider_4 = Slider(61, range=1..100)
pulled_bars_2 = Data(pulled_bars)
deformedshape = DeformedShape(
    Bars=pulled_bars_2,
    BarDeformations=pull_4,
    AdapterId="GSA_id",
    LoadCase="A1",
    ScaleFactor=number_slider_4,
    DrawSections=False,
    Component="{ .DeformedShape")

# ----
# (Optional) Check the clusters here (double click them)
# to see more things you can do with results
cluster = Cluster_2(results=pull_5)
cluster_2 = Cluster(forces=pull_5, forces_2=pull_5, forces_3=pull_5)

# ----
# Define Bar Load
number_slider_5 = Slider(100, range=0..100)
pulled_bars_3 = Data(pulled_bars)
# 2.3 Define, apply and push Loads
loadcase_5 = Data(loadcase_2)
Z_2 = UnitZ(Factor=number_slider_5)

neg = Negative(Value=Z_2)

baruniformlydistributedload = BarUniformlyDistributedLoad(
    Loadcase=loadcase_5,
    Objects=pulled_bars_3,
    Force=neg,
    Axis="{ \"_t\" : \"System.Enum\", \"TypeName\" : { \"_t\" : \"System.Type\", \"Name\" : \"BH.oM.Structure.Loads.LoadAxis\" }, \"Value\" : \"Global\" }",
    Projected=False,
    Component="{ .BarUniformlyDistributedLoad")

# ----
# Bar Loads
toggle_13 = BooleanToggle(False)
adapter_11 = Data(adapter)
push_5 = Push(
    Adapter=adapter_11,
    Objects=flatten(baruniformlydistributedload),
    PushType="{ \"_t\" : \"System.Enum\", \"TypeName\" : { \"_t\" : \"System.Type\", \"Name\" : \"BH.oM.Adapter.PushType\" }, \"Value\" : \"AdapterDefault\" }",
    Active=chained_toggle_8,
    Component="{ .Push")  # -> Objects, Success

and = GateAnd(A=push_5.Success, B=push_4.Success)
chained_toggle_10 = Boolean(and)

chained_toggle_11 = Boolean(chained_toggle_10)

toggle_14 = BooleanToggle(False)
adapter_12 = Data(adapter)
push_6 = Push(
    Adapter=adapter_12,
    Objects=flatten(loadcombination),
    PushType="{ \"_t\" : \"System.Enum\", \"TypeName\" : { \"_t\" : \"System.Type\", \"Name\" : \"BH.oM.Adapter.PushType\" }, \"Value\" : \"AdapterDefault\" }",
    Active=chained_toggle_11,
    Component="{ .Push")  # -> Objects, Success
# 4. Analyse Load Combinations
# Run the analysis in the connected software.
# 
# Some Adapter might allow you to launch the analysis automatically through the Execute component.
chained_toggle_12 = Boolean(push_6.Success)

# ==== cluster Cluster
forces = ClusterInput()
forces_2 = ClusterInput()
forces_3 = ClusterInput()
absolutemaxenvelopebyobject = AbsoluteMaxEnvelopeByObject(Forces=forces, Component="{ .AbsoluteMaxEnvelopeByObject")
maxenvelopebyobject = MaxEnvelopeByObject(Forces=forces_2, Component="{ .MaxEnvelopeByObject")
minenvelopebyobject = MinEnvelopeByObject(Forces=forces_3, Component="{ .MinEnvelopeByObject")
explode = Explode(Object=absolutemaxenvelopebyobject, Component="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")  # -> FX, FY, FZ, MX, MY, MZ, ObjectId, ResultCase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

# ==== cluster Cluster_2
results = ClusterInput()
groupbyobjectid = GroupByObjectId(Results=results, Component="{ .GroupByObjectId")
absolutemaxforces = AbsoluteMaxForces(Forces=groupbyobjectid, Component="{ .AbsoluteMaxForces")
explode = Explode(Object=absolutemaxforces, Component="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")  # -> FX, FY, FZ, MX, MY, MZ, ObjectId, ResultCase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
