# Grasshopper definition Bars-with-properties.gh (Grasshopper 0.9.76)
# plug-ins: BH.UI.Grasshopper

# ----
# Adapter
path = FilePath()
bhom = BHoMObject(m_ForcePreview=False, m_MaxItemsPreview=10000)

# ----
# Create Material
panel = Panel("Steel")

steel = Steel(
    Name=panel,
    E=Slider(33000000, range=0..100000000),
    V=Slider(0.3, range=0..1),
    TC=1.2e-05,
    Density=Slider(7.5, range=0..10),
    DampingRatio=0,
    YieldStress=0,
    UltimateStress=0,
    Component="{ .Steel")
bhom_2 = BHoMObject(steel, m_ForcePreview=False, m_MaxItemsPreview=10000)

# ----
# Create Section
number_slider = Slider(0.5, range=0..1)
steelboxsection = SteelBoxSection(
    Height=number_slider,
    Width=Slider(0.5, range=0..1),
    Thickness=Slider(0.03, range=0..1),
    InnerRadius=0,
    OuterRadius=0,
    Material=bhom_2,
    Component="{ .SteelBoxSection")

# ----
# Create Bar Release
panel_2 = Panel("Pin")
barreleasepinpin = BarReleasePinPin(Name=panel_2, Component="{ .BarReleasePinPin")

bhom_3 = BHoMObject(steelboxsection, m_ForcePreview=False, m_MaxItemsPreview=10000)
bhom_4 = BHoMObject(barreleasepinpin, m_ForcePreview=False, m_MaxItemsPreview=10000)

# ----
# Create Bar
line = Line([Line((-1, -2, 0), (1, -2, 0)), Line((1, -2, 0), (1, 2, 0)), Line((1, 2, 0), (-1, 2, 0)), Line((-1, 2, 0), (-1, -2, 0))])
barfeatype = BarFEAType(
    {"Flexural": 0, "Axial": 1, "CompressionOnly": 2, "TensionOnly": 3}, selected="Flexural",
    Component="{ \"_t\" : \"System.Type\", \"Name\" : \"BH.oM.Structure.Elements.BarFEAType\" }",
    Selection=0)
bar = Bar(
    Line=line,
    Property=bhom_3,
    OrientationAngle=Slider(0, range=-180..180),
    Release=bhom_4,
    FeaType=barfeatype,
    Component="{ .Bar")

bhom_5 = BHoMObject(bar, m_ForcePreview=False, m_MaxItemsPreview=10000)

# ----
# Push Bars
toggle = BooleanToggle(False)
push = Push(Adapter=bhom, Objects=bhom_5, Active=toggle, Component="{ .Push")  # -> Objects, Success
