# Grasshopper definition Loadcases-and-combinations.gh (Grasshopper 0.9.76)
# plug-ins: BH.UI.Grasshopper

# ----
# Adapter
path = FilePath()
bhom = BHoMObject()

# ----
# Create Loadcases
panel = Panel("Loadcase 1")
number_slider = Slider(1, range=0..1)
series = Series(Start=number_slider, Step=number_slider, Count=Slider(4, range=0..10))
loadcase = Loadcase(
    Name=[panel, "Loadcase 2", "Loadcase 3", "Loadcase 4"],
    Number=series,
    Nature="{ \"_t\" : \"System.Enum\", \"TypeName\" : { \"_t\" : \"System.Type\", \"Name\" : \"BH.oM.Structure.Loads.LoadNature\" }, \"Value\" : \"Other\" }",
    Component="{ .Loadcase")

bhom_2 = BHoMObject(loadcase)

# ----
# Push
toggle = BooleanToggle(False)
push = Push(Adapter=bhom, Objects=bhom_2, Active=toggle, Component="{ .Push")  # -> Objects, Success

bhom_3 = BHoMObject(push.Objects)

# ----
# Create Load Combination
number_slider_2 = Slider(2, range=0..10)
loadcombination = LoadCombination(
    Name="Loadcombination 1",
    Number=Slider(100, range=0..100),
    Cases=bhom_3,
    Factors=[Slider(2, range=0..10), Slider(3, range=0..10), Slider(4, range=0..10), number_slider_2],
    ExcludeZeroFactorCases=True,
    Component="{ .LoadCombination")

# ----
# Push
bhom_4 = BHoMObject(loadcombination)
push_2 = Push(Adapter=bhom, Objects=bhom_4, Active=Toggle(False), Component="{ .Push")  # -> Objects, Success
