# Grasshopper definition Nodes-with-constraints.gh (Grasshopper 0.9.76)
# plug-ins: BH.UI.Grasshopper

# ----
# Adapter
path = FilePath()
bhom = BHoMObject(m_ForcePreview=False, m_MaxItemsPreview=10000)

# ----
# Create Constraint
toggle = BooleanToggle(False)
constraint6dof = Constraint6DOF(
    X=toggle,
    Y=Toggle(False),
    Z=Toggle(False),
    Xx=Toggle(False),
    Yy=Toggle(False),
    Zz=Toggle(False),
    Name="Pin",
    Component="{ .Constraint6DOF")

bhom_2 = BHoMObject(constraint6dof, m_ForcePreview=False, m_MaxItemsPreview=10000)

# ----
# Create Nodes
pt = Point([Point(-1, -2, 0), Point(1, -2, 0), Point(1, 2, 0), Point(-1, 2, 0), Point(-1, -2, 0)])
node = Node(Position=pt, Constraint=bhom_2, Component="{ .Node")

bhom_3 = BHoMObject(node, m_ForcePreview=False, m_MaxItemsPreview=10000)

# ----
# Push
toggle_2 = BooleanToggle(False)
push = Push(Adapter=bhom, Objects=bhom_3, Active=toggle_2, Component="{ .Push")  # -> Objects, Success
