# Grasshopper definition Panels-with-properties.gh (Grasshopper 0.9.76)
# plug-ins: BH.UI.Grasshopper

# ----
# Create Adapter Here
toggle = BooleanToggle(False)
path = FilePath("C:\Users\pnugent\Desktop\wgsdgh.mdl")
lusasadapter = LusasAdapter(FilePath=path, Active=toggle, Component="{ ..ctor")
bhom = BHoMObject(lusasadapter)

# ----
# Create Panels with Properties
number_slider = Slider(0.3, range=0..1)
materialtype = MaterialType(
    {"Aluminium": 0, "Steel": 1, "Concrete": 2, "Timber": 3, "Rebar": 4, "Tendon": 5, "Glass": 6, "Cable": 7}, selected="Steel",
    Component="{ \"_t\" : \"System.Type\", \"Name\" : \"BH.oM.Common.Materials.MaterialType\" }",
    Selection=1)
material = Material(
    Name="Steel",
    Type=materialtype,
    E=Slider(33000000, range=0..100000000),
    V=number_slider,
    TC=1.2e-05,
    Density=Slider(2.5, range=0..10),
    Component="{ .Material")
number_slider_2 = Slider(0.2, range=0..1)
multiplication = Multiplication(A=number_slider_2, B=Slider(1000, range=0..1000))
srf = Surface(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)
concat = Concatenate(FragmentA=multiplication, FragmentB="mm")
edges = BrepEdges(Brep=srf)  # -> Naked, Interior, NonManifold
constantthickness = ConstantThickness(
    Thickness=number_slider_2,
    Material=material,
    Name=concat,
    Type="{ \"_t\" : \"System.Enum\", \"TypeName\" : { \"_t\" : \"System.Type\", \"Name\" : \"BH.oM.Structure.Properties.Surface.PanelType\" }, \"Value\" : \"Undefined\" }",
    Component="{ .ConstantThickness")
join = JoinCurves(Curves=edges.Naked, Preserve=False)
panelplanar = PanelPlanar(Outlines=join, Property=constantthickness, Component="{ .PanelPlanar")

# ----
# Push Panels
toggle_2 = BooleanToggle(False)
push = Push(Adapter=bhom, Objects=panelplanar, Active=toggle_2)  # -> Objects, Success
