# Grasshopper definition Pull - TasTBD.gh (Grasshopper 0.9.76)
# plug-ins: BH.UI.Grasshopper

# ---- group: - right click - Set One File Path - to chose file
tbd_file_path = FilePath("C:\Users\mdengusi\Documents\GitHub\BHoM\samples\TAS_Toolkit\TasSample_2zones.tbd")

# ---- group: Space
createtype = CreateType(Component="{ \"_t\" : \"System.Type\", \"Name\" : \"BH.oM.Environment.Elements.Space\" }")

# ---- group: Building Element
createtype_2 = CreateType(Component="{ \"_t\" : \"System.Type\", \"Name\" : \"BH.oM.Environment.Elements.BuildingElement\" }")

# ----
tastbdadapter = TasTBDAdapter(TBDFilePath=tbd_file_path, Component="{ ..ctor")
tastbdadapter_2 = TasTBDAdapter(TBDFilePath=tbd_file_path, Component="{ ..ctor")
filterquery = FilterQuery(Type=createtype, Component="{ .FilterQuery")
filterquery_2 = FilterQuery(Type=createtype_2, Component="{ .FilterQuery")
pull = Pull(Adapter=tastbdadapter, Query=filterquery, Active=Toggle(False), Component="{ .Pull")
pull_2 = Pull(Adapter=tastbdadapter_2, Query=filterquery_2, Active=Toggle(False), Component="{ .Pull")
explode = Explode(Object=pull, Component="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")  # -> Number, Location, InternalConditions, HeatingLoad, CoolingLoad, ExtendedProperties, BHoM_Guid, Name, Tags, CustomData
explode_2 = Explode(Object=pull_2, Component="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")  # -> PanelCurve, Openings, ExtendedProperties, BHoM_Guid, Name, Tags, CustomData
panel = Panel(explode.HeatingLoad)
panel_2 = Panel(explode_2.Name)
