# Dynamo graph Pull - TasTBD_ver01.dyn (Dynamo 1.3.4.6666)

# note: Colour Coding Stategy

# group: Get Things
# note: Get Inputs from Revit etc.

# group: Chop / Change Things
# note: Managing List / Filter Lists etc

# group: Input Things
# note: User Inputs Required

# group: Calculate Things
# note: Calculations

# group: Export Things
# note: Export to external files / software

# group: See Things
# note: Dispay Outputs

# group: WIP Things
# note: Things still under progress

# group: Select Tas TBD
file_path = Filename(".\SAM_Live_2zones.tbd")

tasTBDAdapter = CreateAdapterComponent(file_path)

# group: Choose method how you want to specify Building there are few option chose one you like
createType = CreateTypeComponent()
# note: Script Purpose:
# Pull data from Tas EDSL
# Version Information to create script:
# Dynamo 1.3.4.6666
# Revit 2018.8.3
# Date created: 14/12/2018
# Date updated: 23/04/2019
string = StringInput("BH.oM.Environment.Elements.Building")

filterQuery = CreateQueryComponent(createType)

# group: Pull Building
boolean = BoolSelector(false)

pull = PullComponent(tasTBDAdapter, filterQuery, arg3=boolean)

# group: Select Tas TBD
file_path_2 = Filename(".\SAM_Live_2zones.tbd")

tasTBDAdapter_2 = CreateAdapterComponent(file_path_2)

# group: Pull Spaces
createType_2 = CreateTypeComponent()
boolean_2 = BoolSelector(false)

filterQuery_2 = CreateQueryComponent(createType_2)
pull_2 = PullComponent(tasTBDAdapter_2, filterQuery_2, arg3=boolean_2)

# group: Select Tas TBD
file_path_3 = Filename(".\SAM_Live_2zones.tbd")

tasTBDAdapter_3 = CreateAdapterComponent(file_path_3)

# group: Pull Constructions
createType_3 = CreateTypeComponent()
boolean_3 = BoolSelector(false)

filterQuery_3 = CreateQueryComponent(createType_3)
pull_3 = PullComponent(tasTBDAdapter_3, filterQuery_3, arg3=boolean_3)

# group: Select Tas TBD
file_path_4 = Filename(".\SAM_Live_2zones.tbd")

tasTBDAdapter_4 = CreateAdapterComponent(file_path_4)

# group: Pull InternalCondition
createType_4 = CreateTypeComponent()
boolean_4 = BoolSelector(true)

filterQuery_4 = CreateQueryComponent(createType_4)
pull_4 = PullComponent(tasTBDAdapter_4, filterQuery_4, arg3=boolean_4)

# group: Select Tas TBD
file_path_5 = Filename(".\SAM_Live_2zones.tbd")

tasTBDAdapter_5 = CreateAdapterComponent(file_path_5)

# group: Pull Panels
createType_5 = CreateTypeComponent()
boolean_5 = BoolSelector(false)

filterQuery_5 = CreateQueryComponent(createType_5)
pull_5 = PullComponent(tasTBDAdapter_5, filterQuery_5, arg3=boolean_5)
toLines = ConvertComponent(pull_5)
byJoinedCurves = PolyCurve.ByJoinedCurves(toLines)
