# Grasshopper definition Pull - TasTBD_ver01.gh (Grasshopper 0.9.76)
# plug-ins: BH.UI.Grasshopper

# ---- group: - right click - Set One File Path - to chose file
tbd_file_path = FilePath("C:\Users\mdengusi\Documents\GitHub\BHoM\samples\TAS_Toolkit\TasSample_2zones.tbd")

# ---- group: Space
createtype = CreateType(Component="{ \"_t\" : \"System.Type\", \"Name\" : \"BH.oM.Environment.Elements.Space\" }")

# ---- group: Panels
createtype_2 = CreateType(Component="{ \"_t\" : \"System.Type\", \"Name\" : \"BH.oM.Environment.Elements.Panel\" }")

# ----
tastbdadapter = TasTBDAdapter(TBDFilePath=tbd_file_path, Component="{ ..ctor")
tastbdadapter_2 = TasTBDAdapter(TBDFilePath=tbd_file_path, Component="{ ..ctor")
filterrequest = FilterRequest(Type=createtype, Component="{ .FilterRequest")
filterrequest_2 = FilterRequest(Type=createtype_2, Component="{ .FilterRequest")
pull = Pull(Adapter=tastbdadapter, Request=filterrequest, Active=Toggle(False), Component="{ .Pull")
pull_2 = Pull(Adapter=tastbdadapter_2, Request=filterrequest_2, Active=Toggle(False), Component="{ .Pull")
explode = Explode(Object=pull, Component="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")  # -> Zones, Gains, Type, Location, BHoM_Guid, Name, Fragments, Tags, CustomData
explode_2 = Explode(Object=pull_2, Component="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")  # -> ExternalEdges, Openings, Construction, Type, ConnectedSpaces, BHoM_Guid, Name, Fragments, Tags, CustomData
panel = Panel(explode.Name)
