# Grasshopper definition Pull - TasTBD_ver02.gh (Grasshopper 1.0.7)
# plug-ins: BH.UI.Grasshopper

# ---- group: - right click - Set One File Path - to chose file
tbd_file_path = FilePath("C:\Users\DengusiakM\Documents\GitHub\samples\TAS_Toolkit\TasSample_2zones.tbd")

# ---- group: Panels
createtype = CreateType(Component="BH.oM.Environment.Elements.Panel")

# ----
tassettings = TASSettings(
    PlanarTolerance=1e-06,
    DistanceTolerance=1e-06,
    MinimumSegmentLength=1e-06,
    AngleTolerance=1e-06,
    Component="{ .TASSettings")

# ---- group: Space
createtype_2 = CreateType(Component="BH.oM.Environment.Elements.Space")

# ----
filterrequest = FilterRequest(Type=createtype, Component="{ .FilterRequest")
filterrequest_2 = FilterRequest(Type=createtype_2, Component="{ .FilterRequest")
tastbdadapter = TasTBDAdapter(TBDFilePath=tbd_file_path, TasSettings=tassettings, Component="{ ..ctor")
pull = Pull(
    Adapter=tastbdadapter,
    Request=filterrequest_2,
    PullType="{ \"_t\" : \"System.Enum\", \"TypeName\" : { \"_t\" : \"System.Type\", \"Name\" : \"BH.oM.Adapter.PullType\" }, \"Value\" : \"AdapterDefault\" }",
    Active=Toggle(False),
    Component="{ .Pull")
pull_2 = Pull(
    Adapter=tastbdadapter,
    Request=filterrequest,
    PullType="{ \"_t\" : \"System.Enum\", \"TypeName\" : { \"_t\" : \"System.Type\", \"Name\" : \"BH.oM.Adapter.PullType\" }, \"Value\" : \"AdapterDefault\" }",
    Active=Toggle(False),
    Component="{ .Pull")
explode = Explode(Object=pull, Component="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")  # -> Zones, Gains, Type, Location, BHoM_Guid, Name, Fragments, Tags, CustomData
explode_2 = Explode(Object=pull_2, Component="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")  # -> ExternalEdges, Openings, Construction, Type, ConnectedSpaces, BHoM_Guid, Name, Fragments, Tags, CustomData
panel = Panel(explode.Name)
panel_2 = Panel(explode_2.Name)
