# Dynamo graph Pull - TasTSD_ver01.dyn (Dynamo 1.3.4.6666)

# group: Get Things
# note: Get Inputs from Revit etc.

# group: Chop / Change Things
# note: Managing List / Filter Lists etc

# group: Input Things
# note: User Inputs Required

# group: Calculate Things
# note: Calculations

# group: Export Things
# note: Export to external files / software

# group: See Things
# note: Dispay Outputs

# group: WIP Things
# note: Things still under progress

# note: Colour Coding Stategy
# note: Script Purpose:
# Pull data from Tas EDSL
# Version Information to create script:
# Dynamo 1.3.3.4111
# Revit 2018.8.3
# Date created: 23/01/2019
# Date updated: 25/06/2019
file_path = Filename("C:\Users\mdengusi\Desktop\SAM_Bath\2019-01-11 XML\TasSample_2zones.tsd")
TSDResultType = CreateEnumComponent()
simulationResultType = CreateEnumComponent()
profileResultUnit = CreateEnumComponent()
profileResultType = CreateEnumComponent()
code_block = CodeBlock { 1; }
tasTSDAdapter = CreateAdapterComponent(file_path, TSDResultType, simulationResultType, profileResultUnit, profileResultType, code_block, code_block)
boolean = BoolSelector(true)
pull = PullComponent(tasTSDAdapter, arg3=boolean)
explodeobject_old = ExplodeObjectNode(pull, outputcount=6)
flatten = Flatten(explodeobject_old.out1)
explodeobject_old_2 = ExplodeObjectNode(flatten, outputcount=7)
