# Dynamo graph Pull Revit - Push gbXML_01.dyn (Dynamo 1.3.3.4111)

# note: Colour Coding Stategy
# note: Script Purpose:
# Pull data from Tas EDSL
# Version Information to create script:
# Dynamo 1.3.3.4111
# Revit 2018.8.3
# Date created: 14/12/2018
# Date updated: 14/12/2018

# group: Get Things
# note: Get Inputs from Revit etc.

# group: Chop / Change Things
# note: Managing List / Filter Lists etc

# group: Input Things
# note: User Inputs Required

# group: Calculate Things
# note: Calculations

# group: Export Things
# note: Export to external files / software

# group: See Things
# note: Dispay Outputs

# group: WIP Things
# note: Things still under progress

# group: Select Building
boolean = BoolSelector(true)
createType = CreateTypeComponent()

revitAdapter = CreateAdapterComponent(arg1=boolean)
filterQuery = CreateQueryComponent(createType)
pull = PullComponent(revitAdapter, filterQuery, arg3=boolean)

# group: expanded method
buildings = QueryComponent(pull)
# note: Option 1
buildingElements = QueryComponent(pull)
stripOpenings = QueryComponent(buildingElements)
uniqueSpaceNames = QueryComponent(stripOpenings)
buildSpaces = ComputeComponent(stripOpenings, uniqueSpaceNames)
spaces = QueryComponent(pull)
matchSpaces = QueryComponent(buildSpaces, spaces)
shadingElements = QueryComponent(buildingElements)
levels = QueryComponent(pull)
openings = QueryComponent(buildingElements)
documentBuilder = CreateObjectComponent(buildings, matchSpaces, shadingElements, levels, openings)
openingsFromElements = QueryComponent(buildingElements)

# group: export details
string = StringInput("BHoMgbXML")
directory_path = Directory("C:\Users\mdengusi\Desktop")

exportType = CreateEnumComponent()
exportDetail = CreateEnumComponent()
XMLAdapter = CreateAdapterComponent(string, directory_path, exportType, exportDetail)

# group: merged into one node
# note: Option 2
documentBuilder_2 = CreateObjectComponent(pull)

boolean_2 = BoolSelector(true)

# group: gbXML
push = PushComponent(XMLAdapter, documentBuilder_2, arg4=boolean_2)

watch = Watch(push.out1)
