# Dynamo graph Pull Revit - Push gbXML_03.dyn (Dynamo 1.3.4.6666)

# note: Colour Coding Stategy
# note: Script Purpose:
# Pull data from Revit
# Version Information to create script:
# Dynamo 1.3.3.4111
# Revit 2018.8.3
# Date created: 14/12/2018
# Date updated: 25/06/2019

# group: Get Things
# note: Get Inputs from Revit etc.

# group: Chop / Change Things
# note: Managing List / Filter Lists etc

# group: Input Things
# note: User Inputs Required

# group: Calculate Things
# note: Calculations

# group: Export Things
# note: Export to external files / software

# group: See Things
# note: Dispay Outputs

# group: WIP Things
# note: Things still under progress

# group: export details
string = StringInput("BHoMgbXML_Dyn")
directory_path = Directory("C:\Users\mdengusi\Desktop\SAM_Bath\2019-06-23 SAM2019")

exportType = CreateEnumComponent()
exportDetail = CreateEnumComponent()
XMLAdapter = CreateAdapterComponent(string, directory_path, exportType, exportDetail)

# group: Select Building
boolean = BoolSelector(true)
createType = CreateTypeComponent()

revitAdapter = CreateAdapterComponent(arg1=boolean)
filterRequest = CreateRequestComponent(createType)
pull = PullComponent(revitAdapter, filterRequest, arg3=boolean)

# group: merged into one node
documentBuilder = CreateObjectComponent(pull)

boolean_2 = BoolSelector(true)

# group: gbXML
push = PushComponent(XMLAdapter, documentBuilder, arg4=boolean_2)

watch = Watch(push.out1)

# group: expanded method
panels = QueryComponent(pull)
levels = QueryComponent(pull)
buildings = QueryComponent(pull)
spaces = QueryComponent(pull)

panelType = CreateEnumComponent()
panelsByType = QueryComponent(panels, panelType)

# group: visualise geometry two options
toLines = QueryComponent(panels)
flatten = Flatten(toLines)  # frozen
byJoinedCurves = PolyCurve.ByJoinedCurves(toLines)

# group: visualise geometry two options
flatten_2 = Flatten()  # unwired: arg0
byJoinedCurves_2 = PolyCurve.ByJoinedCurves()  # frozen; unwired: arg0
toLines_2 = QueryComponent(panels)
