# Grasshopper definition Pull Revit - Push gbXML_04.gh (Grasshopper 0.9.76)
# plug-ins: BH.UI.Grasshopper

toggle = BooleanToggle(False)

filterrequest = FilterRequest(Type="BH.oM.Environment.Elements.Building", Component="{ .FilterRequest")

revitadapter = RevitAdapter(Active=toggle, Component="{ ..ctor")
pull = Pull(Adapter=revitadapter, Request=filterrequest, Active=toggle, Component="{ .Pull")

buildings = Buildings(BhomObjects=pull, Component="{ .Buildings")
spaces = Spaces(BhomObjects=pull, Component="{ .Spaces")
levels = Levels(Objects=pull, Component="{ .Levels")
panels = Panels(Objects=pull, Component="{ .Panels")

exportdetail = ExportDetail(
    {"Undefined": 0, "BuildingShell": 1, "Full": 2, "IndividualSpaces": 3}, selected="Full",
    Component="BH.oM.XML.Enums.ExportDetail",
    Selection=2)
exporttype = ExportType({"Undefined": 0, "gbXMLTAS": 1, "gbXMLIES": 2}, selected="gbXMLTAS", Component="BH.oM.XML.Enums.ExportType", Selection=1)
polyline = Polyline(Panel=panels, Component="{ .Polyline")
xmladapter = XMLAdapter(
    XmlFileName="BHoMgbXML_GH",
    XmlDirectoryPath="C:\Users\mdengusi\Desktop\SAM_Bath\2019-04-23 oMupdate",
    ExportType=exporttype,
    ExportDetail=exportdetail,
    Component="{ ..ctor")
documentbuilder = DocumentBuilder(Objs=pull, Component="{ .DocumentBuilder")
push = Push(Adapter=xmladapter, Objects=documentbuilder, Active=Toggle(False), Component="{ .Push")  # -> Objects, Success
panel = Panel(push.Success)
