# Dynamo graph Pull Revit - Push gbXML_05.dyn (Dynamo 1.3.4.6666)

# note: Colour Coding Stategy
# note: Script Purpose:
# Pull data from Revit
# Version Information to create script:
# Dynamo 1.3.3.4111
# Revit 2018.8.3
# Date created: 14/12/2018
# Date updated: 23/04/2019

# group: Get Things
# note: Get Inputs from Revit etc.

# group: Chop / Change Things
# note: Managing List / Filter Lists etc

# group: Input Things
# note: User Inputs Required

# group: Calculate Things
# note: Calculations

# group: Export Things
# note: Export to external files / software

# group: See Things
# note: Dispay Outputs

# group: WIP Things
# note: Things still under progress

string = StringInput("BHoMgbXML_DynIP")
directory_path = Directory("C:\Users\mdengusi\Desktop\SAM_Bath\2019-07-04 BHoMtest")
fileSettings = CreateObjectComponent(string, directory_path)
boolean = BoolSelector(false)
boolean_2 = BoolSelector(true)
boolean_3 = BoolSelector(true)
boolean_4 = BoolSelector(true)
unitType = CreateEnumComponent()
exportDetail = CreateEnumComponent()
XMLSettings = CreateObjectComponent(boolean, boolean_2, boolean_3, boolean_4, unitType, exportDetail)
XMLAdapter = CreateAdapterComponent(fileSettings, XMLSettings)

# group: Select Building
boolean_5 = BoolSelector(true)
createType = CreateTypeComponent()

revitAdapter = CreateAdapterComponent(arg1=boolean_5)
filterRequest = CreateRequestComponent(createType)
pull = PullComponent(revitAdapter, filterRequest, arg3=boolean_5)

# group: merged into one node
documentBuilder = CreateObjectComponent(pull)

boolean_6 = BoolSelector(true)

# group: gbXML
push = PushComponent(XMLAdapter, documentBuilder, arg4=boolean_6)

watch = Watch(push.out1)

# group: expanded method
panels = QueryComponent(pull)
levels = QueryComponent(pull)
buildings = QueryComponent(pull)
spaces = QueryComponent(pull)

panelType = CreateEnumComponent()
panelsByType = QueryComponent(panels, panelType)
integer_slider = IntegerSlider(20, range=0..21 step 1)
getItemAtIndex = List.GetItemAtIndex(list=panels, index=integer_slider)
polyline = QueryComponent(getItemAtIndex)

# group: visualise geometry two options
flatten = Flatten(panels)
byJoinedCurves = PolyCurve.ByJoinedCurves(polyline)

string_2 = StringInput("SAMRevit.json")
fileAdapter = CreateAdapterComponent(directory_path, string_2)
