# Grasshopper definition Pull Revit - Push gbXML_05.gh (Grasshopper 0.9.76)
# plug-ins: BH.UI.Grasshopper

toggle = BooleanToggle(False)

filterrequest = FilterRequest(Type="BH.oM.Environment.Elements.Building", Component="{ .FilterRequest")

revitadapter = RevitAdapter(Active=toggle, Component="{ ..ctor")
pull = Pull(Adapter=revitadapter, Request=filterrequest, Active=toggle, Component="{ .Pull")
exportdetail = ExportDetail(
    {"Undefined": 0, "BuildingShell": 1, "Full": 2, "IndividualSpaces": 3}, selected="Full",
    Component="BH.oM.XML.Enums.ExportDetail",
    Selection=2)

buildings = Buildings(BhomObjects=pull, Component="{ .Buildings")
spaces = Spaces(BhomObjects=pull, Component="{ .Spaces")
levels = Levels(Objects=pull, Component="{ .Levels")
panels = Panels(Objects=pull, Component="{ .Panels")

xmlsettings = XMLSettings(
    ReplaceCurtainWalls=False,
    ReplaceSolidOpeningsIntoDoors=False,
    IncludeConstructions=False,
    FixIncorrectAirTypes=False,
    NewFile=True,
    UnitType="{ \"_t\" : \"System.Enum\", \"TypeName\" : { \"_t\" : \"System.Type\", \"Name\" : \"BH.oM.XML.Enums.UnitType\" }, \"Value\" : \"SI\" }",
    ExportDetail=exportdetail,
    DistanceTolerance=0.01,
    Component="{ .XMLSettings")
polyline = Polyline(Panel=panels, Component="{ .Polyline")
xmlfilesettings = XMLFileSettings(
    FileName="BHoMgbXML_GH",
    Directory="C:\Users\mdengusi\Desktop\SAM_Bath\2019-09-16 RevitPush",
    Component="{ .XMLFileSettings")
documentbuilder = DocumentBuilder(Objs=pull, Component="{ .DocumentBuilder")
xmladapter = XMLAdapter(XmlFileSettings=xmlfilesettings, XmlSettings=xmlsettings, Component="{ ..ctor")
push = Push(Adapter=xmladapter, Objects=documentbuilder, Active=Toggle(False), Component="{ .Push")  # -> Objects, Success
panel = Panel(push.Success)
