# Grasshopper definition Pull Revit - Push ies_00.gh (Grasshopper 0.9.76)
# plug-ins: BH.UI.Grasshopper

toggle = BooleanToggle(False)

filterrequest = FilterRequest(Type="BH.oM.Environment.Elements.Building", Component="{ .FilterRequest")

revitadapter = RevitAdapter(Active=toggle, Component="{ ..ctor")
pull = Pull(Adapter=revitadapter, Request=filterrequest, Active=toggle, Component="{ .Pull")

buildings = Buildings(BhomObjects=pull, Component="{ .Buildings")
spaces = Spaces(BhomObjects=pull, Component="{ .Spaces")
levels = Levels(Objects=pull, Component="{ .Levels")
panels = Panels(Objects=pull, Component="{ .Panels")

polyline = Polyline(Panel=panels, Component="{ .Polyline")
filesettingsies = FileSettingsIES(FileName="BHoMgem_GH1", Directory="C:\Users\mdengusi\Desktop\SAM_Bath\2019-08-13 normal", Component="{ .FileSettingsIES")
tospace = ToSpace(Panels=panels, SpaceName="00_901 Attic", Component="{ .ToSpace")
tospaces = ToSpaces(Panels=panels, Component="{ .ToSpaces")
iesadapter = IESAdapter(IesFileSettings=filesettingsies, Component="{ ..ctor")
push = Push(Adapter=iesadapter, Objects=panels, Active=Toggle(False), Component="{ .Push")  # -> Objects, Success
panel = Panel(push.Success)
