# Grasshopper definition Pull Revit - Push ies_01.gh (Grasshopper 0.9.76)
# plug-ins: BH.UI.Grasshopper

toggle = BooleanToggle(False)

filterrequest = FilterRequest(Type="BH.oM.Environment.Elements.Building", Component="{ .FilterRequest")

revitadapter = RevitAdapter(Active=toggle, Component="{ ..ctor")
pull = Pull(Adapter=revitadapter, Request=filterrequest, Active=toggle, Component="{ .Pull")

buildings = Buildings(BhomObjects=pull, Component="{ .Buildings")
spaces = Spaces(BhomObjects=pull, Component="{ .Spaces")
levels = Levels(Objects=pull, Component="{ .Levels")
panels = Panels(Objects=pull, Component="{ .Panels")

polyline = Polyline(Panel=panels, Component="{ .Polyline")
settingsies = SettingsIES(PlanarTolerance=0.01, Component="{ .SettingsIES")
filesettingsies = FileSettingsIES(
    FileName="BHoMgem_GH1",
    Directory="C:\Users\mdengusi\Desktop\SAM_Bath\2019-09-16 RevitPush",
    Component="{ .FileSettingsIES")
iesadapter = IESAdapter(IesFileSettings=filesettingsies, SettingsIES=settingsies, Component="{ ..ctor")
push = Push(Adapter=iesadapter, Objects=panels, Active=Toggle(False), Component="{ .Push")  # -> Objects, Success
panel = Panel(push.Success)
