# Dynamo graph Pull XML - Push Revit_01.dyn (Dynamo 1.3.4.6666)

# group: Get Things
# note: Get Inputs from Revit etc.

# group: Chop / Change Things
# note: Managing List / Filter Lists etc

# group: Input Things
# note: User Inputs Required

# group: Calculate Things
# note: Calculations

# group: Export Things
# note: Export to external files / software

# group: See Things
# note: Dispay Outputs

# group: WIP Things
# note: Things still under progress

boolean = BoolSelector(true)
revitAdapter = CreateAdapterComponent(arg1=boolean)
# note: Colour Coding Stategy
# note: Script Purpose:
# Pull data from Tas EDSL
# Version Information to create script:
# Dynamo 1.3.3.4111
# Revit 2018.8.3
# Date created: 14/12/2018
# Date updated: 25/06/2019
string = StringInput("BHoMgbXML_gbXMLTAS_Full_TAS")
directory_path = Directory("C:\Users\mdengusi\Desktop\SAM_Bath\2019-01-18")
XMLAdapter = CreateAdapterComponent(string, directory_path)  # unwired: arg2, arg3
createType = CreateTypeComponent()
filterRequest = CreateRequestComponent(createType)
boolean_2 = BoolSelector(true)
pull = PullComponent(XMLAdapter, filterRequest, arg3=boolean_2)
push = PushComponent(revitAdapter, pull, arg4=boolean)
