# Grasshopper definition Pull gbXML- Push Revit_00.gh (Grasshopper 0.9.76)
# plug-ins: BH.UI.Grasshopper

xmlsettings = XMLSettings(
    ReplaceCurtainWalls=False,
    ReplaceSolidOpeningsIntoDoors=False,
    IncludeConstructions=False,
    FixIncorrectAirTypes=False,
    NewFile=True,
    UnitType="{ \"_t\" : \"System.Enum\", \"TypeName\" : { \"_t\" : \"System.Type\", \"Name\" : \"BH.oM.XML.Enums.UnitType\" }, \"Value\" : \"SI\" }",
    ExportDetail="{ \"_t\" : \"System.Enum\", \"TypeName\" : { \"_t\" : \"System.Type\", \"Name\" : \"BH.oM.XML.Enums.ExportDetail\" }, \"Value\" : \"Full\" }",
    DistanceTolerance=0.01,
    Component="{ .XMLSettings")
paneltype = PanelType(
    {"Undefined": 0, "Ceiling": 1, "CurtainWall": 2, "Floor": 3, "FloorExposed": 4, "FloorInternal": 5, "FloorRaised": 6, "Roof": 7, "Shade": 8, "SlabOnGrade": 9, "SolarPanel": 10, "UndergroundCeiling": 11, "UndergroundSlab": 12, "UndergroundWall": 13, "Wall": 14, "WallExternal": 15, "WallInternal": 16}, selected="Roof",
    Component="BH.oM.Environment.Elements.PanelType",
    Selection=7)
xmlfilesettings = XMLFileSettings(
    FileName="BHoMgbXML_GH",
    Directory="C:\Users\mdengusi\Desktop\SAM_Bath\2019-09-16 RevitPush",
    Component="{ .XMLFileSettings")
createtype = CreateType(Component="BH.oM.Environment.Elements.Panel")
paneltype_2 = PanelType(
    {"Undefined": 0, "Ceiling": 1, "CurtainWall": 2, "Floor": 3, "FloorExposed": 4, "FloorInternal": 5, "FloorRaised": 6, "Roof": 7, "Shade": 8, "SlabOnGrade": 9, "SolarPanel": 10, "UndergroundCeiling": 11, "UndergroundSlab": 12, "UndergroundWall": 13, "Wall": 14, "WallExternal": 15, "WallInternal": 16}, selected="UndergroundWall",
    Component="BH.oM.Environment.Elements.PanelType",
    Selection=13)
paneltype_3 = PanelType(
    {"Undefined": 0, "Ceiling": 1, "CurtainWall": 2, "Floor": 3, "FloorExposed": 4, "FloorInternal": 5, "FloorRaised": 6, "Roof": 7, "Shade": 8, "SlabOnGrade": 9, "SolarPanel": 10, "UndergroundCeiling": 11, "UndergroundSlab": 12, "UndergroundWall": 13, "Wall": 14, "WallExternal": 15, "WallInternal": 16}, selected="WallExternal",
    Component="BH.oM.Environment.Elements.PanelType",
    Selection=15)
paneltype_4 = PanelType(
    {"Undefined": 0, "Ceiling": 1, "CurtainWall": 2, "Floor": 3, "FloorExposed": 4, "FloorInternal": 5, "FloorRaised": 6, "Roof": 7, "Shade": 8, "SlabOnGrade": 9, "SolarPanel": 10, "UndergroundCeiling": 11, "UndergroundSlab": 12, "UndergroundWall": 13, "Wall": 14, "WallExternal": 15, "WallInternal": 16}, selected="FloorExposed",
    Component="BH.oM.Environment.Elements.PanelType",
    Selection=4)
paneltype_5 = PanelType(
    {"Undefined": 0, "Ceiling": 1, "CurtainWall": 2, "Floor": 3, "FloorExposed": 4, "FloorInternal": 5, "FloorRaised": 6, "Roof": 7, "Shade": 8, "SlabOnGrade": 9, "SolarPanel": 10, "UndergroundCeiling": 11, "UndergroundSlab": 12, "UndergroundWall": 13, "Wall": 14, "WallExternal": 15, "WallInternal": 16}, selected="WallInternal",
    Component="BH.oM.Environment.Elements.PanelType",
    Selection=16)
paneltype_6 = PanelType(
    {"Undefined": 0, "Ceiling": 1, "CurtainWall": 2, "Floor": 3, "FloorExposed": 4, "FloorInternal": 5, "FloorRaised": 6, "Roof": 7, "Shade": 8, "SlabOnGrade": 9, "SolarPanel": 10, "UndergroundCeiling": 11, "UndergroundSlab": 12, "UndergroundWall": 13, "Wall": 14, "WallExternal": 15, "WallInternal": 16}, selected="SlabOnGrade",
    Component="BH.oM.Environment.Elements.PanelType",
    Selection=9)
paneltype_7 = PanelType(
    {"Undefined": 0, "Ceiling": 1, "CurtainWall": 2, "Floor": 3, "FloorExposed": 4, "FloorInternal": 5, "FloorRaised": 6, "Roof": 7, "Shade": 8, "SlabOnGrade": 9, "SolarPanel": 10, "UndergroundCeiling": 11, "UndergroundSlab": 12, "UndergroundWall": 13, "Wall": 14, "WallExternal": 15, "WallInternal": 16}, selected="UndergroundCeiling",
    Component="BH.oM.Environment.Elements.PanelType",
    Selection=11)
paneltype_8 = PanelType(
    {"Undefined": 0, "Ceiling": 1, "CurtainWall": 2, "Floor": 3, "FloorExposed": 4, "FloorInternal": 5, "FloorRaised": 6, "Roof": 7, "Shade": 8, "SlabOnGrade": 9, "SolarPanel": 10, "UndergroundCeiling": 11, "UndergroundSlab": 12, "UndergroundWall": 13, "Wall": 14, "WallExternal": 15, "WallInternal": 16}, selected="FloorInternal",
    Component="BH.oM.Environment.Elements.PanelType",
    Selection=5)
xmladapter = XMLAdapter(XmlFileSettings=xmlfilesettings, XmlSettings=xmlsettings, Component="{ ..ctor")
filterrequest = FilterRequest(Type=createtype, Component="{ .FilterRequest")
pull = Pull(Adapter=xmladapter, Request=filterrequest, Active=Toggle(True), Component="{ .Pull")
panelsbytype = PanelsByType(Panels=pull, Type=paneltype, Component="{ .PanelsByType")
panelsbytype_2 = PanelsByType(Panels=pull, Type=paneltype_2, Component="{ .PanelsByType")
panelsbytype_3 = PanelsByType(Panels=pull, Type=paneltype_3, Component="{ .PanelsByType")
panelsbytype_4 = PanelsByType(Panels=pull, Type=paneltype_4, Component="{ .PanelsByType")
panelsbytype_5 = PanelsByType(Panels=pull, Type=paneltype_5, Component="{ .PanelsByType")
panelsbytype_6 = PanelsByType(Panels=pull, Type=paneltype_6, Component="{ .PanelsByType")
panelsbytype_7 = PanelsByType(Panels=pull, Type=paneltype_7, Component="{ .PanelsByType")
panelsbytype_8 = PanelsByType(Panels=pull, Type=paneltype_8, Component="{ .PanelsByType")
polyline = Polyline(Panel=panelsbytype, Component="{ .Polyline")
explode = Explode(Object=panelsbytype, Component="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")  # -> ExternalEdges, Openings, Construction, Type, ConnectedSpaces, BHoM_Guid, Name, Fragments, Tags, CustomData
explode_2 = Explode(Object=panelsbytype_2, Component="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")  # -> ExternalEdges, Openings, Construction, Type, ConnectedSpaces, BHoM_Guid, Name, Fragments, Tags, CustomData
explode_3 = Explode(Object=panelsbytype_4, Component="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")  # -> ExternalEdges, Openings, Construction, Type, ConnectedSpaces, BHoM_Guid, Name, Fragments, Tags, CustomData
polyline_2 = Polyline(Panel=panelsbytype_2, Component="{ .Polyline")
explode_4 = Explode(Object=panelsbytype_6, Component="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")  # -> ExternalEdges, Openings, Construction, Type, ConnectedSpaces, BHoM_Guid, Name, Fragments, Tags, CustomData
explode_5 = Explode(Object=panelsbytype_7, Component="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")  # -> ExternalEdges, Openings, Construction, Type, ConnectedSpaces, BHoM_Guid, Name, Fragments, Tags, CustomData
explode_6 = Explode(Object=panelsbytype_3, Component="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")  # -> ExternalEdges, Openings, Construction, Type, ConnectedSpaces, BHoM_Guid, Name, Fragments, Tags, CustomData
explode_7 = Explode(Object=panelsbytype_8, Component="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")  # -> ExternalEdges, Openings, Construction, Type, ConnectedSpaces, BHoM_Guid, Name, Fragments, Tags, CustomData
polyline_3 = Polyline(Panel=panelsbytype_4, Component="{ .Polyline")
explode_8 = Explode(Object=panelsbytype_5, Component="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")  # -> ExternalEdges, Openings, Construction, Type, ConnectedSpaces, BHoM_Guid, Name, Fragments, Tags, CustomData
polyline_4 = Polyline(Panel=panelsbytype_6, Component="{ .Polyline")
polyline_5 = Polyline(Panel=panelsbytype_7, Component="{ .Polyline")
polyline_6 = Polyline(Panel=panelsbytype_3, Component="{ .Polyline")
explode_9 = Explode(Object=pull, Component="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")  # -> ExternalEdges, Openings, Construction, Type, ConnectedSpaces, BHoM_Guid, Name, Fragments, Tags, CustomData
polyline_7 = Polyline(Panel=panelsbytype_8, Component="{ .Polyline")
polyline_8 = Polyline(Panel=panelsbytype_5, Component="{ .Polyline")
list_item = ListItem(List=explode_2.Name, Index=0, Wrap=True)
list_item_2 = ListItem(List=explode_3.Name, Index=0, Wrap=True)
list_item_3 = ListItem(List=explode_4.Name, Index=0, Wrap=True)
list_item_4 = ListItem(List=explode_5.Name, Index=0, Wrap=True)
list_item_5 = ListItem(List=explode.Name, Index=0, Wrap=True)
list_item_6 = ListItem(List=explode_6.Name, Index=0, Wrap=True)
list_item_7 = ListItem(List=explode_7.Name, Index=0, Wrap=True)
planarsurface = PlanarSurface(BoundaryCurves=polyline_2, Component="{ .PlanarSurface")
list_item_8 = ListItem(List=explode_8.Name, Index=0, Wrap=True)
planarsurface_2 = PlanarSurface(BoundaryCurves=polyline_3, Component="{ .PlanarSurface")
planarsurface_3 = PlanarSurface(BoundaryCurves=polyline_4, Component="{ .PlanarSurface")
planarsurface_4 = PlanarSurface(BoundaryCurves=polyline_5, Component="{ .PlanarSurface")
planarsurface_5 = PlanarSurface(BoundaryCurves=polyline, Component="{ .PlanarSurface")
planarsurface_6 = PlanarSurface(BoundaryCurves=polyline_6, Component="{ .PlanarSurface")
planarsurface_7 = PlanarSurface(BoundaryCurves=polyline_7, Component="{ .PlanarSurface")
planarsurface_8 = PlanarSurface(BoundaryCurves=polyline_8, Component="{ .PlanarSurface")
panel = Panel(list_item_2)
panel_2 = Panel(list_item_3)
panel_3 = Panel(list_item_4)
panel_4 = Panel(list_item)
panel_5 = Panel(list_item_7)
panel_6 = Panel(list_item_5)
panel_7 = Panel(list_item_6)
panel_8 = Panel(list_item_8)
construction = Construction(Name=panel_4, Component="{ .Construction")
construction_2 = Construction(Name=panel, Component="{ .Construction")
construction_3 = Construction(Name=panel_2, Component="{ .Construction")
construction_4 = Construction(Name=panel_3, Component="{ .Construction")
construction_5 = Construction(Name=panel_6, Component="{ .Construction")
construction_6 = Construction(Name=panel_7, Component="{ .Construction")
construction_7 = Construction(Name=panel_5, Component="{ .Construction")
construction_8 = Construction(Name=panel_8, Component="{ .Construction")
wall = Wall(
    Location=planarsurface,
    Construction=construction,
    Offset="{ \"_t\" : \"System.Enum\", \"TypeName\" : { \"_t\" : \"System.Type\", \"Name\" : \"BH.oM.Physical.Elements.Offset\" }, \"Value\" : \"Undefined\" }",
    Component="{ .Wall")
wall_2 = Wall(
    Location=planarsurface_6,
    Construction=construction_6,
    Offset="{ \"_t\" : \"System.Enum\", \"TypeName\" : { \"_t\" : \"System.Type\", \"Name\" : \"BH.oM.Physical.Elements.Offset\" }, \"Value\" : \"Undefined\" }",
    Component="{ .Wall")
floor = Floor(
    Location=planarsurface_2,
    Construction=construction_2,
    Offset="{ \"_t\" : \"System.Enum\", \"TypeName\" : { \"_t\" : \"System.Type\", \"Name\" : \"BH.oM.Physical.Elements.Offset\" }, \"Value\" : \"Undefined\" }",
    Component="{ .Floor")
floor_2 = Floor(
    Location=planarsurface_3,
    Construction=construction_3,
    Offset="{ \"_t\" : \"System.Enum\", \"TypeName\" : { \"_t\" : \"System.Type\", \"Name\" : \"BH.oM.Physical.Elements.Offset\" }, \"Value\" : \"Undefined\" }",
    Component="{ .Floor")
floor_3 = Floor(
    Location=planarsurface_4,
    Construction=construction_4,
    Offset="{ \"_t\" : \"System.Enum\", \"TypeName\" : { \"_t\" : \"System.Type\", \"Name\" : \"BH.oM.Physical.Elements.Offset\" }, \"Value\" : \"Undefined\" }",
    Component="{ .Floor")
floor_4 = Floor(
    Location=planarsurface_7,
    Construction=construction_7,
    Offset="{ \"_t\" : \"System.Enum\", \"TypeName\" : { \"_t\" : \"System.Type\", \"Name\" : \"BH.oM.Physical.Elements.Offset\" }, \"Value\" : \"Undefined\" }",
    Component="{ .Floor")
roof = Roof(
    Location=planarsurface_5,
    Construction=construction_5,
    Offset="{ \"_t\" : \"System.Enum\", \"TypeName\" : { \"_t\" : \"System.Type\", \"Name\" : \"BH.oM.Physical.Elements.Offset\" }, \"Value\" : \"Undefined\" }",
    Component="{ .Roof")
wall_3 = Wall(
    Location=planarsurface_8,
    Construction=construction_8,
    Offset="{ \"_t\" : \"System.Enum\", \"TypeName\" : { \"_t\" : \"System.Type\", \"Name\" : \"BH.oM.Physical.Elements.Offset\" }, \"Value\" : \"Undefined\" }",
    Component="{ .Wall")
merge = Merge(Data1=roof, Data2=wall_2, Data3=wall_3, Data4=floor_4, Data5=floor_2, Data6=floor_3, Data7=wall, Data8=floor)
revitadapter = RevitAdapter(Active=Toggle(True), Component="{ ..ctor")
push = Push(Adapter=revitadapter, Objects=flatten(merge), Active=Toggle(True), Component="{ .Push")  # -> Objects, Success
panel_9 = Panel(push.Success)
