# Dynamo graph Pull gbXML- Push gbXML_00.dyn (Dynamo 1.3.4.6666)

string = StringInput("BHoMgbXML_Dyn_TAS_Lshape2zonesExport")
string_2 = StringInput("C:\Users\mdengusi\BuroHappold\Buildings and Habitats object Model - 01_Test Scripts\XML_Toolkit\_Macro\Pull\LinkedFilesForScripts")
XMLAdapter = CreateAdapterComponent(string, string_2)  # unwired: arg2, arg3
string_3 = StringInput("BHoMgbXML_Dyn_TAS_Lshape2zones")
string_4 = StringInput("C:\Users\mdengusi\BuroHappold\Buildings and Habitats object Model - 01_Test Scripts\XML_Toolkit\_Macro\Pull\LinkedFilesForScripts")
XMLAdapter_2 = CreateAdapterComponent(string_3, string_4)  # unwired: arg2, arg3
boolean = BoolSelector(false)
pull = PullComponent(XMLAdapter_2, arg3=boolean)
documentBuilder = CreateObjectComponent(pull)
boolean_2 = BoolSelector(false)
push = PushComponent(XMLAdapter, documentBuilder, arg4=boolean_2)
