# Grasshopper definition Pull gbXML- Push gbXML_01.gh (Grasshopper 0.9.76)
# plug-ins: BH.UI.Grasshopper

xmladapter = XMLAdapter(
    XmlFileName="BHoMgbXML_GH_TAS",
    XmlDirectoryPath="C:\Users\mdengusi\Desktop\SAM_Bath\2019-06-11 SAMrun2019",
    ExportType="{ \"_t\" : \"System.Enum\", \"TypeName\" : { \"_t\" : \"System.Type\", \"Name\" : \"BH.oM.XML.Enums.ExportType\" }, \"Value\" : \"gbXMLTAS\" }",
    ExportDetail="{ \"_t\" : \"System.Enum\", \"TypeName\" : { \"_t\" : \"System.Type\", \"Name\" : \"BH.oM.XML.Enums.ExportDetail\" }, \"Value\" : \"Full\" }",
    Component="{ ..ctor")
panel = Panel(xmladapter)
pull = Pull(Adapter=xmladapter, Active=Toggle(False), Component="{ .Pull")
panel_2 = Panel(pull)

spaces = Spaces(BhomObjects=pull, Component="{ .Spaces")
buildings = Buildings(BhomObjects=pull, Component="{ .Buildings")
levels = Levels(Objects=pull, Component="{ .Levels")
panels = Panels(Objects=pull, Component="{ .Panels")

uniquespacenames = UniqueSpaceNames(Panels=panels, Component="{ .UniqueSpaceNames")
merge = Merge(Data1=panels, Data2=buildings, Data3=levels, Data4=spaces)
exportdetail = ExportDetail(
    {"Undefined": 0, "BuildingShell": 1, "Full": 2, "IndividualSpaces": 3}, selected="Full",
    Component="BH.oM.XML.Enums.ExportDetail",
    Selection=2)
exporttype = ExportType({"Undefined": 0, "gbXMLTAS": 1, "gbXMLIES": 2}, selected="gbXMLTAS", Component="BH.oM.XML.Enums.ExportType", Selection=1)
xmladapter_2 = XMLAdapter(
    XmlFileName="BHoMgbXML_GH5",
    XmlDirectoryPath="C:\Users\mdengusi\Desktop\SAM_Bath\2019-06-11 SAMrun2019",
    ExportType=exporttype,
    ExportDetail=exportdetail,
    Component="{ ..ctor")
documentbuilder = DocumentBuilder(Objs=merge, Component="{ .DocumentBuilder")
push = Push(Adapter=xmladapter_2, Objects=documentbuilder, Active=Toggle(False), Component="{ .Push")  # -> Objects, Success
panel_3 = Panel(push.Success)

toggle = BooleanToggle(False)
filterrequest = FilterRequest(Type="BH.oM.Environment.Elements.Building", Component="{ .FilterRequest")
revitadapter = RevitAdapter(Active=toggle, Component="{ ..ctor")

pull_2 = Pull(Adapter=revitadapter, Request=filterrequest, Active=toggle, Component="{ .Pull")

buildings_2 = Buildings(BhomObjects=pull_2, Component="{ .Buildings")
levels_2 = Levels(Objects=pull_2, Component="{ .Levels")
panels_2 = Panels(Objects=pull_2, Component="{ .Panels")

uniquespacenames_2 = UniqueSpaceNames(Panels=panels_2, Component="{ .UniqueSpaceNames")
changeadjacentspaces = ChangeAdjacentSpaces(
    Panels=panels,
    SpaceNamesToChange=uniquespacenames,
    ReplacementSpaceNames=uniquespacenames_2,
    Component="{ .ChangeAdjacentSpaces")
