# Grasshopper definition Pull gbXML- Push gbXML_02.gh (Grasshopper 0.9.76)
# plug-ins: BH.UI.Grasshopper

xmlsettings = XMLSettings(
    ReplaceCurtainWalls=False,
    ReplaceSolidOpeningsIntoDoors=False,
    IncludeConstructions=False,
    FixIncorrectAirTypes=False,
    NewFile=True,
    UnitType="{ \"_t\" : \"System.Enum\", \"TypeName\" : { \"_t\" : \"System.Type\", \"Name\" : \"BH.oM.XML.Enums.UnitType\" }, \"Value\" : \"SI\" }",
    ExportDetail="{ \"_t\" : \"System.Enum\", \"TypeName\" : { \"_t\" : \"System.Type\", \"Name\" : \"BH.oM.XML.Enums.ExportDetail\" }, \"Value\" : \"Full\" }",
    DistanceTolerance=0.01,
    Component="{ .XMLSettings")
xmlfilesettings = XMLFileSettings(
    FileName="BHoMgbXML_GH",
    Directory="C:\Users\mdengusi\Desktop\SAM_Bath\2019-09-16 RevitPush",
    Component="{ .XMLFileSettings")
xmladapter = XMLAdapter(XmlFileSettings=xmlfilesettings, XmlSettings=xmlsettings, Component="{ ..ctor")
pull = Pull(Adapter=xmladapter, Active=Toggle(False), Component="{ .Pull")
panel = Panel(pull)

spaces = Spaces(BhomObjects=pull, Component="{ .Spaces")
buildings = Buildings(BhomObjects=pull, Component="{ .Buildings")
levels = Levels(Objects=pull, Component="{ .Levels")
panels = Panels(Objects=pull, Component="{ .Panels")

uniquespacenames = UniqueSpaceNames(Panels=panels, Component="{ .UniqueSpaceNames")
merge = Merge(Data1=panels, Data2=buildings, Data3=levels, Data4=spaces)
xmlsettings_2 = XMLSettings(
    ReplaceCurtainWalls=False,
    ReplaceSolidOpeningsIntoDoors=False,
    IncludeConstructions=False,
    FixIncorrectAirTypes=False,
    NewFile=True,
    UnitType="{ \"_t\" : \"System.Enum\", \"TypeName\" : { \"_t\" : \"System.Type\", \"Name\" : \"BH.oM.XML.Enums.UnitType\" }, \"Value\" : \"SI\" }",
    ExportDetail="{ \"_t\" : \"System.Enum\", \"TypeName\" : { \"_t\" : \"System.Type\", \"Name\" : \"BH.oM.XML.Enums.ExportDetail\" }, \"Value\" : \"Full\" }",
    DistanceTolerance=0.01,
    Component="{ .XMLSettings")
xmlfilesettings_2 = XMLFileSettings(
    FileName="BHoMgbXML_GH_reexported",
    Directory="C:\Users\mdengusi\Desktop\SAM_Bath\2019-09-16 RevitPush",
    Component="{ .XMLFileSettings")
documentbuilder = DocumentBuilder(Objs=merge, Component="{ .DocumentBuilder")
xmladapter_2 = XMLAdapter(XmlFileSettings=xmlfilesettings_2, XmlSettings=xmlsettings_2, Component="{ ..ctor")
push = Push(Adapter=xmladapter_2, Objects=documentbuilder, Active=Toggle(True), Component="{ .Push")  # -> Objects, Success
panel_2 = Panel(push.Success)

toggle = BooleanToggle(False)
filterrequest = FilterRequest(Type="BH.oM.Environment.Elements.Building", Component="{ .FilterRequest")
revitadapter = RevitAdapter(Active=toggle, Component="{ ..ctor")

pull_2 = Pull(Adapter=revitadapter, Request=filterrequest, Active=toggle, Component="{ .Pull")

buildings_2 = Buildings(BhomObjects=pull_2, Component="{ .Buildings")
levels_2 = Levels(Objects=pull_2, Component="{ .Levels")
panels_2 = Panels(Objects=pull_2, Component="{ .Panels")

uniquespacenames_2 = UniqueSpaceNames(Panels=panels_2, Component="{ .UniqueSpaceNames")
changeadjacentspaces = ChangeAdjacentSpaces(
    Panels=panels,
    SpaceNamesToChange=uniquespacenames,
    ReplacementSpaceNames=uniquespacenames_2,
    Component="{ .ChangeAdjacentSpaces")
