# Grasshopper definition Revit_gbXML_T3D_TBD_ver02.gh (Grasshopper 0.9.76)
# plug-ins: BH.UI.Grasshopper

path_t3d = FilePath("C:\Users\mdengusi\Desktop\SAM_Bath\2019-08-29\000000_SAM_Live_943.t3d")
path_tbd = FilePath("C:\Users\mdengusi\Desktop\SAM_Bath\2019-08-29\000000_SAM_Live_943.tbd")

toggle = BooleanToggle(False)
# Pull Revit
revitadapter = RevitAdapter(Active=toggle, Component="{ ..ctor")

filterrequest = FilterRequest(Type="BH.oM.Environment.Elements.Building", Component="{ .FilterRequest")

pull = Pull(Adapter=revitadapter, Query=filterrequest, Active=toggle, Component="{ .Pull")
openings = Openings(Objects=pull, Component="{ .Openings")
panels = Panels(Objects=pull, Component="{ .Panels")
uniqueopeninginstances = UniqueOpeningInstances(Openings=openings, Component="{ .UniqueOpeningInstances")
uniquepanelinstances = UniquePanelInstances(Panels=panels, Component="{ .UniquePanelInstances")

# ----
# Push gbXML
panel = Panel("C:\Users\mdengusi\Desktop\SAM_Bath\2019-08-29")
exportdetail = ExportDetail(
    {"Undefined": 0, "BuildingShell": 1, "Full": 2, "IndividualSpaces": 3}, selected="Full",
    Component="BH.oM.XML.Enums.ExportDetail",
    Selection=2)
xmlsettings = XMLSettings(
    ReplaceCurtainWalls=False,
    ReplaceSolidOpeningsIntoDoors=False,
    IncludeConstructions=False,
    FixIncorrectAirTypes=False,
    NewFile=True,
    UnitType="{ \"_t\" : \"System.Enum\", \"TypeName\" : { \"_t\" : \"System.Type\", \"Name\" : \"BH.oM.XML.Enums.UnitType\" }, \"Value\" : \"SI\" }",
    ExportDetail="{ \"_t\" : \"System.Enum\", \"TypeName\" : { \"_t\" : \"System.Type\", \"Name\" : \"BH.oM.XML.Enums.ExportDetail\" }, \"Value\" : \"Full\" }",
    DistanceTolerance=0.01,
    Component="{ .XMLSettings")
xmlfilesettings = XMLFileSettings(FileName="BHoMgbXML_GH", Directory=panel, Component="{ .XMLFileSettings")
documentbuilder = DocumentBuilder(Objs=pull, Component="{ .DocumentBuilder")
xmladapter = XMLAdapter(XmlFileSettings=xmlfilesettings, XmlSettings=xmlsettings, Component="{ ..ctor")
push = Push(Adapter=xmladapter, Objects=documentbuilder, Active=Toggle(False), Component="{ .Push")  # -> Objects, Success
fullfilename = FullFileName(FileSettings=xmlfilesettings, Component="{ .FullFileName")
panel_2 = Panel(push.Success)

panel_3 = Panel(fullfilename)

# ----
# complete in TAS
toggle_2 = BooleanToggle(False)
t3dfromgbxml = T3DFromGBXML(GbXMLFile=fullfilename, T3dFile=path_t3d, FixNormals=False, Run=toggle_2, Component="{ .T3DFromGBXML")
panel_4 = Panel(t3dfromgbxml)
toggle_3 = BooleanToggle(False)
t3dfileupdate = T3DFileUpdate(
    T3dFile=path_t3d,
    Panels=uniquepanelinstances,
    Openings=uniqueopeninginstances,
    Run=t3dfromgbxml,
    Component="{ .T3DFileUpdate")
toggle_4 = BooleanToggle(False)
panel_5 = Panel(t3dfileupdate)
t3dshadingcalculation = T3DShadingCalculation(
    T3dFile=path_t3d,
    TbdFile=path_tbd,
    AutoAssignConstructions=True,
    Run=t3dfileupdate,
    Component="{ .T3DShadingCalculation")
toggle_5 = BooleanToggle(False)
panel_6 = Panel(t3dshadingcalculation)
tbdfileupdate = TBDFileUpdate(TbdFile=path_tbd, Run=t3dshadingcalculation, Component="{ .TBDFileUpdate")
toggle_6 = BooleanToggle(True)
panel_7 = Panel(tbdfileupdate)
tbdloadsimulation = TBDLoadSimulation(TbdFile=path_tbd, Run=tbdfileupdate, Component="{ .TBDLoadSimulation")
tbd3dvisulisation = TBD3dVisulisation(TbdFile=path_tbd, Run=Toggle(False), Component="{ .TBD3dVisulisation")
panel_8 = Panel(tbd3dvisulisation)

panel_9 = Panel(tbdloadsimulation)
