# Dynamo graph Pull Revit - Push gbXML.dyn (Dynamo 1.3.3.4111)

# note: Colour Coding Stategy

# group: Get Things
# note: Get Inputs from Revit etc.

# group: Chop / Change Things
# note: Managing List / Filter Lists etc

# group: Input Things
# note: User Inputs Required

# group: Calculate Things
# note: Calculations

# group: Export Things
# note: Export to external files / software

# group: See Things
# note: Dispay Outputs

# group: WIP Things
# note: Things still under progress

# group: export details
string = StringInput("BHoMgbXML")
directory_path = Directory("C:\Users\mdengusi\Desktop\SAM_Bath\2018-11-21 LaundryBHoM")

XMLAdapter = CreateAdapterComponent(string, directory_path)  # unwired: arg2

# group: Select Building
boolean = BoolSelector(false)
createType = CreateTypeComponent()

# note: Script Purpose:
# Pull data from Tas EDSL
# Version Information to create script:
# Dynamo 1.3.3.4111
# Revit 2018.8.3
# Date created: 14/12/2018
# Date updated: 14/12/2018
revitAdapter = CreateAdapterComponent(arg1=boolean)
filterQuery = CreateQueryComponent(createType)
pull = PullComponent(revitAdapter, filterQuery, arg3=boolean)

# group: Operations
buildingElements = QueryComponent(pull)
splitBuildingElements = ModifyComponent(buildingElements)
stripOpenings = QueryComponent(splitBuildingElements)
splitBuildingElementsByOverlap = ModifyComponent(stripOpenings)
cullDuplicates = QueryComponent(splitBuildingElementsByOverlap)
cullOverlaps = QueryComponent(cullDuplicates)
uniqueSpaceNames = QueryComponent(cullOverlaps)
buildSpaces_Revit = ComputeComponent(cullOverlaps, uniqueSpaceNames)
spaces = QueryComponent(pull)
matchSpaces = QueryComponent(buildSpaces_Revit, spaces)
shadingElements = QueryComponent(buildingElements)
levels = QueryComponent(pull)
getOpenings = QueryComponent(buildingElements)
documentBuilder = CreateObjectComponent(arg1=matchSpaces, arg2=shadingElements, arg4=levels, arg5=getOpenings)

boolean_2 = BoolSelector(false)

# group: gbXML
push = PushComponent(XMLAdapter, documentBuilder, arg4=boolean_2)
