# Grasshopper definition Pull Revit - Push gbXML.gh (Grasshopper 0.9.76)
# plug-ins: Alligator

toggle = BooleanToggle(False)

# ----
# BH.oM.Environment.Elements.Building
createtype = CreateType(Component="{ \"_t\" : \"System.Type\", \"Name\" : \"BH.oM.Environment.Elements.Building\" }")

revitadapter = RevitAdapter(Active=toggle, Component="{ ..ctor")
filterquery = FilterQuery(Type=createtype, Component="{ .FilterQuery")
pull = Pull(Adapter=revitadapter, Query=filterquery, Active=toggle, Component="{ .Pull")

levels = Levels(BhomObjects=pull, Component="{ .Levels")
spaces = Spaces(BhomObjects=pull, Component="{ .Spaces")
buildingelements = BuildingElements(BhomObjects=pull, Component="{ .BuildingElements")
splitbuildingelements = SplitBuildingElements(ElementsToSplit=buildingelements, Component="{ .SplitBuildingElements")
getopenings = GetOpenings(Elements=buildingelements, Component="{ .GetOpenings")
shadingelements = ShadingElements(Elements=buildingelements, Component="{ .ShadingElements")
stripopenings = StripOpenings(Elements=splitbuildingelements, Component="{ .StripOpenings")
splitbuildingelementsbyoverlap = SplitBuildingElementsByOverlap(ElementsToSplit=stripopenings, Component="{ .SplitBuildingElementsByOverlap")
cullduplicates = CullDuplicates(Elements=splitbuildingelementsbyoverlap, Component="{ .CullDuplicates")
culloverlaps = CullOverlaps(Elements=cullduplicates, Component="{ .CullOverlaps")
uniquespacenames = UniqueSpaceNames(Elements=culloverlaps, Component="{ .UniqueSpaceNames")
buildspaces_revit = BuildSpaces_Revit(Elements=culloverlaps, RevitSpaceNames=uniquespacenames, Component="{ .BuildSpaces_Revit")
matchspaces = MatchSpaces(ElementsAsSpaces=buildspaces_revit, Spaces=spaces, Component="{ .MatchSpaces")
documentbuilder = DocumentBuilder(
    ElementsAsSpaces=matchspaces,
    ShadingElements=shadingelements,
    Levels=levels,
    Openings=getopenings,
    Component="{ .DocumentBuilder")

xmladapter = XMLAdapter(
    XmlFileName="BHoMgbXML",
    XmlDirectoryPath="C:\Users\mdengusi\Desktop\SAM_Bath\2018-11-21 LaundryBHoM\",
    ExportType="{ \"_t\" : \"System.Enum\", \"TypeName\" : { \"_t\" : \"System.Type\", \"Name\" : \"BH.oM.XML.Enums.ExportType\" }, \"Value\" : \"gbXMLTAS\" }",
    Component="{ ..ctor")
push = Push(Adapter=xmladapter, Objects=documentbuilder, Active=Toggle(False), Component="{ .Push")  # -> Objects, Success
