# Dynamo graph Pull Revit - Push gbXML_01.dyn (Dynamo 1.3.3.4111)

# note: Colour Coding Stategy
# note: Script Purpose:
# Pull data from Tas EDSL
# Version Information to create script:
# Dynamo 1.3.3.4111
# Revit 2018.8.3
# Date created: 14/12/2018
# Date updated: 14/12/2018

# group: Get Things
# note: Get Inputs from Revit etc.

# group: Chop / Change Things
# note: Managing List / Filter Lists etc

# group: Input Things
# note: User Inputs Required

# group: Calculate Things
# note: Calculations

# group: Export Things
# note: Export to external files / software

# group: See Things
# note: Dispay Outputs

# group: WIP Things
# note: Things still under progress

# group: export details
string = StringInput("BHoMgbXML")
directory_path = Directory("C:\Users\mdengusi\Documents\GitHub\samples\TAS_Toolkit")

XMLAdapter = CreateAdapterComponent(string, directory_path)  # unwired: arg2, arg3

# group: Select Building
boolean = BoolSelector(false)
createType = CreateTypeComponent()

revitAdapter = CreateAdapterComponent(arg1=boolean)
filterQuery = CreateQueryComponent(createType)
pull = PullComponent(revitAdapter, filterQuery, arg3=boolean)
buildings = QueryComponent(pull)
buildingElements = QueryComponent(pull)
stripOpenings = QueryComponent(buildingElements)
uniqueSpaceNames = QueryComponent(stripOpenings)
buildSpaces = ComputeComponent(stripOpenings, uniqueSpaceNames)
spaces = QueryComponent(pull)
matchSpaces = QueryComponent(buildSpaces, spaces)
shadingElements = QueryComponent(buildingElements)
levels = QueryComponent(pull)
openings = QueryComponent(buildingElements)
documentBuilder = CreateObjectComponent(buildings, matchSpaces, shadingElements, levels, openings)
boolean_2 = BoolSelector(true)

# group: gbXML
push = PushComponent(XMLAdapter, documentBuilder, arg4=boolean_2)

watch = Watch(push.out1)
explodeobject_old = ExplodeObjectNode(buildingElements, outputcount=7)
explodeobject_old_2 = ExplodeObjectNode(explodeobject_old.out0, outputcount=6)
code_block = CodeBlock(l=explodeobject_old.out6) { List.GetItemAtIndex(l<1>,4); }
