# Grasshopper definition Pull Revit - Push gbXML_02.gh (Grasshopper 0.9.76)
# plug-ins: BH.UI.Grasshopper

toggle = BooleanToggle(True)

filterquery = FilterQuery(Type="BH.oM.Environment.Elements.Building", Component="{ .FilterQuery")

revitadapter = RevitAdapter(Active=toggle, Component="{ ..ctor")
pull = Pull(Adapter=revitadapter, Query=filterquery, Active=toggle, Component="{ .Pull")

buildings = Buildings(BhomObjects=pull, Component="{ .Buildings")
spaces = Spaces(BhomObjects=pull, Component="{ .Spaces")
levels = Levels(Objects=pull, Component="{ .Levels")
panels = Panels(Objects=pull, Component="{ .Panels")

exportdetail = ExportDetail(
    {"Undefined": 0, "BuildingShell": 1, "Full": 2, "IndividualSpaces": 3}, selected="Full",
    Component="{ \"_t\" : \"System.Type\", \"Name\" : \"BH.oM.XML.Enums.ExportDetail\" }",
    Selection=2)
exporttype = ExportType(
    {"Undefined": 0, "gbXMLTAS": 1, "gbXMLIES": 2}, selected="gbXMLTAS",
    Component="{ \"_t\" : \"System.Type\", \"Name\" : \"BH.oM.XML.Enums.ExportType\" }",
    Selection=1)
topolyline = ToPolyline(Panel=panels, Component="{ .ToPolyline")
tospaces = ToSpaces(Panels=panels, Component="{ .ToSpaces")
xmladapter = XMLAdapter(
    XmlFileName="BHoMgbXML_GH",
    XmlDirectoryPath="C:\Users\mdengusi\Desktop\SAM_Bath\2019-04-23 oMupdate",
    ExportType=exporttype,
    ExportDetail=exportdetail,
    Component="{ ..ctor")
documentbuilder = DocumentBuilder(Objs=pull, Component="{ .DocumentBuilder")

paneltype = PanelType(
    {"Undefined": 0, "Ceiling": 1, "CurtainWall": 2, "Floor": 3, "FloorExposed": 4, "FloorInternal": 5, "FloorRaised": 6, "Roof": 7, "Shade": 8, "SlabOnGrade": 9, "SolarPanel": 10, "UndergroundCeiling": 11, "UndergroundSlab": 12, "UndergroundWall": 13, "Wall": 14, "WallExternal": 15, "WallInternal": 16}, selected="Shade",
    Component="{ \"_t\" : \"System.Type\", \"Name\" : \"BH.oM.Environment.Elements.PanelType\" }",
    Selection=8)  # disabled
panelsbytype = PanelsByType(Panels=panels, Type=paneltype, Component="{ .PanelsByType")  # disabled
topolyline_2 = ToPolyline(Panel=panelsbytype, Component="{ .ToPolyline")  # disabled

push = Push(Adapter=xmladapter, Objects=documentbuilder, Active=Toggle(True), Component="{ .Push")  # -> Objects, Success
panel = Panel(push.Success)
