# Dynamo graph Pull Revit - Push gbXML_06.dyn (Dynamo 1.3.4.6666)

# note: Colour Coding Stategy
# note: Script Purpose:
# Pull data from Revit
# Version Information to create script:
# Dynamo 1.3.3.4111
# Revit 2018.8.3
# Date created: 14/12/2018
# Date updated: 23/04/2019

# group: Get Things
# note: Get Inputs from Revit etc.

# group: Chop / Change Things
# note: Managing List / Filter Lists etc

# group: Input Things
# note: User Inputs Required

# group: Calculate Things
# note: Calculations

# group: Export Things
# note: Export to external files / software

# group: See Things
# note: Dispay Outputs

# group: WIP Things
# note: Things still under progress

string = StringInput("BHoMgbXML_Dyn")
directory_path = Directory("C:\Users\mdengusi\Desktop\SAM_Bath\2019-07-04 BHoMtest")
XMLFileSettings = CreateObjectComponent(string, directory_path)
exportDetail = CreateEnumComponent()
XMLSettings = CreateObjectComponent(arg6=exportDetail)  # unwired: arg5
XMLAdapter = CreateAdapterComponent(XMLFileSettings, XMLSettings)

# group: Select Building
boolean = BoolSelector(true)
createType = CreateTypeComponent()

revitAdapter = CreateAdapterComponent(arg1=boolean)
filterRequest = CreateRequestComponent(createType)
pull = PullComponent(revitAdapter, filterRequest, arg3=boolean)

# group: merged into one node
documentBuilder = CreateObjectComponent(pull)

boolean_2 = BoolSelector(false)

# group: gbXML
push = PushComponent(XMLAdapter, documentBuilder, arg4=boolean_2)

watch = Watch(push.out1)

# group: expanded method
panels = QueryComponent(pull)
levels = QueryComponent(pull)
buildings = QueryComponent(pull)
spaces = QueryComponent(pull)

panelType = CreateEnumComponent()
panelsByType = QueryComponent(panels, panelType)
integer_slider = IntegerSlider(20, range=0..21 step 1)
getItemAtIndex = List.GetItemAtIndex(list=panels, index=integer_slider)
polyline = QueryComponent(getItemAtIndex)

# group: visualise geometry two options
flatten = Flatten(panels)
byJoinedCurves = PolyCurve.ByJoinedCurves(polyline)

boolean_3 = BoolSelector(false)
boolean_4 = BoolSelector(true)
boolean_5 = BoolSelector(true)
unitType = CreateEnumComponent()
boolean_6 = BoolSelector(false)
string_2 = StringInput("SAMRevit.json")
fileAdapter = CreateAdapterComponent(directory_path, string_2)
