# Dynamo graph Pull Revit - Push gbXML_07.dyn (Dynamo 2.3.0.5885)
# packages: BHoM 2.0.0

# note: Colour Coding Stategy
# note: Script Purpose:
# Pull data from Revit
# Version Information to create script:
# Dynamo 1.3.3.4111
# Revit 2018.8.3
# Date created: 14/12/2018
# Date updated: 23/04/2019

# group: Get Things
# note: Get Inputs from Revit etc.

# group: Chop / Change Things
# note: Managing List / Filter Lists etc

# group: Input Things
# note: User Inputs Required

# group: Calculate Things
# note: Calculations

# group: Export Things
# note: Export to external files / software

# group: See Things
# note: Dispay Outputs

# group: WIP Things
# note: Things still under progress

string = StringInput("BHoMgbXML_Dyn1")  # graph input
directory_path = Directory("C:\Users\DengusiakM\Desktop\SAM\2020-01-19 GH")  # graph input
XMLFileSettings = CreateObjectComponent(FileName=string, Directory=directory_path, SerialisedCaller="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", lacing=Shortest)
exportDetail = CreateEnumComponent(index=2, SerialisedCaller="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")  # graph input
XMLSettings = CreateObjectComponent(exportDetail=exportDetail, SerialisedCaller="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")
XMLAdapter = CreateAdapterComponent(xmlFileSettings=XMLFileSettings, xmlSettings=XMLSettings, SerialisedCaller="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")

# group: Select Building
boolean = BoolSelector(true)  # graph input
createType = CreateTypeComponent()  # graph input

revitAdapter = CreateAdapterComponent(active=boolean, SerialisedCaller="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")
filterRequest = CreateRequestComponent(type=createType, SerialisedCaller="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")
pull = PullComponent(adapter=revitAdapter, request=filterRequest, active=boolean, SerialisedCaller="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")

# group: merged into one node
documentBuilder = CreateObjectComponent(objs=pull, SerialisedCaller="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")

boolean_2 = BoolSelector(true)  # graph input

# group: gbXML
push = PushComponent(adapter=XMLAdapter, objects=documentBuilder, active=boolean_2, SerialisedCaller="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")

watch = Watch(push.success)

# group: expanded method
buildings = QueryComponent(bhomObjects=pull, SerialisedCaller="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")
spaces = QueryComponent(bhomObjects=pull, SerialisedCaller="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")
panels = QueryComponent(bhomObjects=pull, SerialisedCaller="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")
levels = QueryComponent(bhomObjects=pull, SerialisedCaller="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", lacing=Shortest)

polyline = QueryComponent(panel=panels, SerialisedCaller="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")
boolean_3 = BoolSelector(false)  # graph input
boolean_4 = BoolSelector(true)  # graph input
boolean_5 = BoolSelector(true)  # graph input
unitType = CreateEnumComponent(index=1, SerialisedCaller="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")  # graph input
boolean_6 = BoolSelector(false)  # graph input
string_2 = StringInput("SAMRevit.json")  # graph input
fileAdapter = CreateAdapterComponent(folder=directory_path, fileName=string_2, SerialisedCaller="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")
revitAdapter_2 = CreateAdapterComponent(active=boolean, SerialisedCaller="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", lacing=Shortest)
