# Dynamo graph Pull XML - Push Revit_02.dyn (Dynamo 1.3.4.6666)

# group: Get Things
# note: Get Inputs from Revit etc.

# group: Chop / Change Things
# note: Managing List / Filter Lists etc

# group: Input Things
# note: User Inputs Required

# group: Calculate Things
# note: Calculations

# group: Export Things
# note: Export to external files / software

# group: See Things
# note: Dispay Outputs

# group: WIP Things
# note: Things still under progress

boolean = BoolSelector(false)
revitAdapter = CreateAdapterComponent(arg1=boolean)
string = StringInput("BHoMgbXML_GH")
directory_path = Directory("C:\Users\mdengusi\Desktop\SAM_Bath\2019-09-16 RevitPush")
# note: Colour Coding Stategy
# note: Script Purpose:
# Pull data from gbXML push Revit
# Version Information to create script:
# Dynamo 1.3.3.4111
# Revit 2018.8.3
# Date created: 18/09/2018
# Date updated: --
XMLFileSettings = CreateObjectComponent(string, directory_path)
XMLSettings = CreateObjectComponent()  # unwired: arg5, arg6
XMLAdapter = CreateAdapterComponent(XMLFileSettings, XMLSettings)
createType = CreateTypeComponent()
filterRequest = CreateRequestComponent(createType)
boolean_2 = BoolSelector(true)
pull = PullComponent(XMLAdapter, filterRequest, arg3=boolean_2)
panelType = CreateEnumComponent()
panelsByType = QueryComponent(pull, panelType)
polyline = QueryComponent(panelsByType)
# note: Issue with create PlanarSurface logged
planarSurface = CreateObjectComponent(polyline)
explodeobject_old = ExplodeObjectNode(panelsByType, outputcount=10)
firstItem = List.FirstItem(explodeobject_old.out6)
watch = Watch(firstItem)
# note: Issue with create Construction logged
construction = CreateObjectComponent(watch)
roof = CreateObjectComponent(planarSurface, construction)  # unwired: arg3
push = PushComponent(revitAdapter, roof, arg4=boolean)
toLines = QueryComponent(panelsByType)
