# Grasshopper definition Pull gbXML- Push gbXML_00 WIP.gh (Grasshopper 0.9.76)
# plug-ins: BH.UI.Grasshopper

exportdetail = ExportDetail(
    {"Undefined": 0, "BuildingShell": 1, "Full": 2, "IndividualSpaces": 3}, selected="Full",
    Component="{ \"_t\" : \"System.Type\", \"Name\" : \"BH.oM.XML.Enums.ExportDetail\" }",
    Selection=2)
exporttype = ExportType(
    {"Undefined": 0, "gbXMLTAS": 1, "gbXMLIES": 2}, selected="gbXMLTAS",
    Component="{ \"_t\" : \"System.Type\", \"Name\" : \"BH.oM.XML.Enums.ExportType\" }",
    Selection=1)
xmladapter = XMLAdapter(
    XmlFileName="BHoMgbXML_GH_TAS",
    XmlDirectoryPath="C:\Users\mdengusi\Desktop\SAM_Bath\2019-06-11 SAMrun2019",
    ExportType=exporttype,
    ExportDetail=exportdetail,
    Component="{ ..ctor")

filterquery = FilterQuery(Type="BH.oM.Environment.Elements.Building", Component="{ .FilterQuery")

pull = Pull(Adapter=xmladapter, Active=Toggle(False), Component="{ .Pull")

buildings = Buildings(BhomObjects=pull, Component="{ .Buildings")
spaces = Spaces(BhomObjects=pull, Component="{ .Spaces")
levels = Levels(Objects=pull, Component="{ .Levels")
panels = Panels(Objects=pull, Component="{ .Panels")

exportdetail_2 = ExportDetail(
    {"Undefined": 0, "BuildingShell": 1, "Full": 2, "IndividualSpaces": 3}, selected="Full",
    Component="{ \"_t\" : \"System.Type\", \"Name\" : \"BH.oM.XML.Enums.ExportDetail\" }",
    Selection=2)
exporttype_2 = ExportType(
    {"Undefined": 0, "gbXMLTAS": 1, "gbXMLIES": 2}, selected="gbXMLTAS",
    Component="{ \"_t\" : \"System.Type\", \"Name\" : \"BH.oM.XML.Enums.ExportType\" }",
    Selection=1)
xmladapter_2 = XMLAdapter(
    XmlFileName="BHoMgbXML_GH2",
    XmlDirectoryPath="C:\Users\mdengusi\Desktop\SAM_Bath\2019-06-11 SAMrun2019",
    ExportType=exporttype_2,
    ExportDetail=exportdetail_2,
    Component="{ ..ctor")
documentbuilder = DocumentBuilder(Objs=pull, Component="{ .DocumentBuilder")
push = Push(Adapter=xmladapter_2, Objects=documentbuilder, Active=Toggle(False), Component="{ .Push")  # -> Objects, Success
panel = Panel(push.Success)
