# Grasshopper definition Revit_gbXML_T3D_TBD_ver01.gh (Grasshopper 0.9.76)
# plug-ins: BH.UI.Grasshopper

path_t3d = FilePath("C:\Users\mdengusi\Desktop\SAM_Bath\2019-05-09 testTASBHoM\000000_SAM_Live_943.t3d")
path_tbd = FilePath("C:\Users\mdengusi\Desktop\SAM_Bath\2019-05-09 testTASBHoM\000000_SAM_Live_943.tbd")

toggle = BooleanToggle(False)
# Pull Revit
revitadapter = RevitAdapter(Active=toggle, Component="{ ..ctor")

filterrequest = FilterRequest(Type="BH.oM.Environment.Elements.Building", Component="{ .FilterRequest")

pull = Pull(Adapter=revitadapter, Query=filterrequest, Active=toggle, Component="{ .Pull")
openings = Openings(Objects=pull, Component="{ .Openings")
panels = Panels(Objects=pull, Component="{ .Panels")
uniqueopeninginstances = UniqueOpeningInstances(Openings=openings, Component="{ .UniqueOpeningInstances")
uniquepanelinstances = UniquePanelInstances(Panels=panels, Component="{ .UniquePanelInstances")

exportdetail = ExportDetail(
    {"Undefined": 0, "BuildingShell": 1, "Full": 2, "IndividualSpaces": 3}, selected="Full",
    Component="{ \"_t\" : \"System.Type\", \"Name\" : \"BH.oM.XML.Enums.ExportDetail\" }",
    Selection=2)
exporttype = ExportType(
    {"Undefined": 0, "gbXMLTAS": 1, "gbXMLIES": 2}, selected="gbXMLTAS",
    Component="{ \"_t\" : \"System.Type\", \"Name\" : \"BH.oM.XML.Enums.ExportType\" }",
    Selection=1)
panel = Panel("C:\Users\mdengusi\Desktop\SAM_Bath\2019-05-09 testTASBHoM")
# Push gbXML
panel_2 = Panel("BHoMgbXML_GH")
xmladapter = XMLAdapter(XmlFileName=panel_2, XmlDirectoryPath=panel, ExportType=exporttype, ExportDetail=exportdetail, Component="{ ..ctor")
documentbuilder = DocumentBuilder(Objs=pull, Component="{ .DocumentBuilder")
xmlfilepath = XMLFilePath(XmlFileName=panel_2, XmlDirectoryPath=panel, ExportType=exporttype, Component="{ .XMLFilePath")
push = Push(Adapter=xmladapter, Objects=documentbuilder, Active=Toggle(False), Component="{ .Push")  # -> Objects, Success
panel_3 = Panel(push.Success)

# ----
# complete in TAS
toggle_2 = BooleanToggle(False)
t3dfromgbxml = T3DFromGBXML(GbXMLFile=xmlfilepath, T3dFile=path_t3d, FixNormals=False, Run=toggle_2, Component="{ .T3DFromGBXML")
panel_4 = Panel(t3dfromgbxml)
toggle_3 = BooleanToggle(False)
t3dfileupdate = T3DFileUpdate(
    T3dFile=path_t3d,
    Panels=uniquepanelinstances,
    Openings=uniqueopeninginstances,
    Run=panel_4,
    Component="{ .T3DFileUpdate")
toggle_4 = BooleanToggle(False)
panel_5 = Panel(t3dfileupdate)
t3dshadingcalculation = T3DShadingCalculation(T3dFile=path_t3d, TbdFile=path_tbd, AutoAssignConstructions=True, Run=panel_5, Component="{ .T3DShadingCalculation")
toggle_5 = BooleanToggle(True)
panel_6 = Panel(t3dshadingcalculation)
tbdfileupdate = TBDFileUpdate(TbdFile=path_tbd, Run=panel_6, Component="{ .TBDFileUpdate")
toggle_6 = BooleanToggle(False)
panel_7 = Panel(tbdfileupdate)
tbdloadsimulation = TBDLoadSimulation(TbdFile=path_tbd, Run=panel_7, Component="{ .TBDLoadSimulation")
tbd3dvisulisation = TBD3dVisulisation(TbdFile=path_tbd, Run=Toggle(False), Component="{ .TBD3dVisulisation")
panel_8 = Panel(tbd3dvisulisation)
