# Grasshopper definition Revit_gbXML_T3D_TBD_ver01DELELTE.gh (Grasshopper 0.9.76)
# plug-ins: BH.UI.Grasshopper

path_t3d = FilePath("C:\Users\mdengusi\Desktop\SAM_Bath\2019-05-09 testTASBHoM\000000_SAM_Live_943.t3d")
path_tbd = FilePath("C:\Users\mdengusi\Desktop\SAM_Bath\2019-05-09 testTASBHoM\000000_SAM_Live_943.tbd")

toggle = BooleanToggle(True)
# Pull Revit
revitadapter = RevitAdapter(Active=toggle, Component="{ ..ctor")

filterrequest = FilterRequest(Type="BH.oM.Environment.Elements.Building", Component="{ .FilterRequest")

pull = Pull(Adapter=revitadapter, Query=filterrequest, Active=toggle, Component="{ .Pull")
openings = Openings(Objects=pull, Component="{ .Openings")
panels = Panels(Objects=pull, Component="{ .Panels")
uniqueopeninginstances = UniqueOpeningInstances(Openings=openings, Component="{ .UniqueOpeningInstances")
uniquepanelinstances = UniquePanelInstances(Panels=panels, Component="{ .UniquePanelInstances")

tospaces = ToSpaces(Panels=panels, Component="{ .ToSpaces")  # -> simplify(PanelsAsSpaces)
panel = Panel(tospaces)
polyline = Polyline(Panel=tospaces, Component="{ .Polyline")
spaces = Spaces(Objects=pull, Component="{ .Spaces")
explode = Explode(Object=polyline, Component="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")

exportdetail = ExportDetail(
    {"Undefined": 0, "BuildingShell": 1, "Full": 2, "IndividualSpaces": 3}, selected="Full",
    Component="{ \"_t\" : \"System.Type\", \"Name\" : \"BH.oM.XML.Enums.ExportDetail\" }",
    Selection=2)
exporttype = ExportType(
    {"Undefined": 0, "gbXMLTAS": 1, "gbXMLIES": 2}, selected="gbXMLTAS",
    Component="{ \"_t\" : \"System.Type\", \"Name\" : \"BH.oM.XML.Enums.ExportType\" }",
    Selection=1)
panel_2 = Panel("C:\Users\mdengusi\Desktop\SAM_Bath\2019-05-09 testTASBHoM")
# Push gbXML
panel_3 = Panel("BHoMgbXML_GH")
xmladapter = XMLAdapter(XmlFileName=panel_3, XmlDirectoryPath=panel_2, ExportType=exporttype, ExportDetail=exportdetail, Component="{ ..ctor")
documentbuilder = DocumentBuilder(Objs=pull, Component="{ .DocumentBuilder")
xmlfilepath = XMLFilePath(XmlFileName=panel_3, XmlDirectoryPath=panel_2, ExportType=exporttype, Component="{ .XMLFilePath")
push = Push(Adapter=xmladapter, Objects=documentbuilder, Active=Toggle(True), Component="{ .Push")  # -> Objects, Success
panel_4 = Panel(push.Success)

explode_2 = Explode(Object=spaces, Component="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")  # -> Zones, Gains, Type, Location, BHoM_Guid, Name, Fragments, Tags, CustomData
panel_5 = Panel(explode)
deconstruct = Deconstruct(Point=explode)  # -> XComponent, YComponent, ZComponent
sort_list = SortList(Keys=deconstruct.ZComponent)  # -> Keys, ValuesA
mass_addition = MassAddition(Input=deconstruct.ZComponent)  # -> Result, PartialResults
larger_than = LargerThan(FirstNumber=mass_addition.Result, SecondNumber=0)  # -> LargerThan, OrEqualTo
path_mapper = PathMapper(larger_than.LargerThan, source="{A;B}", target="{A}")
cull_pattern = CullPattern(List=tospaces, CullPattern=invert(path_mapper))
polyline_2 = Polyline(Panel=cull_pattern, Component="{ .Polyline")
panel_6 = Panel(cull_pattern)

# ----
# complete in TAS
toggle_2 = BooleanToggle(True)
t3dfromgbxml = T3DFromGBXML(GbXMLFile=xmlfilepath, T3dFile=path_t3d, FixNormals=False, Run=toggle_2, Component="{ .T3DFromGBXML")
panel_7 = Panel(t3dfromgbxml)
toggle_3 = BooleanToggle(False)
t3dfileupdate = T3DFileUpdate(
    T3dFile=path_t3d,
    Panels=uniquepanelinstances,
    Openings=uniqueopeninginstances,
    Run=panel_7,
    Component="{ .T3DFileUpdate")
toggle_4 = BooleanToggle(False)
panel_8 = Panel(t3dfileupdate)
t3dshadingcalculation = T3DShadingCalculation(T3dFile=path_t3d, TbdFile=path_tbd, AutoAssignConstructions=True, Run=panel_8, Component="{ .T3DShadingCalculation")
toggle_5 = BooleanToggle(True)
panel_9 = Panel(t3dshadingcalculation)
tbdfileupdate = TBDFileUpdate(TbdFile=path_tbd, Run=panel_9, Component="{ .TBDFileUpdate")
toggle_6 = BooleanToggle(False)
panel_10 = Panel(tbdfileupdate)
tbdloadsimulation = TBDLoadSimulation(TbdFile=path_tbd, Run=panel_10, Component="{ .TBDLoadSimulation")
tbd3dvisulisation = TBD3dVisulisation(TbdFile=path_tbd, Run=Toggle(True), Component="{ .TBD3dVisulisation")
panel_11 = Panel(tbd3dvisulisation)
