# Grasshopper definition HelloWorld.gh (Grasshopper 0.9.76)
# plug-ins: BH.UI.Grasshopper

crv = Curve(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)
bar = Bar(
    Line=crv,
    OrientationAngle=0,
    FeaType="{ \"_t\" : \"System.Enum\", \"TypeName\" : { \"_t\" : \"System.Type\", \"Name\" : \"BH.oM.Structure.Elements.BarFEAType\" }, \"Value\" : \"Flexural\" }",
    Component="{ .Bar")
pt = Point(Point(-41.13411337, 75.52265546, 0))
pt_2 = Point(Point(-59.43544008, -21.19884492, 0))
createcustom = CreateCustom(Property1="HelloWorld", Property2="GoodMorningUniverse")
node = Node(Position=pt, Component="{ .Node")
node_2 = Node(Position=pt_2, Component="{ .Node")
explode = Explode(Object=bar, Component="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")  # -> StartNode, EndNode, SectionProperty, OrientationAngle, Release, FEAType, Spring, Offset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
bar_2 = Bar(
    StartNode=node_2,
    EndNode=node,
    CustomProperty=createcustom,
    NewProp="HelloWorld",
    Prop1="GoodMorningUniverse",
    Component="{ \"_t\" : \"System.Type\", \"Name\" : \"BH.oM.Structure.Elements.Bar\" }")
explode_2 = Explode(Object=bar_2, Component="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")  # -> StartNode, EndNode, SectionProperty, OrientationAngle, Release, FEAType, Spring, Offset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
explode_3 = Explode(Object=explode_2.CustomData, Component="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")  # -> CustomProperty, NewProp, X
explode_4 = Explode(Object=explode_3.CustomProperty, Component="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")  # -> Property1, Property2
